# Dynamo graph 21_extractTopologyObjectsParameters.dyn (Dynamo 2.12.0.5650)

# group: Input
# note: input: directory of the .json (string)
string = StringInput("C:\dev\phd\jw\healing\data\healing2023\20_extract_data\res\")
string_2 = StringInput("collected_GPs.json")
concat = String.Concat(string0=string, string1=string_2)

# group: Export GPs
code_block = CodeBlock { "Id"; "Name"; "Value"; "ElementIfcGUID"; }
list_create = List.Create(item0=code_block.out0, item1=code_block.out1, item2=code_block.out2, item3=code_block.out3)
join = List.Join()  # unwired: list0, list1, list2, list3
element_types = ElementTypes("GlobalParameter")
all_elements_of_type = ElementsOfType(element_type=element_types)
id = Element.Id(element=all_elements_of_type)
name = GlobalParameter.Name(globalParameter=all_elements_of_type)
value = GlobalParameter.Value(globalParameter=all_elements_of_type)
python_script = Python(IN[0]=all_elements_of_type)  # CPython3
# ---------- python_script.python (70 lines) ----------
###############################################################
# Load the Libraries

import clr
import sys
import math
import System
import io
import os

localapp = os.getenv(r'LOCALAPPDATA')
sys.path.append(os.path.join(localapp, r'python-3.8.3-embed-amd64\Lib\site-packages'))
sys.path.append(os.path.join(localapp, r'python-3.8.3-embed-amd64\Lib\jw-packages'))

# dynamo/revit-related libraries
clr.AddReference('DynamoRevitDS')
import Dynamo 
from System import Array
from System.Collections.Generic import *
clr.AddReference("RevitNodes")
import Revit
clr.ImportExtensions(Revit.Elements)
clr.ImportExtensions(Revit.GeometryConversion)
clr.AddReference("RevitServices")
import RevitServices
from RevitServices.Persistence import DocumentManager 
from RevitServices.Transactions import TransactionManager 
clr.AddReference("RevitAPI")
clr.AddReference('ProtoGeometry')
import Autodesk 
from Autodesk.DesignScript.Geometry import *
from Autodesk.DesignScript import *
from Autodesk.Revit.DB import *
from Autodesk.Revit.DB import Parameter
from Autodesk.Revit.DB.Architecture import *
from Autodesk.Revit.DB import IFailuresPreprocessor

doc = DocumentManager.Instance.CurrentDBDocument

###############################################################
# Customize functions


###############################################################
# Prepare the input, output

gps = UnwrapElement(IN[0])

out = []

###############################################################
# Start Transaction in Revit

TransactionManager.Instance.EnsureInTransaction(doc)

###############################################################
# Main part

id_element_affected = [gp.GetAffectedElements() for gp in gps]

###############################################################
# End Transaction in Revit

TransactionManager.Instance.TransactionTaskDone()

out = id_element_affected
###############################################################
# End the node

OUT = out
# ----------------------------------------
flatten = List.Flatten(list=python_script)
python_script_2 = Python(IN[0]=flatten)  # CPython3
# ---------- python_script_2.python (85 lines) ----------
###############################################################
# Load the Libraries

import clr
import sys
import math
import System
from System import Int16, Int32, Int64, String
import io
import os

localapp = os.getenv(r'LOCALAPPDATA')
sys.path.append(os.path.join(localapp, r'python-3.8.3-embed-amd64\Lib\site-packages'))
sys.path.append(os.path.join(localapp, r'python-3.8.3-embed-amd64\Lib\jw-packages'))

# dynamo/revit-related libraries
clr.AddReference('DynamoRevitDS')
import Dynamo 
from System import Array
from System.Collections.Generic import *
clr.AddReference("RevitNodes")
import Revit
clr.ImportExtensions(Revit.Elements)
clr.ImportExtensions(Revit.GeometryConversion)
clr.AddReference("RevitServices")
import RevitServices
from RevitServices.Persistence import DocumentManager 
from RevitServices.Transactions import TransactionManager 
clr.AddReference("RevitAPI")
clr.AddReference('ProtoGeometry')
import Autodesk 
from Autodesk.DesignScript.Geometry import *
from Autodesk.DesignScript import *
from Autodesk.Revit.DB import *
from Autodesk.Revit.DB import Parameter
from Autodesk.Revit.DB.Architecture import *
from Autodesk.Revit.DB import IFailuresPreprocessor

doc = DocumentManager.Instance.CurrentDBDocument

###############################################################
# Customize functions

def getElementByValue(v):
	# if value is ElementId or Reference object
	if isinstance(v, (ElementId, Reference)):
		return doc.GetElement(v)
	# if value is a integer
	elif isinstance(v, (int, Int16, Int32, Int64)):
		return doc.GetElement(ElementId(v))
	# if value is a String 'integer'
	elif isinstance(v, (str, String)) and str(v).isdigit():
		return doc.GetElement(ElementId(int(v)))
	# if value is a String Unique Id
	elif isinstance(v, (str, String)) and '-' in str(v):
		return doc.GetElement(v)

###############################################################
# Prepare the input, output

ids = IN[0]

out = []

###############################################################
# Start Transaction in Revit

TransactionManager.Instance.EnsureInTransaction(doc)

###############################################################
# Main part

for id in ids:
	out.append(getElementByValue(id))

###############################################################
# End Transaction in Revit

TransactionManager.Instance.TransactionTaskDone()


###############################################################
# End the node

OUT = out
# ----------------------------------------
string_3 = StringInput("IfcGUID")
getParameterValueByName = Element.GetParameterValueByName(element=python_script_2, parameterName=string_3)
combine = List.Combine(combineFunction=join, list0=id, list1=name, list2=value, list3=getParameterValueByName)

clean = List.Clean(list=combine)

# group (continued): Export GPs
byKeysValues = DesignScript.Builtin.Dictionary.ByKeysValues(keys=list_create, values=clean@L2)
stringifyJSON = Data.StringifyJSON(values=byKeysValues)
writeText = FileSystem.WriteText(filePath=concat, text=stringifyJSON)
