# Dynamo graph 22_extractObjectsAndSpaces.dyn (Dynamo 2.12.0.5650)
# packages: archi-lab.net 2022.210.1022

# group: Input
string = StringInput("C:\dev\phd\jw\healing\data\healing2023\20_extract_data\res\")
# note: input: directory of the .json (string)
string_2 = StringInput("collected_Instances_Door.json")
concat = String.Concat(string0=string, string1=string_2)
string_3 = StringInput("collected_Instances_Window.json")
concat_2 = String.Concat(string0=string, string1=string_3)
string_4 = StringInput("collected_Instances_Wall.json")
concat_3 = String.Concat(string0=string, string1=string_4)
string_5 = StringInput("collected_Instances_Slab.json")
concat_4 = String.Concat(string0=string, string1=string_5)
string_6 = StringInput("collected_Instances_Space.json")
concat_5 = String.Concat(string0=string, string1=string_6)

# group: Doors
code_block = CodeBlock { "Type IfcGUID"; }
code_block_2 = CodeBlock { "IfcGUID"; "Height"; "Rough Height"; }
list_create = List.Create(item0=code_block_2.out0, item1=code_block_2.out1, item2=code_block_2.out2)
join = List.Join(list0=code_block, list1=list_create)
categories = Categories("OST_Doors")
all_elements_of_category = ElementsOfCategory(Category=categories)
type = archilab.Revit.Elements.Elements.Type(element=all_elements_of_category)
getParameterValueByName = Element.GetParameterValueByName(element=type@L1, parameterName=code_block)
getParameterValueByName_2 = Element.GetParameterValueByName(element=all_elements_of_category@L1, parameterName=list_create)
addItemToFront = List.AddItemToFront(item=getParameterValueByName@L1, list=getParameterValueByName_2@L2)
byKeysValues = DesignScript.Builtin.Dictionary.ByKeysValues(keys=join, values=addItemToFront@L2)
stringifyJSON = Data.StringifyJSON(values=byKeysValues)
writeText = FileSystem.WriteText(filePath=concat, text=stringifyJSON)

# group: Windows
code_block_3 = CodeBlock { "Type IfcGUID"; }
code_block_4 = CodeBlock { "IfcGUID"; "Head Height"; }
list_create_2 = List.Create(item0=code_block_4.out0, item1=code_block_4.out1)
join_2 = List.Join(list0=code_block_3, list1=list_create_2)
categories_2 = Categories("OST_Windows")
all_elements_of_category_2 = ElementsOfCategory(Category=categories_2)
type_2 = archilab.Revit.Elements.Elements.Type(element=all_elements_of_category_2)
getParameterValueByName_3 = Element.GetParameterValueByName(element=type_2@L1, parameterName=code_block_3)
getParameterValueByName_4 = Element.GetParameterValueByName(element=all_elements_of_category_2@L1, parameterName=list_create_2)
addItemToFront_2 = List.AddItemToFront(item=getParameterValueByName_3@L1, list=getParameterValueByName_4@L2)
byKeysValues_2 = DesignScript.Builtin.Dictionary.ByKeysValues(keys=join_2, values=addItemToFront_2@L2)
stringifyJSON_2 = Data.StringifyJSON(values=byKeysValues_2)
writeText_2 = FileSystem.WriteText(filePath=concat_2, text=stringifyJSON_2)

# group: Walls
code_block_5 = CodeBlock { "Type IfcGUID"; }
code_block_6 = CodeBlock { "IfcGUID"; "Length"; "Area"; "Volume"; "Structural"; "Unconnected Height"; }
list_create_3 = List.Create(item0=code_block_6.out0, item1=code_block_6.out1, item2=code_block_6.out2, item3=code_block_6.out3, item4=code_block_6.out4, item5=code_block_6.out5)
join_3 = List.Join(list0=code_block_5, list1=list_create_3)
categories_3 = Categories("OST_Walls")
all_elements_of_category_3 = ElementsOfCategory(Category=categories_3)
type_3 = archilab.Revit.Elements.Elements.Type(element=all_elements_of_category_3)
getParameterValueByName_5 = Element.GetParameterValueByName(element=type_3@L1, parameterName=code_block_5)
getParameterValueByName_6 = Element.GetParameterValueByName(element=all_elements_of_category_3@L1, parameterName=list_create_3)
addItemToFront_3 = List.AddItemToFront(item=getParameterValueByName_5@L1, list=getParameterValueByName_6@L2)
byKeysValues_3 = DesignScript.Builtin.Dictionary.ByKeysValues(keys=join_3, values=addItemToFront_3@L2)
stringifyJSON_3 = Data.StringifyJSON(values=byKeysValues_3)
writeText_3 = FileSystem.WriteText(filePath=concat_3, text=stringifyJSON_3)

# group: Slabs
code_block_7 = CodeBlock { "Type IfcGUID"; }
code_block_8 = CodeBlock { "IfcGUID"; "Perimeter"; "Area"; "Volume"; "Thickness"; }
list_create_4 = List.Create(item0=code_block_8.out0, item1=code_block_8.out1, item2=code_block_8.out2, item3=code_block_8.out3, item4=code_block_8.out4)
join_4 = List.Join(list0=code_block_7, list1=list_create_4)
categories_4 = Categories("OST_Floors")
all_elements_of_category_4 = ElementsOfCategory(Category=categories_4)
type_4 = archilab.Revit.Elements.Elements.Type(element=all_elements_of_category_4)
getParameterValueByName_7 = Element.GetParameterValueByName(element=type_4@L1, parameterName=code_block_7)
getParameterValueByName_8 = Element.GetParameterValueByName(element=all_elements_of_category_4@L1, parameterName=list_create_4)
addItemToFront_4 = List.AddItemToFront(item=getParameterValueByName_7@L1, list=getParameterValueByName_8@L2)
byKeysValues_4 = DesignScript.Builtin.Dictionary.ByKeysValues(keys=join_4, values=addItemToFront_4@L2)
stringifyJSON_4 = Data.StringifyJSON(values=byKeysValues_4)
writeText_4 = FileSystem.WriteText(filePath=concat_4, text=stringifyJSON_4)

# group: Spaces
code_block_9 = CodeBlock { "IfcGUID"; "Perimeter"; "Area"; "Unbounded Height"; "Name"; "Space Function"; "OLF Value"; }
list_create_5 = List.Create(item0=code_block_9.out0, item1=code_block_9.out1, item2=code_block_9.out2, item3=code_block_9.out3, item4=code_block_9.out4, item5=code_block_9.out5, item6=code_block_9.out6)
categories_5 = Categories("OST_Rooms")
all_elements_of_category_5 = ElementsOfCategory(Category=categories_5)
getParameterValueByName_9 = Element.GetParameterValueByName(element=all_elements_of_category_5@L1, parameterName=list_create_5)
byKeysValues_5 = DesignScript.Builtin.Dictionary.ByKeysValues(keys=list_create_5, values=getParameterValueByName_9@L2)
stringifyJSON_5 = Data.StringifyJSON(values=byKeysValues_5)
writeText_5 = FileSystem.WriteText(filePath=concat_5, text=stringifyJSON_5)
