# Dynamo graph 1 Press Play for More Information about Dynamo Player.dyn (Dynamo 2.1.0.7464)

# group: Press Play for More Information about Dynamo Player
# note: CATEGORY:
# Administration
# DESCRIPTION:
# This workflow pops up a message about Dynamo Player.
# The Dynamo Player application executes Dynamo scripts in the Revit environment. Dynamo scripts can be written to perform many complex functions in Revit, some of which can be very useful to minimize repetitve and time consuming tasks, to run model checks, or to extract and utilize information from the Revit model. Learn more at http://dynamobim.org.
# MODEL PREPARATION:
# - None
# NOTE:
#  - None
# AUTHORS:
# - Autodesk
# Copyright(c) 2017, Autodesk
# REQUIRED PACKAGES:
# - None

code_block = CodeBlock { "You just ran a Dynamo script in Dynamo Player!" + "\n\n" +  "Dynamo Player executes Dynamo scripts for Revit. Scripts can perform many complex functions in Revit. They can minimize repetitive tasks, run Revit model checks, or extract and utilize information from the model."; }
code_block_2 = CodeBlock { "Learn more about Dynamo scripts at dynamobim.org"; }
python_script = Python(IN[0]=code_block, IN[1]=code_block_2)
# ---------- python_script.python (15 lines) ----------
#This script pops up a dialog box with a message from the previous node.
import clr
clr.AddReference('RevitAPIUI')

from Autodesk.Revit.UI import TaskDialog

mainText = IN[0]
footerText = IN[1]

messagePop = TaskDialog("Dynamo Player")
messagePop.MainContent = mainText + "\n\n" + "<a href=\"http://dynamobim.org/ \">" + footerText + "</a>";

OUT = "Success!"

messagePop.Show()
# ----------------------------------------
