# Dynamo graph Add Levels Above Selected Level (Imperial).dyn (Dynamo 2.1.0.7464)

# group: Add Levels Above Selected Level (Imperial)
# note: CATEGORY:
# Modeling
# DESCRIPTION:
# Create a series of levels above the selected level.
# MODEL PREPARATION:
# - None
# NOTE:
# - To ensure that the levels will not be deleted the
# next time you run the graph, avoid saving the graph.
# - Newly created levels will assume default 3D extents; adjust length(s) as necessary.
# - Crop Region extents may affect the visibility of newly created Levels. If a new level or levels is not visible in the active view, turn off the Crop Region.
# AUTHORS:
# - Autodesk
# Copyright (c) 2017, Autodesk
# REQUIRED PACKAGES:
# - None

# group: INPUT
# note: Select a level. The best way to select a level is to navigate to section/elevation view.
select_a_level = DSModelElementSelection()  # nothing selected; graph input
number_of_new_levels_to_create = IntegerSlider(5, range=1..100 step 1)  # graph input

distance_from_selected_level = LengthFromString(Value=3.048)  # "Distance from Selected Level (Feet and Inches)"; graph input

# group: Compute level elevations
sequence = Sequence(start=distance_from_selected_level, amount=number_of_new_levels_to_create, step=distance_from_selected_level, lacing=Longest)

# group: Create new levels
byLevelAndOffset = Level.ByLevelAndOffset(level=select_a_level, offset=sequence)

# group: OUTPUT
new_levels = Watch(byLevelAndOffset)  # graph output
