# Dynamo graph Select All Not Keynoted in the Active View.dyn (Dynamo 2.1.0.7464)

# group: Select All Not Keynoted in the Active View
# note: CATEGORY:
# Administration
# DESCRIPTION:
# This workflow selects all elements in the active Revit view that have empty Keynote parameters.
# MODEL PREPARATION:
# - None
# NOTE:
#  - None
# AUTHORS:
# - Autodesk
# Copyright(c) 2017, Autodesk
# REQUIRED PACKAGES:
# - None

all_elements_in_active_view = ElementsInView()
code_block = CodeBlock { "Family"; }
getParameterValueByName = Element.GetParameterValueByName(element=all_elements_in_active_view, parameterName=code_block)
string = StringInput("")
ne = getParameterValueByName != string
filterByBoolMask = List.FilterByBoolMask(list=all_elements_in_active_view, mask=ne)
filterByBoolMask_2 = List.FilterByBoolMask(list=getParameterValueByName, mask=ne)
code_block_2 = CodeBlock { "Keynote"; }
getParameterValueByName_2 = Element.GetParameterValueByName(element=filterByBoolMask_2.in, parameterName=code_block_2)
code_block_3 = CodeBlock { ""; }
eq = getParameterValueByName_2 == code_block_3
filterByBoolMask_3 = List.FilterByBoolMask(list=filterByBoolMask.in, mask=eq)
select_elems = Python(IN[0]=filterByBoolMask_3.in)
# ---------- select_elems.python (25 lines) ----------
import clr
clr.AddReference("RevitAPI")
clr.AddReference("RevitAPIUI")
import Autodesk
from Autodesk.Revit.UI import *
from Autodesk.Revit.DB import *
clr.AddReference("RevitServices")
import RevitServices
from RevitServices.Persistence import DocumentManager
clr.AddReference("RevitNodes")
import Revit
# clr.ImportExtensions(Revit.Elements)
from System.Collections.Generic import *

elems = UnwrapElement(IN[0])

elemIds = []
for elem in elems:
	elemIds.append(elem.Id)
	
uidoc = DocumentManager.Instance.CurrentUIDocument
uidoc.Selection.SetElementIds(List[ElementId](elemIds))

# Just for fun - give it to the output!
OUT = elemIds
# ----------------------------------------
