# Dynamo graph Update Sheet Names to Upper Case.dyn (Dynamo 2.1.0.7464)

# group: Update Sheet Names to Upper Case
# note: CATEGORY:
# Administration
# DESCRIPTION:
# This workflow sets the names of all Sheets in the model to UPPER CASE.
# MODEL PREPARATION:
# - None
# NOTE:
#  - None
# AUTHORS:
# - Autodesk
# Copyright(c) 2017, Autodesk
# REQUIRED PACKAGES:
# - None

element_types = ElementTypes("ViewSheet")
all_elements_of_type = ElementsOfType(element_type=element_types)
code_block = CodeBlock { "Sheet Name"; }
getParameterValueByName = Element.GetParameterValueByName(element=all_elements_of_type, parameterName=code_block)
toUpper = String.ToUpper(str=getParameterValueByName)
setParameterByName = Element.SetParameterByName(element=all_elements_of_type, parameterName=code_block, value=toUpper)
