# Dynamo custom node autoCheck.dyf (Dynamo 2.12.0.5650)
# category: ModelHealer
# automatically check building rules.
# packages: Rhythm 2023.2.2

# group: Input
DirectoryPathIN = Input(DirectoryPathIN: var[]..[])
ID = Input(ID: var[]..[])
IBCRulesAsAString = Input(IBCRulesAsAString: var[]..[])
DirectoryPathOUT = Input(DirectoryPathOUT: var[]..[])

directory_from_path = DirectoryObject(path=DirectoryPathIN)
code_block = CodeBlock { "*.rvt"; }
getDirectoryContents = FileSystem.GetDirectoryContents(directory=directory_from_path, searchString=code_block)
remove_rvt = BoolSelector(false)
fileName = FileSystem.FileName(path=getDirectoryContents.files, withExtension=remove_rvt)
string_from_object = FromObject(object=ID)
eq = fileName == string_from_object
filterByBoolMask = List.FilterByBoolMask(list=getDirectoryContents.files, mask=eq)
ʳʰʸᵗʰᵐ_applications = Rhythm.Revit.Application.Applications.OpenDocumentFile(filePath=filterByBoolMask.in)
ʳʰʸᵗʰᵐ_documents = Rhythm.Revit.Application.Documents.DynamoDocumentToDbDocument(dynamoDocument=ʳʰʸᵗʰᵐ_applications)
code_block_2 = CodeBlock { "\\"; }
add = DirectoryPathOUT + code_block_2
python_script = Python(IN[0]=ʳʰʸᵗʰᵐ_documents, IN[1]=string_from_object, IN[2]=IBCRulesAsAString, IN[3]=add)  # CPython3
# ---------- python_script.python (80 lines) ----------
###############################################################
# Import general packages.
import clr
import sys
import math
import System
import io
import os
import importlib

# Import Revit/Dynamo API related packages.
clr.AddReference('DynamoRevitDS')
import Dynamo 
from System import Array
from System.Collections.Generic import *
clr.AddReference("RevitNodes")
import Revit
clr.ImportExtensions(Revit.Elements)
clr.ImportExtensions(Revit.GeometryConversion)
clr.AddReference("RevitServices")
import RevitServices
from RevitServices.Persistence import DocumentManager 
from RevitServices.Transactions import TransactionManager 
clr.AddReference("RevitAPI")
clr.AddReference('ProtoGeometry')
import Autodesk 
from Autodesk.DesignScript.Geometry import *
from Autodesk.DesignScript import *
from Autodesk.Revit.DB import *
from Autodesk.Revit.DB import Parameter
from Autodesk.Revit.DB.Architecture import *
from Autodesk.Revit.DB import IFailuresPreprocessor

# Import external python packages.
localapp = os.getenv(r'LOCALAPPDATA')
sys.path.append(os.path.join(localapp, r'python-3.8.3-embed-amd64\Lib\site-packages'))

# Import customized python packgaes.
sys.path.append(r'C:\dev\phd\jw\healing\src\godyn')

import healBasics
importlib.reload(healBasics)
import healChecks
importlib.reload(healChecks)
import healParameters
importlib.reload(healParameters)

###############################################################
doc = DocumentManager.Instance.CurrentDBDocument

###############################################################
# Temporary functions


###############################################################
# Prepare the input (of the Python Node)
ext_doc = IN[0]
ext_id = IN[1]
checkRules = IN[2]
savePath = IN[3]

##############################################################
# Prepare the output (of the Python Node)
out = 'Succeed.'

###############################################################
# Start Transaction in Revit

###############################################################
# Main part
result = healChecks.checkIBCCompliance(ext_doc, checkRules)
healChecks.saveCheckingResults(result, savePath, ext_id)


###############################################################
# End Transaction in Revit

###############################################################
# End
OUT = out
# ----------------------------------------

# group: OUTPUT
Succeed = Output(python_script)  # "Succeed."
