# Dynamo custom node autoParametrize.dyf (Dynamo 2.12.0.5650)
# category: ModelHealer
# automated parametrize the current model in South-North and East-West directions.

# group: Input
levelName = Input(levelName: var[]..[])
ppNameSN = Input(ppNameSN: var[]..[])
Run = Input(Run: bool = false)
gridNameSN = Input(gridNameSN: var[]..[])
gridNameEW = Input(gridNameEW: var[]..[])
ppNameEW = Input(ppNameEW: var[]..[])

# group: Select FloorPlan View according to Level
categories = Categories("OST_Rooms")
categories_2 = Categories("OST_Views")
all_elements_of_category = ElementsOfCategory(Category=categories_2)
boolean = BoolSelector(false)
clean = List.Clean(list=all_elements_of_category, preserveIndices=boolean)
code_block = CodeBlock { "View Name"; }
getParameterValueByName = Element.GetParameterValueByName(element=clean, parameterName=code_block)
eq = levelName == getParameterValueByName
filterByBoolMask = List.FilterByBoolMask(list=clean, mask=eq)

# group: Select Level
run = BoolSelector(true)
list_create = List.Create(item0=levelName)
getLevelByLevelName = Python(IN[0]=run, IN[1]=list_create)  # CPython3
# ---------- getLevelByLevelName.python (89 lines) ----------
###############################################################
# Import general packages.
import clr
import sys
import math
import System
import io
import os
import importlib

# Import Revit/Dynamo API related packages.
clr.AddReference('DynamoRevitDS')
import Dynamo
from System import Array
from System.Collections.Generic import *
clr.AddReference("RevitNodes")
import Revit
clr.ImportExtensions(Revit.Elements)
clr.ImportExtensions(Revit.GeometryConversion)
clr.AddReference("RevitServices")
import RevitServices
from RevitServices.Persistence import DocumentManager 
from RevitServices.Transactions import TransactionManager 
clr.AddReference("RevitAPI")
clr.AddReference('ProtoGeometry')
import Autodesk 
from Autodesk.DesignScript.Geometry import *
from Autodesk.DesignScript import *
from Autodesk.Revit.DB import *
from Autodesk.Revit.DB import Parameter
from Autodesk.Revit.DB.Architecture import *
from Autodesk.Revit.DB import IFailuresPreprocessor

# Import external python packages.
localapp = os.getenv(r'LOCALAPPDATA')
sys.path.append(os.path.join(localapp, r'python-3.8.3-embed-amd64\Lib\site-packages'))

# Import customized python packgaes.
sys.path.append(r'C:\dev\phd\jw\healing\src\godyn')

import healBasics
importlib.reload(healBasics)
import healChecks
importlib.reload(healChecks)
import healParameters
importlib.reload(healParameters)

###############################################################
doc = DocumentManager.Instance.CurrentDBDocument


###############################################################
# Temporary functions


###############################################################
# Prepare the input (of the Python Node)
run = IN[0]
names = IN[1]


##############################################################
# Prepare the output (of the Python Node)
out = []


###############################################################
# Start Transaction in Revit
TransactionManager.Instance.EnsureInTransaction(doc)


###############################################################
# Main part
levels = []

if run:
    levels = healBasics.getLevelsByNames(doc, names)
    OUT = levels
else:
	OUT = "Set Run to True"


###############################################################
# End Transaction in Revit
TransactionManager.Instance.TransactionTaskDone()


###############################################################
# End
# ----------------------------------------
single_level = CodeBlock(level=getLevelByLevelName) { single_level = level[0]; }

# group: Select Walls (base) constrained on this level
categories_3 = Categories("OST_Walls")
all_elements_of_category_2 = ElementsOfCategory(Category=categories_3)
name = Element.Name(element=single_level)
code_block_2 = CodeBlock { "Base Constraint"; }
getParameterValueByName_2 = Element.GetParameterValueByName(element=all_elements_of_category_2, parameterName=code_block_2)
name_2 = Element.Name(element=getParameterValueByName_2)
eq_2 = name == name_2
code_block_3 = CodeBlock { true; }
allIndicesOf = List.AllIndicesOf(list=eq_2, item=code_block_3)
walls_based_constrained_on_one = List.GetItemAtIndex(list=all_elements_of_category_2, index=allIndicesOf)  # "Walls based constrained on one level"

# group: Divide Walls locating in the directions of SN (vertical in plan) and EW (horizontal).
getLocation = Element.GetLocation(element=walls_based_constrained_on_one)
startPoint = Curve.StartPoint(curve=getLocation)
X = Point.X(point=startPoint)
endPoint = Curve.EndPoint(curve=getLocation)
X_2 = Point.X(point=endPoint)
code_block_4 = CodeBlock { 0.01; }
eq_3 = Equals(x=X, y=X_2, tolerance=code_block_4)
code_block_5 = CodeBlock { true; }
allIndicesOf_2 = List.AllIndicesOf(list=eq_3, item=code_block_5)
vertical_walls_longer = List.GetItemAtIndex(list=walls_based_constrained_on_one, index=allIndicesOf_2)
code_block_6 = CodeBlock { false; }
allIndicesOf_3 = List.AllIndicesOf(list=eq_3, item=code_block_6)
horizontal_walls_shorter = List.GetItemAtIndex(list=walls_based_constrained_on_one, index=allIndicesOf_3)

# group: Select Grid
list_create_2 = List.Create(item0=gridNameSN, item1=gridNameEW)
getGridByGridName = Python(IN[0]=Run, IN[1]=list_create_2)  # CPython3
# ---------- getGridByGridName.python (88 lines) ----------
###############################################################
# Import general packages.
import clr
import sys
import math
import System
import io
import os
import importlib

# Import Revit/Dynamo API related packages.
clr.AddReference('DynamoRevitDS')
import Dynamo
from System import Array
from System.Collections.Generic import *
clr.AddReference("RevitNodes")
import Revit
clr.ImportExtensions(Revit.Elements)
clr.ImportExtensions(Revit.GeometryConversion)
clr.AddReference("RevitServices")
import RevitServices
from RevitServices.Persistence import DocumentManager 
from RevitServices.Transactions import TransactionManager 
clr.AddReference("RevitAPI")
clr.AddReference('ProtoGeometry')
import Autodesk 
from Autodesk.DesignScript.Geometry import *
from Autodesk.DesignScript import *
from Autodesk.Revit.DB import *
from Autodesk.Revit.DB import Parameter
from Autodesk.Revit.DB.Architecture import *
from Autodesk.Revit.DB import IFailuresPreprocessor

# Import external python packages.
localapp = os.getenv(r'LOCALAPPDATA')
sys.path.append(os.path.join(localapp, r'python-3.8.3-embed-amd64\Lib\site-packages'))

# Import customized python packgaes.
sys.path.append(r'C:\dev\phd\jw\healing\src\godyn')

import healBasics
importlib.reload(healBasics)
import healChecks
importlib.reload(healChecks)
import healParameters
importlib.reload(healParameters)

###############################################################
doc = DocumentManager.Instance.CurrentDBDocument


###############################################################
# Temporary functions


###############################################################
# Prepare the input (of the Python Node)
run = IN[0]
names = IN[1]

##############################################################
# Prepare the output (of the Python Node)
out = []


###############################################################
# Start Transaction in Revit
TransactionManager.Instance.EnsureInTransaction(doc)


###############################################################
# Main part
grids = []

if run:
    grids = healBasics.getGridsByNames(doc, names)
    OUT = grids
else:
	OUT = "Set Run to True"


###############################################################
# End Transaction in Revit
TransactionManager.Instance.TransactionTaskDone()


###############################################################
# End
# ----------------------------------------
code_block_7 = CodeBlock(grids=getGridByGridName) { grids; grid_SN = grids[0]; grid_EW = grids[1]; }
grid_curve_sn = Grid.Curve(grid=code_block_7.grid_SN)
grid_curve_ew = Grid.Curve(grid=code_block_7.grid_EW)

# group: Assign values to PP (for Walls_locating_in_South_North_Direction_per_Level) (SN)
getLocation_2 = Element.GetLocation(element=vertical_walls_longer)
code_block_8 = CodeBlock { 0.5; }
pointAtParameter = Curve.PointAtParameter(curve=getLocation_2, param=code_block_8)
closestPointTo = Geometry.ClosestPointTo(geometry=grid_curve_sn, other=pointAtParameter)
X_3 = Point.X(point=closestPointTo)
Y = Point.Y(point=closestPointTo)
Z = Point.Z(point=pointAtParameter)
byCoordinates = Point.ByCoordinates(x=X_3, y=Y, z=Z)
distanceTo = Geometry.DistanceTo(geometry=byCoordinates, other=pointAtParameter)
meter2foot = BoolSelector(true)
foot2meter = BoolSelector(false)
unitConvert = Python(IN[0]=distanceTo, IN[1]=meter2foot, IN[2]=foot2meter)  # CPython3
# ---------- unitConvert.python (86 lines) ----------
###############################################################
# Load the Libraries

import clr
import sys
import math
import System
import io
import os

localapp = os.getenv(r'LOCALAPPDATA')
sys.path.append(os.path.join(localapp, r'python-3.8.3-embed-amd64\Lib\site-packages'))
sys.path.append(os.path.join(localapp, r'python-3.8.3-embed-amd64\Lib\jw-packages'))

# dynamo/revit-related libraries
clr.AddReference('DynamoRevitDS')
import Dynamo 
from System import Array
from System.Collections.Generic import *
clr.AddReference("RevitNodes")
import Revit
clr.ImportExtensions(Revit.Elements)
clr.ImportExtensions(Revit.GeometryConversion)
clr.AddReference("RevitServices")
import RevitServices
from RevitServices.Persistence import DocumentManager 
from RevitServices.Transactions import TransactionManager 
clr.AddReference("RevitAPI")
clr.AddReference('ProtoGeometry')
import Autodesk 
from Autodesk.DesignScript.Geometry import *
from Autodesk.DesignScript import *
from Autodesk.Revit.DB import *
from Autodesk.Revit.DB import Parameter
from Autodesk.Revit.DB.Architecture import *
from Autodesk.Revit.DB import IFailuresPreprocessor

doc = DocumentManager.Instance.CurrentDBDocument

###############################################################
# Customize functions

def foot_to_meter(ori_value):
    if isinstance(ori_value, list):
        return [UnitUtils.ConvertFromInternalUnits(value, UnitTypeId.Meters) for value in ori_value]
    return float(UnitUtils.ConvertFromInternalUnits(ori_value, UnitTypeId.Meters))


def meter_to_foot(ori_value):
    if isinstance(ori_value, list):
        return [UnitUtils.ConvertToInternalUnits(value, UnitTypeId.Meters) for value in ori_value]
    return float(UnitUtils.ConvertToInternalUnits(ori_value, UnitTypeId.Meters))


###############################################################
# Prepare the input, output

ori = IN[0]
meter2foot = IN[1]
foot2meter = IN[2]

###############################################################
# Start Transaction in Revit

#TransactionManager.Instance.EnsureInTransaction(doc)

###############################################################
# Main part

out = []
if (meter2foot and foot2meter) or (not meter2foot and not foot2meter):
    out = 'Please (only) chose one conversion type as True.'
elif meter2foot or foot2meter:
    if meter2foot:
        out = meter_to_foot(ori)
    elif foot2meter:
        out = foot_to_meter(ori)
    out = [round(v,5) for v in out]
###############################################################
# End Transaction in Revit

#TransactionManager.Instance.TransactionTaskDone()

###############################################################
# End the node
OUT = out
# ----------------------------------------
string = StringInput("distance_ew")
setParameterByName = Element.SetParameterByName(element=vertical_walls_longer, parameterName=string, value=distanceTo)

# group: Create GP representing "distance in the ew direction" (for Walls_locating_in_South_North_Direction_per_Level) (SN)
code_block_9 = CodeBlock { "_"; }
add = levelName + code_block_9
add_2 = add + ppNameSN
id = Element.Id(element=vertical_walls_longer)
sortByKey = List.SortByKey(list=vertical_walls_longer, keys=id)
count = List.Count(list=sortByKey.sortedList)
ofRepeatedItem = List.OfRepeatedItem(item=add_2, amount=count)
code_block_10 = CodeBlock { 0; }
range = Range(start=code_block_10, end=count)
add_3 = ofRepeatedItem + range
list_create_3 = List.Create(item0=add_3)
flatten = List.Flatten(list=list_create_3)
createGP = Python(IN[0]=flatten, IN[1]=unitConvert)  # CPython3
# ---------- createGP.python (83 lines) ----------
###############################################################
# Import general packages.
import clr
import sys
import math
import System
import io
import os
import importlib

# Import Revit/Dynamo API related packages.
clr.AddReference('DynamoRevitDS')
import Dynamo
from System import Array
from System.Collections.Generic import *
clr.AddReference("RevitNodes")
import Revit
clr.ImportExtensions(Revit.Elements)
clr.ImportExtensions(Revit.GeometryConversion)
clr.AddReference("RevitServices")
import RevitServices
from RevitServices.Persistence import DocumentManager 
from RevitServices.Transactions import TransactionManager 
clr.AddReference("RevitAPI")
clr.AddReference('ProtoGeometry')
import Autodesk 
from Autodesk.DesignScript.Geometry import *
from Autodesk.DesignScript import *
from Autodesk.Revit.DB import *
from Autodesk.Revit.DB import Parameter
from Autodesk.Revit.DB.Architecture import *
from Autodesk.Revit.DB import IFailuresPreprocessor

# Import external python packages.
localapp = os.getenv(r'LOCALAPPDATA')
sys.path.append(os.path.join(localapp, r'python-3.8.3-embed-amd64\Lib\site-packages'))

# Import customized python packgaes.
sys.path.append(r'C:\dev\phd\jw\healing\src\godyn')

import healBasics
importlib.reload(healBasics)
import healChecks
importlib.reload(healChecks)
import healParameters
importlib.reload(healParameters)

###############################################################
doc = DocumentManager.Instance.CurrentDBDocument


###############################################################
# Temporary functions


###############################################################
# Prepare the input (of the Python Node)
gp_names = IN[0]
gp_values = IN[1]


##############################################################
# Prepare the output (of the Python Node)
out = []


###############################################################
# Start Transaction in Revit
TransactionManager.Instance.EnsureInTransaction(doc)


###############################################################
# Main part
new_gps = healParameters.setGlobalParameters(doc, gp_names, gp_values)

###############################################################
# End Transaction in Revit
TransactionManager.Instance.TransactionTaskDone()


###############################################################
# End
OUT = new_gps
# ----------------------------------------
regenerate_gp = Python(IN[0]=createGP)  # CPython3
# ---------- regenerate_gp.python (31 lines) ----------
###############################################################
# Load the Libraries

import clr
import sys
import math
import System
import io
import os

# dynamo/revit-related libraries
clr.AddReference('DynamoRevitDS')
import Dynamo 
from System import Array
from System.Collections.Generic import *
clr.AddReference("RevitNodes")
import Revit
clr.ImportExtensions(Revit.Elements)
clr.ImportExtensions(Revit.GeometryConversion)
clr.AddReference("RevitServices")
import RevitServices
from RevitServices.Persistence import DocumentManager 
from RevitServices.Transactions import TransactionManager 
clr.AddReference("RevitAPI")
clr.AddReference('ProtoGeometry')

doc = DocumentManager.Instance.CurrentDBDocument
doc.Regenerate()

output = IN[0]
OUT = output
# ----------------------------------------
regenerate_pp = Python(IN[0]=setParameterByName)  # CPython3; same code as regenerate_gp
assigngptopp_sn = Python(IN[0]=string, IN[1]=regenerate_pp, IN[2]=regenerate_gp)  # CPython3
# ---------- assigngptopp_sn.python (84 lines) ----------
###############################################################
# Import general packages.
import clr
import sys
import math
import System
import io
import os
import importlib

# Import Revit/Dynamo API related packages.
clr.AddReference('DynamoRevitDS')
import Dynamo
from System import Array
from System.Collections.Generic import *
clr.AddReference("RevitNodes")
import Revit
clr.ImportExtensions(Revit.Elements)
clr.ImportExtensions(Revit.GeometryConversion)
clr.AddReference("RevitServices")
import RevitServices
from RevitServices.Persistence import DocumentManager 
from RevitServices.Transactions import TransactionManager 
clr.AddReference("RevitAPI")
clr.AddReference('ProtoGeometry')
import Autodesk 
from Autodesk.DesignScript.Geometry import *
from Autodesk.DesignScript import *
from Autodesk.Revit.DB import *
from Autodesk.Revit.DB import Parameter
from Autodesk.Revit.DB.Architecture import *
from Autodesk.Revit.DB import IFailuresPreprocessor

# Import external python packages.
localapp = os.getenv(r'LOCALAPPDATA')
sys.path.append(os.path.join(localapp, r'python-3.8.3-embed-amd64\Lib\site-packages'))

# Import customized python packgaes.
sys.path.append(r'C:\dev\phd\jw\healing\src\godyn')

import healBasics
importlib.reload(healBasics)
import healChecks
importlib.reload(healChecks)
import healParameters
importlib.reload(healParameters)

###############################################################
doc = DocumentManager.Instance.CurrentDBDocument


###############################################################
# Temporary functions


###############################################################
# Prepare the input (of the Python Node)
pp_name = IN[0]
all_elements = IN[1]
all_gps = IN[2]


##############################################################
# Prepare the output (of the Python Node)
out = []


###############################################################
# Start Transaction in Revit
TransactionManager.Instance.EnsureInTransaction(doc)


###############################################################
# Main part
out = healParameters.assignGlobalParameters(doc, all_elements, all_gps, pp_name)

###############################################################
# End Transaction in Revit
TransactionManager.Instance.TransactionTaskDone()


###############################################################
# End
OUT = out
# ----------------------------------------

# group: Create Dimensions (Walls_South_North_per_Level)
list_create_4 = List.Create()  # unwired: item0, item1
cartesianProduct = List.CartesianProduct(combineFunction=list_create_4, list0=code_block_7.grid_SN, list1=vertical_walls_longer)
byElements = Dimension.ByElements(view=filterByBoolMask.in, referenceElements=cartesianProduct, line=grid_curve_sn)
regenerate = Python(IN[0]=byElements)  # CPython3; same code as regenerate_gp
flatten_2 = List.Flatten(list=regenerate)
labeldimensions_sn = Python(IN[0]=regenerate_gp, IN[1]=flatten_2)  # CPython3
# ---------- labeldimensions_sn.python (83 lines) ----------
###############################################################
# Import general packages.
import clr
import sys
import math
import System
import io
import os
import importlib

# Import Revit/Dynamo API related packages.
clr.AddReference('DynamoRevitDS')
import Dynamo
from System import Array
from System.Collections.Generic import *
clr.AddReference("RevitNodes")
import Revit
clr.ImportExtensions(Revit.Elements)
clr.ImportExtensions(Revit.GeometryConversion)
clr.AddReference("RevitServices")
import RevitServices
from RevitServices.Persistence import DocumentManager 
from RevitServices.Transactions import TransactionManager 
clr.AddReference("RevitAPI")
clr.AddReference('ProtoGeometry')
import Autodesk 
from Autodesk.DesignScript.Geometry import *
from Autodesk.DesignScript import *
from Autodesk.Revit.DB import *
from Autodesk.Revit.DB import Parameter
from Autodesk.Revit.DB.Architecture import *
from Autodesk.Revit.DB import IFailuresPreprocessor

# Import external python packages.
localapp = os.getenv(r'LOCALAPPDATA')
sys.path.append(os.path.join(localapp, r'python-3.8.3-embed-amd64\Lib\site-packages'))

# Import customized python packgaes.
sys.path.append(r'C:\dev\phd\jw\healing\src\godyn')

import healBasics
importlib.reload(healBasics)
import healChecks
importlib.reload(healChecks)
import healParameters
importlib.reload(healParameters)

###############################################################
doc = DocumentManager.Instance.CurrentDBDocument


###############################################################
# Temporary functions


###############################################################
# Prepare the input (of the Python Node)
all_gps = UnwrapElement(IN[0])
all_dms = UnwrapElement(IN[1])


##############################################################
# Prepare the output (of the Python Node)
out = []


###############################################################
# Start Transaction in Revit
TransactionManager.Instance.EnsureInTransaction(doc)


###############################################################
# Main part
out = healParameters.labelDimensionsbyGlobalParameters(all_gps, all_dms)

###############################################################
# End Transaction in Revit
TransactionManager.Instance.TransactionTaskDone()


###############################################################
# End
OUT = out
# ----------------------------------------

# group: Assign values to PP (for Walls_locating_in_East_West_Direction_per_Level) (EW)
getLocation_3 = Element.GetLocation(element=horizontal_walls_shorter)
code_block_11 = CodeBlock { 0.5; }
pointAtParameter_2 = Curve.PointAtParameter(curve=getLocation_3, param=code_block_11)
closestPointTo_2 = Geometry.ClosestPointTo(geometry=grid_curve_ew, other=pointAtParameter_2)
X_4 = Point.X(point=closestPointTo_2)
Y_2 = Point.Y(point=closestPointTo_2)
Z_2 = Point.Z(point=pointAtParameter_2)
byCoordinates_2 = Point.ByCoordinates(x=X_4, y=Y_2, z=Z_2)
distanceTo_2 = Geometry.DistanceTo(geometry=byCoordinates_2, other=pointAtParameter_2)
meter2foot_2 = BoolSelector(true)
foot2meter_2 = BoolSelector(false)
unitConvert_2 = Python(IN[0]=distanceTo_2, IN[1]=meter2foot_2, IN[2]=foot2meter_2)  # CPython3; same code as unitConvert
string_2 = StringInput("distance_sn")
setParameterByName_2 = Element.SetParameterByName(element=horizontal_walls_shorter, parameterName=string_2, value=distanceTo_2)

# group: Create GP GP representing "distance in the sn direction" (for Walls_locating_in_East_West_Direction_per_Level) (EW)
code_block_12 = CodeBlock { "_"; }
add_4 = levelName + code_block_12
add_5 = add_4 + ppNameEW
id_2 = Element.Id(element=horizontal_walls_shorter)
sortByKey_2 = List.SortByKey(list=horizontal_walls_shorter, keys=id_2)
count_2 = List.Count(list=sortByKey_2.sortedList)
ofRepeatedItem_2 = List.OfRepeatedItem(item=add_5, amount=count_2)
code_block_13 = CodeBlock { 0; }
range_2 = Range(start=code_block_13, end=count_2)
add_6 = ofRepeatedItem_2 + range_2
list_create_5 = List.Create(item0=add_6)
flatten_3 = List.Flatten(list=list_create_5)
createGP_2 = Python(IN[0]=flatten_3, IN[1]=unitConvert_2)  # CPython3; same code as createGP
regenerate_gp_2 = Python(IN[0]=createGP_2)  # CPython3; same code as regenerate_gp
regenerate_pp_2 = Python(IN[0]=setParameterByName_2)  # CPython3; same code as regenerate_gp
assigngptopp_ew = Python(IN[0]=string_2, IN[1]=regenerate_pp_2, IN[2]=regenerate_gp_2)  # CPython3; same code as assigngptopp_sn

# group: Create Dimensions (Walls_East_West_per_Level)
list_create_6 = List.Create()  # unwired: item0, item1
cartesianProduct_2 = List.CartesianProduct(combineFunction=list_create_6, list0=code_block_7.grid_EW, list1=horizontal_walls_shorter)
byElements_2 = Dimension.ByElements(view=filterByBoolMask.in, referenceElements=cartesianProduct_2, line=grid_curve_ew)
regenerate_2 = Python(IN[0]=byElements_2)  # CPython3; same code as regenerate_gp
flatten_4 = List.Flatten(list=regenerate_2)
labeldimensions_ew = Python(IN[0]=regenerate_gp_2, IN[1]=flatten_4)  # CPython3; same code as labeldimensions_sn

# group: OUTPUT
list_create_7 = List.Create(item0=assigngptopp_sn, item1=assigngptopp_ew)
allTrue = List.AllTrue(list=list_create_7)
Succeed = Output(allTrue)
