# Dynamo graph 10_autoParametrizing.dyn "11_autoParametrizing" (Dynamo 2.12.0.5650)
# packages: Clockwork for Dynamo 2.x 2.3.0

# group: Create PP for all Walls
string = StringInput("distance_ew")
string_2 = StringInput("distance_sn")
list_create = List.Create(item0=string, item1=string_2)
select_parameter_type = ParameterType("Length")
select_builtin_parameter_group = BuiltInParameterGroup("PG_LENGTH")
boolean = BoolSelector(true)
categories = Categories("OST_Walls")
createProjectParameter = Parameter.CreateProjectParameter(parameterName=list_create, type=select_parameter_type, group=select_builtin_parameter_group, instance=boolean, categoryList=categories)  # frozen; unwired: groupName
passthrough_sn = Custom[Passthrough (SN)](waitFor=createProjectParameter)  # package Clockwork for Dynamo 2.x; Forces a sequential order of execution. The node wired into the output of the Passthrough node will be executed *after* the node wired into the waitFor input (e.g. important for some Revit operations). The value of the passThrough input will be passed on to the node wired into the output port of the Passthrough node.; unwired: passThrough
passthrough_ew = Custom[Passthrough (EW)](waitFor=createProjectParameter)  # package Clockwork for Dynamo 2.x; Forces a sequential order of execution. The node wired into the output of the Passthrough node will be executed *after* the node wired into the waitFor input (e.g. important for some Revit operations). The value of the passThrough input will be passed on to the node wired into the output port of the Passthrough node.; unwired: passThrough
code_block = CodeBlock { "Walls"; }
list_create_2 = List.Create(item0=code_block)
byName = Category.ByName(name=list_create_2)

categories_2 = Categories("OST_Walls")
all_elements_of_category = ElementsOfCategory(Category=categories_2)
code_block_2 = CodeBlock { "X Coordinate"; }
getLocation = Element.GetLocation(element=all_elements_of_category)
startPoint = Curve.StartPoint(curve=getLocation)
X = Point.X(point=startPoint)
endPoint = Curve.EndPoint(curve=getLocation)
X_2 = Point.X(point=endPoint)
add = X + X_2
code_block_3 = CodeBlock { 2; }
div = add / code_block_3
setParameterByName = Element.SetParameterByName(element=all_elements_of_category, parameterName=code_block_2, value=div)  # frozen
code_block_4 = CodeBlock { "Y Coordinate"; }
Y = Point.Y(point=startPoint)
Y_2 = Point.Y(point=endPoint)
add_2 = Y + Y_2
div_2 = add_2 / code_block_3
setParameterByName_2 = Element.SetParameterByName(element=all_elements_of_category, parameterName=code_block_4, value=div_2)  # frozen
Z = Point.Z(point=startPoint)
Z_2 = Point.Z(point=endPoint)
add_3 = Z + Z_2
div_3 = add_3 / code_block_3
element_types = ElementTypes("GlobalParameter")  # frozen
all_elements_of_type = ElementsOfType(element_type=element_types)
name = Element.Name(element=all_elements_of_type)
code_block_5 = CodeBlock { "Y"; }
countOccurrences = String.CountOccurrences(string=name, searchFor=code_block_5)
code_block_6 = CodeBlock { 1; }
allIndicesOf = List.AllIndicesOf(list=countOccurrences, item=code_block_6)
getItemAtIndex = List.GetItemAtIndex(list=all_elements_of_type, index=allIndicesOf)
categories_3 = Categories("OST_Walls")  # frozen
all_elements_of_category_2 = ElementsOfCategory(Category=categories_3)
levels = Levels("D_ue_E1_UK")
name_2 = Element.Name(element=levels)
code_block_7 = CodeBlock { "Base Constraint"; }
getParameterValueByName = Element.GetParameterValueByName(element=all_elements_of_category_2, parameterName=code_block_7)
name_3 = Element.Name(element=getParameterValueByName)
eq = name_2 == name_3
code_block_8 = CodeBlock { true; }
allIndicesOf_2 = List.AllIndicesOf(list=eq, item=code_block_8)
walls = List.GetItemAtIndex(list=all_elements_of_category_2, index=allIndicesOf_2)
getLocation_2 = Element.GetLocation(element=walls)
startPoint_2 = Curve.StartPoint(curve=getLocation_2)
X_3 = Point.X(point=startPoint_2)
endPoint_2 = Curve.EndPoint(curve=getLocation_2)
X_4 = Point.X(point=endPoint_2)
code_block_9 = CodeBlock { 0.1; }
eq_2 = Equals(x=X_3, y=X_4, tolerance=code_block_9)
code_block_10 = CodeBlock { false; }
allIndicesOf_3 = List.AllIndicesOf(list=eq_2, item=code_block_10)
horizontal_walls = List.GetItemAtIndex(list=walls, index=allIndicesOf_3)
code_block_11 = CodeBlock { "Y Distance with First Axes"; }
getParameterValueByName_2 = Element.GetParameterValueByName(element=horizontal_walls, parameterName=code_block_11)
setValue = GlobalParameter.SetValue(parameter=getItemAtIndex, value=getParameterValueByName_2)
code_block_12 = CodeBlock { "X"; }
countOccurrences_2 = String.CountOccurrences(string=name, searchFor=code_block_12)
code_block_13 = CodeBlock { 1; }
allIndicesOf_4 = List.AllIndicesOf(list=countOccurrences_2, item=code_block_13)
getItemAtIndex_2 = List.GetItemAtIndex(list=all_elements_of_type, index=allIndicesOf_4)
code_block_14 = CodeBlock { true; }
allIndicesOf_5 = List.AllIndicesOf(list=eq_2, item=code_block_14)
vertical_walls = List.GetItemAtIndex(list=walls, index=allIndicesOf_5)
code_block_15 = CodeBlock { "X Distance with First Axes"; }
getParameterValueByName_3 = Element.GetParameterValueByName(element=vertical_walls, parameterName=code_block_15)
setValue_2 = GlobalParameter.SetValue(parameter=getItemAtIndex_2, value=getParameterValueByName_3)
categories_4 = Categories("OST_Grids")  # frozen
all_elements_of_category_3 = ElementsOfCategory(Category=categories_4)
code_block_16 = CodeBlock { 7; }
getItemAtIndex_3 = List.GetItemAtIndex(list=all_elements_of_category_3, index=code_block_16)
curve = Grid.Curve(grid=getItemAtIndex_3)
code_block_17 = CodeBlock { 0; }
getItemAtIndex_4 = List.GetItemAtIndex(list=all_elements_of_category_3, index=code_block_17)
curve_2 = Grid.Curve(grid=getItemAtIndex_4)
geometry = Element.Geometry()  # frozen; unwired: element
byGeometry = BoundingBox.ByGeometry(geom=geometry)
maxPoint = BoundingBox.MaxPoint(boundingBox=byGeometry)
Y_3 = Point.Y(point=maxPoint)
minPoint = BoundingBox.MinPoint(boundingBox=byGeometry)
Y_4 = Point.Y(point=minPoint)
add_4 = Y_3 + Y_4
code_block_18 = CodeBlock { 2; }
div_4 = add_4 / code_block_18
X_5 = Point.X(point=minPoint)
X_6 = Point.X(point=maxPoint)
add_5 = X_5 + X_6
code_block_19 = CodeBlock { 2; }
div_5 = add_5 / code_block_19

# group: Select Level
rerunnodes = Python()  # CPython3; frozen; unwired: IN[0]
# ---------- rerunnodes.python (83 lines) ----------
###############################################################
# Import general packages.
import clr
import sys
import math
import System
import io
import os
import importlib

# Import Revit/Dynamo API related packages.
clr.AddReference('DynamoRevitDS')
import Dynamo
from System import Array
from System.Collections.Generic import *
clr.AddReference("RevitNodes")
import Revit
clr.ImportExtensions(Revit.Elements)
clr.ImportExtensions(Revit.GeometryConversion)
clr.AddReference("RevitServices")
import RevitServices
from RevitServices.Persistence import DocumentManager 
from RevitServices.Transactions import TransactionManager 
clr.AddReference("RevitAPI")
clr.AddReference('ProtoGeometry')
import Autodesk 
from Autodesk.DesignScript.Geometry import *
from Autodesk.DesignScript import *
from Autodesk.Revit.DB import *
from Autodesk.Revit.DB import Parameter
from Autodesk.Revit.DB.Architecture import *
from Autodesk.Revit.DB import IFailuresPreprocessor

# Import external python packages.
localapp = os.getenv(r'LOCALAPPDATA')
sys.path.append(os.path.join(localapp, r'python-3.8.3-embed-amd64\Lib\site-packages'))

# Import customized python packgaes.
sys.path.append(r'C:\dev\phd\jw\healing\src\godyn')

import healBasics
importlib.reload(healBasics)
import healChecks
importlib.reload(healChecks)
import healParameters
importlib.reload(healParameters)

###############################################################
doc = DocumentManager.Instance.CurrentDBDocument


###############################################################
# Temporary functions


###############################################################
# Prepare the input (of the Python Node)
element = IN[0]


##############################################################
# Prepare the output (of the Python Node)
out = []


###############################################################
# Start Transaction in Revit
TransactionManager.Instance.EnsureInTransaction(doc)


###############################################################
# Main part
healBasics.rerunNodes()


###############################################################
# End Transaction in Revit
TransactionManager.Instance.TransactionTaskDone()


###############################################################
# End
OUT = out
# ----------------------------------------
select_level = StringInput("D_ue_E1_OK")

# group: Select FloorPlan View according to Level
categories_5 = Categories("OST_Rooms")
categories_6 = Categories("OST_Views")
all_elements_of_category_4 = ElementsOfCategory(Category=categories_6)
boolean_2 = BoolSelector(false)
clean = List.Clean(list=all_elements_of_category_4, preserveIndices=boolean_2)
code_block_20 = CodeBlock { "View Name"; }
getParameterValueByName_4 = Element.GetParameterValueByName(element=clean, parameterName=code_block_20)
eq_3 = select_level == getParameterValueByName_4
filterByBoolMask = List.FilterByBoolMask(list=clean, mask=eq_3)

# group: Select Level
run = BoolSelector(true)
list_create_3 = List.Create(item0=select_level)
getLevelByLevelName = Python(IN[0]=run, IN[1]=list_create_3)  # CPython3
# ---------- getLevelByLevelName.python (89 lines) ----------
###############################################################
# Import general packages.
import clr
import sys
import math
import System
import io
import os
import importlib

# Import Revit/Dynamo API related packages.
clr.AddReference('DynamoRevitDS')
import Dynamo
from System import Array
from System.Collections.Generic import *
clr.AddReference("RevitNodes")
import Revit
clr.ImportExtensions(Revit.Elements)
clr.ImportExtensions(Revit.GeometryConversion)
clr.AddReference("RevitServices")
import RevitServices
from RevitServices.Persistence import DocumentManager 
from RevitServices.Transactions import TransactionManager 
clr.AddReference("RevitAPI")
clr.AddReference('ProtoGeometry')
import Autodesk 
from Autodesk.DesignScript.Geometry import *
from Autodesk.DesignScript import *
from Autodesk.Revit.DB import *
from Autodesk.Revit.DB import Parameter
from Autodesk.Revit.DB.Architecture import *
from Autodesk.Revit.DB import IFailuresPreprocessor

# Import external python packages.
localapp = os.getenv(r'LOCALAPPDATA')
sys.path.append(os.path.join(localapp, r'python-3.8.3-embed-amd64\Lib\site-packages'))

# Import customized python packgaes.
sys.path.append(r'C:\dev\phd\jw\healing\src\godyn')

import healBasics
importlib.reload(healBasics)
import healChecks
importlib.reload(healChecks)
import healParameters
importlib.reload(healParameters)

###############################################################
doc = DocumentManager.Instance.CurrentDBDocument


###############################################################
# Temporary functions


###############################################################
# Prepare the input (of the Python Node)
run = IN[0]
names = IN[1]


##############################################################
# Prepare the output (of the Python Node)
out = []


###############################################################
# Start Transaction in Revit
TransactionManager.Instance.EnsureInTransaction(doc)


###############################################################
# Main part
levels = []

if run:
    levels = healBasics.getLevelsByNames(doc, names)
    OUT = levels
else:
	OUT = "Set Run to True"


###############################################################
# End Transaction in Revit
TransactionManager.Instance.TransactionTaskDone()


###############################################################
# End
# ----------------------------------------
single_level = CodeBlock(level=getLevelByLevelName) { single_level = level[0]; }

# group: Select Walls (base) constrained on this level
categories_7 = Categories("OST_Walls")
all_elements_of_category_5 = ElementsOfCategory(Category=categories_7)
name_4 = Element.Name(element=single_level)
code_block_21 = CodeBlock { "Base Constraint"; }
getParameterValueByName_5 = Element.GetParameterValueByName(element=all_elements_of_category_5, parameterName=code_block_21)
name_5 = Element.Name(element=getParameterValueByName_5)
eq_4 = name_4 == name_5
code_block_22 = CodeBlock { true; }
allIndicesOf_6 = List.AllIndicesOf(list=eq_4, item=code_block_22)
walls_based_constrained_on_one = List.GetItemAtIndex(list=all_elements_of_category_5, index=allIndicesOf_6)  # "Walls based constrained on one level"

# group: Divide Walls locating in the directions of SN (vertical in plan) and EW (horizontal).
getLocation_3 = Element.GetLocation(element=walls_based_constrained_on_one)
startPoint_3 = Curve.StartPoint(curve=getLocation_3)
X_7 = Point.X(point=startPoint_3)
endPoint_3 = Curve.EndPoint(curve=getLocation_3)
X_8 = Point.X(point=endPoint_3)
code_block_23 = CodeBlock { 0.01; }
eq_5 = Equals(x=X_7, y=X_8, tolerance=code_block_23)
code_block_24 = CodeBlock { true; }
allIndicesOf_7 = List.AllIndicesOf(list=eq_5, item=code_block_24)
vertical_walls_longer = List.GetItemAtIndex(list=walls_based_constrained_on_one, index=allIndicesOf_7)
code_block_25 = CodeBlock { false; }
allIndicesOf_8 = List.AllIndicesOf(list=eq_5, item=code_block_25)
horizontal_walls_shorter = List.GetItemAtIndex(list=walls_based_constrained_on_one, index=allIndicesOf_8)

# group: Select Grid
run_2 = BoolSelector(true)
grid_in_sn_direction = StringInput("1")
grid_in_ew_direction = StringInput("A")
list_create_4 = List.Create(item0=grid_in_sn_direction, item1=grid_in_ew_direction)
getGridByGridName = Python(IN[0]=run_2, IN[1]=list_create_4)  # CPython3
# ---------- getGridByGridName.python (88 lines) ----------
###############################################################
# Import general packages.
import clr
import sys
import math
import System
import io
import os
import importlib

# Import Revit/Dynamo API related packages.
clr.AddReference('DynamoRevitDS')
import Dynamo
from System import Array
from System.Collections.Generic import *
clr.AddReference("RevitNodes")
import Revit
clr.ImportExtensions(Revit.Elements)
clr.ImportExtensions(Revit.GeometryConversion)
clr.AddReference("RevitServices")
import RevitServices
from RevitServices.Persistence import DocumentManager 
from RevitServices.Transactions import TransactionManager 
clr.AddReference("RevitAPI")
clr.AddReference('ProtoGeometry')
import Autodesk 
from Autodesk.DesignScript.Geometry import *
from Autodesk.DesignScript import *
from Autodesk.Revit.DB import *
from Autodesk.Revit.DB import Parameter
from Autodesk.Revit.DB.Architecture import *
from Autodesk.Revit.DB import IFailuresPreprocessor

# Import external python packages.
localapp = os.getenv(r'LOCALAPPDATA')
sys.path.append(os.path.join(localapp, r'python-3.8.3-embed-amd64\Lib\site-packages'))

# Import customized python packgaes.
sys.path.append(r'C:\dev\phd\jw\healing\src\godyn')

import healBasics
importlib.reload(healBasics)
import healChecks
importlib.reload(healChecks)
import healParameters
importlib.reload(healParameters)

###############################################################
doc = DocumentManager.Instance.CurrentDBDocument


###############################################################
# Temporary functions


###############################################################
# Prepare the input (of the Python Node)
run = IN[0]
names = IN[1]

##############################################################
# Prepare the output (of the Python Node)
out = []


###############################################################
# Start Transaction in Revit
TransactionManager.Instance.EnsureInTransaction(doc)


###############################################################
# Main part
grids = []

if run:
    grids = healBasics.getGridsByNames(doc, names)
    OUT = grids
else:
	OUT = "Set Run to True"


###############################################################
# End Transaction in Revit
TransactionManager.Instance.TransactionTaskDone()


###############################################################
# End
# ----------------------------------------
code_block_26 = CodeBlock(grids=getGridByGridName) { grids; grid_SN = grids[0]; grid_EW = grids[1]; }
grid_curve_sn = Grid.Curve(grid=code_block_26.grid_SN)
grid_curve_ew = Grid.Curve(grid=code_block_26.grid_EW)

# group: Assign values to PP (for Walls_locating_in_South_North_Direction_per_Level) (SN)
string_3 = StringInput("distance_ew")
getLocation_4 = Element.GetLocation(element=vertical_walls_longer)
code_block_27 = CodeBlock { 0.5; }
pointAtParameter = Curve.PointAtParameter(curve=getLocation_4, param=code_block_27)
closestPointTo = Geometry.ClosestPointTo(geometry=grid_curve_sn, other=pointAtParameter)
X_9 = Point.X(point=closestPointTo)
Y_5 = Point.Y(point=closestPointTo)
Z_3 = Point.Z(point=pointAtParameter)
byCoordinates = Point.ByCoordinates(x=X_9, y=Y_5, z=Z_3)
distanceTo = Geometry.DistanceTo(geometry=byCoordinates, other=pointAtParameter)
setParameterByName_3 = Element.SetParameterByName(element=vertical_walls_longer, parameterName=string_3, value=distanceTo)
meter2foot = BoolSelector(true)
foot2meter = BoolSelector(false)
unitConvert = Python(IN[0]=distanceTo, IN[1]=meter2foot, IN[2]=foot2meter)  # CPython3
# ---------- unitConvert.python (86 lines) ----------
###############################################################
# Load the Libraries

import clr
import sys
import math
import System
import io
import os

localapp = os.getenv(r'LOCALAPPDATA')
sys.path.append(os.path.join(localapp, r'python-3.8.3-embed-amd64\Lib\site-packages'))
sys.path.append(os.path.join(localapp, r'python-3.8.3-embed-amd64\Lib\jw-packages'))

# dynamo/revit-related libraries
clr.AddReference('DynamoRevitDS')
import Dynamo 
from System import Array
from System.Collections.Generic import *
clr.AddReference("RevitNodes")
import Revit
clr.ImportExtensions(Revit.Elements)
clr.ImportExtensions(Revit.GeometryConversion)
clr.AddReference("RevitServices")
import RevitServices
from RevitServices.Persistence import DocumentManager 
from RevitServices.Transactions import TransactionManager 
clr.AddReference("RevitAPI")
clr.AddReference('ProtoGeometry')
import Autodesk 
from Autodesk.DesignScript.Geometry import *
from Autodesk.DesignScript import *
from Autodesk.Revit.DB import *
from Autodesk.Revit.DB import Parameter
from Autodesk.Revit.DB.Architecture import *
from Autodesk.Revit.DB import IFailuresPreprocessor

doc = DocumentManager.Instance.CurrentDBDocument

###############################################################
# Customize functions

def foot_to_meter(ori_value):
    if isinstance(ori_value, list):
        return [UnitUtils.ConvertFromInternalUnits(value, UnitTypeId.Meters) for value in ori_value]
    return float(UnitUtils.ConvertFromInternalUnits(ori_value, UnitTypeId.Meters))


def meter_to_foot(ori_value):
    if isinstance(ori_value, list):
        return [UnitUtils.ConvertToInternalUnits(value, UnitTypeId.Meters) for value in ori_value]
    return float(UnitUtils.ConvertToInternalUnits(ori_value, UnitTypeId.Meters))


###############################################################
# Prepare the input, output

ori = IN[0]
meter2foot = IN[1]
foot2meter = IN[2]

###############################################################
# Start Transaction in Revit

#TransactionManager.Instance.EnsureInTransaction(doc)

###############################################################
# Main part

out = []
if (meter2foot and foot2meter) or (not meter2foot and not foot2meter):
    out = 'Please (only) chose one conversion type as True.'
elif meter2foot or foot2meter:
    if meter2foot:
        out = meter_to_foot(ori)
    elif foot2meter:
        out = foot_to_meter(ori)
    out = [round(v,5) for v in out]
###############################################################
# End Transaction in Revit

#TransactionManager.Instance.TransactionTaskDone()

###############################################################
# End the node
OUT = out
# ----------------------------------------

# group: Create GP representing "distance in the ew direction" (for Walls_locating_in_South_North_Direction_per_Level) (SN)
regenerate_pp = Python(IN[0]=setParameterByName_3)  # CPython3
# ---------- regenerate_pp.python (31 lines) ----------
###############################################################
# Load the Libraries

import clr
import sys
import math
import System
import io
import os

# dynamo/revit-related libraries
clr.AddReference('DynamoRevitDS')
import Dynamo 
from System import Array
from System.Collections.Generic import *
clr.AddReference("RevitNodes")
import Revit
clr.ImportExtensions(Revit.Elements)
clr.ImportExtensions(Revit.GeometryConversion)
clr.AddReference("RevitServices")
import RevitServices
from RevitServices.Persistence import DocumentManager 
from RevitServices.Transactions import TransactionManager 
clr.AddReference("RevitAPI")
clr.AddReference('ProtoGeometry')

doc = DocumentManager.Instance.CurrentDBDocument
doc.Regenerate()

output = IN[0]
OUT = output
# ----------------------------------------
code_block_28 = CodeBlock { "_"; }
add_6 = select_level + code_block_28
code_block_29 = CodeBlock { "distance_ew"; }
add_7 = add_6 + code_block_29
id = Element.Id(element=vertical_walls_longer)
sortByKey = List.SortByKey(list=vertical_walls_longer, keys=id)
count = List.Count(list=sortByKey.sortedList)
ofRepeatedItem = List.OfRepeatedItem(item=add_7, amount=count)
code_block_30 = CodeBlock { 0; }
range = Range(start=code_block_30, end=count)
add_8 = ofRepeatedItem + range
list_create_5 = List.Create(item0=add_8)
flatten = List.Flatten(list=list_create_5)
createGP = Python(IN[0]=flatten, IN[1]=unitConvert)  # CPython3
# ---------- createGP.python (83 lines) ----------
###############################################################
# Import general packages.
import clr
import sys
import math
import System
import io
import os
import importlib

# Import Revit/Dynamo API related packages.
clr.AddReference('DynamoRevitDS')
import Dynamo
from System import Array
from System.Collections.Generic import *
clr.AddReference("RevitNodes")
import Revit
clr.ImportExtensions(Revit.Elements)
clr.ImportExtensions(Revit.GeometryConversion)
clr.AddReference("RevitServices")
import RevitServices
from RevitServices.Persistence import DocumentManager 
from RevitServices.Transactions import TransactionManager 
clr.AddReference("RevitAPI")
clr.AddReference('ProtoGeometry')
import Autodesk 
from Autodesk.DesignScript.Geometry import *
from Autodesk.DesignScript import *
from Autodesk.Revit.DB import *
from Autodesk.Revit.DB import Parameter
from Autodesk.Revit.DB.Architecture import *
from Autodesk.Revit.DB import IFailuresPreprocessor

# Import external python packages.
localapp = os.getenv(r'LOCALAPPDATA')
sys.path.append(os.path.join(localapp, r'python-3.8.3-embed-amd64\Lib\site-packages'))

# Import customized python packgaes.
sys.path.append(r'C:\dev\phd\jw\healing\src\godyn')

import healBasics
importlib.reload(healBasics)
import healChecks
importlib.reload(healChecks)
import healParameters
importlib.reload(healParameters)

###############################################################
doc = DocumentManager.Instance.CurrentDBDocument


###############################################################
# Temporary functions


###############################################################
# Prepare the input (of the Python Node)
gp_names = IN[0]
gp_values = IN[1]


##############################################################
# Prepare the output (of the Python Node)
out = []


###############################################################
# Start Transaction in Revit
TransactionManager.Instance.EnsureInTransaction(doc)


###############################################################
# Main part
new_gps = healParameters.setGlobalParameters(doc, gp_names, gp_values)

###############################################################
# End Transaction in Revit
TransactionManager.Instance.TransactionTaskDone()


###############################################################
# End
OUT = new_gps
# ----------------------------------------
regenerate_gp = Python(IN[0]=createGP)  # CPython3; same code as regenerate_pp
assigngptopp_sn = Python(IN[0]=string_3, IN[1]=regenerate_pp, IN[2]=regenerate_gp)  # CPython3
# ---------- assigngptopp_sn.python (84 lines) ----------
###############################################################
# Import general packages.
import clr
import sys
import math
import System
import io
import os
import importlib

# Import Revit/Dynamo API related packages.
clr.AddReference('DynamoRevitDS')
import Dynamo
from System import Array
from System.Collections.Generic import *
clr.AddReference("RevitNodes")
import Revit
clr.ImportExtensions(Revit.Elements)
clr.ImportExtensions(Revit.GeometryConversion)
clr.AddReference("RevitServices")
import RevitServices
from RevitServices.Persistence import DocumentManager 
from RevitServices.Transactions import TransactionManager 
clr.AddReference("RevitAPI")
clr.AddReference('ProtoGeometry')
import Autodesk 
from Autodesk.DesignScript.Geometry import *
from Autodesk.DesignScript import *
from Autodesk.Revit.DB import *
from Autodesk.Revit.DB import Parameter
from Autodesk.Revit.DB.Architecture import *
from Autodesk.Revit.DB import IFailuresPreprocessor

# Import external python packages.
localapp = os.getenv(r'LOCALAPPDATA')
sys.path.append(os.path.join(localapp, r'python-3.8.3-embed-amd64\Lib\site-packages'))

# Import customized python packgaes.
sys.path.append(r'C:\dev\phd\jw\healing\src\godyn')

import healBasics
importlib.reload(healBasics)
import healChecks
importlib.reload(healChecks)
import healParameters
importlib.reload(healParameters)

###############################################################
doc = DocumentManager.Instance.CurrentDBDocument


###############################################################
# Temporary functions


###############################################################
# Prepare the input (of the Python Node)
pp_name = IN[0]
all_elements = IN[1]
all_gps = IN[2]


##############################################################
# Prepare the output (of the Python Node)
out = []


###############################################################
# Start Transaction in Revit
TransactionManager.Instance.EnsureInTransaction(doc)


###############################################################
# Main part
out = healParameters.assignGlobalParameters(doc, all_elements, all_gps, pp_name)

###############################################################
# End Transaction in Revit
TransactionManager.Instance.TransactionTaskDone()


###############################################################
# End
OUT = out
# ----------------------------------------

# group: Assign values to PP (for Walls_locating_in_East_West_Direction_per_Level) (EW)
string_4 = StringInput("distance_sn")
getLocation_5 = Element.GetLocation(element=horizontal_walls_shorter)
code_block_31 = CodeBlock { 0.5; }
pointAtParameter_2 = Curve.PointAtParameter(curve=getLocation_5, param=code_block_31)
closestPointTo_2 = Geometry.ClosestPointTo(geometry=grid_curve_ew, other=pointAtParameter_2)
X_10 = Point.X(point=closestPointTo_2)
Y_6 = Point.Y(point=closestPointTo_2)
Z_4 = Point.Z(point=pointAtParameter_2)
byCoordinates_2 = Point.ByCoordinates(x=X_10, y=Y_6, z=Z_4)
distanceTo_2 = Geometry.DistanceTo(geometry=byCoordinates_2, other=pointAtParameter_2)
setParameterByName_4 = Element.SetParameterByName(element=horizontal_walls_shorter, parameterName=string_4, value=distanceTo_2)
meter2foot_2 = BoolSelector(true)
foot2meter_2 = BoolSelector(false)
unitConvert_2 = Python(IN[0]=distanceTo_2, IN[1]=meter2foot_2, IN[2]=foot2meter_2)  # CPython3; same code as unitConvert

# group: Create GP GP representing "distance in the sn direction" (for Walls_locating_in_East_West_Direction_per_Level) (EW)
regenerate_pp_2 = Python(IN[0]=setParameterByName_4)  # CPython3; same code as regenerate_pp
code_block_32 = CodeBlock { "_"; }
add_9 = select_level + code_block_32
code_block_33 = CodeBlock { "distance_sn"; }
add_10 = add_9 + code_block_33
id_2 = Element.Id(element=horizontal_walls_shorter)
sortByKey_2 = List.SortByKey(list=horizontal_walls_shorter, keys=id_2)
count_2 = List.Count(list=sortByKey_2.sortedList)
ofRepeatedItem_2 = List.OfRepeatedItem(item=add_10, amount=count_2)
code_block_34 = CodeBlock { 0; }
range_2 = Range(start=code_block_34, end=count_2)
add_11 = ofRepeatedItem_2 + range_2
list_create_6 = List.Create(item0=add_11)
flatten_2 = List.Flatten(list=list_create_6)
createGP_2 = Python(IN[0]=flatten_2, IN[1]=unitConvert_2)  # CPython3; same code as createGP
regenerate_gp_2 = Python(IN[0]=createGP_2)  # CPython3; same code as regenerate_pp
assigngptopp_ew = Python(IN[0]=string_4, IN[1]=regenerate_pp_2, IN[2]=regenerate_gp_2)  # CPython3; same code as assigngptopp_sn

# group: Create Dimensions (Walls_South_North_per_Level)
list_create_7 = List.Create()  # unwired: item0, item1
cartesianProduct = List.CartesianProduct(combineFunction=list_create_7, list0=code_block_26.grid_SN, list1=vertical_walls_longer)
byElements = Dimension.ByElements(view=filterByBoolMask.in, referenceElements=cartesianProduct, line=grid_curve_sn)
regenerate = Python(IN[0]=byElements)  # CPython3; same code as regenerate_pp
flatten_3 = List.Flatten(list=regenerate)
labeldimensions_sn = Python(IN[0]=regenerate_gp, IN[1]=flatten_3)  # CPython3
# ---------- labeldimensions_sn.python (83 lines) ----------
###############################################################
# Import general packages.
import clr
import sys
import math
import System
import io
import os
import importlib

# Import Revit/Dynamo API related packages.
clr.AddReference('DynamoRevitDS')
import Dynamo
from System import Array
from System.Collections.Generic import *
clr.AddReference("RevitNodes")
import Revit
clr.ImportExtensions(Revit.Elements)
clr.ImportExtensions(Revit.GeometryConversion)
clr.AddReference("RevitServices")
import RevitServices
from RevitServices.Persistence import DocumentManager 
from RevitServices.Transactions import TransactionManager 
clr.AddReference("RevitAPI")
clr.AddReference('ProtoGeometry')
import Autodesk 
from Autodesk.DesignScript.Geometry import *
from Autodesk.DesignScript import *
from Autodesk.Revit.DB import *
from Autodesk.Revit.DB import Parameter
from Autodesk.Revit.DB.Architecture import *
from Autodesk.Revit.DB import IFailuresPreprocessor

# Import external python packages.
localapp = os.getenv(r'LOCALAPPDATA')
sys.path.append(os.path.join(localapp, r'python-3.8.3-embed-amd64\Lib\site-packages'))

# Import customized python packgaes.
sys.path.append(r'C:\dev\phd\jw\healing\src\godyn')

import healBasics
importlib.reload(healBasics)
import healChecks
importlib.reload(healChecks)
import healParameters
importlib.reload(healParameters)

###############################################################
doc = DocumentManager.Instance.CurrentDBDocument


###############################################################
# Temporary functions


###############################################################
# Prepare the input (of the Python Node)
all_gps = UnwrapElement(IN[0])
all_dms = UnwrapElement(IN[1])


##############################################################
# Prepare the output (of the Python Node)
out = []


###############################################################
# Start Transaction in Revit
TransactionManager.Instance.EnsureInTransaction(doc)


###############################################################
# Main part
out = healParameters.labelDimensionsbyGlobalParameters(all_gps, all_dms)

###############################################################
# End Transaction in Revit
TransactionManager.Instance.TransactionTaskDone()


###############################################################
# End
OUT = out
# ----------------------------------------

# group: Create Dimensions (Walls_East_West_per_Level)
list_create_8 = List.Create()  # unwired: item0, item1
cartesianProduct_2 = List.CartesianProduct(combineFunction=list_create_8, list0=code_block_26.grid_EW, list1=horizontal_walls_shorter)
byElements_2 = Dimension.ByElements(view=filterByBoolMask.in, referenceElements=cartesianProduct_2, line=grid_curve_ew)
regenerate_2 = Python(IN[0]=byElements_2)  # CPython3; same code as regenerate_pp
flatten_4 = List.Flatten(list=regenerate_2)
labeldimensions_ew = Python(IN[0]=regenerate_gp_2, IN[1]=flatten_4)  # CPython3; same code as labeldimensions_sn
