# Dynamo graph 24_extractTopologyObjectSpace.dyn (Dynamo 2.12.0.5650)
# packages: Clockwork for Dynamo 2.x 2.3.0, archi-lab.net 2022.210.1022

# group: Get Room Boundaries
categories = Categories("OST_Rooms")
all_elements_of_category = ElementsOfCategory(Category=categories)
boundaries = Custom[Room.Boundaries](room=all_elements_of_category)  # package Clockwork for Dynamo 2.x; Gets a list of all boundaries of a given room or area and a corresponding list of the elements that are generating those boundaries.
boolean = BoolSelector(false)
clean = List.Clean(list=boundaries.elements, preserveIndices=boolean)
type = Object.Type(object=clean@L2)

# group: Input
string = StringInput("C:\dev\phd\jw\healing\data\healing2023\20_extract_data\res\")
string_2 = StringInput("collected_topology_space_seplines.txt")
concat = String.Concat(string0=string, string1=string_2)
string_3 = StringInput("collected_topology_space_host.txt")
concat_2 = String.Concat(string0=string, string1=string_3)
string_4 = StringInput("collected_topology_space_walls.txt")
concat_3 = String.Concat(string0=string, string1=string_4)
string_5 = StringInput("collected_topology_space_doors.txt")
concat_4 = String.Concat(string0=string, string1=string_5)

# group: Get related walls
code_block = CodeBlock { "Revit.Elements.Wall"; }
eq = type == code_block
filterByBoolMask = List.FilterByBoolMask(list=clean, mask=eq)
type_2 = archilab.Revit.Elements.Elements.Type(element=filterByBoolMask.in)
name = WallType.Name(wallType=type_2)
code_block_2 = CodeBlock { "\n"; }
code_block_3 = CodeBlock { ","; }
string_6 = StringInput("IfcGUID")
getParameterValueByName = Element.GetParameterValueByName(element=filterByBoolMask.in, parameterName=string_6)
join = String.Join(separator=code_block_3, string0=getParameterValueByName)
flatten = List.Flatten(list=join)
join_2 = String.Join(separator=code_block_2, string0=flatten)
writeText = FileSystem.WriteText(filePath=concat_3, text=join_2)

# group: Set separation line to move with nearby elements
code_block_4 = CodeBlock { "Revit.Elements.ModelCurve"; }
eq_2 = type == code_block_4
filterByBoolMask_2 = List.FilterByBoolMask(list=clean, mask=eq_2)
clean_2 = List.Clean(list=filterByBoolMask_2.in)
isEmpty = List.IsEmpty(list=clean_2@L2)
filterByBoolMask_3 = List.FilterByBoolMask(list=clean_2, mask=isEmpty)
flatten_2 = List.Flatten(list=filterByBoolMask_3.out)
code_block_5 = CodeBlock { "Moves With Nearby Elements"; }
boolean_2 = BoolSelector(true)
setParameterByName = Element.SetParameterByName(element=flatten_2, parameterName=code_block_5, value=boolean_2)
getParameterValueByName_2 = Element.GetParameterValueByName(element=setParameterByName, parameterName=code_block_5)

# group: Get related separation lines
code_block_6 = CodeBlock { "\n"; }
code_block_7 = CodeBlock { ","; }
passthrough = Custom[Passthrough](passThrough=filterByBoolMask_2.in, waitFor=getParameterValueByName_2)  # package Clockwork for Dynamo 2.x; Forces a sequential order of execution. The node wired into the output of the Passthrough node will be executed *after* the node wired into the waitFor input (e.g. important for some Revit operations). The value of the passThrough input will be passed on to the node wired into the output port of the Passthrough node.
id = Element.Id(element=passthrough)
string_from_object = FromObject(object=id)
join_3 = String.Join(separator=code_block_7, string0=string_from_object)
join_4 = String.Join(separator=code_block_6, string0=join_3)
writeText_2 = FileSystem.WriteText(filePath=concat, text=join_4)

# group: Get spaces
code_block_8 = CodeBlock { "\n"; }
string_7 = StringInput("IfcGUID")
getParameterValueByName_3 = Element.GetParameterValueByName(element=all_elements_of_category, parameterName=string_7)
join_5 = String.Join(separator=code_block_8, string0=getParameterValueByName_3)
writeText_3 = FileSystem.WriteText(filePath=concat_2, text=join_5)

# group: Get related doors
code_block_9 = CodeBlock { "\n"; }
code_block_10 = CodeBlock { ","; }
select_phase = RevitPhases("Phase 1")
doors = Custom[Room.Doors](room=all_elements_of_category, phase=select_phase)  # package Clockwork for Dynamo 2.x; Retrieves all doors that are associated with a room (hosted in walls and roofs).
string_8 = StringInput("IfcGUID")
getParameterValueByName_4 = Element.GetParameterValueByName(element=doors, parameterName=string_8)
join_6 = String.Join(separator=code_block_10, string0=getParameterValueByName_4)
flatten_3 = List.Flatten(list=join_6)
join_7 = String.Join(separator=code_block_9, string0=flatten_3)
writeText_4 = FileSystem.WriteText(filePath=concat_4, text=join_7)
