# Dynamo graph calculateLongestExitDistance.dyn (Dynamo 2.12.0.5650)
# packages: Clockwork for Dynamo 2.x 2.3.0

level = StringInput("D_ue_E1_OK")

# group: Select all Spaces at one Level
categories = Categories("OST_Rooms")  # frozen
name = Category.Name(category=categories)
eq = _ == name  # unwired: x
filterByBoolMask = List.FilterByBoolMask(mask=eq)  # unwired: list

# group: Adds points along each wall
number_slider = DoubleSlider(5, range=1..10 step 1)
code_block = CodeBlock(x=number_slider) { 0..1..#x; }
code_block_2 = CodeBlock { -1; }
dropItems = List.DropItems(list=code_block, amount=code_block_2)

# group: Consolidates the Path of Travel start points
pointAtParameter = Curve.PointAtParameter(param=dropItems)  # unwired: curve
flatten = List.Flatten(list=pointAtParameter@L4)

# group: Select Views (Floor Plans)
categories_2 = Categories("OST_Views")
all_elements_of_category = ElementsOfCategory(Category=categories_2)
boolean = BoolSelector(false)
clean = List.Clean(list=all_elements_of_category, preserveIndices=boolean)
code_block_3 = CodeBlock { "View Name"; }
getParameterValueByName = Element.GetParameterValueByName(element=clean, parameterName=code_block_3)
eq_2 = level == getParameterValueByName
filterByBoolMask_2 = List.FilterByBoolMask(list=clean, mask=eq_2)
categories_3 = Categories("OST_Rooms")
all_elements_of_category_in_view = ElementsOfCategoryInView(Category=categories_3, View=filterByBoolMask_2.in)
code_block_4 = CodeBlock { "OK"; }

# group: Split Corridors and Non-corridors
name_2 = Element.Name(element=all_elements_of_category_in_view)
string = StringInput("Corridor")
eq_3 = name_2 == string
filterByBoolMask_3 = List.FilterByBoolMask(list=all_elements_of_category_in_view, mask=eq_3)
doors = Custom[Room.Doors](room=filterByBoolMask_3.out)  # package Clockwork for Dynamo 2.x; Retrieves all doors that are associated with a room (hosted in walls and roofs).
location = Custom[Element.Location+](element=doors@L2)  # package Clockwork for Dynamo 2.x; Returns the location of an element as point, curve or curve loop, along with some booleans to help filtering the results. Unlike the OOTB Element.GetLocation node, it also retunrs sketch lines of sketch-based elements like floor slabs as well as the element's rotation property.

# group: Different cases for "Exit"
ground_level = StringInput("D_ue_U1_OK")
eq_4 = ground_level == level
string_2 = StringInput("Exit")
storey_exit = StringInput("Storey Exit")
if_ground_level = RefactoredIf(test=eq_4, true=string_2, false=storey_exit)

# group: Select Exit Door(s) at the Level
run = BoolSelector(false)  # frozen
list_create = List.Create(item0=level)
getLevelByLevelName = Python(IN[0]=run, IN[1]=list_create)  # CPython3
# ---------- getLevelByLevelName.python (28 lines) ----------
import clr

clr.AddReference('RevitAPI')
from Autodesk.Revit.DB import *

clr.AddReference('RevitServices')
import RevitServices
from RevitServices.Persistence import DocumentManager

doc = DocumentManager.Instance.CurrentDBDocument

#Preparing input from dynamo to revit
run = IN[0]
names = IN[1]

#Do some action in a Transaction
levels = []

if run:
	fec = FilteredElementCollector(doc).OfClass(Level).ToElements()

	for l in fec:
		for n in names:
			if l.Name == n:
				levels.append(l)
	OUT = levels
else:
	OUT = "Set Run to True"
# ----------------------------------------
categories_4 = Categories("OST_Doors")
all_elements_of_category_2 = ElementsOfCategory(Category=categories_4)
code_block_5 = CodeBlock { "Level"; }
getParameterValueByName_2 = Element.GetParameterValueByName(element=all_elements_of_category_2@L1, parameterName=code_block_5)
name_3 = Level.Name(level=getParameterValueByName_2)
eq_5 = name_3@L1 == list_create
flatten_2 = List.Flatten(list=eq_5)
filterByBoolMask_4 = List.FilterByBoolMask(list=all_elements_of_category_2, mask=flatten_2)
getParameterValueByName_3 = Element.GetParameterValueByName(element=filterByBoolMask_4.in, parameterName=if_ground_level)
code_block_6 = CodeBlock { 1; }
allIndicesOf = List.AllIndicesOf(list=getParameterValueByName_3@L2, item=code_block_6)
getItemAtIndex = List.GetItemAtIndex(list=filterByBoolMask_4.in@L2, index=allIndicesOf@L2)
location_2 = Custom[Element.Location+](element=getItemAtIndex)

# group: Path of Travel nodes
boolean_2 = BoolSelector(true)
byFloorPlanPoints = PathOfTravel.ByFloorPlanPoints(floorPlan=filterByBoolMask_2.in, startPtsList=location.points@L1, endPtsList=location_2.points@L1, manyToMany=boolean_2, lacing=Longest)
regenerate = Python(IN[0]=byFloorPlanPoints)  # CPython3
# ---------- regenerate.python (31 lines) ----------
###############################################################
# Load the Libraries

import clr
import sys
import math
import System
import io
import os

# dynamo/revit-related libraries
clr.AddReference('DynamoRevitDS')
import Dynamo 
from System import Array
from System.Collections.Generic import *
clr.AddReference("RevitNodes")
import Revit
clr.ImportExtensions(Revit.Elements)
clr.ImportExtensions(Revit.GeometryConversion)
clr.AddReference("RevitServices")
import RevitServices
from RevitServices.Persistence import DocumentManager 
from RevitServices.Transactions import TransactionManager 
clr.AddReference("RevitAPI")
clr.AddReference('ProtoGeometry')

doc = DocumentManager.Instance.CurrentDBDocument
doc.Regenerate()

output = IN[0]
OUT = output
# ----------------------------------------
boolean_3 = BoolSelector(false)
clean_2 = List.Clean(list=regenerate, preserveIndices=boolean_3)
string_3 = StringInput("Length")
getParameterValueByName_4 = Element.GetParameterValueByName(element=clean_2, parameterName=string_3)

# group: Sort Path of Travel Lists
transpose = List.Transpose(lists=byFloorPlanPoints@L4)  # frozen
transpose_2 = List.Transpose(lists=transpose@L3)
boolean_4 = BoolSelector(false)
clean_3 = List.Clean(list=transpose_2, preserveIndices=boolean_4)
string_4 = StringInput("Length")
getParameterValueByName_5 = Element.GetParameterValueByName(element=clean_3, parameterName=string_4)
sortByKey = List.SortByKey(list=clean_3@L2, keys=getParameterValueByName_5@L2)
firstItem = List.FirstItem(list=sortByKey.sortedList@L2)
firstItem_2 = List.FirstItem(list=sortByKey.sortedKeys@L2)
sortByKey_2 = List.SortByKey(list=firstItem@L2, keys=firstItem_2@L2)
number = DoubleInput(-1)
dropItems_2 = List.DropItems(list=sortByKey_2.sortedList@L2, amount=number)
number_2 = DoubleInput(1)
dropItems_3 = List.DropItems(list=sortByKey.sortedList@L2, amount=number_2)

# group: Delete Paths of Travel
delete = Element.Delete(element=dropItems_2)  # frozen
delete_2 = Element.Delete(element=dropItems_3)  # frozen

# group: Draw Longest Exit Distance
lastItem = List.LastItem(list=sortByKey_2.sortedList@L2)
