# Dynamo graph 11_delParameters.dyn "10_delParameters" (Dynamo 2.12.0.5650)

# group: Clear all existing Dimensions in the model.
run = BoolSelector(true)
categories = Categories("OST_Dimensions")
all_elements_of_category = ElementsOfCategory(Category=categories)
code_block = CodeBlock { null; }
if_ = RefactoredIf(test=run, true=all_elements_of_category, false=code_block)
delete = Element.Delete(element=if_)

# group: Clear all Global Parameters by keys.
string = StringInput("D_ue")
run_2 = BoolSelector(true)
delete_gp_by_key = Python(IN[0]=string, IN[1]=run_2)  # CPython3
# ---------- delete_gp_by_key.python (85 lines) ----------
###############################################################
# Import general packages.
import clr
import sys
import math
import System
import io
import os
import importlib

# Import Revit/Dynamo API related packages.
clr.AddReference('DynamoRevitDS')
import Dynamo
from System import Array
from System.Collections.Generic import *
clr.AddReference("RevitNodes")
import Revit
clr.ImportExtensions(Revit.Elements)
clr.ImportExtensions(Revit.GeometryConversion)
clr.AddReference("RevitServices")
import RevitServices
from RevitServices.Persistence import DocumentManager 
from RevitServices.Transactions import TransactionManager 
clr.AddReference("RevitAPI")
clr.AddReference('ProtoGeometry')
import Autodesk 
from Autodesk.DesignScript.Geometry import *
from Autodesk.DesignScript import *
from Autodesk.Revit.DB import *
from Autodesk.Revit.DB import Parameter
from Autodesk.Revit.DB.Architecture import *
from Autodesk.Revit.DB import IFailuresPreprocessor

# Import external python packages.
localapp = os.getenv(r'LOCALAPPDATA')
sys.path.append(os.path.join(localapp, r'python-3.8.3-embed-amd64\Lib\site-packages'))

# Import customized python packgaes.
sys.path.append(r'C:\dev\phd\jw\healing\src\godyn')

import healBasics
importlib.reload(healBasics)
import healChecks
importlib.reload(healChecks)
import healParameters
importlib.reload(healParameters)

###############################################################
doc = DocumentManager.Instance.CurrentDBDocument


###############################################################
# Temporary functions


###############################################################
# Prepare the input (of the Python Node)
key = IN[0]
run = IN[1]


##############################################################
# Prepare the output (of the Python Node)
out = []


###############################################################
# Start Transaction in Revit
TransactionManager.Instance.EnsureInTransaction(doc)


###############################################################
# Main part
if run:
    healParameters.deleteGlobalParameter(doc,key)
    
    
###############################################################
# End Transaction in Revit
TransactionManager.Instance.TransactionTaskDone()


###############################################################
# End
OUT = key
# ----------------------------------------
