# Dynamo graph 20_extractTopology.dyn (Dynamo 2.12.0.5650)

string = StringInput("C:\dev\phd\jw\healing\data\healing2023\20_extract_data\res\")
string_2 = StringInput("collected_GPs.json")
extract_topology_ob_pa = Custom[extract-Topology-OB-PA](directoryOUT=string, jsonOUT=string_2)  # extract the topology between Objects and Global Parameters
string_3 = StringInput("collected_Instances_Door.json")
string_4 = StringInput("collected_Instances_Window.json")
string_5 = StringInput("collected_Instances_Wall.json")
string_6 = StringInput("collected_Instances_Slab.json")
string_7 = StringInput("collected_Instances_Space.json")
extract_ob_sp = Custom[extract-OB-SP](directoryOUT=string, doorJSON=string_3, windowJSON=string_4, wallJSON=string_5, slabJSON=string_6, spaceJSON=string_7)  # extract Objects and Spaces
string_8 = StringInput("collected_topology_space_seplines.txt")
string_9 = StringInput("collected_topology_space_walls.txt")
string_10 = StringInput("collected_topology_space_doors.txt")
string_11 = StringInput("collected_topology_space_host.txt")
extract_topology_ob_sp = Custom[extract-Topology-OB-SP](directoryOUT=string, topologySpaceSeplineTXT=string_8, topologySpaceWallTXT=string_9, topologySpaceDoorTXT=string_10, topologySpaceHostTXT=string_11)  # extract the topology between Objects and Spaces
string_12 = StringInput("collected_topology_wall_inserts.txt")
string_13 = StringInput("collected_topology_wall_host.txt")
string_14 = StringInput("collected_topology_wall_walls.txt")
string_15 = StringInput("collected_topology_wall_slabs.txt")
extract_topology_ob_ob = Custom[extract-Topology-OB-OB](directoryOUT=string, topologyWallInsertsTXT=string_12, topologyWallHostTXT=string_13, topologyWallWallsTXT=string_14, topologyWallSlabsTXT=string_15)  # extract the topology between Objects
