# Dynamo graph mh_createSemanticParameters.dyn "mh_createParameters" (Dynamo 2.12.0.5650)
# packages: archi-lab.net 2022.210.1022, Genius Loci 2022.4.19, Clockwork for Dynamo 2.x 2.3.0

# group: Create PP "MHmusk" and "MHtrack" for elements in all considered categories. "MHmusk": Model Healing musk - > identify the Family Name and Type, "MHtrack": Model Healing track - > the initial status of MHmusk
code_block = CodeBlock { "Doors"; "Windows"; "Walls"; "Floors"; }
list_create = List.Create(item0=code_block.out0, item1=code_block.out1, item2=code_block.out2, item3=code_block.out3)
byName = Category.ByName(name=list_create)
all_elements_of_category = ElementsOfCategory(Category=byName)
code_block_2 = CodeBlock { ["MHmusk","MHtrack"]; "MH"; }
element_types = ElementTypes("ParameterElement")
all_elements_of_type = ElementsOfType(element_type=element_types)
name = Element.Name(element=all_elements_of_type)
allIndicesOf = List.AllIndicesOf(list=name, item=code_block_2.out0)
getItemAtIndex = List.GetItemAtIndex(list=all_elements_of_type, index=allIndicesOf)
flatten = List.Flatten(list=getItemAtIndex)
delete_elements = Custom[Delete Elements](element=flatten)  # package Genius Loci; Delete the input list of elements from the given Revit document. The node returns the number of successfully deleted elements and their Ids as a string. Based on a Springs node
passthrough = Custom[Passthrough](passThrough=code_block_2.out0, waitFor=delete_elements.count)  # package Clockwork for Dynamo 2.x; Forces a sequential order of execution. The node wired into the output of the Passthrough node will be executed *after* the node wired into the waitFor input (e.g. important for some Revit operations). The value of the passThrough input will be passed on to the node wired into the output port of the Passthrough node.
select_parameter_type = ParameterType("Text")
parameter_groups = ParameterGroupUi("PG_TEXT")
boolean = BoolSelector(true)
createProjectParameter = Parameter.CreateProjectParameter(parameterName=passthrough@L2, groupName=code_block_2.out1, type=select_parameter_type, group=parameter_groups, instance=boolean, categoryList=byName)
passthrough_2 = Custom[Passthrough](passThrough=all_elements_of_category, waitFor=createProjectParameter)

# group: Create GP by using element IfcGUID as name, and the Family Name&Type as value (Text)
gp_key = StringInput("gp_musk_")
split_doors_windows_and_walls = CodeBlock(elements=passthrough_2) { door_elements=elements[0]; window_elements=elements[1]; wall_elements=elements[2]; floor_elements=elements[3]; }
list_create_2 = List.Create(item0=split_doors_windows_and_walls.door_elements, item1=split_doors_windows_and_walls.window_elements)
string = StringInput("IfcGUID")
getParameterValueByName = Element.GetParameterValueByName(element=list_create_2@L1, parameterName=string)
getParameterValueByName_2 = Element.GetParameterValueByName(element=split_doors_windows_and_walls.wall_elements@L1, parameterName=string)
getParameterValueByName_3 = Element.GetParameterValueByName(element=split_doors_windows_and_walls.floor_elements@L1, parameterName=string)
join = List.Join(list0=getParameterValueByName, list1=getParameterValueByName_2, list2=getParameterValueByName_3)
string_2 = StringInput("Type")
getParameterValueByName_4 = Element.GetParameterValueByName(element=list_create_2, parameterName=string_2)
familyName = ElementType.FamilyName(elementType=getParameterValueByName_4@L1)
string_3 = StringInput("&")
add = familyName + string_3
name_2 = FamilyType.Name(familyType=getParameterValueByName_4@L1)
add_2 = add + name_2
type = archilab.Revit.Elements.Elements.Type(element=split_doors_windows_and_walls.wall_elements)
name_3 = WallType.Name(wallType=type)
type_2 = archilab.Revit.Elements.Elements.Type(element=split_doors_windows_and_walls.floor_elements)
name_4 = FloorType.Name(floorType=type_2)
join_2 = List.Join(list0=add_2, list1=name_3, list2=name_4)
n01_createGlobalParameters = Python(IN[0]=join, IN[1]=join_2, IN[2]=gp_key)  # "01_createGlobalParameters"; CPython3
# ---------- n01_createGlobalParameters.python (65 lines) ----------
import sys
import os

localapp = os.getenv(r'LOCALAPPDATA')
sys.path.append(os.path.join(localapp, r'python-3.8.3-embed-amd64\Lib\site-packages'))
sys.path.append(os.path.join(localapp, r'python-3.8.3-embed-amd64\Lib\jw-packages'))

import RevitServices
from RevitServices.Persistence import DocumentManager 
from RevitServices.Transactions import TransactionManager 
import Autodesk
from Autodesk.Revit.DB import *
from Autodesk.Revit.DB.Architecture import *

doc = DocumentManager.Instance.CurrentDBDocument

###############################################################
# Customize functions
###############################################################

def set_GlobalParameter(doc, gp_name, gp_type, gp_value):
    """
    Set Global Parameters by name and value

    """

    # The element id of the global parameter is provided by the FindByName method.
    # If there's already a global parameter with the same name
    existing_param_id = Autodesk.Revit.DB.GlobalParametersManager.FindByName(doc, gp_name)
    if existing_param_id.ToString() != "-1":
        doc.Delete(existing_param_id)
    
    # Create a new global parameter and set its value
    para = Autodesk.Revit.DB.GlobalParameter.Create(doc, gp_name, gp_type)
    para.SetValue(gp_value)

    return para

###############################################################

ifcGUIDs = IN[0]
musks = IN[1]
gp_key = IN[2]

###############################################################

new_gps = []

TransactionManager.Instance.EnsureInTransaction(doc)

gp_type = Autodesk.Revit.DB.ParameterType.Text

if not any(ifcGUIDs.count(x) > 1 for x in ifcGUIDs):
    for name, musk in zip(ifcGUIDs, musks):
        gp_name = gp_key + name
        gp_value = Autodesk.Revit.DB.StringParameterValue(musk)
        new_gp = set_GlobalParameter(
            doc, gp_name, gp_type, gp_value)
        new_gps.append(new_gp)
    out = new_gps
else:
    out =  "Repeated IfcGUID found."
TransactionManager.Instance.TransactionTaskDone()

OUT = out
# ----------------------------------------

# group: Associate GP to PP (of family instances)
element_types_2 = ElementTypes("GlobalParameter")
passthrough_3 = Custom[Passthrough](passThrough=gp_key, waitFor=n01_createGlobalParameters)
passthrough_4 = Custom[Passthrough](passThrough=element_types_2, waitFor=n01_createGlobalParameters)
all_elements_of_type_2 = ElementsOfType(element_type=passthrough_4)
n02_associateGoalbal2Project = Python(IN[0]=passthrough_3, IN[1]=all_elements_of_type_2)  # "02_associateGoalbal2Project"; CPython3
# ---------- n02_associateGoalbal2Project.python (80 lines) ----------
import sys
import os

localapp = os.getenv(r'LOCALAPPDATA')
sys.path.append(os.path.join(localapp, r'python-3.8.3-embed-amd64\Lib\site-packages'))
sys.path.append(os.path.join(localapp, r'python-3.8.3-embed-amd64\Lib\jw-packages'))

import clr
clr.AddReference("RevitAPI")
from Autodesk.Revit.DB import *
from Autodesk.Revit.DB.Structure import *

clr.AddReference("RevitAPIUI")
from Autodesk.Revit.UI import *

clr.AddReference("System")
from System.Collections.Generic import List

clr.AddReference("RevitNodes")
import Revit
clr.ImportExtensions(Revit.GeometryConversion)
clr.ImportExtensions(Revit.Elements)

clr.AddReference("RevitServices")
import RevitServices
from RevitServices.Persistence import DocumentManager
from RevitServices.Transactions import TransactionManager

doc = DocumentManager.Instance.CurrentDBDocument

###############################################################
# Customize functions
###############################################################

pp_name_musk, pp_name_track = "MHmusk","MHtrack"
gp_key = IN[0]
all_gps = IN[1]

###############################################################
def flatten(xss):
    return [x for xs in xss for x in xs]

all_doors = FilteredElementCollector(doc).OfCategory(
    BuiltInCategory.OST_Doors).WhereElementIsNotElementType().ToElements()
all_windows = FilteredElementCollector(doc).OfCategory(
    BuiltInCategory.OST_Windows).WhereElementIsNotElementType().ToElements()
all_wals = FilteredElementCollector(doc).OfCategory(
    BuiltInCategory.OST_Walls).WhereElementIsNotElementType().ToElements()
all_floors = FilteredElementCollector(doc).OfCategory(
    BuiltInCategory.OST_Floors).WhereElementIsNotElementType().ToElements()

all_elements = flatten([all_doors, all_windows, all_wals, all_floors])
all_elements_ifcGUIDs = [element.LookupParameter("IfcGUID").AsString() for element in all_elements]

relevant_gps = [gp for gp in all_gps if gp_key in gp.Name]
ifcGUIDs_for_relevant_gps = [gp.Name.replace(gp_key,'') for gp in relevant_gps]

if all_elements_ifcGUIDs == ifcGUIDs_for_relevant_gps:
    
    # if the list order is correct 
    for element, gp in zip(all_elements, relevant_gps):
        
        # associate GP to PP: pp_musk.
        pp_musk = element.GetParameters(pp_name_musk)
        pp_musk = pp_musk[0]
        pp_musk.AssociateWithGlobalParameter(ElementId(gp.Id))

        # copy the value of PP:pp_musk to PP: pp_track.
        pp_track = element.GetParameters(pp_name_track)
        pp_track = pp_track[0]
        gp_element = UnwrapElement(gp)
        pp_track.Set(gp_element.GetValue().Value)

    out = "success."

else:
    # if doesnt match
    out = "failed, IfcGUIDS do not match."

OUT = out
# ----------------------------------------

# group: Export GPs
string_4 = StringInput("C:\dev\phd\jw\healing\data\onebuilding\res\collected_GPs.json")
passthrough_5 = Custom[Passthrough](passThrough=element_types_2, waitFor=n02_associateGoalbal2Project)
all_elements_of_type_3 = ElementsOfType(element_type=passthrough_5)
name_5 = GlobalParameter.Name(globalParameter=all_elements_of_type_3)
value = GlobalParameter.Value(globalParameter=all_elements_of_type_3)
byKeysValues = DesignScript.Builtin.Dictionary.ByKeysValues(keys=name_5@L1, values=value@L1)
stringifyJSON = Data.StringifyJSON(values=byKeysValues)
writeText = FileSystem.WriteText(filePath=string_4, text=stringifyJSON)
