# Dynamo graph mh_extractTypesOfFamily.dyn (Dynamo 2.12.0.5650)
# packages: Clockwork for Dynamo 2.x 2.3.0

# group: Doors
string = StringInput("C:\dev\phd\jw\healing\data\onebuilding\res\collected_Types_Door.json")
code_block = CodeBlock { "Family"; "Family Type"; }
list_create = List.Create(item0=code_block.out0, item1=code_block.out1)
code_block_2 = CodeBlock { "Type IfcGUID"; "Fire Resistance"; "Width"; "Rough Width"; "Thickness"; "Type Mark"; }
list_create_2 = List.Create(item0=code_block_2.out0, item1=code_block_2.out1, item2=code_block_2.out2, item3=code_block_2.out3, item4=code_block_2.out4, item5=code_block_2.out5)
join = List.Join(list0=list_create, list1=list_create_2)
categories = Categories("OST_Doors")
all_family_types_of_category = Custom[All Family Types Of Category](category=categories)  # package Clockwork for Dynamo 2.x; Gets all family types/symbols of a given category in the model.
family = FamilyType.Family(familyType=all_family_types_of_category)
uniqueItems = List.UniqueItems(list=family)
types = Family.Types(family=uniqueItems)
family_2 = FamilyType.Family(familyType=types)
name = Family.Name(family=family_2)
name_2 = FamilyType.Name(familyType=types)
getParameterValueByName = Element.GetParameterValueByName(element=types@L1, parameterName=list_create_2)
addItemToFront = List.AddItemToFront(item=name_2@L1, list=getParameterValueByName@L2)
addItemToFront_2 = List.AddItemToFront(item=name@L1, list=addItemToFront@L2)
byKeysValues = DesignScript.Builtin.Dictionary.ByKeysValues(keys=join, values=addItemToFront_2@L2)
stringifyJSON = Data.StringifyJSON(values=byKeysValues)
writeText = FileSystem.WriteText(filePath=string, text=stringifyJSON)

# group: Windows
string_2 = StringInput("C:\dev\phd\jw\healing\data\onebuilding\res\collected_Types_Window.json")
code_block_3 = CodeBlock { "Family"; "Family Type"; }
list_create_3 = List.Create(item0=code_block_3.out0, item1=code_block_3.out1)
code_block_4 = CodeBlock { "Type IfcGUID"; "Fire Resistance"; "Width"; "Rough Width"; "Thickness"; "Type Mark"; }
list_create_4 = List.Create(item0=code_block_4.out0, item1=code_block_4.out1, item2=code_block_4.out2, item3=code_block_4.out3, item4=code_block_4.out4, item5=code_block_4.out5)
join_2 = List.Join(list0=list_create_3, list1=list_create_4)
categories_2 = Categories("OST_Windows")
all_family_types_of_category_2 = Custom[All Family Types Of Category](category=categories_2)
family_3 = FamilyType.Family(familyType=all_family_types_of_category_2)
uniqueItems_2 = List.UniqueItems(list=family_3)
types_2 = Family.Types(family=uniqueItems_2)
family_4 = FamilyType.Family(familyType=types_2)
name_3 = Family.Name(family=family_4)
name_4 = FamilyType.Name(familyType=types_2)
getParameterValueByName_2 = Element.GetParameterValueByName(element=types_2@L1, parameterName=list_create_4)
addItemToFront_3 = List.AddItemToFront(item=name_4@L1, list=getParameterValueByName_2@L2)
addItemToFront_4 = List.AddItemToFront(item=name_3@L1, list=addItemToFront_3@L2)
byKeysValues_2 = DesignScript.Builtin.Dictionary.ByKeysValues(keys=join_2, values=addItemToFront_4@L2)
stringifyJSON_2 = Data.StringifyJSON(values=byKeysValues_2)
writeText_2 = FileSystem.WriteText(filePath=string_2, text=stringifyJSON_2)

# group: Walls
string_3 = StringInput("C:\dev\phd\jw\healing\data\onebuilding\res\collected_Types_Wall.json")
code_block_5 = CodeBlock { "Wall Type"; }
code_block_6 = CodeBlock { "Type IfcGUID"; "Fire Resistance"; "Width"; "Thickness"; "Roughness"; }
list_create_5 = List.Create(item0=code_block_6.out0, item1=code_block_6.out1, item2=code_block_6.out2, item3=code_block_6.out3, item4=code_block_6.out4)
addItemToFront_5 = List.AddItemToFront(item=code_block_5, list=list_create_5)
categories_3 = Categories("OST_Walls")
all_family_types_of_category_3 = Custom[All Family Types Of Category](category=categories_3)
name_5 = WallType.Name(wallType=all_family_types_of_category_3)
getParameterValueByName_3 = Element.GetParameterValueByName(element=all_family_types_of_category_3@L1, parameterName=list_create_5)
addItemToFront_6 = List.AddItemToFront(item=name_5@L1, list=getParameterValueByName_3@L2)
byKeysValues_3 = DesignScript.Builtin.Dictionary.ByKeysValues(keys=addItemToFront_5, values=addItemToFront_6@L2)
stringifyJSON_3 = Data.StringifyJSON(values=byKeysValues_3)
writeText_3 = FileSystem.WriteText(filePath=string_3, text=stringifyJSON_3)

# group: Slabs
string_4 = StringInput("C:\dev\phd\jw\healing\data\onebuilding\res\collected_Types_Slab.json")
code_block_7 = CodeBlock { "Floor Type"; }
code_block_8 = CodeBlock { "Type IfcGUID"; "Absorptance"; "Roughness"; }
list_create_6 = List.Create(item0=code_block_8.out0, item1=code_block_8.out1, item2=code_block_8.out2)
addItemToFront_7 = List.AddItemToFront(item=code_block_7, list=list_create_6)
categories_4 = Categories("OST_Floors")
all_family_types_of_category_4 = Custom[All Family Types Of Category](category=categories_4)
name_6 = WallType.Name(wallType=all_family_types_of_category_4)
getParameterValueByName_4 = Element.GetParameterValueByName(element=all_family_types_of_category_4@L1, parameterName=list_create_6)
addItemToFront_8 = List.AddItemToFront(item=name_6@L1, list=getParameterValueByName_4@L2)
byKeysValues_4 = DesignScript.Builtin.Dictionary.ByKeysValues(keys=addItemToFront_7, values=addItemToFront_8@L2)
stringifyJSON_4 = Data.StringifyJSON(values=byKeysValues_4)
writeText_4 = FileSystem.WriteText(filePath=string_4, text=stringifyJSON_4)
