# Dynamo graph mh_modifySemantics.dyn (Dynamo 2.12.0.5650)
# packages: archi-lab.net 2022.210.1022

code_block = CodeBlock { ["gp_musk_2_414Bjl90PPXdZA2Pm_XU","gp_musk_2_414Bjl90PPXdZA2Pm_XH"]; }
findByName = GlobalParameter.FindByName(name=code_block)
findAffectedElementsbyGP = Python(IN[0]=findByName)  # CPython3
# ---------- findAffectedElementsbyGP.python (70 lines) ----------
###############################################################
# Load the Libraries

import clr
import sys
import math
import System
import io
import os

localapp = os.getenv(r'LOCALAPPDATA')
sys.path.append(os.path.join(localapp, r'python-3.8.3-embed-amd64\Lib\site-packages'))
sys.path.append(os.path.join(localapp, r'python-3.8.3-embed-amd64\Lib\jw-packages'))

# dynamo/revit-related libraries
clr.AddReference('DynamoRevitDS')
import Dynamo 
from System import Array
from System.Collections.Generic import *
clr.AddReference("RevitNodes")
import Revit
clr.ImportExtensions(Revit.Elements)
clr.ImportExtensions(Revit.GeometryConversion)
clr.AddReference("RevitServices")
import RevitServices
from RevitServices.Persistence import DocumentManager 
from RevitServices.Transactions import TransactionManager 
clr.AddReference("RevitAPI")
clr.AddReference('ProtoGeometry')
import Autodesk 
from Autodesk.DesignScript.Geometry import *
from Autodesk.DesignScript import *
from Autodesk.Revit.DB import *
from Autodesk.Revit.DB import Parameter
from Autodesk.Revit.DB.Architecture import *
from Autodesk.Revit.DB import IFailuresPreprocessor

doc = DocumentManager.Instance.CurrentDBDocument

###############################################################
# Customize functions


###############################################################
# Prepare the input, output

gps = UnwrapElement(IN[0])

out = []

###############################################################
# Start Transaction in Revit

TransactionManager.Instance.EnsureInTransaction(doc)

###############################################################
# Main part

id_element_affected = [gp.GetAffectedElements() for gp in gps]

###############################################################
# End Transaction in Revit

TransactionManager.Instance.TransactionTaskDone()

out = id_element_affected
###############################################################
# End the node

OUT = out
# ----------------------------------------
byElementId = archilab.Revit.Selection.Select.ByElementId(id=findAffectedElementsbyGP@L1)
string = StringInput("Type")
string_2 = StringInput("MHmusk")
getParameterValueByName = Element.GetParameterValueByName(element=byElementId, parameterName=string_2)
string_3 = StringInput("&")
split = String.Split(string=getParameterValueByName, separator0=string_3)
transpose = List.Transpose(lists=split)
code_block_2 = CodeBlock(info=transpose) { family=info[0]; name=info[1]; }
byName = Family.ByName(name=code_block_2.family)
byFamilyAndName = FamilyType.ByFamilyAndName(family=byName, name=code_block_2.name)
setParameterByName = Element.SetParameterByName(element=byElementId, parameterName=string, value=byFamilyAndName)

# group: mapping from values to Family types use PP values to stimulate the family changing.
code_block_3 = CodeBlock {  }
code_block_4 = CodeBlock {  }
check_the_code_here = Python()  # CPython3; frozen; unwired: IN[0]
# ---------- check_the_code_here.python (55 lines) ----------
import clr

clr.AddReference('RevitAPI')
from Autodesk.Revit.DB import *

clr.AddReference('RevitAPIUI')
from Autodesk.Revit.UI import *

clr.AddReference('System')
from System.Collections.Generic import List

clr.AddReference('RevitNodes')
import Revit
clr.ImportExtensions(Revit.Elements)

clr.AddReference('RevitServices')
import RevitServices
from RevitServices.Persistence import DocumentManager
from RevitServices.Transactions import TransactionManager

doc = DocumentManager.Instance.CurrentDBDocument

run = IN[0]

#Do some action in a Transaction
famTypes = []
pNames = []
pValue = []

types = doc.FamilyManager.Types
params = doc.FamilyManager.Parameters

if run:
	TransactionManager.Instance.EnsureInTransaction(doc)
	for param in params:
		pNames.Add(param.Definition.Name)
	
	for type in types:
		famTypes.Add(type)
		for param in params:
			StoreType = param.StorageType
			if StoreType == StorageType.Double:
				v = type.AsDouble(param)
			elif StoreType == StorageType.Integer:
				v = type.AsInteger(param)
			elif StoreType == StorageType.String:
				v = type.AsString(param)
			elif StoreType == StorageType.ElementId:
				v = type.AsElementId(param)
			
			pValue.Add(v)
	TransactionManager.Instance.TransactionTaskDone()
	OUT = famTypes,pNames,pValue
else:
	OUT = "Set Run to True"
# ----------------------------------------
string_4 = StringInput("https://forum.dynamobim.com/t/get-family-type-by-name-instead-of-using-family-type-node/31132/18")
