# Dynamo graph 23_extractTopologyObjects.dyn (Dynamo 2.12.0.5650)
# packages: Clockwork for Dynamo 2.x 2.3.0, bimorphNodes 4.1.2, archi-lab.net 2022.210.1022

# group: Input.
string = StringInput("C:\dev\phd\jw\healing\data\healing2023\20_extract_data\res\")
string_2 = StringInput("collected_topology_wall_host.txt")
concat = String.Concat(string0=string, string1=string_2)
string_3 = StringInput("collected_topology_wall_inserts.txt")
concat_2 = String.Concat(string0=string, string1=string_3)
string_4 = StringInput("collected_topology_wall_walls.txt")
concat_3 = String.Concat(string0=string, string1=string_4)
string_5 = StringInput("collected_topology_wall_slabs.txt")
concat_4 = String.Concat(string0=string, string1=string_5)

# group: Wall as Core connections.
categories = Categories("OST_Walls")
all_elements_of_category = ElementsOfCategory(Category=categories)
string_6 = StringInput("IfcGUID")

# group: hosts (walls)
code_block = CodeBlock { "\n"; }
getParameterValueByName = Element.GetParameterValueByName(element=all_elements_of_category@L1, parameterName=string_6)
join = String.Join(separator=code_block, string0=getParameterValueByName)
writeText = FileSystem.WriteText(filePath=concat, text=join)
code_block_2 = CodeBlock { ","; }

# group: followers (doors and windows embedded in walls)
inserts = Custom[Element.Inserts](element=all_elements_of_category)  # package Clockwork for Dynamo 2.x; Gets all the objects inserted into a given element.
getParameterValueByName_2 = Element.GetParameterValueByName(element=inserts, parameterName=string_6)
join_2 = String.Join(separator=code_block_2, string0=getParameterValueByName_2)
flatten = List.Flatten(list=join_2)
join_3 = String.Join(separator=code_block, string0=flatten)
writeText_2 = FileSystem.WriteText(filePath=concat_2, text=join_3)

# group: connectors (walls - walls)
boundingBox = Element.BoundingBox(element=all_elements_of_category)
getElementsIntersect = Revit.BoundingBox.GetElementsIntersect(boundingBox=boundingBox, elements=all_elements_of_category)
getParameterValueByName_3 = Element.GetParameterValueByName(element=getElementsIntersect, parameterName=string_6)
join_4 = String.Join(separator=code_block_2, string0=getParameterValueByName_3)
flatten_2 = List.Flatten(list=join_4)
join_5 = String.Join(separator=code_block, string0=flatten_2)
writeText_3 = FileSystem.WriteText(filePath=concat_3, text=join_5)

# group: floors (floors connected to walls)
boundingBox_2 = Element.BoundingBox(element=all_elements_of_category)
categories_2 = Categories("OST_Floors")
all_elements_of_category_2 = ElementsOfCategory(Category=categories_2)
type = archilab.Revit.Elements.Elements.Type(element=all_elements_of_category_2)
name = Element.Name(element=type)
string_7 = StringInput("Topping")
contains = String.Contains(string=name, searchFor=string_7)
filterByBoolMask = List.FilterByBoolMask(list=all_elements_of_category_2, mask=contains)
getElementsIntersect_2 = Revit.BoundingBox.GetElementsIntersect(boundingBox=boundingBox_2, elements=filterByBoolMask.out)
getParameterValueByName_4 = Element.GetParameterValueByName(element=getElementsIntersect_2, parameterName=string_6)
join_6 = String.Join(separator=code_block_2, string0=getParameterValueByName_4)
flatten_3 = List.Flatten(list=join_6)
join_7 = String.Join(separator=code_block, string0=flatten_3)
writeText_4 = FileSystem.WriteText(filePath=concat_4, text=join_7)
