# Dynamo graph healing_jn_adjusting.dyn "healing_adjusting" (Dynamo 2.12.0.5650)

n141_varyParameters = Python()  # "141_varyParameters"; CPython3; unwired: IN[0]
# ---------- n141_varyParameters.python (33 lines) ----------
###############################################################
# Load the Libraries
###############################################################
# general libraries
import clr
import sys
import math
import System
import csv

#--------------------------------------------------------------
#------------------ OK NOW YOU CAN CODE -----------------------
#--------------------------------------------------------------
variation_file = r"C:\dev\phd\jw\healing\data\onestorey\0_variationData.txt"

with open(variation_file) as f:
    datafilename = f.readlines()

with open(datafilename[0], 'r') as csv:
     first_line = csv.readline()
     your_data = csv.readlines()
     
csv_name = datafilename[0].split("\\")[-1:]
ncol = first_line.count(',')

#--------------------------------------------------------------
#------------------ OK NOW END THE CODE -----------------------
#--------------------------------------------------------------

###############################################################
# Prepare the output 
###############################################################
OUT = str(csv_name[0]), ncol
# ----------------------------------------
input_data_filter = CodeBlock(data=n141_varyParameters)
# ---------- input_data_filter.designscript (5 lines) ----------
data;
datafilename = data[0];
nr_min = 1;
// change here if collapses
nr_max = data[1];
# ----------------------------------------
generation_number = CodeBlock(nr_min=input_data_filter.nr_min, nr_max=input_data_filter.nr_max) { nr_min..nr_max; }
boolean = BoolSelector(true)
boolean_2 = BoolSelector(false)
boolean_3 = BoolSelector(true)
checkRules = StringInput("IBC1020_2, IBC1207_1, IBC1207_2, IBC1207_3")
healing_adjustment = Custom[Healing-Adjustment](varyParameterCSV=input_data_filter.datafilename, modelNumber=generation_number, saveInput=boolean, analyzeModel=boolean_2, checkCompliance=boolean_3, checkRules=checkRules)
watch = Watch(healing_adjustment.inputInfo)
watch_2 = Watch(healing_adjustment.outputInfo)
watch_3 = Watch(healing_adjustment.analysisInfo)
