# Dynamo graph Calculate Longest Exit Distance.dyn "Calculate Longest Exit Distance." (Dynamo 2.5.0.6960)

# group: Calculate Longest Exit Distance
# note: CATEGORY:
# Administration
# DESCRIPTION:
# Creates a single Path of Travel from a point (on the perimeter of a room within a project) that has the longest distance to its closest exit.
# MODEL PREPARATION:
# - The model must have rooms.
# NOTE:
# - The graph, in its current form, can only analyze two exits.
# - The graph analyzes each room boundary at its corner and its midpoint.
# - If the room boundary falls within solid geometry (e.g. at the centerline of a curtain wall), a Path of Travel may be blocked from consideration by the graph.
# AUTHORS:
# - Autodesk
# Copyright (c) 2019, Autodesk
# REQUIRED PACKAGES:
# - None

# group: Finds all the rooms in the active view (Note: Revit Model must contain room elements in order for the script to complete.)
current = Document.Current()
activeView = Document.ActiveView(document=current)
categories = Categories("OST_Rooms")
all_elements_of_category_in_view = ElementsOfCategoryInView(Category=categories, View=activeView)

# group: Finds walls around rooms
coreBoundary = Room.CoreBoundary(room=all_elements_of_category_in_view)

# group: Adds points along each wall
number_slider = DoubleSlider(3, range=1..10 step 1)
code_block = CodeBlock(x=number_slider) { 0..1..#x; }
code_block_2 = CodeBlock { -1; }
dropItems = List.DropItems(list=code_block, amount=code_block_2)

# group: Consolidates the Path of Travel start points
pointAtParameter = Curve.PointAtParameter(curve=coreBoundary, param=dropItems, lacing=CrossProduct)
flatten = List.Flatten(list=pointAtParameter@L4)

# group: START HERE! Use the select buttons and select two exit doors in the Revit model. Then press Run in the lower left of the Dynamo applcation window to run the script.
select_exit_door = DSModelElementSelection()  # 1 picked in the model; graph input
solids = Element.Solids(element=select_exit_door)
select_alternate_exit_door = DSModelElementSelection()  # 1 picked in the model; graph input
solids_2 = Element.Solids(element=select_alternate_exit_door)

# group: Collect list of end points at exits
byUnion = Solid.ByUnion(solids=solids)
centroid = Solid.Centroid(solid=byUnion)
byUnion_2 = Solid.ByUnion(solids=solids_2)
centroid_2 = Solid.Centroid(solid=byUnion_2)
list_create = List.Create(item0=centroid, item1=centroid_2)
boolean = BoolSelector(false)
clean = List.Clean(list=list_create, preserveIndices=boolean)
number_slider_2 = DoubleSlider(2, range=-1..3 step 1)
flatten_2 = List.Flatten(list=clean, amt=number_slider_2)

# group: Path of Travel node
boolean_2 = BoolSelector(true)
byFloorPlanPoints = PathOfTravel.ByFloorPlanPoints(floorPlan=activeView, startPtList=flatten, endPtList=flatten_2@@L1, manyToMany=boolean_2)

# group: Sort Path of Travel Lists
transpose = List.Transpose(lists=byFloorPlanPoints@L4)
transpose_2 = List.Transpose(lists=transpose@L3)
boolean_3 = BoolSelector(false)
clean_2 = List.Clean(list=transpose_2, preserveIndices=boolean_3)
string = StringInput("Length")
getParameterValueByName = Element.GetParameterValueByName(element=clean_2, parameterName=string)
sortByKey = List.SortByKey(list=clean_2@L2, keys=getParameterValueByName@L2)
firstItem = List.FirstItem(list=sortByKey.sorted_list@L2)
firstItem_2 = List.FirstItem(list=sortByKey.sorted_keys@L2)
sortByKey_2 = List.SortByKey(list=firstItem@L2, keys=firstItem_2@L2)
code_block_3 = CodeBlock { -1; }
dropItems_2 = List.DropItems(list=sortByKey_2.sorted_list@L2, amount=code_block_3)
code_block_4 = CodeBlock { 1; }
dropItems_3 = List.DropItems(list=sortByKey.sorted_list@L2, amount=code_block_4)

# group: Delete Paths of Travel
delete = Element.Delete(element=dropItems_2)
delete_2 = Element.Delete(element=dropItems_3)

# group: Draw Longest Exit Distance
lastItem = List.LastItem(list=sortByKey_2.sorted_list@L2)
