# Dynamo custom node Healing-Adjustment.dyf (Dynamo 2.12.0.5650)
# category: Healing

saveInput = Input(saveInput: bool)
analyzeModel = Input(analyzeModel: bool)
checkCompliance = Input(checkCompliance: bool)
checkRules = Input(checkRules: string)
varyParameterCSV = Input(varyParameterCSV: string)
modelNumber = Input(modelNumber: int)
healing_updateparameters = Custom[Healing-UpdateParameters](saveInput=saveInput, analyzeModel=analyzeModel, checkCompliance=checkCompliance, checkRules=checkRules, varyParameterCSV=varyParameterCSV, modelNumber=modelNumber)
healing_compliance = Custom[Healing-Compliance](checkRules=healing_updateparameters.checkRules, checkCompliance=healing_updateparameters.checkCompliance, analyzeModel=healing_updateparameters.analyzeModel, saveInput=healing_updateparameters.saveInput)
