# Dynamo custom node Healing-Compliance.dyf (Dynamo 2.12.0.5650)
# category: Healing
# packages: Clockwork for Dynamo 2.x 2.3.0

saveInput = Input(saveInput: bool)
n131_savectInput = Python(IN[0]=saveInput)  # "131_savectInput"; CPython3
# ---------- n131_savectInput.python (186 lines) ----------
###############################################################
# Load the Libraries
###############################################################
# general libraries
import clr
import sys
import math
import System

# identify the pathway
import io
import os
localapp = os.getenv(r'LOCALAPPDATA')
sys.path.append(os.path.join(localapp, r'python-3.8.3-embed-amd64\Lib\site-packages'))

# plotting
import pandas as pd
import numpy as np
import matplotlib.pyplot as plt
import matplotlib as mpl
from matplotlib import cm
from matplotlib.ticker import MultipleLocator, FormatStrFormatter, MaxNLocator
mpl.rcParams['text.usetex'] = True
from mpl_toolkits.axes_grid1.inset_locator import inset_axes, zoomed_inset_axes
from mpl_toolkits.axes_grid1.anchored_artists import AnchoredSizeBar
import scipy.stats as ss
from scipy.stats import norm
import ast 

# dynamo/revit-related libraries
clr.AddReference('DynamoRevitDS')
import Dynamo 
from System import Array
from System.Collections.Generic import *
clr.AddReference("RevitNodes")
import Revit
clr.ImportExtensions(Revit.Elements)
clr.ImportExtensions(Revit.GeometryConversion)
clr.AddReference("RevitServices")
import RevitServices
from RevitServices.Persistence import DocumentManager 
from RevitServices.Transactions import TransactionManager 
clr.AddReference("RevitAPI")
clr.AddReference('ProtoGeometry')
import Autodesk 
from Autodesk.DesignScript.Geometry import *
from Autodesk.DesignScript import *
from Autodesk.Revit.DB import *
from Autodesk.Revit.DB import Parameter
from Autodesk.Revit.DB.Architecture import *
from Autodesk.Revit.DB import IFailuresPreprocessor


###############################################################
# Customize functions
###############################################################


"""
Units displayed/assigned in Dynamo are feet. 1meter = 3.28084 foot
meter_to_foot: Converts a value from Revit's internal units to a given display unit.
foot_to_meter: Converts a value from a given display unit to Revit's internal units.
"""


def meter_to_foot(ori_value):
    if isinstance(ori_value, list):
        return [UnitUtils.ConvertFromInternalUnits(value, UnitTypeId.Meters) for value in ori_value]
    return float(UnitUtils.ConvertFromInternalUnits(ori_value, UnitTypeId.Meters))


def foot_to_meter(ori_value):
    if isinstance(ori_value, list):
        return [UnitUtils.ConvertToInternalUnits(value, UnitTypeId.Meters) for value in ori_value]
    return float(UnitUtils.ConvertToInternalUnits(ori_value, UnitTypeId.Meters))


"""
Extract the directory of the dyn.
"""


def getFileDirectory(filename=" "):
    dynscriptpath = Dynamo.Applications.DynamoRevit(
    ).RevitDynamoModel.CurrentWorkspace.FileName
    pathelement = dynscriptpath.split("\\")[:-1]
    folderpath = ""
    for i in pathelement:
        folderpath += (i + "\\")
    if filename != " ":
        folderpath += (filename)
    return folderpath


"""
Extract the directory for input extraction
"""


def get_directory_extractinput(nr_model):
    dynscriptpath = Dynamo.Applications.DynamoRevit(
    ).RevitDynamoModel.CurrentWorkspace.FileName
    pathelement = dynscriptpath.split("\\")[:-1]
    folderpath = ""
    for i in pathelement:
        folderpath += (i + "\\")
    folderpath += ('res\\inputdata_'+str(nr_model))
    return folderpath


###############################################################
# Current doc/app/ui
###############################################################
doc = DocumentManager.Instance.CurrentDBDocument

###############################################################
# Prepare the input
###############################################################
saveInput = IN[0]

###############################################################
# Record file into a .txt
###############################################################
# Get the current file path
saveDir = getFileDirectory()

stdout_original = sys.stdout
stdout_file = open(saveDir+"log\log32.txt", 'w')
sys.stdout = stdout_file

###############################################################
# Transaction in Revit
###############################################################
TransactionManager.Instance.EnsureInTransaction(doc)

#--------------------------------------------------------------
#------------------ OK NOW YOU CAN CODE -----------------------
#--------------------------------------------------------------

# Capture the Nr of the model
nr_model_gp_id = Autodesk.Revit.DB.GlobalParametersManager.FindByName(
    doc, 'nr_model')
nr_model_gp_element = doc.GetElement(nr_model_gp_id)
nr_model = int(nr_model_gp_element.GetValue().Value)
saveDir_extractinput = get_directory_extractinput(nr_model)

if saveInput:
    
    # Select adjustable parameters (among the global parameters)

    gp_ids = Autodesk.Revit.DB.GlobalParametersManager.GetAllGlobalParameters(doc)
    gp_elements = [doc.GetElement(item) for item in gp_ids]
    gp_names = [item.Name for item in gp_elements]

    adj_gp_ids, adj_gp_elements, adj_gp_names, adj_gp_values = [], [], [], []
    for name in gp_names:
        if 'nr_model' in name:
            continue
        else:
            adj_gp_id = Autodesk.Revit.DB.GlobalParametersManager.FindByName(
                doc, name)
            adj_gp_element = doc.GetElement(adj_gp_id)
            adj_gp_value = meter_to_foot(adj_gp_element.GetValue().Value)
            adj_gp_ids.append(adj_gp_id)
            adj_gp_elements.append(adj_gp_element)
            adj_gp_names.append(name)
            adj_gp_values.append(adj_gp_value)

    # Convert the inputparameters to to pandas dataframe (till now we only consider the geometric part)

    geom_Input = pd.DataFrame([adj_gp_values], columns=adj_gp_names)
    geom_Input.to_hdf(saveDir_extractinput+'.h5', key='geom_Input', mode='w')

#--------------------------------------------------------------
#------------------ OK NOW END THE CODE -----------------------
#--------------------------------------------------------------
TransactionManager.Instance.TransactionTaskDone()

# Close and save the recording file
sys.stdout = stdout_original
stdout_file.close()

###############################################################
# Prepare the output 
###############################################################
OUT = str(saveDir_extractinput+'.h5')
# ----------------------------------------
watch = Watch(n131_savectInput)
inputInfo = Output(watch)  # "inputInfo: string"
checkCompliance = Input(checkCompliance: bool)
checkRules = Input(checkRules: string)

# group: Process - G : Save Input and Output
n132_checkCompliance = Python(IN[0]=checkCompliance, IN[1]=checkRules)  # "132_checkCompliance"; IronPython2
# ---------- n132_checkCompliance.python (460 lines) ----------
###############################################################
# Load the Libraries
###############################################################
# general libraries
import clr
import sys
import math
import System

# identify the pathway
import io
import os
localapp = os.getenv(r'LOCALAPPDATA')
sys.path.append(os.path.join(localapp, r'python-3.8.3-embed-amd64\Lib\site-packages'))

# plotting
#import pandas as pd
#import numpy as np
#import matplotlib.pyplot as plt
#import matplotlib as mpl
#from matplotlib import cm
#from matplotlib.ticker import MultipleLocator, FormatStrFormatter, MaxNLocator
#mpl.rcParams['text.usetex'] = True
#from mpl_toolkits.axes_grid1.inset_locator import inset_axes, zoomed_inset_axes
#from mpl_toolkits.axes_grid1.anchored_artists import AnchoredSizeBar
#import scipy.stats as ss
#from scipy.stats import norm

# dynamo/revit-related libraries
clr.AddReference('DynamoRevitDS')
import Dynamo 
from System import Array
from System.Collections.Generic import *
clr.AddReference("RevitNodes")
import Revit
clr.ImportExtensions(Revit.Elements)
clr.ImportExtensions(Revit.GeometryConversion)
clr.AddReference("RevitServices")
import RevitServices
from RevitServices.Persistence import DocumentManager 
from RevitServices.Transactions import TransactionManager 
clr.AddReference("RevitAPI")
clr.AddReference('ProtoGeometry')
import Autodesk 
from Autodesk.DesignScript.Geometry import *
from Autodesk.DesignScript import *
from Autodesk.Revit.DB import *
from Autodesk.Revit.DB import Parameter
from Autodesk.Revit.DB.Architecture import *
from Autodesk.Revit.DB import IFailuresPreprocessor


###############################################################
# Customize functions
###############################################################

"""
Extract the directory of the dyn.
"""


def getFileDirectory(filename=" "):
    dynscriptpath = Dynamo.Applications.DynamoRevit(
    ).RevitDynamoModel.CurrentWorkspace.FileName
    pathelement = dynscriptpath.split("\\")[:-1]
    folderpath = ""
    for i in pathelement:
        folderpath += (i + "\\")
    if filename != " ":
        folderpath += (filename)
    return folderpath

"""
Units displayed/assigned in Dynamo are feet. 1meter = 3.28084 foot
meter_to_foot: Converts a value from Revit's internal units to a given display unit.
foot_to_meter: Converts a value from a given display unit to Revit's internal units.
"""


def meter_to_foot(ori_value):
    if isinstance(ori_value, list):
        return [UnitUtils.ConvertFromInternalUnits(value, UnitTypeId.Meters) for value in ori_value]
    return float(UnitUtils.ConvertFromInternalUnits(ori_value, UnitTypeId.Meters))


def foot_to_meter(ori_value):
    if isinstance(ori_value, list):
        return [UnitUtils.ConvertToInternalUnits(value, UnitTypeId.Meters) for value in ori_value]
    return float(UnitUtils.ConvertToInternalUnits(ori_value, UnitTypeId.Meters))


"""
if a list is empty
"""


def is_list_empty(list):
    return not bool(list)


"""
flatten a list
"""

def flatten(l):
    return [item for sublist in l for item in sublist]


"""
Extract the space information
"all labelled as Room elements"
"""


def extractSpaceInfo(doc):
    # Collect all the spaces
    # spaces = FilteredElementCollector(doc).OfCategory(BuiltInCategory.OST_Rooms).WhereElementIsNotElementType().ToElements()
    collector = FilteredElementCollector(doc)
    spaces = collector.OfClass(SpatialElement).ToElements()
    
    # Collect the space Id
    spaceId = [Element.Id.GetValue(ss) for ss in spaces]

    # ss.Name doesn't work...
    # might because: IronPython is getting some IL that it doesn't quite understand and therefore needs to be told how to retrieve the property. 
    # Collect the space name
    spaceName = [Element.Name.GetValue(ss) for ss in spaces]

    # Collect the space area
    spaceArea = [ss.Area for ss in spaces]
    spaceArea = [UnitUtils.ConvertFromInternalUnits(value, UnitTypeId.SquareMeters) for value in spaceArea]

    # Collect the space height
    # spaceHeight = [ss.LimitOffset for ss in spaces]
    spaceHeight = [ss.UnboundedHeight for ss in spaces]
    spaceHeight = [UnitUtils.ConvertFromInternalUnits(value, UnitTypeId.Meters) for value in spaceHeight]

    # Collect the space width
    spaceShell = [sp.ClosedShell.GetBoundingBox() for sp in spaces]
    spaceWidth = [min((meter_to_foot(abs(sp_shl.Max.X - sp_shl.Min.X))),meter_to_foot(abs(sp_shl.Max.Y - sp_shl.Min.Y))) for sp_shl in spaceShell]
    
    return spaces, spaceId, spaceName, spaceArea, spaceHeight, spaceWidth


"""
checkCompliance_1
checkCompliance_IBC1020_2
- Width and capacity
- The required capacity of corridors shall be determined as specified in Section 1005.1,
- but the minimum width shall be not less than that specified in Table 1020.2.
OCCUPANCY	                                                                           MINIMUM WIDTH(inches)
Any facility not listed in this table	                                                   <44>
Access to and utilization of mechanical, plumbing or electrical systems or equipment	    24
With an occupant load of less than 50	                                                    36
Within a dwelling unit	                                                                    36
In Group E with a corridor having an occupant load of 100 or more	                        72
In corridors and areas serving stretcher traffic in ambulatory care facilities	            72
Group I-2 in areas where required for bed movement	                                        96
For SI: 1 inch = 25.4 mm.
"""


def checkCompliance_IBC1020_2(doc):
    spaces, spaceId, spaceName, spaceArea, spaceHeight, spaceWidth = extractSpaceInfo(doc)
    checkContent = "IBC1020_2"
    checkCompliance = True
    failedComponents = []
    failedDistance = []
    corridor_min_width = 0.0254*44
    compliance_limit = corridor_min_width

    # track the average buffer distance 
    n_target = 0
    min_pos_distance = 0

    for ii in range(len(spaces)):

        if "Corridor" in spaceName[ii]:
            
            buffer_distance = spaceWidth[ii] - compliance_limit
            reason = [compliance_limit, spaceWidth[ii], buffer_distance]

            # Record of the failures
            if spaceWidth[ii]<compliance_limit:
                checkCompliance = False
                failedComponents.append(spaceId[ii])
                failedDistance.append(reason)
            
            # Record of the succeed
            min_pos_distance = buffer_distance if n_target == 0 else min(min_pos_distance, buffer_distance)
            n_target+=1

    if checkCompliance:
        failedDistance.append([compliance_limit, 0, min_pos_distance])

    return checkContent, checkCompliance, failedComponents, failedDistance


"""
checkCompliance_2
checkCompliance_IBC1207_1
- Minimum room widths
- Habitable spaces, other than a kitchen, shall be not less than 7 feet (2134 mm) in any plan dimension.
- Kitchens shall have a clear passageway of not less than 3 feet (914 mm) between counter fronts and appliances or counter fronts and walls.
- P352
"""


def checkCompliance_IBC1207_1(doc):
    spaces, spaceId, spaceName, spaceArea, spaceHeight, spaceWidth = extractSpaceInfo(doc)
    checkContent = "IBC1207_1"
    checkCompliance = True
    failedComponents = []
    failedDistance = []
    room_min_width = 2.134
    compliance_limit = room_min_width

    # track the average buffer distance 
    n_target = 0
    min_pos_distance = 0

    for ii in range(len(spaces)):

        if "Room" in spaceName[ii]:

            buffer_distance = spaceWidth[ii] - compliance_limit
            reason = [compliance_limit, spaceWidth[ii], buffer_distance]
            
            # Record of the failures
            if spaceWidth[ii]<compliance_limit:
                checkCompliance = False
                failedComponents.append(spaceId[ii])
                failedDistance.append(reason)
            
            # Record of the succeed
            min_pos_distance = buffer_distance if n_target == 0 else min(min_pos_distance, buffer_distance)
            n_target+=1
    
    if checkCompliance:
        failedDistance.append([compliance_limit, 0, min_pos_distance])
        
    return checkContent, checkCompliance, failedComponents, failedDistance


"""
checkCompliance_3
- checkCompliance_IBC1207_2
- Minimum ceiling heights
- Occupiable spaces, habitable spaces and corridors shall have a ceiling height of not less than 7 feet 6 inches (2286 mm) above the finished floor.
- Bathrooms, toilet rooms, kitchens, storage rooms and laundry rooms shall have a ceiling height of not less than 7 feet (2134 mm) above the finished floor.
- plus
- Exceptions: 1. 2. 3. 4.
- P352
"""


def checkCompliance_IBC1207_2(doc):
    spaces, spaceId, spaceName, spaceArea, spaceHeight, spaceWidth = extractSpaceInfo(doc)
    checkContent = "IBC1207_2"
    checkCompliance = True
    failedComponents =[]
    failedDistance = []
    room_min_height = 2.286
    compliance_limit = room_min_height
    
    # track the average buffer distance 
    n_target = 0
    min_pos_distance = 0

    for ii in range(len(spaces)):
        if "Room" in spaceName[ii]:

            buffer_distance = spaceHeight[ii] - compliance_limit           
            reason = [compliance_limit, spaceHeight[ii], buffer_distance]

            # Record of the failures
            if spaceHeight[ii]<compliance_limit:
                checkCompliance = False
                failedComponents.append(spaceId[ii])
                failedDistance.append(reason)
            
            # Record of the succeed
            min_pos_distance = buffer_distance if n_target == 0 else min(min_pos_distance, buffer_distance)
            n_target+=1
    
    if checkCompliance:
        failedDistance.append([compliance_limit, 0, min_pos_distance])

    return checkContent, checkCompliance, failedComponents, failedDistance


"""
checkCompliance_4
checkCompliance_IBC1207_3
- Room area
- Every dwelling unit shall have not less than one room that shall have not less than 120 square feet (11.2 m2) of net floor area.
- Other habitable rooms shall have a net floor area of not less than 70 square feet (6.5 m2).
- plus
- Exceptions: Kitchens are not required to be of a minimum floor area.
- P352
"""


def checkCompliance_IBC1207_3(doc):
    spaces, spaceId, spaceName, spaceArea, spaceHeight, spaceWidth = extractSpaceInfo(doc)
    checkContent = "IBC1207_3"
    checkCompliance = True
    failedComponents = []
    failedDistance = []
    room_min_area = 6.5
    
    room_least1_min_area = 11.2
    
    compliance_limit = room_min_area
    
    # track the average buffer distance 
    n_target = 0
    min_pos_distance = 0

    # filter to only room spaces
    space_del_indices = []
    for ii in range(len(spaces)):
        if "Room" not in spaceName[ii]:
            space_del_indices.append(ii)
    spaces = [i for j, i in enumerate(spaces) if j not in space_del_indices]
    spaceArea = [i for j, i in enumerate(spaceArea) if j not in space_del_indices]
    spaceId = [i for j, i in enumerate(spaceId) if j not in space_del_indices]

    # first checking part
    for jj in range(len(spaces)):
        
        buffer_distance = spaceArea[jj] - compliance_limit          
        reason = [compliance_limit, spaceArea[jj], buffer_distance]
        
        # Record of the failures
        if spaceArea[jj] < compliance_limit:
            checkCompliance = False            
            failedComponents.append(spaceId[jj])
            failedDistance.append(reason)
        
        # Record of the succeed
        min_pos_distance = buffer_distance if n_target == 0 else min(min_pos_distance, buffer_distance)
        n_target+=1
    
    if checkCompliance:
        failedDistance.append([compliance_limit, 0, min_pos_distance])
    
    # second checking part
    # temporarily ignore the second part of this rule

    # if max(spaceArea) < room_least1_min_area:
    #     checkCompliance = False
    #     index_max = spaceArea.index(max(spaceArea))
    #     failedComponents.append(spaceId[index_max])
    #     reason = [room_least1_min_area, max(spaceArea), max(spaceArea) - room_least1_min_area]
    #     failedDistance.append(reason)
    
    return checkContent, checkCompliance, failedComponents, failedDistance


"""
Central processing of all checks 
"""


def checkCompliance_IBC(doc,checkRules):
    res = []
    if 'IBC1020_2' in checkRules:
        res.append(checkCompliance_IBC1020_2(doc))
    if 'IBC1207_1' in checkRules:
        res.append(checkCompliance_IBC1207_1(doc))
    if 'IBC1207_2' in checkRules:
        res.append(checkCompliance_IBC1207_2(doc))
    if 'IBC1207_3' in checkRules:
        res.append(checkCompliance_IBC1207_3(doc))
    return res


###############################################################
# Current doc/app/ui
###############################################################
doc = DocumentManager.Instance.CurrentDBDocument

###############################################################
# Prepare the input
###############################################################
checkModel = IN[0]
checkRules = IN[1]

###############################################################
# Record file into a .txt
###############################################################
# Get the current file path
saveDir = getFileDirectory()

stdout_original = sys.stdout
stdout_file = open(saveDir+"log\log32.txt", 'w')
sys.stdout = stdout_file

###############################################################
# Transaction in Revit
###############################################################
TransactionManager.Instance.EnsureInTransaction(doc)

#--------------------------------------------------------------
#------------------ OK NOW YOU CAN CODE -----------------------
#--------------------------------------------------------------
# Post process the checking results
failedRules = []
failedCompNumbers = []
failedPercent = []

# Code Compliance Checking for the selected building rules
checkResults = []
if checkModel:
    checkResults = checkCompliance_IBC(doc,checkRules)

    for result in checkResults:
        # result = [checkContent, checkCompliance, failedComponents, failedDistance]
        percent = 0.
        failednumber = 0
        failedRules.append(result[0])

        # if failed on one rule
        if not result[1]:
            
            # write the failed number(s)
            failedCompNumbers.append(result[2])
            
            # take the average failure (buffer) distance
            for failedcomponent in result[3]:           
                percent += failedcomponent[2]/failedcomponent[0]
            percent /= len(result[3])
            failedPercent.append(percent)
        
        # if succeed on one rule
        else:

            # write the failed component numbers as an empty list: [] (amount =0)
            failedCompNumbers.append([])
            
            # write the average buffer distance
            for failedcomponent in result[3]:           
                percent = failedcomponent[2]/failedcomponent[0]
            failedPercent.append(percent)

#--------------------------------------------------------------
#------------------ OK NOW END THE CODE -----------------------
#--------------------------------------------------------------
TransactionManager.Instance.TransactionTaskDone()

# Close and save the recording file
sys.stdout = stdout_original
stdout_file.close()

###############################################################
# Prepare the output 
###############################################################
# OUT = checkResults
OUT = failedRules,failedCompNumbers,failedPercent
# ----------------------------------------
n133_saveCheckingResults = Python(IN[0]=checkCompliance, IN[1]=n132_checkCompliance)  # "133_saveCheckingResults"; CPython3
# ---------- n133_saveCheckingResults.python (175 lines) ----------
###############################################################
# Load the Libraries
###############################################################
# general libraries
from xml.dom.minidom import Document
import clr
import sys
import math
import System
import csv 

# identify the pathway
import io
import os
localapp = os.getenv(r'LOCALAPPDATA')
sys.path.append(os.path.join(localapp, r'python-3.8.3-embed-amd64\Lib\site-packages'))

# plotting
import pandas as pd
import numpy as np
import matplotlib.pyplot as plt
import matplotlib as mpl
from matplotlib import cm
from matplotlib.ticker import MultipleLocator, FormatStrFormatter, MaxNLocator
mpl.rcParams['text.usetex'] = True
from mpl_toolkits.axes_grid1.inset_locator import inset_axes, zoomed_inset_axes
from mpl_toolkits.axes_grid1.anchored_artists import AnchoredSizeBar
import scipy.stats as ss
from scipy.stats import norm
import ast 

# dynamo/revit-related libraries
clr.AddReference('DynamoRevitDS')
import Dynamo 
from System import Array
from System.Collections.Generic import *
clr.AddReference("RevitNodes")
import Revit
clr.ImportExtensions(Revit.Elements)
clr.ImportExtensions(Revit.GeometryConversion)
clr.AddReference("RevitServices")
import RevitServices
from RevitServices.Persistence import DocumentManager 
from RevitServices.Transactions import TransactionManager 
clr.AddReference("RevitAPI")
clr.AddReference('ProtoGeometry')
import Autodesk 
from Autodesk.DesignScript.Geometry import *
from Autodesk.DesignScript import *
from Autodesk.Revit.DB import *
from Autodesk.Revit.DB import Parameter
from Autodesk.Revit.DB.Architecture import *
from Autodesk.Revit.DB import IFailuresPreprocessor


###############################################################
# Customize functions
###############################################################


"""
Extract the directory of the dyn.
"""


def getFileDirectory(filename=" "):
    dynscriptpath = Dynamo.Applications.DynamoRevit(
    ).RevitDynamoModel.CurrentWorkspace.FileName
    pathelement = dynscriptpath.split("\\")[:-1]
    folderpath = ""
    for i in pathelement:
        folderpath += (i + "\\")
    if filename != " ":
        folderpath += (filename)
    return folderpath

"""
Extract the directory for input extraction
"""


def get_directory_extractoutput(nr_model):
    dynscriptpath = Dynamo.Applications.DynamoRevit(
    ).RevitDynamoModel.CurrentWorkspace.FileName
    pathelement = dynscriptpath.split("\\")[:-1]
    folderpath = ""
    for i in pathelement:
        folderpath += (i + "\\")
    folderpath += ('res\\outputdata_'+str(nr_model))
    return folderpath


"""
Extract the directory of the rvt.
"""


def get_projectname(doc):
    projectname = Document.PathName.GetValue(doc)
    return projectname


###############################################################
# Current doc/app/ui
###############################################################
doc = DocumentManager.Instance.CurrentDBDocument

###############################################################
# Prepare the input
###############################################################
checkCompliance = IN[0]
compliance_checking = UnwrapElement(IN[1])
[
    failedRules,
    failedCompNumbers,
    failedPercent,
    ] = compliance_checking

###############################################################
# Record file into a .txt
###############################################################
# Get the current file path
saveDir = getFileDirectory()

stdout_original = sys.stdout
stdout_file = open(saveDir+"log\log33.txt", 'w')
sys.stdout = stdout_file

###############################################################
# Transaction in Revit
###############################################################
TransactionManager.Instance.EnsureInTransaction(doc)

#--------------------------------------------------------------
#------------------ OK NOW YOU CAN CODE -----------------------
#--------------------------------------------------------------

# Capture the Nr of the model
nr_model_gp_id = Autodesk.Revit.DB.GlobalParametersManager.FindByName(
    doc, 'nr_model')
nr_model_gp_element = doc.GetElement(nr_model_gp_id)
nr_model = int(nr_model_gp_element.GetValue().Value)
saveDir_extractoutput = get_directory_extractoutput(nr_model)

if checkCompliance:

    # Collect the checking results
    summaryCheckResults = []
    if len(failedRules) == 1:
        summaryCheckResults = [[failedRules[0],len(failedCompNumbers[0]),failedPercent[0]]]
    else:
        for ii in range(len(failedRules)):
            summaryCheckResults.append([failedRules[ii],len(failedCompNumbers[ii]),failedPercent[ii]])

    # Convert the checking results to pandas Dataframe

    summaryCheckResults_df = pd.DataFrame(summaryCheckResults, columns =['failedrules','failedcomponentnumbers','averagefailedpercent'])

    # Convert to a single h5 file

    summaryCheckResults_df.to_hdf(saveDir_extractoutput+'.h5', key = 'checking', mode = 'w')

#--------------------------------------------------------------
#------------------ OK NOW END THE CODE -----------------------
#--------------------------------------------------------------
TransactionManager.Instance.TransactionTaskDone()

# Close and save the recording file
sys.stdout = stdout_original
stdout_file.close()

###############################################################
# Prepare the output 
###############################################################
OUT = str(saveDir_extractoutput+'.h5')
# ----------------------------------------

watch_2 = Watch(n133_saveCheckingResults)
outputInfo = Output(watch_2)  # "outputInfo: string"
analyzeModel = Input(analyzeModel: bool)

# group: Process - F : Analyze Model
categories = Categories("OST_Rooms")
all_elements_of_category = ElementsOfCategory(Category=categories)
select_phase = RevitPhases("New Construction")
doors = Custom[Room.Doors](room=all_elements_of_category, phase=select_phase)  # package Clockwork for Dynamo 2.x; Retrieves all doors that are associated with a room (hosted in walls and roofs).
n134_analyzeModel = Python(IN[0]=analyzeModel, IN[1]=all_elements_of_category, IN[2]=doors)  # "134_analyzeModel"; IronPython2
# ---------- n134_analyzeModel.python (395 lines) ----------
###############################################################
# Load the Libraries
###############################################################
# general libraries
import clr
import sys
import math
import System

# identify the pathway
import io
import os
localapp = os.getenv(r'LOCALAPPDATA')
sys.path.append(os.path.join(localapp, r'python-3.8.3-embed-amd64\Lib\site-packages'))

# plotting
#import pandas as pd
#import numpy as np
#import matplotlib.pyplot as plt
#import matplotlib as mpl
#from matplotlib import cm
#from matplotlib.ticker import MultipleLocator, FormatStrFormatter, MaxNLocator
#mpl.rcParams['text.usetex'] = True
#from mpl_toolkits.axes_grid1.inset_locator import inset_axes, zoomed_inset_axes
#from mpl_toolkits.axes_grid1.anchored_artists import AnchoredSizeBar
#import scipy.stats as ss
#from scipy.stats import norm

# dynamo/revit-related libraries
clr.AddReference('DynamoRevitDS')
import Dynamo 
from System import Array
from System.Collections.Generic import *
clr.AddReference("RevitNodes")
import Revit
clr.ImportExtensions(Revit.Elements)
clr.ImportExtensions(Revit.GeometryConversion)
clr.AddReference("RevitServices")
import RevitServices
from RevitServices.Persistence import DocumentManager 
from RevitServices.Transactions import TransactionManager 
clr.AddReference("RevitAPI")
clr.AddReference('ProtoGeometry')
import Autodesk 
from Autodesk.DesignScript.Geometry import *
from Autodesk.DesignScript import *
from Autodesk.Revit.DB import *
from Autodesk.Revit.DB import Parameter
from Autodesk.Revit.DB.Architecture import *
from Autodesk.Revit.DB import IFailuresPreprocessor


###############################################################
# Customize functions
###############################################################


"""
Extract the directory of the dyn.
"""


def getFileDirectory(filename=" "):
    dynscriptpath = Dynamo.Applications.DynamoRevit(
    ).RevitDynamoModel.CurrentWorkspace.FileName
    pathelement = dynscriptpath.split("\\")[:-1]
    folderpath = ""
    for i in pathelement:
        folderpath += (i + "\\")
    if filename != " ":
        folderpath += (filename)
    return folderpath

"""
Extract the space information
"all labelled as Room elements"
"""
# init_data = [1, nb_smoke_vent, length_smoke_vent, init_comp, init_dist, init_comp_log, init_dist_log, init_comp_norm, init_dist_norm, init_comp_log_norm, init_dist_log_norm]
# init_data = np.array([init_data])                
# init_data = pd.DataFrame(init_data, columns=['index', 'number', 'length', 'incompliance', 'distance', 'incompliance-log', 'distance-log',
#         'incompliance-norm', 'distance-norm', 'incompliance-log-norm', 'distance-log-norm'])


def extractSpaceInfo(doc,spaces=[]):
    # Collect all the spaces
    # spaces = FilteredElementCollector(doc).OfCategory(BuiltInCategory.OST_Rooms).WhereElementIsNotElementType().ToElements()
    collector = FilteredElementCollector(doc)
    spaces = collector.OfClass(SpatialElement).ToElements()
    
    # Collect the space Id
    spaceId = [Element.Id.GetValue(ss) for ss in spaces]

    # ss.Name doesn't work...
    # might because: IronPython is getting some IL that it doesn't quite understand and therefore needs to be told how to retrieve the property. 
    # Collect the space name
    spaceName = [Element.Name.GetValue(ss) for ss in spaces]

    # Collect the space area
    spaceArea = [ss.Area for ss in spaces]
    spaceArea = [UnitUtils.ConvertFromInternalUnits(value, UnitTypeId.SquareMeters) for value in spaceArea]

    # Collect the space height
    # spaceHeight = [ss.LimitOffset for ss in spaces]
    spaceHeight = [ss.UnboundedHeight for ss in spaces]
    spaceHeight = [UnitUtils.ConvertFromInternalUnits(value, UnitTypeId.Meters) for value in spaceHeight]

    # Collect the space width
    spaceShell = [sp.ClosedShell.GetBoundingBox() for sp in spaces]
    spaceWidth = [min((meter_to_foot(abs(sp_shl.Max.X - sp_shl.Min.X))),meter_to_foot(abs(sp_shl.Max.Y - sp_shl.Min.Y))) for sp_shl in spaceShell]
    
    return spaces, spaceId, spaceName, spaceArea, spaceHeight, spaceWidth


"""
Units displayed/assigned in Dynamo are feet. 1meter = 3.28084 foot
meter_to_foot: Converts a value from Revit's internal units to a given display unit.
foot_to_meter: Converts a value from a given display unit to Revit's internal units.
"""


def meter_to_foot(ori_value):
    if isinstance(ori_value, list):
        return [UnitUtils.ConvertFromInternalUnits(value, UnitTypeId.Meters) for value in ori_value]
    return float(UnitUtils.ConvertFromInternalUnits(ori_value, UnitTypeId.Meters))


def foot_to_meter(ori_value):
    if isinstance(ori_value, list):
        return [UnitUtils.ConvertToInternalUnits(value, UnitTypeId.Meters) for value in ori_value]
    return float(UnitUtils.ConvertToInternalUnits(ori_value, UnitTypeId.Meters))


"""
Get the boundaries of a room / a list of rooms
"""


def getRoomBoundaries(item):
	doc = item.Document
	calculator = SpatialElementGeometryCalculator(doc)
	options = Autodesk.Revit.DB.SpatialElementBoundaryOptions()
	
    # Get boundary location from area computation settings
	boundloc = Autodesk.Revit.DB.AreaVolumeSettings.GetAreaVolumeSettings(doc).GetSpatialElementBoundaryLocation(SpatialElementType.Room)
	options.SpatialElementBoundaryLocation = boundloc

    # Get boundary segments
	elements, curves = [],[]
	try:
		for boundarylist in item.GetBoundarySegments(options):
			for boundary in boundarylist:
				elements.append(doc.GetElement(boundary.ElementId))
                curves.append(boundary.GetCurve().ToProtoType())
	except: pass
	return elements


"""
Get the Icollection of a set of elements
"""


def getIcollection(elements):
    elementsId = [Element.Id.GetValue(elem) for elem in elements]
    elements_Icollection = List[ElementId](elementsId)
    return elements_Icollection


"""
Get the Model Lines from a set of elements
"""


def filterSeparationLines(doc,elemsets):
    elemsets_Icollection = getIcollection(elemsets)
    collector_lines = FilteredElementCollector(doc,elemsets_Icollection).OfCategory(
        BuiltInCategory.OST_RoomSeparationLines).WhereElementIsNotElementType().ToElements()
    collector_lines_Icollection = getIcollection(collector_lines)
    if len(collector_lines_Icollection) > 0:
        collector_others = FilteredElementCollector(doc,elemsets_Icollection).Excluding(
        collector_lines_Icollection).WhereElementIsNotElementType().ToElements()
    else:
        collector_others = elemsets
    return collector_lines,collector_others

"""
Get the openings from a set of elements(OST_Walls)
"""


def filterOpenings(doc,elemsets):
    elemsets_Icollection = getIcollection(elemsets)
    collector_doors = FilteredElementCollector(doc,elemsets_Icollection).OfCategory(
        BuiltInCategory.OST_Doors).WhereElementIsNotElementType().ToElements()
    collector_doors_Icollection = getIcollection(collector_doors)
    if len(collector_doors_Icollection) > 0:
        collector_windows = FilteredElementCollector(doc,elemsets_Icollection).Excluding(
        collector_doors_Icollection).WhereElementIsNotElementType().ToElements()
    else:
        collector_windows = elemsets
    return collector_doors,collector_windows


"""
Get inserted elements of an element
"""


def getInsertedElements(item):
    doc = item.Document

    # Get inserted segments
    elements = []
    for ops in item.FindInserts(True,False,False,False):
        # bool addRectOpenings; bool includeShadows; bool includeEmbeddedWalls; bool includeSharedEmbeddedInserts.
        elements.append(doc.GetElement(ops))
    
    return elements

###############################################################
# Current doc/app/ui
###############################################################
doc = DocumentManager.Instance.CurrentDBDocument

###############################################################
# Prepare the input
###############################################################
analyzeModel = IN[0]
spaces_Fordoors = UnwrapElement(IN[1])
doors_Fromspaces = UnwrapElement(IN[2])

###############################################################
# Record file into a .txt
###############################################################
# Get the current file path
saveDir = getFileDirectory()

stdout_original = sys.stdout
stdout_file = open(saveDir+"log\log34.txt", 'w')
sys.stdout = stdout_file

###############################################################
# Transaction in Revit
###############################################################
TransactionManager.Instance.EnsureInTransaction(doc)

#--------------------------------------------------------------
#------------------ OK NOW YOU CAN CODE -----------------------
#--------------------------------------------------------------
summary_topo_SpaceDoor = []
summary_sema_Space = []
summary_sema_Wall = []
summary_topo_SpaceSeparation = []
summary_topo_SpaceBoundary = []
summary_sema_Door = []
summary_sema_Window = []
summary_topo_WallDoor = []
summary_topo_WallWindow =[]

if analyzeModel:
    
    # Select all the spaces
    collector = FilteredElementCollector(doc)
    allSpaces = collector.OfClass(SpatialElement).ToElements()

    # Select all the walls
    allWalls = FilteredElementCollector(doc,).OfCategory(
            BuiltInCategory.OST_Walls).WhereElementIsNotElementType().ToElements()

    # Select all the doors
    allDoors = FilteredElementCollector(doc,).OfCategory(
            BuiltInCategory.OST_Doors).WhereElementIsNotElementType().ToElements()

    # Select all the windows
    allWindows = FilteredElementCollector(doc,).OfCategory(
            BuiltInCategory.OST_Windows).WhereElementIsNotElementType().ToElements()

    # Summary Topology: Spaces - Doors
    # Summary Semantics: Spaces
    # 'spacearea','spaceheight','spacewidth','spacelocation'

    for jj in range(len(spaces_Fordoors)):
        sps = spaces_Fordoors[jj]
        sps_Id = Element.Id.GetValue(sps).IntegerValue
        sps_Name = Element.Name.GetValue(sps)
        sps_Area = UnitUtils.ConvertFromInternalUnits(sps.Area, UnitTypeId.SquareMeters)
        sps_Height = UnitUtils.ConvertFromInternalUnits(sps.UnboundedHeight, UnitTypeId.Meters)
        sps_Shell = sps.ClosedShell.GetBoundingBox()
        sps_Width = min((meter_to_foot(abs(sps_Shell.Max.X - sps_Shell.Min.X))),meter_to_foot(abs(sps_Shell.Max.Y - sps_Shell.Min.Y)))
        sps_Locx = UnitUtils.ConvertFromInternalUnits(sps.Location.Point.X, UnitTypeId.Meters)
        sps_Locy = UnitUtils.ConvertFromInternalUnits(sps.Location.Point.Y, UnitTypeId.Meters)
        sps_Locz = UnitUtils.ConvertFromInternalUnits(sps.Location.Point.Z, UnitTypeId.Meters)
        summary_sema_Space.append([sps_Id, sps_Name, sps_Area, sps_Height, sps_Width, sps_Locx, sps_Locy, sps_Locz])
        
        sps_doors = doors_Fromspaces[jj]
        for item in sps_doors:
            sps_doors_Id = Element.Id.GetValue(item).IntegerValue
            summary_topo_SpaceDoor.append([sps_Id,sps_doors_Id])

    # Summary Semantics: Walls
    # 'wallid','wallwidth','walllength'

    for item in allWalls:
        sps_walls_Id = Element.Id.GetValue(item).IntegerValue
        sps_walls_Width = item.Width
        sps_walls_Width = UnitUtils.ConvertFromInternalUnits(sps_walls_Width, UnitTypeId.Meters)
        sps_WallLength = UnitUtils.ConvertFromInternalUnits(item.Location.Curve.Length, UnitTypeId.Meters)
        summary_sema_Wall.append([sps_walls_Id, sps_walls_Width, sps_WallLength])

    # Summary Topology: Spaces - Boundaries [SeparationLines, Walls]

    for ii in range(len(allSpaces)):
        sps = allSpaces[ii]
        sps_Id = Element.Id.GetValue(sps).IntegerValue

        # Select all the boundaries of the spaces
        sps_boundaries = getRoomBoundaries(sps)

        # Filter the boundaries into separation lines and walls
        sps_separationlines, sps_walls = filterSeparationLines(doc,sps_boundaries)
        
        # Space - separation lines
        for item in sps_separationlines:
            sps_separationlines_Id = Element.Id.GetValue(item).IntegerValue
            summary_topo_SpaceSeparation.append([sps_Id, sps_separationlines_Id])
        
        # Space - walls
        for item in sps_walls:
            sps_walls_Id = Element.Id.GetValue(item).IntegerValue
            summary_topo_SpaceBoundary.append([sps_Id, sps_walls_Id])

    # Summary Semantics: Doors
    # 'doorid','doorlocx','doorlocy','doorlocz'

    for item in allDoors:
        wll_doors_Id = Element.Id.GetValue(item).IntegerValue
        wll_doors_Locx = UnitUtils.ConvertFromInternalUnits(item.Location.Point.X, UnitTypeId.Meters)
        wll_doors_Locy = UnitUtils.ConvertFromInternalUnits(item.Location.Point.Y, UnitTypeId.Meters)
        wll_doors_Locz = UnitUtils.ConvertFromInternalUnits(item.Location.Point.Z, UnitTypeId.Meters)
        summary_sema_Door.append([wll_doors_Id, wll_doors_Locx, wll_doors_Locy, wll_doors_Locz])

    # Summary Semantics: Windows
    # 'windowid','windowlocx','windowlocy','windowlocz'

    for item in allWindows:
        wll_windows_Id = Element.Id.GetValue(item).IntegerValue
        wll_windows_Locx = UnitUtils.ConvertFromInternalUnits(item.Location.Point.X, UnitTypeId.Meters)
        wll_windows_Locy = UnitUtils.ConvertFromInternalUnits(item.Location.Point.Y, UnitTypeId.Meters)
        wll_windows_Locz = UnitUtils.ConvertFromInternalUnits(item.Location.Point.Z, UnitTypeId.Meters)
        summary_sema_Window.append([wll_windows_Id, wll_windows_Locx, wll_windows_Locy, wll_windows_Locz])

    # Summary Topology: Walls - Openings [doors, windows]

    for ii in range(len(allWalls)):
        wll = allWalls[ii]
        wll_Id = Element.Id.GetValue(wll).IntegerValue

        # Select all the openings of the walls
        wll_openings = getInsertedElements(wll)

        # Filter the openings into doors and windows
        [wll_openings_doors, wll_openings_windows] = filterOpenings(doc,wll_openings) if len(wll_openings) > 0 else [[],[]]
        
        # Wall - doors
        for item in wll_openings_doors:
            wll_openings_doors_Id = Element.Id.GetValue(item).IntegerValue
            summary_topo_WallDoor.append([wll_Id, wll_openings_doors_Id])

        # Wall - windows
        for item in wll_openings_windows:
            wll_openings_windows_Id = Element.Id.GetValue(item).IntegerValue
            summary_topo_WallWindow.append([wll_Id, wll_openings_windows_Id])

#--------------------------------------------------------------
#------------------ OK NOW END THE CODE -----------------------
#--------------------------------------------------------------
TransactionManager.Instance.TransactionTaskDone()

# Close and save the recording file
sys.stdout = stdout_original
stdout_file.close()

###############################################################
# Prepare the output 
###############################################################
OUT = [
    summary_sema_Space,
    summary_sema_Wall,
    summary_sema_Door,
    summary_sema_Window,
    summary_topo_SpaceDoor,
    summary_topo_SpaceSeparation,
    summary_topo_SpaceBoundary,
    summary_topo_WallDoor,
    summary_topo_WallWindow]
# ----------------------------------------
n135_saveModelanalysis = Python(IN[0]=analyzeModel, IN[1]=n134_analyzeModel)  # "135_saveModelanalysis"; CPython3
# ---------- n135_saveModelanalysis.python (192 lines) ----------
###############################################################
# Load the Libraries
###############################################################
# general libraries
from xml.dom.minidom import Document
import clr
import sys
import math
import System
import csv 

# identify the pathway
import io
import os
localapp = os.getenv(r'LOCALAPPDATA')
sys.path.append(os.path.join(localapp, r'python-3.8.3-embed-amd64\Lib\site-packages'))

# plotting
import pandas as pd
import numpy as np
import matplotlib.pyplot as plt
import matplotlib as mpl
from matplotlib import cm
from matplotlib.ticker import MultipleLocator, FormatStrFormatter, MaxNLocator
mpl.rcParams['text.usetex'] = True
from mpl_toolkits.axes_grid1.inset_locator import inset_axes, zoomed_inset_axes
from mpl_toolkits.axes_grid1.anchored_artists import AnchoredSizeBar
import scipy.stats as ss
from scipy.stats import norm
import ast 

# dynamo/revit-related libraries
clr.AddReference('DynamoRevitDS')
import Dynamo 
from System import Array
from System.Collections.Generic import *
clr.AddReference("RevitNodes")
import Revit
clr.ImportExtensions(Revit.Elements)
clr.ImportExtensions(Revit.GeometryConversion)
clr.AddReference("RevitServices")
import RevitServices
from RevitServices.Persistence import DocumentManager 
from RevitServices.Transactions import TransactionManager 
clr.AddReference("RevitAPI")
clr.AddReference('ProtoGeometry')
import Autodesk 
from Autodesk.DesignScript.Geometry import *
from Autodesk.DesignScript import *
from Autodesk.Revit.DB import *
from Autodesk.Revit.DB import Parameter
from Autodesk.Revit.DB.Architecture import *
from Autodesk.Revit.DB import IFailuresPreprocessor


###############################################################
# Customize functions
###############################################################


"""
Extract the directory of the dyn.
"""


def getFileDirectory(filename=" "):
    dynscriptpath = Dynamo.Applications.DynamoRevit(
    ).RevitDynamoModel.CurrentWorkspace.FileName
    pathelement = dynscriptpath.split("\\")[:-1]
    folderpath = ""
    for i in pathelement:
        folderpath += (i + "\\")
    if filename != " ":
        folderpath += (filename)
    return folderpath

"""
Extract the directory for input extraction
"""


def get_directory_extractmodelanalysis(nr_model):
    dynscriptpath = Dynamo.Applications.DynamoRevit(
    ).RevitDynamoModel.CurrentWorkspace.FileName
    pathelement = dynscriptpath.split("\\")[:-1]
    folderpath = ""
    for i in pathelement:
        folderpath += (i + "\\")
    folderpath += ('res\\modelanalysisdata_'+str(nr_model))
    return folderpath


"""
Extract the directory of the rvt.
"""


def get_projectname(doc):
    projectname = Document.PathName.GetValue(doc)
    return projectname


###############################################################
# Current doc/app/ui
###############################################################
doc = DocumentManager.Instance.CurrentDBDocument

###############################################################
# Prepare the input
###############################################################
analyzeModel = IN[0]
model_analyzing = UnwrapElement(IN[1])
[
    summary_sema_Space,
    summary_sema_Wall,
    summary_sema_Door,
    summary_sema_Window,
    summary_topo_SpaceDoor,
    summary_topo_SpaceSeparation,
    summary_topo_SpaceBoundary,
    summary_topo_WallDoor,
    summary_topo_WallWindow
    ] = model_analyzing

###############################################################
# Record file into a .txt
###############################################################
# Get the current file path
saveDir = getFileDirectory()

stdout_original = sys.stdout
stdout_file = open(saveDir+"log\log35.txt", 'w')
sys.stdout = stdout_file

###############################################################
# Transaction in Revit
###############################################################
TransactionManager.Instance.EnsureInTransaction(doc)

#--------------------------------------------------------------
#------------------ OK NOW YOU CAN CODE -----------------------
#--------------------------------------------------------------

# Capture the Nr of the model
nr_model_gp_id = Autodesk.Revit.DB.GlobalParametersManager.FindByName(
        doc, 'nr_model')
nr_model_gp_element = doc.GetElement(nr_model_gp_id)
nr_model = int(nr_model_gp_element.GetValue().Value)
saveDir_extractmodelanalysis = get_directory_extractmodelanalysis(nr_model)

if analyzeModel:

    # Convert the semantics to pandas dataframe

    sema_Space = pd.DataFrame(summary_sema_Space, columns =['spaceid','spacename','spacearea','spaceheight','spacewidth','spacelocx','spacelocy','spacelocz'])
    sema_Wall = pd.DataFrame(summary_sema_Wall, columns =['wallid','wallwidth','walllength'])
    sema_Door = pd.DataFrame(summary_sema_Door, columns =['doorid','doorlocx','doorlocy','doorlocz'])
    sema_Window = pd.DataFrame(summary_sema_Window, columns =['windowid','windowlocx','windowlocy','windowlocz'])

    # Convert the topology to pandas dataframe

    topo_SpaceDoor = pd.DataFrame(summary_topo_SpaceDoor, columns =['spaceid','doorid'])
    topo_SpaceSeparation = pd.DataFrame(summary_topo_SpaceSeparation,columns=['spaceid','boundaryseplineid'])
    topo_SpaceBoundary = pd.DataFrame(summary_topo_SpaceBoundary,columns=['spaceid','boundarywallid'])
    topo_WallDoor = pd.DataFrame(summary_topo_WallDoor, columns=['wallid','doorid'])
    topo_WallWindow = pd.DataFrame(summary_topo_WallWindow, columns=['wallid','windowid'])

    # Convert to a single h5 file

    sema_Space.to_hdf(saveDir_extractmodelanalysis+'.h5', key = 'sema_Space', mode = 'w')
    sema_Wall.to_hdf(saveDir_extractmodelanalysis+'.h5', key = 'sema_Wall')
    sema_Door.to_hdf(saveDir_extractmodelanalysis+'.h5', key = 'sema_Door')
    sema_Window.to_hdf(saveDir_extractmodelanalysis+'.h5', key = 'sema_Window')
    topo_SpaceDoor.to_hdf(saveDir_extractmodelanalysis+'.h5', key = 'topo_SpaceDoor')
    topo_SpaceSeparation.to_hdf(saveDir_extractmodelanalysis+'.h5', key = 'topo_SpaceSeparation')
    topo_SpaceBoundary.to_hdf(saveDir_extractmodelanalysis+'.h5', key = 'topo_SpaceBoundary')
    topo_WallDoor.to_hdf(saveDir_extractmodelanalysis+'.h5', key = 'topo_WallDoor')
    topo_WallWindow.to_hdf(saveDir_extractmodelanalysis+'.h5', key = 'topo_WallWindow')

#--------------------------------------------------------------
#------------------ OK NOW END THE CODE -----------------------
#--------------------------------------------------------------
TransactionManager.Instance.TransactionTaskDone()

# Close and save the recording file
sys.stdout = stdout_original
stdout_file.close()

###############################################################
# Prepare the output 
###############################################################
OUT = str(saveDir_extractmodelanalysis+'.h5')
# ----------------------------------------

watch_3 = Watch(n135_saveModelanalysis)
analysisInfo = Output(watch_3)  # "analysisInfo: string"
