# Dynamo custom node Healing-Generation.dyf (Dynamo 2.12.0.5650)
# category: Healing
# packages: Clockwork for Dynamo 2.x 2.3.0

# group: Input1 : Initial Parameters
modelNumber = Input(modelNumber: int)
filePath = Input(filePath: string)
n101_getFileDirectory = Python(IN[0]=filePath)  # "101_getFileDirectory"; CPython3
# ---------- n101_getFileDirectory.python (53 lines) ----------
###############################################################
# Load the Libraries
###############################################################
# general libraries
import clr
import sys

# identify the pathway
import io
import os
localapp = os.getenv(r'LOCALAPPDATA')
sys.path.append(os.path.join(localapp, r'python-3.8.3-embed-amd64\Lib\site-packages'))

# dynamo/revit-related libraries
clr.AddReference('DynamoRevitDS')
import Dynamo
from System.Collections.Generic import *
clr.AddReference("RevitNodes")
import Revit
from RevitServices.Persistence import DocumentManager 
from RevitServices.Transactions import TransactionManager 
clr.AddReference("RevitAPI")

###############################################################
# Customize functions
###############################################################


"""
Extract the directory of the dyn.
"""

def getFileDirectory(filename=" "):
    dynscriptpath = Dynamo.Applications.DynamoRevit(
    ).RevitDynamoModel.CurrentWorkspace.FileName
    pathelement = dynscriptpath.split("\\")[:-1]
    folderpath = ""
    for i in pathelement:
        folderpath += (i + "\\")
    if filename != " ":
        folderpath += (filename)
    return folderpath


###############################################################
# Current doc/app/ui
###############################################################

# Get the Input
initialParameterFile = IN[0]

# Export the file name with directory
OUT = getFileDirectory(initialParameterFile)
# ----------------------------------------
boolean = BoolSelector(true)
importCSV = Data.ImportCSV(filePath=n101_getFileDirectory, transpose=boolean)
n102_setGlobalParameters = Python(IN[0]=modelNumber, IN[1]=importCSV)  # "102_setGlobalParameters"; CPython3
# ---------- n102_setGlobalParameters.python (195 lines) ----------
###############################################################
# Load the Libraries
###############################################################
# general libraries
from wsgiref import validate
import clr
import sys
import math
import System

# identify the pathway
import io
import os
localapp = os.getenv(r'LOCALAPPDATA')
sys.path.append(os.path.join(localapp, r'python-3.8.3-embed-amd64\Lib\site-packages'))

# plotting
import pandas as pd
import numpy as np
import matplotlib.pyplot as plt
import matplotlib as mpl
from matplotlib import cm
from matplotlib.ticker import MultipleLocator, FormatStrFormatter, MaxNLocator
mpl.rcParams['text.usetex'] = True
from mpl_toolkits.axes_grid1.inset_locator import inset_axes, zoomed_inset_axes
from mpl_toolkits.axes_grid1.anchored_artists import AnchoredSizeBar
import scipy.stats as ss
from scipy.stats import norm
import ast 

# dynamo/revit-related libraries
clr.AddReference('DynamoRevitDS')
import Dynamo 
from System import Array
from System.Collections.Generic import *
clr.AddReference("RevitNodes")
import Revit
clr.ImportExtensions(Revit.Elements)
clr.ImportExtensions(Revit.GeometryConversion)
clr.AddReference("RevitServices")
import RevitServices
from RevitServices.Persistence import DocumentManager 
from RevitServices.Transactions import TransactionManager 
clr.AddReference("RevitAPI")
clr.AddReference('ProtoGeometry')
import Autodesk 
from Autodesk.DesignScript.Geometry import *
from Autodesk.DesignScript import *
from Autodesk.Revit.DB import *
from Autodesk.Revit.DB import Parameter
from Autodesk.Revit.DB.Architecture import *
from Autodesk.Revit.DB import GlobalParametersManager

###############################################################
# Customize functions
###############################################################


"""
Extract the directory of the dyn.
"""

def getFileDirectory(filename=" "):
    dynscriptpath = Dynamo.Applications.DynamoRevit(
    ).RevitDynamoModel.CurrentWorkspace.FileName
    pathelement = dynscriptpath.split("\\")[:-1]
    folderpath = ""
    for i in pathelement:
        folderpath += (i + "\\")
    if filename != " ":
        folderpath += (filename)
    return folderpath


"""
Switch types for Global Parameters by the assined value
"""


def switchtypes_GlobalParameter(v):
    if isinstance(v, ElementId):
        return Autodesk.Revit.DB.ParameterType.Integer, Autodesk.Revit.DB.ElementIdParameterValue(v)
    elif isinstance(v, int):
        print ("int")
        return Autodesk.Revit.DB.ParameterType.Integer, Autodesk.Revit.DB.IntegerParameterValue(v)
    elif isinstance(v, float):
        print ("float")
        return Autodesk.Revit.DB.ParameterType.Number, Autodesk.Revit.DB.DoubleParameterValue(v)
    elif isinstance(v, str):
        print ("str")
        return Autodesk.Revit.DB.ParameterType.Text, Autodesk.Revit.DB.StringParameterValue(v)
    else:
        return Autodesk.Revit.DB.ParameterType.Text,Autodesk.Revit.DB.StringParameterValue(v)


"""
Set Global Parameters by name and value 
"""


def set_GlobalParameter(doc,name,v):

    # The element id of the global parameter is provided by the FindByName method.
    existing_param_id = Autodesk.Revit.DB.GlobalParametersManager.FindByName(doc, name)

    # If there's already a global parameter with the same name
    if existing_param_id.ToString() != "-1":
        doc.Delete(existing_param_id)

    # Switch to the right ParameterType and ParameterValue type
    pt, pv = switchtypes_GlobalParameter(v)
    
    # Create a new global parameter
    para = Autodesk.Revit.DB.GlobalParameter.Create(doc,name,pt)

    # Set the value for the global parameter
    para.SetValue(pv)

    return para

###############################################################
# Current doc/app/ui
###############################################################
doc = DocumentManager.Instance.CurrentDBDocument

###############################################################
# Prepare the input
###############################################################
nr_model = int(IN[0])
csvdata = IN[1]

# zum hier, we can direclty query from the GlobalParametersManager.Names... not from the initial csv
 
###############################################################
# Record file into a .txt
###############################################################
# Get the current file path
saveDir = getFileDirectory()

stdout_original = sys.stdout
stdout_file = open(saveDir+"log\log00.txt", 'w')
sys.stdout = stdout_file

###############################################################
# Transaction in Revit
###############################################################
TransactionManager.Instance.EnsureInTransaction(doc)

#--------------------------------------------------------------
#------------------ OK NOW YOU CAN CODE -----------------------
#--------------------------------------------------------------
# Set all global parameters by csv values based on the variation number: nr_model
for item in csvdata:
    gp = set_GlobalParameter(doc, str(item[0]), item[nr_model])

# Get all values 
param_name_list = [str(item[0]) for item in csvdata]
param_id_list = [Autodesk.Revit.DB.GlobalParametersManager.FindByName(doc, item) for item in param_name_list]
param_list = [doc.GetElement(item) for item in param_id_list]
param_value_list = [item.GetValue().Value for item in param_list]

# save by levels
storey_level_list = param_value_list[0:3]
zone_level_list = [param_value_list[3:5],param_value_list[5:7],param_value_list[7:9],param_value_list[9:11]]
space_level_list= [[param_value_list[11]],param_value_list[12:15],param_value_list[15:19],[param_value_list[19]]]

#--------------------------------------------------------------
#------------------ OK NOW END THE CODE -----------------------
#--------------------------------------------------------------
TransactionManager.Instance.TransactionTaskDone()

# Close and save the recording file
sys.stdout = stdout_original
stdout_file.close()

###############################################################
# Prepare the output 
###############################################################
OUT = [
    storey_level_list,
    zone_level_list,
    space_level_list
    ]

# OUT = [
#     param_value_list[0:3], 
#     param_value_list[3:5], 
#     param_value_list[5:7], 
#     param_value_list[7:9], 
#     param_value_list[9:11], 
#     [param_value_list[11]], 
#     param_value_list[12:15],
#     param_value_list[15:19],
#     [param_value_list[19]],
#     ]
# ----------------------------------------
parameters_by_level_no = CodeBlock(res=n102_setGlobalParameters) { res; storey_level = res[0]; zone_level = res[1]; space_level = res[2]; }  # "Parameters_by_level (no constraints)"

# group: Input3 : Tolerance of Constraints
boundary_min = DoubleSlider(0.15, range=0.1..0.4 step 0.05)
boundary_max = DoubleSlider(0.85, range=0.6..0.9 step 0.05)
step_value = DoubleSlider(0.25, range=0.1..0.3 step 0.05)
boundary_values = CodeBlock(bdry_min=boundary_min, bdry_max=boundary_max, step=step_value) { bdry_min; bdry_max; step; tol = [bdry_min, bdry_max, step]; }

# group: Process - A: Apply constraints
constraintsForZones = BoolSelector(false)
n104_constraints2Zones = Python(IN[0]=parameters_by_level_no.storey_level, IN[1]=parameters_by_level_no.zone_level, IN[2]=parameters_by_level_no.space_level, IN[3]=boundary_values.tol, IN[4]=constraintsForZones)  # "104_constraints2Zones"; CPython3
# ---------- n104_constraints2Zones.python (309 lines) ----------
###############################################################
# Load the Libraries
###############################################################
# general libraries
from gzip import READ
import clr
import sys
import math
import System

# identify the pathway
import io
import os
localapp = os.getenv(r'LOCALAPPDATA')
sys.path.append(os.path.join(localapp, r'python-3.8.3-embed-amd64\Lib\site-packages'))

# plotting
#import pandas as pd
#import numpy as np
#import matplotlib.pyplot as plt
#import matplotlib as mpl
#from matplotlib import cm
#from matplotlib.ticker import MultipleLocator, FormatStrFormatter, MaxNLocator
#mpl.rcParams['text.usetex'] = True
#from mpl_toolkits.axes_grid1.inset_locator import inset_axes, zoomed_inset_axes
#from mpl_toolkits.axes_grid1.anchored_artists import AnchoredSizeBar
#import scipy.stats as ss
#from scipy.stats import norm

# dynamo/revit-related libraries
clr.AddReference('DynamoRevitDS')
import Dynamo 
from System import Array
from System.Collections.Generic import *
clr.AddReference("RevitNodes")
import Revit
clr.ImportExtensions(Revit.Elements)
clr.ImportExtensions(Revit.GeometryConversion)
clr.AddReference("RevitServices")
import RevitServices
from RevitServices.Persistence import DocumentManager 
from RevitServices.Transactions import TransactionManager 
clr.AddReference("RevitAPI")
clr.AddReference('ProtoGeometry')
import Autodesk 
from Autodesk.DesignScript.Geometry import *
from Autodesk.DesignScript import *
from Autodesk.Revit.DB import *
from Autodesk.Revit.DB import Parameter
from Autodesk.Revit.DB.Architecture import *
from Autodesk.Revit.DB import IFailuresPreprocessor


###############################################################
# Customize functions
###############################################################


"""
Extract the directory of the dyn.
"""


def getFileDirectory(filename=" "):
    dynscriptpath = Dynamo.Applications.DynamoRevit(
    ).RevitDynamoModel.CurrentWorkspace.FileName
    pathelement = dynscriptpath.split("\\")[:-1]
    folderpath = ""
    for i in pathelement:
        folderpath += (i + "\\")
    if filename != " ":
        folderpath += (filename)
    return folderpath


"""
Units displayed/assigned in Dynamo are feet. 1meter = 3.28084 foot
meter_to_foot: Converts a value from Revit's internal units to a given display unit.
foot_to_meter: Converts a value from a given display unit to Revit's internal units.
"""


def meter_to_foot(ori_value):
    if isinstance(ori_value, list):
        return [UnitUtils.ConvertFromInternalUnits(value, UnitTypeId.Meters) for value in ori_value]
    return float(UnitUtils.ConvertFromInternalUnits(ori_value, UnitTypeId.Meters))


def foot_to_meter(ori_value):
    if isinstance(ori_value, list):
        return [UnitUtils.ConvertToInternalUnits(value, UnitTypeId.Meters) for value in ori_value]
    return float(UnitUtils.ConvertToInternalUnits(ori_value, UnitTypeId.Meters))


"""
Calculate the minimum and maximum boundaries in X and Y directions
"""


def bdry_global2zone(gg, b_min, b_max):
    return gg*b_min, gg*b_max



"""
randomly vary the values
"""


def random_variation(li, step):
    len_li = len(li)
    index_list = list(range(0, len_li))
    index_target = int(random.choice(index_list))
    vary_k = random.randint(0, 1)
    li[index_target] = li[index_target] + \
        step if vary_k else li[index_target]-step

    return li


"""
Adjust the values to satisfy the constraints in X and Y directions
To satisfy
(x_min < x3) and (x3 <= x1) and (x1 < x2) and (x2 < x_max)
and
(y_min < y3) and (y3 < y1) and (y1 == y2) and (y2 < y_max)
"""


def constraintOfZoneFromStorey_X(x1, x2, x3, x_min, x_max):
    if (x_min <= x3) and (x3 <= x1) and (x1 < x2) and (x2 <= x_max):
        return True
    else:
        return False


def constraintOfZoneFromStorey_Y(y1, y2, y3, y_min, y_max):
    if (y_min <= y3) and (y3 < y1) and (y2 == y1) and (y1 <= y_max):
        return True
    else:
        return False


def adjustZoneFromStorey_X(x1, x2, x3, step, x_min, x_max):
    # To satisfy: (x_min < x3) and (x3 <= x1) and (x1 < x2) and (x2 < x_max):

    # sort from small to big x3 <= x1 < x2
    def sortlist(li):
        li.sort()
        return li
    [x3, x1, x2] = sortlist([x1, x2, x3])

    if x1 == x2 and x2 == x3:
        x_step = x1*x1/(x3+x2)
        x3, x2 = x_min + step * x_step, x_max - step * x_step

    # adjustment
    def adjust_X(x1, x2, x3, step, x_min, x_max):
        if x_min >= x3:
            x3 += step
        elif x_min < x3:
            if x2 >= x_max:
                x2 -= step
            elif x2 < x_max:
                if x3 > x1:
                    value = x3
                    x3 = x1
                    x1 = value
                elif x3 <= x1:
                    if x1 > x2:
                        value = x2
                        x2 = x1
                        x1 = value
                    elif x1 == x2:
                        x1 = (x3+x2)/2
                    elif x1 < x2:
                        None

        [x3, x1, x2] = sortlist([x1, x2, x3])
        return x3, x1, x2

    # process adjustment
    while (constraintOfZoneFromStorey_X(x1, x2, x3, x_min, x_max) != True):
        x3, x1, x2 = adjust_X(x1, x2, x3, step, x_min, x_max)
        print("x3 = {}, x1 = {}, x2 = {}".format(x3, x1, x2))
    print("\n Final Values: x3 = {}, x1 = {}, x2 = {} \n".format(x3, x1, x2))
    return round(x1, 1), round(x2, 1), round(x3, 1)


def adjustZoneFromStorey_Y(y1, y2, y3, step, y_min, y_max):
    # To satisfy: (y_min < y3) and (y3 < y1) and (y1 == y2) and (y2 < y_max):

    # sort from small to big y3 < y1 = y2
    def sortlist(li):
        li.sort()
        return li
    [y3, y1, y2] = sortlist([y1, y2, y3])

    if y1 == y2 and y2 == y3:
        y_step = y1*y1/(y3+y2)
        y3, y2 = y_min + step * y_step, y_max - step * y_step

    # adjustment
    def adjust_Y(y1, y2, y3, step, y_min, y_max):
        if y_min >= y3:
            y3 += step
        elif y_min < y3:
            if y2 >= y_max:
                y2 -= step
            elif y2 < y_max:
                if y1 != y2:
                    y1, y2 = (y1+y2)/2, (y1+y2)/2
                elif y1 == y2:
                    if y3 >= y1:
                        value = y3
                        y3 = y1
                        y1, y2 = value, value
                    elif y3 < y1:
                        None
        [y3, y1, y2] = sortlist([y1, y2, y3])
        return y3, y1, y2

    # process adjustment
    while (constraintOfZoneFromStorey_Y(y1, y2, y3, y_min, y_max) != True):
        y3, y1, y2 = adjust_Y(y1, y2, y3, step, y_min, y_max)
        print("y3 = {}, y1 = {}, y2 = {}".format(y3, y1, y2))
    print("\n Final Values: y3 = {}, y1 = {}, y2 = {} \n".format(y3, y1, y2))
    return round(y1, 1), round(y2, 1), round(y3, 1)


###############################################################
# Current doc/app/ui
###############################################################
doc = DocumentManager.Instance.CurrentDBDocument

###############################################################
# Prepare the input
###############################################################
storey_level_list = IN[0]
zone_level_list = IN[1]
space_level_list = IN[2]
tol = IN[3]
constraintForZone = IN[4]

bdry_min, bdry_max, step = tol

###############################################################
# Record file into a .txt
###############################################################
# Get the current file path
saveDir = getFileDirectory()

stdout_original = sys.stdout
stdout_file = open(saveDir+"log\log01.txt", 'w')
sys.stdout = stdout_file

###############################################################
# Transaction in Revit
###############################################################
TransactionManager.Instance.EnsureInTransaction(doc)

#--------------------------------------------------------------
#------------------ OK NOW YOU CAN CODE -----------------------
#--------------------------------------------------------------
# if the constraints are applied
if constraintForZone:

    x1, y1 = zone_level_list[0][0], zone_level_list[0][1]
    x2, y2 = zone_level_list[1][0], zone_level_list[1][1]
    x3, y3 = zone_level_list[2][0], zone_level_list[2][1]
    x4, y4 = zone_level_list[3][0], zone_level_list[3][1]

    x_min, x_max = bdry_global2zone(storey_level_list[0], bdry_min, bdry_max)
    y_min, y_max = bdry_global2zone(storey_level_list[1], bdry_min, bdry_max)

    # There is no zone 4 in this case study (to improve later)
    if x4 != 0 or y4 != 0:
        x4, y4 = 0, 0

    # Check if the constraints in X and in Y are satisfied, if not adjust them
    y1, y2, y3 = adjustZoneFromStorey_Y(y1, y2, y3, step, y_min, y_max)
    x1, x2, x3 = adjustZoneFromStorey_X(x1, x2, x3, step, x_min, x_max)
    zone_level_list = [[x1, y1], [x2, y2], [x3, y3], [x4, y4]]

#--------------------------------------------------------------
#------------------ OK NOW END THE CODE -----------------------
#--------------------------------------------------------------
TransactionManager.Instance.TransactionTaskDone()

# Close and save the recording file
sys.stdout = stdout_original
stdout_file.close()

###############################################################
# Prepare the output 
###############################################################
OUT = [
    storey_level_list,
    zone_level_list,
    space_level_list
    ]

# OUT = [
#     [gx, gy, gz, x1, y1, x2, y2, x3, y3, x4, y4],
#     [x1, y1],
#     [x2, y2],
#     [x3, y3],
#     [x4, y4],
#     ]
# ----------------------------------------
constraintsForSpaces = BoolSelector(false)
n105_constraints2Spaces = Python(IN[0]=n104_constraints2Zones, IN[1]=constraintsForSpaces)  # "105_constraints2Spaces"; CPython3
# ---------- n105_constraints2Spaces.python (208 lines) ----------
###############################################################
# Load the Libraries
###############################################################
# general libraries
import clr
import sys
import math
import System

# identify the pathway
import io
import os
localapp = os.getenv(r'LOCALAPPDATA')
sys.path.append(os.path.join(localapp, r'python-3.8.3-embed-amd64\Lib\site-packages'))

# plotting
#import pandas as pd
#import numpy as np
#import matplotlib.pyplot as plt
#import matplotlib as mpl
#from matplotlib import cm
#from matplotlib.ticker import MultipleLocator, FormatStrFormatter, MaxNLocator
#mpl.rcParams['text.usetex'] = True
#from mpl_toolkits.axes_grid1.inset_locator import inset_axes, zoomed_inset_axes
#from mpl_toolkits.axes_grid1.anchored_artists import AnchoredSizeBar
#import scipy.stats as ss
#from scipy.stats import norm

# dynamo/revit-related libraries
clr.AddReference('DynamoRevitDS')
import Dynamo 
from System import Array
from System.Collections.Generic import *
clr.AddReference("RevitNodes")
import Revit
clr.ImportExtensions(Revit.Elements)
clr.ImportExtensions(Revit.GeometryConversion)
clr.AddReference("RevitServices")
import RevitServices
from RevitServices.Persistence import DocumentManager 
from RevitServices.Transactions import TransactionManager 
clr.AddReference("RevitAPI")
clr.AddReference('ProtoGeometry')
import Autodesk 
from Autodesk.DesignScript.Geometry import *
from Autodesk.DesignScript import *
from Autodesk.Revit.DB import *
from Autodesk.Revit.DB import Parameter
from Autodesk.Revit.DB.Architecture import *
from Autodesk.Revit.DB import IFailuresPreprocessor


###############################################################
# Customize functions
###############################################################


"""
Extract the directory of the dyn.
"""


def getFileDirectory(filename=" "):
    dynscriptpath = Dynamo.Applications.DynamoRevit(
    ).RevitDynamoModel.CurrentWorkspace.FileName
    pathelement = dynscriptpath.split("\\")[:-1]
    folderpath = ""
    for i in pathelement:
        folderpath += (i + "\\")
    if filename != " ":
        folderpath += (filename)
    return folderpath


"""
Units displayed/assigned in Dynamo are feet. 1meter = 3.28084 foot
meter_to_foot: Converts a value from Revit's internal units to a given display unit.
foot_to_meter: Converts a value from a given display unit to Revit's internal units.
"""


def meter_to_foot(ori_value):
    if isinstance(ori_value, list):
        return [UnitUtils.ConvertFromInternalUnits(value, UnitTypeId.Meters) for value in ori_value]
    return float(UnitUtils.ConvertFromInternalUnits(ori_value, UnitTypeId.Meters))


def foot_to_meter(ori_value):
    if isinstance(ori_value, list):
        return [UnitUtils.ConvertToInternalUnits(value, UnitTypeId.Meters) for value in ori_value]
    return float(UnitUtils.ConvertToInternalUnits(ori_value, UnitTypeId.Meters))


"""
configurate a list
"""


def configurelist(li):
    def sortlist(li):
        li.sort()
        return li

    if len(li) == 1:
        if li[0] == 0:
            return []
        else:
            return li
    elif len(li) > 1:
        return sortlist(li)


"""
scale the list to a suitable range
"""


def scalelist(li, bdry_value):
    
    # if there's no zone, return an empty list
    if bdry_value == 0:
        return []
    
    # decide whether we need to scale the list
    scale = False
    for item in li:
        if item >= bdry_value:
            scale = True
            break
    
    # if it needs to be scaled
    if scale:
        scale_base = max(li) + min(li)
        li = [round(item * bdry_value / scale_base, 1) for item in li]

    return li


###############################################################
# Current doc/app/ui
###############################################################
doc = DocumentManager.Instance.CurrentDBDocument

###############################################################
# Prepare the input
###############################################################
storey_zone_space_levels_list = IN[0]
constraintForSpace = IN[1]

storey_level_list, zone_level_list, space_level_list = storey_zone_space_levels_list
gx, gy, gz = storey_level_list
[x1, y1],[x2, y2], [x3, y3], [x4, y4] = zone_level_list

###############################################################
# Record file into a .txt
###############################################################
# Get the current file path
saveDir = getFileDirectory()

stdout_original = sys.stdout
stdout_file = open(saveDir+"log\log02.txt", 'w')
sys.stdout = stdout_file

###############################################################
# Transaction in Revit
###############################################################
TransactionManager.Instance.EnsureInTransaction(doc)

#--------------------------------------------------------------
#------------------ OK NOW YOU CAN CODE -----------------------
#--------------------------------------------------------------
# if the constraints are applied
if constraintForSpace:
    # Update the list of room separation locations for all zones
    li_all_zones = []
    for zz in space_level_list:
        li_zone = configurelist(zz)
        li_all_zones.append(li_zone)

    # Find the bondary values for each room zone
    li_all_zones_bdry = [
        x1,
        gx - x2,
        gx - x3,
        x4]

    li_all_zones_scaled = []
    for ii in range(len(li_all_zones)):
        li_all_zones_scaled.append(scalelist(li_all_zones[ii], li_all_zones_bdry[ii]))
    space_level_list = li_all_zones_scaled

#--------------------------------------------------------------
#------------------ OK NOW END THE CODE -----------------------
#--------------------------------------------------------------
TransactionManager.Instance.TransactionTaskDone()

# Close and save the recording file
sys.stdout = stdout_original
stdout_file.close()

###############################################################
# Prepare the output 
###############################################################
OUT = [
    storey_level_list,
    zone_level_list,
    space_level_list
    ]
# ----------------------------------------
constraintsForStoreys = BoolSelector(true)
n103_constraints2Storey = Python(IN[0]=constraintsForStoreys)  # "103_constraints2Storey"; CPython3
# ---------- n103_constraints2Storey.python (140 lines) ----------
###############################################################
# Load the Libraries
###############################################################
# general libraries
import clr
import sys
import math
import System

# identify the pathway
import io
import os
localapp = os.getenv(r'LOCALAPPDATA')
sys.path.append(os.path.join(localapp, r'python-3.8.3-embed-amd64\Lib\site-packages'))

# plotting
#import pandas as pd
#import numpy as np
#import matplotlib.pyplot as plt
#import matplotlib as mpl
#from matplotlib import cm
#from matplotlib.ticker import MultipleLocator, FormatStrFormatter, MaxNLocator
#mpl.rcParams['text.usetex'] = True
#from mpl_toolkits.axes_grid1.inset_locator import inset_axes, zoomed_inset_axes
#from mpl_toolkits.axes_grid1.anchored_artists import AnchoredSizeBar
#import scipy.stats as ss
#from scipy.stats import norm

# dynamo/revit-related libraries
clr.AddReference('DynamoRevitDS')
import Dynamo 
from System import Array
from System.Collections.Generic import *
clr.AddReference("RevitNodes")
import Revit
clr.ImportExtensions(Revit.Elements)
clr.ImportExtensions(Revit.GeometryConversion)
clr.AddReference("RevitServices")
import RevitServices
from RevitServices.Persistence import DocumentManager 
from RevitServices.Transactions import TransactionManager 
clr.AddReference("RevitAPI")
clr.AddReference('ProtoGeometry')
import Autodesk 
from Autodesk.DesignScript.Geometry import *
from Autodesk.DesignScript import *
from Autodesk.Revit.DB import *
from Autodesk.Revit.DB import Parameter
from Autodesk.Revit.DB.Architecture import *
from Autodesk.Revit.DB import IFailuresPreprocessor


###############################################################
# Customize functions
###############################################################


"""
Extract the directory of the dyn.
"""


def getFileDirectory(filename=" "):
    dynscriptpath = Dynamo.Applications.DynamoRevit(
    ).RevitDynamoModel.CurrentWorkspace.FileName
    pathelement = dynscriptpath.split("\\")[:-1]
    folderpath = ""
    for i in pathelement:
        folderpath += (i + "\\")
    if filename != " ":
        folderpath += (filename)
    return folderpath


"""
Units displayed/assigned in Dynamo are feet. 1meter = 3.28084 foot
meter_to_foot: Converts a value from Revit's internal units to a given display unit.
foot_to_meter: Converts a value from a given display unit to Revit's internal units.
"""


def meter_to_foot(ori_value):
    if isinstance(ori_value, list):
        return [UnitUtils.ConvertFromInternalUnits(value, UnitTypeId.Meters) for value in ori_value]
    return float(UnitUtils.ConvertFromInternalUnits(ori_value, UnitTypeId.Meters))


def foot_to_meter(ori_value):
    if isinstance(ori_value, list):
        return [UnitUtils.ConvertToInternalUnits(value, UnitTypeId.Meters) for value in ori_value]
    return float(UnitUtils.ConvertToInternalUnits(ori_value, UnitTypeId.Meters))


###############################################################
# Current doc/app/ui
###############################################################
doc = DocumentManager.Instance.CurrentDBDocument

###############################################################
# Prepare the input
###############################################################
constraintForStorey = IN[0]

###############################################################
# Record file into a .txt
###############################################################
# Get the current file path
saveDir = getFileDirectory()

stdout_original = sys.stdout
stdout_file = open(saveDir+"log\log02.txt", 'w')
sys.stdout = stdout_file

###############################################################
# Transaction in Revit
###############################################################
TransactionManager.Instance.EnsureInTransaction(doc)

#--------------------------------------------------------------
#------------------ OK NOW YOU CAN CODE -----------------------
#--------------------------------------------------------------
gridsForZones  = []

# if the constraints are applied
if constraintForStorey:
    gridsForZones  = [[1,2],[2,3],[3,4],[4,1]]

#--------------------------------------------------------------
#------------------ OK NOW END THE CODE -----------------------
#--------------------------------------------------------------
TransactionManager.Instance.TransactionTaskDone()

# Close and save the recording file
sys.stdout = stdout_original
stdout_file.close()

###############################################################
# Prepare the output 
###############################################################
OUT = gridsForZones
# ----------------------------------------
n106_integrateConstraints = Python(IN[0]=n103_constraints2Storey, IN[1]=n105_constraints2Spaces)  # "106_integrateConstraints"; CPython3
# ---------- n106_integrateConstraints.python (190 lines) ----------
###############################################################
# Load the Libraries
###############################################################
# general libraries
import clr
import sys
import math
import System

# identify the pathway
import io
import os
localapp = os.getenv(r'LOCALAPPDATA')
sys.path.append(os.path.join(localapp, r'python-3.8.3-embed-amd64\Lib\site-packages'))

# plotting
#import pandas as pd
#import numpy as np
#import matplotlib.pyplot as plt
#import matplotlib as mpl
#from matplotlib import cm
#from matplotlib.ticker import MultipleLocator, FormatStrFormatter, MaxNLocator
#mpl.rcParams['text.usetex'] = True
#from mpl_toolkits.axes_grid1.inset_locator import inset_axes, zoomed_inset_axes
#from mpl_toolkits.axes_grid1.anchored_artists import AnchoredSizeBar
#import scipy.stats as ss
#from scipy.stats import norm

# dynamo/revit-related libraries
clr.AddReference('DynamoRevitDS')
import Dynamo 
from System import Array
from System.Collections.Generic import *
clr.AddReference("RevitNodes")
import Revit
clr.ImportExtensions(Revit.Elements)
clr.ImportExtensions(Revit.GeometryConversion)
clr.AddReference("RevitServices")
import RevitServices
from RevitServices.Persistence import DocumentManager 
from RevitServices.Transactions import TransactionManager 
clr.AddReference("RevitAPI")
clr.AddReference('ProtoGeometry')
import Autodesk 
from Autodesk.DesignScript.Geometry import *
from Autodesk.DesignScript import *
from Autodesk.Revit.DB import *
from Autodesk.Revit.DB import Parameter
from Autodesk.Revit.DB.Architecture import *
from Autodesk.Revit.DB import IFailuresPreprocessor


###############################################################
# Customize functions
###############################################################


"""
Extract the directory of the dyn.
"""


def getFileDirectory(filename=" "):
    dynscriptpath = Dynamo.Applications.DynamoRevit(
    ).RevitDynamoModel.CurrentWorkspace.FileName
    pathelement = dynscriptpath.split("\\")[:-1]
    folderpath = ""
    for i in pathelement:
        folderpath += (i + "\\")
    if filename != " ":
        folderpath += (filename)
    return folderpath


"""
Units displayed/assigned in Dynamo are feet. 1meter = 3.28084 foot
meter_to_foot: Converts a value from Revit's internal units to a given display unit.
foot_to_meter: Converts a value from a given display unit to Revit's internal units.
"""


def meter_to_foot(ori_value):
    if isinstance(ori_value, list):
        return [UnitUtils.ConvertFromInternalUnits(value, UnitTypeId.Meters) for value in ori_value]
    return float(UnitUtils.ConvertFromInternalUnits(ori_value, UnitTypeId.Meters))


def foot_to_meter(ori_value):
    if isinstance(ori_value, list):
        return [UnitUtils.ConvertToInternalUnits(value, UnitTypeId.Meters) for value in ori_value]
    return float(UnitUtils.ConvertToInternalUnits(ori_value, UnitTypeId.Meters))


"""
configurate a list
"""


def configurelist(li):
    def sortlist(li):
        li.sort()
        return li

    if len(li) == 1:
        if li[0] == 0:
            return []
        else:
            return li
    elif len(li) > 1:
        return sortlist(li)


"""
scale the list to a suitable range
"""


def scalelist(li, bdry_value):
    
    # if there's no zone, return an empty list
    if bdry_value == 0:
        return []
    
    # decide whether we need to scale the list
    scale = False
    for item in li:
        if item >= bdry_value:
            scale = True
            break
    
    # if it needs to be scaled
    if scale:
        scale_base = max(li) + min(li)
        li = [round(item * bdry_value / scale_base, 1) for item in li]

    return li


###############################################################
# Current doc/app/ui
###############################################################
doc = DocumentManager.Instance.CurrentDBDocument

###############################################################
# Prepare the input
###############################################################
gridsForZones = IN[0]
storey_zone_space_levels_list = IN[1]

storey_level_list, zone_level_list, space_level_list = storey_zone_space_levels_list

###############################################################
# Record file into a .txt
###############################################################
# Get the current file path
saveDir = getFileDirectory()

stdout_original = sys.stdout
stdout_file = open(saveDir+"log\log02.txt", 'w')
sys.stdout = stdout_file

###############################################################
# Transaction in Revit
###############################################################
TransactionManager.Instance.EnsureInTransaction(doc)

#--------------------------------------------------------------
#------------------ OK NOW YOU CAN CODE -----------------------
#--------------------------------------------------------------
# all coordinates for creating references
all_cords = []

for zz in range(len(gridsForZones)):
    cord = [gridsForZones[zz][0],gridsForZones[zz][1],zone_level_list[zz][0],zone_level_list[zz][1],space_level_list[zz]]
    all_cords.append(cord)

# all_cords[-1][-1] = 0
#--------------------------------------------------------------
#------------------ OK NOW END THE CODE -----------------------
#--------------------------------------------------------------
TransactionManager.Instance.TransactionTaskDone()

# Close and save the recording file
sys.stdout = stdout_original
stdout_file.close()

###############################################################
# Prepare the output 
###############################################################
OUT = all_cords
# ----------------------------------------

# group: Process - B : Build References (Storey, Zone, Space)
reference_point = CodeBlock { Point.ByCoordinates(0.0,0.0,0.0); }
n107_createReferences = Python(IN[0]=reference_point, IN[1]=n105_constraints2Spaces, IN[2]=n106_integrateConstraints)  # "107_createReferences"; IronPython2
# ---------- n107_createReferences.python (422 lines) ----------
###############################################################
# Load the Libraries
###############################################################
# general libraries
import clr
import sys
import math
import System

# identify the pathway
import io
import os
localapp = os.getenv(r'LOCALAPPDATA')
sys.path.append(os.path.join(localapp, r'python-3.8.3-embed-amd64\Lib\site-packages'))

# plotting
#import pandas as pd
#import numpy as np
#import matplotlib.pyplot as plt
#import matplotlib as mpl
#from matplotlib import cm
#from matplotlib.ticker import MultipleLocator, FormatStrFormatter, MaxNLocator
#mpl.rcParams['text.usetex'] = True
#from mpl_toolkits.axes_grid1.inset_locator import inset_axes, zoomed_inset_axes
#from mpl_toolkits.axes_grid1.anchored_artists import AnchoredSizeBar
#import scipy.stats as ss
#from scipy.stats import norm

# dynamo/revit-related libraries
clr.AddReference('DynamoRevitDS')
import Dynamo 
from System import Array
from System.Collections.Generic import *
clr.AddReference("RevitNodes")
import Revit
clr.ImportExtensions(Revit.Elements)
clr.ImportExtensions(Revit.GeometryConversion)
clr.AddReference("RevitServices")
import RevitServices
from RevitServices.Persistence import DocumentManager 
from RevitServices.Transactions import TransactionManager 
clr.AddReference("RevitAPI")
clr.AddReference('ProtoGeometry')
import Autodesk 
from Autodesk.DesignScript.Geometry import *
from Autodesk.DesignScript import *
from Autodesk.Revit.DB import *
from Autodesk.Revit.DB import Parameter
from Autodesk.Revit.DB.Architecture import *
from Autodesk.Revit.DB import IFailuresPreprocessor

from itertools import combinations

###############################################################
# Customize functions
###############################################################

"""
Extract the directory of the dyn.
"""


def getFileDirectory(filename=" "):
    dynscriptpath = Dynamo.Applications.DynamoRevit(
    ).RevitDynamoModel.CurrentWorkspace.FileName
    pathelement = dynscriptpath.split("\\")[:-1]
    folderpath = ""
    for i in pathelement:
        folderpath += (i + "\\")
    if filename != " ":
        folderpath += (filename)
    return folderpath


"""
Clear the model
"""


def clear_model(bool_value):
    doc.Regenerate()
    if bool_value:
        del_floor = FilteredElementCollector(doc).OfCategory(
            BuiltInCategory.OST_Floors).WhereElementIsNotElementType().ToElements()
        del_wall = FilteredElementCollector(doc).OfCategory(
            BuiltInCategory.OST_Walls).WhereElementIsNotElementType().ToElements()
        del_roof = FilteredElementCollector(doc).OfCategory(
            BuiltInCategory.OST_Roofs).WhereElementIsNotElementType().ToElements()
        del_room = FilteredElementCollector(doc).OfCategory(
            BuiltInCategory.OST_Rooms).WhereElementIsNotElementType().ToElements()
        del_all = [del_floor, del_wall, del_roof, del_room]
        for element_type in del_all:
            for element in element_type:
                doc.Delete(element.Id)


"""
Units displayed/assigned in Dynamo are feet. 1meter = 3.28084 foot
meter_to_foot: Converts a value from Revit's internal units to a given display unit.
foot_to_meter: Converts a value from a given display unit to Revit's internal units.
"""


def meter_to_foot(ori_value):
    if isinstance(ori_value, list):
        return [UnitUtils.ConvertFromInternalUnits(value, UnitTypeId.Meters) for value in ori_value]
    return float(UnitUtils.ConvertFromInternalUnits(ori_value, UnitTypeId.Meters))


def foot_to_meter(ori_value):
    if isinstance(ori_value, list):
        return [UnitUtils.ConvertToInternalUnits(value, UnitTypeId.Meters) for value in ori_value]
    return float(UnitUtils.ConvertToInternalUnits(ori_value, UnitTypeId.Meters))


"""
Create the levels
"""


def create_levels(level_elevations):
    ref_level_z = level_elevations[0]
    print level_elevations
    print ref_level_z

    # Collect all levels
    levelArray = (FilteredElementCollector(doc)
        .OfCategory(BuiltInCategory.OST_Levels)
        .WhereElementIsNotElementType()
        .ToElements())
    
    # Clean the Level 0
    # Check the number of the existing levels, if multiple, delete and save only one
    if levelArray.Count > 1:
        for levelElement in levelArray:
            if levelElement.Elevation != ref_level_z:
                doc.Delete(levelElement.Id)
    ref_level = levelArray[0]
    ref_level.Name = "Level0"
    # Check the if the saved one is the reference level, correct it if not
    if ref_level.Elevation != ref_level_z:
        ref_level_new = Autodesk.Revit.DB.Level.Create(doc, ref_level_z)
        doc.Delete(ref_level.Id)
        ref_level = ref_level_new
        ref_level.Name = "Level0"
    
    # Create all levels needed
    for nb_levels in range(len(level_elevations)-1):
        new_level = Autodesk.Revit.DB.Level.Create(doc, level_elevations[nb_levels+1])
        new_level.ToDSType(True).SetParameterByName("Name", "Level"+str(nb_levels+1))
        doc.Regenerate()

    levelArray = (FilteredElementCollector(doc)
        .OfCategory(BuiltInCategory.OST_Levels)
        .WhereElementIsNotElementType()
        .ToElements())
    return levelArray


"""
Clear existing grids
"""


def clear_grids(bl):
    if (bl):
        doc.Regenerate()
        del_grid = FilteredElementCollector(doc).OfCategory(BuiltInCategory.OST_Grids).WhereElementIsNotElementType().ToElements()
        for element in del_grid:
            doc.Delete(element.Id)


"""
Add new grids by x or y 
"""

def add_grids(glob_ref, dir, val=0):
    dim_x, dim_y, ref_x, ref_y, ref_z = glob_ref

    if dir == "Y":
        pp1 = Geometry.Point.ByCoordinates(ref_x,val,ref_z)
        pp2 = Geometry.Point.ByCoordinates(ref_x+dim_x,val,ref_z)
        ll = Geometry.Line.ByStartPointEndPoint(pp1, pp2).ToRevitType()
    elif dir == "X":
        pp1 = Geometry.Point.ByCoordinates(val,ref_y,ref_z)
        pp2 = Geometry.Point.ByCoordinates(val,ref_y+dim_y,ref_z)
        ll = Geometry.Line.ByStartPointEndPoint(pp1, pp2).ToRevitType()        
    new_grid = Grid.Create(doc,ll)
    return new_grid

"""
renumber all grids (to improve)
"""
def rename_grids(bl):
    if (bl):
        rename_grid = FilteredElementCollector(doc).OfCategory(BuiltInCategory.OST_Grids).WhereElementIsNotElementType().ToElements()
        nb_gds = 1
        for gg in rename_grid:
            gg.ToDSType(True).SetParameterByName("Name", str(nb_gds))
            nb_gds +=1
    doc.Regenerate()


"""
build room zone
"""
def room_zone(glob_ref,glob_grids,rm_zones_cord):
    glob_grids = [glob_grids[int(rm_zones_cord[0]-1)], glob_grids[int(rm_zones_cord[1]-1)]]

    grid_segments_X = rm_zones_cord[2]
    grid_segments_Y = rm_zones_cord[3]
    
    rm_glob_grids = []
    rm_bound_grids = []
    for gg in glob_grids:
        if gg.Curve.ToProtoType().StartPoint.X == gg.Curve.ToProtoType().EndPoint.X:
            bound_grids = add_grids(glob_ref, "Y", grid_segments_Y).ToDSType(True)
            rm_glob_grids.append(gg.ToDSType(True))
        elif gg.Curve.ToProtoType().StartPoint.Y == gg.Curve.ToProtoType().EndPoint.Y:
            bound_grids = add_grids(glob_ref, "X", grid_segments_X).ToDSType(True)
            rm_glob_grids.append(gg.ToDSType(True))
        rm_bound_grids.append(bound_grids)
    rm_grids = [rm_glob_grids,rm_bound_grids]
    
    return rm_grids


"""
find the intersection point from two lines
"""


def intersectionPointOfLines(line_1, line_2):
    def det(a, b):
        return a[0] * b[1] - a[1] * b[0]

    line1 = [[line_1.StartPoint.X, line_1.StartPoint.Y], [
        line_1.EndPoint.X, line_1.EndPoint.Y]]
    line2 = [[line_2.StartPoint.X, line_2.StartPoint.Y], [
        line_2.EndPoint.X, line_2.EndPoint.Y]]
    xdiff = [line1[0][0] - line1[1][0], line2[0][0] - line2[1][0]]
    ydiff = [line1[0][1] - line1[1][1], line2[0][1] - line2[1][1]]
    div = det(xdiff, ydiff)

    if (bool(line_1.Intersect(line_2))):
        case = 0
        pt_intersection = line_1.Intersect(line_2)[0]
        if line_1.StartPoint.IsAlmostEqualTo(line_2.StartPoint) or line_1.StartPoint.IsAlmostEqualTo(line_2.EndPoint) or line_1.EndPoint.IsAlmostEqualTo(line_2.StartPoint) or line_1.EndPoint.IsAlmostEqualTo(line_2.EndPoint):
            mutual_inter = False
        else:
            mutual_inter = True
    else:
        pt_intersection = None
        mutual_inter = False
        if abs(div) < 0.0001:
            case = 1
        else:
            case = 2
    return case,pt_intersection,mutual_inter


###############################################################
# Current doc/app/ui
###############################################################
doc = DocumentManager.Instance.CurrentDBDocument

###############################################################
# Prepare the input
###############################################################
glob_ref_pt = UnwrapElement(IN[0])
storey_zone_space_levels_list = IN[1]
rm_zones_ori = IN[2]

storey_level_list, zone_level_list, space_level_list = storey_zone_space_levels_list
glob_dim_x = float(storey_level_list[0])
glob_dim_y = float(storey_level_list[1])
level_elevations = foot_to_meter([0,storey_level_list[2]])

# level_elevations = foot_to_meter(IN[1])

###############################################################
# Record file into a .txt
###############################################################
# Get the current file path
saveDir = getFileDirectory()

stdout_original = sys.stdout
stdout_file = open(saveDir+"log\log04.txt", 'w')
sys.stdout = stdout_file

###############################################################
# Transaction in Revit
###############################################################
TransactionManager.Instance.EnsureInTransaction(doc)

clear_model(True)

#--------------------------------------------------------------
#------------------ OK NOW YOU CAN CODE -----------------------
#--------------------------------------------------------------
# Preprocess the zones of rooms
# if the local reference point of a zone (of room(s)) = (0,0), there's no zone in this corner.
rm_zones_adt = []
for zz in rm_zones_ori:
    if zz[2]!=0 or zz[3]!=0:
        rm_zones_adt.append(zz)
    else:
        continue
rm_zones_cord = [zz[:-1] for zz in rm_zones_adt]
rm_seps_cord_relative = [zz[-1] for zz in rm_zones_adt]

# Create building references
glob_ref_x,glob_ref_y,glob_ref_z = foot_to_meter(glob_ref_pt.X),foot_to_meter(glob_ref_pt.Y),foot_to_meter(glob_ref_pt.Z)
glob_ref = [glob_dim_x, glob_dim_y, glob_ref_x, glob_ref_y, glob_ref_z]

# Create storey references 
levels = create_levels(level_elevations)
collector = FilteredElementCollector(doc)
levels = collector.OfClass(Level).ToElements()

# Clear the old grids
clear_grids(True)

# Create global grids 
glob_grids = []
glob_grids_cod = [["X",glob_ref_x],["Y",glob_dim_y],["X",glob_dim_x],["Y",glob_ref_y]]
for i in range(len(glob_grids_cod)):
    glob_grids.append(add_grids(glob_ref, glob_grids_cod[i][0], glob_grids_cod[i][1])) 

# Rename the global grids
rename_grids(True)

# Create room zone grids 
rm_zones_grids = []
for rm_zone in rm_zones_cord:
    rm_zone_grids = room_zone(glob_ref,glob_grids,rm_zone)
    rm_zones_grids.append(rm_zone_grids)

# Find the crossed points for each zone
rm_zones_pts = []
for ii in range(len(rm_zones_grids)):
    [g1,g2] = rm_zones_grids[ii]
    g12 = g1 + g2
    rm_zones_starting_grids_x, rm_zones_starting_grids_y = [],[]
    gg_curve = []
    pts_inter = []
    for comb_gg in combinations(g12, 2):
        pt_inter = intersectionPointOfLines(comb_gg[0].Curve, comb_gg[1].Curve)[1]
        if pt_inter!=None:
            pts_inter.append(pt_inter)
        else:
            continue
    rm_zones_pts.append(pts_inter)

# Convert rm_seps_cord_relative to rm_seps_cord
rm_zones_starting_pts = []
for zne in rm_zones_pts:
    pt_min = zne[0]
    for ii in range(1,len(zne),1):
        pt_min = zne[ii] if zne[ii].X <= pt_min.X and zne[ii].Y <= pt_min.Y else pt_min
    rm_zones_starting_pts.append(pt_min)
rm_seps_cord = []

for ii in range(len(rm_seps_cord_relative)):
    one_rm_seps = []
    for cord in rm_seps_cord_relative[ii]:
        cord = cord + rm_zones_starting_pts[ii].X
        one_rm_seps.append(cord)
    rm_seps_cord.append(one_rm_seps)

# Create room separation grids
for ii in range(len(rm_zones_grids)):
    rm_seps_grids = [add_grids(glob_ref, "X", sep) for sep in rm_seps_cord[ii]]
    rm_zones_grids[ii].append(rm_seps_grids)

#--------------------------------------------------------------
#------------------ OK NOW END THE CODE -----------------------
#--------------------------------------------------------------
TransactionManager.Instance.TransactionTaskDone()

# Close and save the recording file
sys.stdout = stdout_original
stdout_file.close()

###############################################################
# Prepare the output 
###############################################################
OUT = [ glob_ref,glob_grids,
        rm_seps_cord_relative,rm_seps_cord,
        rm_zones_cord,rm_zones_grids,rm_zones_pts
        ]

#   - - - - - - - - - - OUT - - - - - - - - - -
#   OUT[0] 
#   glob_ref [values] 
#   glob_dim_x, glob_dim_y, glob_ref_x, glob_ref_y, glob_ref_z

#   OUT[1]
#   glob_grids [lines]
#   the grids corresponding to glob_ref

#   OUT[2]
#   rm_seps_cord_relative [values]
#   the relative positions of the rooms in each room zone (in X direction)

#   OUT[3]
#   rm_seps_cord [values] 
#   the absolute positions of the rooms in each room zone (in X direction)

#   OUT[4]
#   rm_zones_cord [values]
#   global references the zones attached to, the dimensions of zones in X,Y directions

#   OUT[5]
#   rm_zones_grids [lines]
#   all grids corresponding to a room zone

#   OUT[6]
#   rm_zones_pts [points]
#   the crossed point of a room zone

#   - - - - - - - - - - - - - - - - - - - - - 
# ----------------------------------------

# group: Input2 : Element Types
floor_types = FloorTypes("Generic - 12\" - Filled")
roof_types = RoofTypes("Sloped Glazing")
wall_types_interior = WallTypes("Generic - 6\"")
wall_types_exterior = WallTypes("Generic - 8\" - Filled")
window_types = FamilyTypes("Window-Casement-Double:48\" x 60\"")
door_types_interior = FamilyTypes("Single-Flush:30\" x 80\"")
door_types_exterior = FamilyTypes("Single-Flush:36\" x 84\"")
n100_setMaterial = Python(IN[0]=floor_types, IN[1]=roof_types, IN[2]=wall_types_interior, IN[3]=wall_types_exterior, IN[4]=window_types, IN[5]=door_types_interior, IN[6]=door_types_exterior)  # "100_setMaterial"; IronPython2
# ---------- n100_setMaterial.python (167 lines) ----------
###############################################################
# Load the Libraries
###############################################################
# general libraries
import clr
import sys
import math
import System

# identify the pathway
import io
import os
localapp = os.getenv(r'LOCALAPPDATA')
sys.path.append(os.path.join(localapp, r'python-3.8.3-embed-amd64\Lib\site-packages'))

# plotting
#import pandas as pd
#import numpy as np
#import matplotlib.pyplot as plt
#import matplotlib as mpl
#from matplotlib import cm
#from matplotlib.ticker import MultipleLocator, FormatStrFormatter, MaxNLocator
#mpl.rcParams['text.usetex'] = True
#from mpl_toolkits.axes_grid1.inset_locator import inset_axes, zoomed_inset_axes
#from mpl_toolkits.axes_grid1.anchored_artists import AnchoredSizeBar
#import scipy.stats as ss
#from scipy.stats import norm

# dynamo/revit-related libraries
clr.AddReference('DynamoRevitDS')
import Dynamo 
from System import Array
from System.Collections.Generic import *
clr.AddReference("RevitNodes")
import Revit
clr.ImportExtensions(Revit.Elements)
clr.ImportExtensions(Revit.GeometryConversion)
clr.AddReference("RevitServices")
import RevitServices
from RevitServices.Persistence import DocumentManager 
from RevitServices.Transactions import TransactionManager 
clr.AddReference("RevitAPI")
clr.AddReference('ProtoGeometry')
import Autodesk 
from Autodesk.DesignScript.Geometry import *
from Autodesk.DesignScript import *
from Autodesk.Revit.DB import *
from Autodesk.Revit.DB import Parameter
from Autodesk.Revit.DB.Architecture import *
from Autodesk.Revit.DB import IFailuresPreprocessor


###############################################################
# Customize functions
###############################################################

"""
Extract the directory of the dyn.
"""


def getFileDirectory(filename=" "):
    dynscriptpath = Dynamo.Applications.DynamoRevit(
    ).RevitDynamoModel.CurrentWorkspace.FileName
    pathelement = dynscriptpath.split("\\")[:-1]
    folderpath = ""
    for i in pathelement:
        folderpath += (i + "\\")
    if filename != " ":
        folderpath += (filename)
    return folderpath



"""
Clear the model
"""


def clear_model(bool_value):
    doc.Regenerate()
    if bool_value:
        del_door = FilteredElementCollector(doc).OfCategory(
            BuiltInCategory.OST_Doors).WhereElementIsNotElementType().ToElements()
        del_floor = FilteredElementCollector(doc).OfCategory(
            BuiltInCategory.OST_Floors).WhereElementIsNotElementType().ToElements()
        del_wall = FilteredElementCollector(doc).OfCategory(
            BuiltInCategory.OST_Walls).WhereElementIsNotElementType().ToElements()
        del_roof = FilteredElementCollector(doc).OfCategory(
            BuiltInCategory.OST_Roofs).WhereElementIsNotElementType().ToElements()
        del_all = [del_door, del_floor, del_wall, del_roof]
        for element_type in del_all:
            for element in element_type:
                doc.Delete(element.Id)


"""
Units displayed/assigned in Dynamo are feet. 1meter = 3.28084 foot
meter_to_foot: Converts a value from Revit's internal units to a given display unit.
foot_to_meter: Converts a value from a given display unit to Revit's internal units.
"""


def meter_to_foot(ori_value):
    if isinstance(ori_value, list):
        return [UnitUtils.ConvertFromInternalUnits(value, UnitTypeId.Meters) for value in ori_value]
    return float(UnitUtils.ConvertFromInternalUnits(ori_value, UnitTypeId.Meters))


def foot_to_meter(ori_value):
    if isinstance(ori_value, list):
        return [UnitUtils.ConvertToInternalUnits(value, UnitTypeId.Meters) for value in ori_value]
    return float(UnitUtils.ConvertToInternalUnits(ori_value, UnitTypeId.Meters))


###############################################################
# Current doc/app/ui
###############################################################
doc = DocumentManager.Instance.CurrentDBDocument

###############################################################
# Prepare the input
###############################################################
floor_type = UnwrapElement(IN[0])
roof_type = UnwrapElement(IN[1])
int_wall_type = UnwrapElement(IN[2])
ext_wall_type = UnwrapElement(IN[3])
window_type = UnwrapElement(IN[4])
int_door_type = UnwrapElement(IN[5])
ext_door_type = UnwrapElement(IN[6])

###############################################################
# Record file into a .txt
###############################################################
# Get the current file path
saveDir = getFileDirectory()

stdout_original = sys.stdout
stdout_file = open(saveDir+"log\log03.txt", 'w')
sys.stdout = stdout_file

###############################################################
# Transaction in Revit
###############################################################
TransactionManager.Instance.EnsureInTransaction(doc)

#--------------------------------------------------------------
#------------------ OK NOW YOU CAN CODE -----------------------
#--------------------------------------------------------------
types_to_activate = [UnwrapElement(window_type), UnwrapElement(int_door_type), UnwrapElement(ext_door_type)]
for ty in types_to_activate:
    if ty.IsActive == False:
        ty.Activate()
        doc.Regenerate()
#--------------------------------------------------------------
#------------------ OK NOW END THE CODE -----------------------
#--------------------------------------------------------------
TransactionManager.Instance.TransactionTaskDone()

# Close and save the recording file
sys.stdout = stdout_original
stdout_file.close()

###############################################################
# Prepare the output 
###############################################################
OUT = floor_type, roof_type, int_wall_type, ext_wall_type, window_type, int_door_type, ext_door_type
# ----------------------------------------

# group: Process - C : Create Geometry
n108_creategeo = Python(IN[0]=n107_createReferences, IN[1]=n100_setMaterial)  # "108-createGeo"; IronPython2
# ---------- n108_creategeo.python (482 lines) ----------
###############################################################
# Load the Libraries
###############################################################
# general libraries
import clr
import sys
import math
import System

# identify the pathway
import io
import os
localapp = os.getenv(r'LOCALAPPDATA')
sys.path.append(os.path.join(localapp, r'python-3.8.3-embed-amd64\Lib\site-packages'))

# plotting
#import pandas as pd
#import numpy as np
#import matplotlib.pyplot as plt
#import matplotlib as mpl
#from matplotlib import cm
#from matplotlib.ticker import MultipleLocator, FormatStrFormatter, MaxNLocator
#mpl.rcParams['text.usetex'] = True
#from mpl_toolkits.axes_grid1.inset_locator import inset_axes, zoomed_inset_axes
#from mpl_toolkits.axes_grid1.anchored_artists import AnchoredSizeBar
#import scipy.stats as ss
#from scipy.stats import norm

# dynamo/revit-related libraries
clr.AddReference('DynamoRevitDS')
import Dynamo 
from System import Array
from System.Collections.Generic import *
clr.AddReference("RevitNodes")
import Revit
clr.ImportExtensions(Revit.Elements)
clr.ImportExtensions(Revit.GeometryConversion)
clr.AddReference("RevitServices")
import RevitServices
from RevitServices.Persistence import DocumentManager 
from RevitServices.Transactions import TransactionManager 
clr.AddReference("RevitAPI")
clr.AddReference('ProtoGeometry')
import Autodesk 
from Autodesk.DesignScript.Geometry import *
from Autodesk.DesignScript import *
from Autodesk.Revit.DB import *
from Autodesk.Revit.DB import Parameter
from Autodesk.Revit.DB.Architecture import *
from Autodesk.Revit.DB import IFailuresPreprocessor

from Revit import GeometryConversion as gc
from itertools import combinations

###############################################################
# Customize functions
###############################################################

"""
Extract the directory of the dyn.
"""


def getFileDirectory(filename=" "):
    dynscriptpath = Dynamo.Applications.DynamoRevit(
    ).RevitDynamoModel.CurrentWorkspace.FileName
    pathelement = dynscriptpath.split("\\")[:-1]
    folderpath = ""
    for i in pathelement:
        folderpath += (i + "\\")
    if filename != " ":
        folderpath += (filename)
    return folderpath

"""
Clear the model
"""


def clear_model(bool_value):
    doc.Regenerate()
    if bool_value:
        del_floor = FilteredElementCollector(doc).OfCategory(
            BuiltInCategory.OST_Floors).WhereElementIsNotElementType().ToElements()
        del_wall = FilteredElementCollector(doc).OfCategory(
            BuiltInCategory.OST_Walls).WhereElementIsNotElementType().ToElements()
        del_roof = FilteredElementCollector(doc).OfCategory(
            BuiltInCategory.OST_Roofs).WhereElementIsNotElementType().ToElements()
        del_room = FilteredElementCollector(doc).OfCategory(
            BuiltInCategory.OST_Rooms).WhereElementIsNotElementType().ToElements()
        del_all = [del_floor, del_wall, del_roof, del_room]
        for element_type in del_all:
            for element in element_type:
                doc.Delete(element.Id)


"""
Units displayed/assigned in Dynamo are feet. 1meter = 3.28084 foot
meter_to_foot: Converts a value from Revit's internal units to a given display unit.
foot_to_meter: Converts a value from a given display unit to Revit's internal units.
"""


def meter_to_foot(ori_value):
    if isinstance(ori_value, list):
        return [UnitUtils.ConvertFromInternalUnits(value, UnitTypeId.Meters) for value in ori_value]
    return float(UnitUtils.ConvertFromInternalUnits(ori_value, UnitTypeId.Meters))


def foot_to_meter(ori_value):
    if isinstance(ori_value, list):
        return [UnitUtils.ConvertToInternalUnits(value, UnitTypeId.Meters) for value in ori_value]
    return float(UnitUtils.ConvertToInternalUnits(ori_value, UnitTypeId.Meters))


"""
find the intersection point from two lines
"""


def intersectionPointOfLines(line_1, line_2):
    def det(a, b):
        return a[0] * b[1] - a[1] * b[0]

    line1 = [[line_1.StartPoint.X, line_1.StartPoint.Y], [
        line_1.EndPoint.X, line_1.EndPoint.Y]]
    line2 = [[line_2.StartPoint.X, line_2.StartPoint.Y], [
        line_2.EndPoint.X, line_2.EndPoint.Y]]
    xdiff = [line1[0][0] - line1[1][0], line2[0][0] - line2[1][0]]
    ydiff = [line1[0][1] - line1[1][1], line2[0][1] - line2[1][1]]
    div = det(xdiff, ydiff)

    if (bool(line_1.Intersect(line_2))):
        case = 0
        pt_intersection = line_1.Intersect(line_2)[0]
        if line_1.StartPoint.IsAlmostEqualTo(line_2.StartPoint) or line_1.StartPoint.IsAlmostEqualTo(line_2.EndPoint) or line_1.EndPoint.IsAlmostEqualTo(line_2.StartPoint) or line_1.EndPoint.IsAlmostEqualTo(line_2.EndPoint):
            mutual_inter = False
        else:
            mutual_inter = True
    else:
        pt_intersection = None
        mutual_inter = False
        if abs(div) < 0.0001:
            case = 1
        else:
            case = 2
    return case,pt_intersection,mutual_inter


"""
CustomizedWall
"""


class CustomizedWall:
    def __init__(self, level1, level2, walltype):
        self.level_b = level1
        self.level_t = level2
        self.type = walltype

    def wallByLine(self, doc, line_loc):
        self.curve = line_loc
        self.flipped = False
        self.ww = Autodesk.Revit.DB.Wall.Create(doc, self.curve, self.type.Id, self.level_b.Id,
            abs(self.level_t.Elevation-self.level_b.Elevation), 0, self.flipped, False)
        #self.ww = Autodesk.Revit.DB.Wall.Create(doc, self.curve, ElementId(
        #    self.type.Id), ElementId(self.level_b.Id), foot_to_meter(abs(self.level_t.Elevation-self.level_b.Elevation)), 0, False, False)

"""
Customizedzone, [CustomizedWall-embedded]
"""


class CustomizedZone:
    def __init__(self, level1, level2, rm_zone_grids):
        self.level_b = level1
        self.level_t = level2
        self.outer_grids = rm_zone_grids[0]
        self.zone_grids = rm_zone_grids[1]
        self.sep_grids = rm_zone_grids[2]
        self.pt_out_out = []
        self.pt_out_zne = []
        self.pt_zne_zne = []
        self.pt_zne_sep = []

    def zoneAnalysis(self):
        self.outer_lines = [gg.Curve.ToProtoType() for gg in self.outer_grids]
        self.zone_lines = [gg.Curve.ToProtoType() for gg in self.zone_grids]
        self.sep_lines = [gg.Curve.ToProtoType() for gg in self.sep_grids]

        res_out_out = intersectionPointOfLines(self.outer_lines[0], self.outer_lines[1])
        self.pt_out_out.append(res_out_out[1])

        #print "\n Start outerline and zoneline interaction analysis: "
        for l1 in self.outer_lines:
            for l2 in self.zone_lines:
                res_out_zne = intersectionPointOfLines(l1, l2)
                if res_out_zne[1] == None:
                    #print "pt_out_zne, no interaction *1"
                    continue
                else:
                    self.pt_out_zne.append(res_out_zne[1])

        #print "\n Start zoneline and zoneline interaction analysis: "
        res_zne_zne = intersectionPointOfLines(
            self.zone_lines[0], self.zone_lines[1])
        self.pt_zne_zne.append(res_zne_zne[1])

        #print "\n Start sepline and all the other lines interaction analysis: "
        outer_zone_lines = self.outer_lines + self.zone_lines
        for l1 in outer_zone_lines:
            for l2 in self.sep_lines:
                res_sep = intersectionPointOfLines(l1, l2)
                if res_sep[1] == None:
                    # print "pt_zne_sep, no interaction *1"
                    continue
                else:
                    self.pt_zne_sep.append(res_sep[1])

    def zoneWalls(self, doc, walltype):
        # 
        self.outer_walllines = []
        self.zone_walllines = []
        self.sep_walllines = []

        for pt in self.pt_out_zne:
            for pt_new in self.pt_zne_zne:
                pt_xyz = UnwrapElement(pt).ToRevitType()
                pt_new_xyz = UnwrapElement(pt_new).ToRevitType()
                zone_l = Autodesk.Revit.DB.Line.CreateBound(pt_xyz,pt_new_xyz)
                self.zone_walllines.append(zone_l)
        
        for comb_pt in combinations(self.pt_zne_sep, 2):
            # ********** to improve the condition here, for separation lines **********
            if abs (comb_pt[0].X - comb_pt[1].X) <= 0.001:
                pt_xyz = UnwrapElement(comb_pt[0]).ToRevitType()
                pt_new_xyz = UnwrapElement(comb_pt[1]).ToRevitType()                
                zone_s = Autodesk.Revit.DB.Line.CreateBound(pt_xyz,pt_new_xyz)
                self.sep_walllines.append(zone_s)
        
        self.wall_type = walltype
        self.zone_walls = []
        self.sep_walls = []
        self.all_walls_inzone = []

        for wline in self.zone_walllines:
            zone_wall = CustomizedWall(self.level_b, self.level_t, self.wall_type)
            zone_wall.wallByLine(doc, wline)
            self.zone_walls.append(zone_wall)
            self.all_walls_inzone.append(zone_wall)
        
        for wline in self.sep_walllines:
            sep_wall = CustomizedWall(self.level_b, self.level_t, self.wall_type)
            sep_wall.wallByLine(doc, wline)
            self.sep_walls.append(sep_wall)
            self.all_walls_inzone.append(sep_wall)


"""
Provide the geometry of slab by level...
"""


def find_perimeter_lines(x,y,level):
    zz = level.Elevation
    xx = x
    yy = y 
    line_1 = Autodesk.Revit.DB.Line.CreateBound(XYZ(0,0,zz),    XYZ(xx,0,zz))
    line_2 = Autodesk.Revit.DB.Line.CreateBound(XYZ(xx,0,zz),   XYZ(xx,yy,zz))
    line_3 = Autodesk.Revit.DB.Line.CreateBound(XYZ(xx,yy,zz),  XYZ(0,yy,zz))
    line_4 = Autodesk.Revit.DB.Line.CreateBound(XYZ(0,yy,zz),   XYZ(0,0,zz))
    
    perimeter_geometry = CurveArray()
    perimeter_geometry.Append(line_1)
    perimeter_geometry.Append(line_2)
    perimeter_geometry.Append(line_3)
    perimeter_geometry.Append(line_4)
    return perimeter_geometry


"""
Flip an object horizontally ...
"""
def FlipObject(item):
    if hasattr(item, "Flip"):
        try:
            item.Flip()
            return True
        except: return False
    else: return False


"""
Creat XYZ from a startpoint and a endpoint
"""


def XYZfromPoints(startpoint,endpoint):
    
    delta_x = endpoint.X - startpoint.X 
    delta_y = endpoint.Y - startpoint.Y 
    delta_z = endpoint.Z - startpoint.Z 
    return XYZ(delta_x,delta_y,delta_z)


"""
Get the exterior oritentation of a wall ...
"""


def GetExteriorWallDirection(item):
    if type(item) == Autodesk.Revit.DB.Wall:
        locationCurve = item.Location
        if locationCurve != None:
            curve = locationCurve.Curve
            direction = XYZ.BasisX
            if type(curve) == Autodesk.Revit.DB.Line:
                direction = curve.ComputeDerivatives(0, True).BasisX.Normalize()
            else:
                direction = (curve.GetEndPoint(1) - curve.GetEndPoint(0)).Normalize()
            exteriorDirection = XYZ.BasisZ.CrossProduct(direction)
            
            if item.Flipped:
                exteriorDirection = -exteriorDirection
            return exteriorDirection.ToVector()
    else:
        return "Not a Wall"


"""
Flip a wall according a supposed-inner reference point
"""


def flapWallByRefPoint(ori_wall,refpt):
    ori_dir = GetExteriorWallDirection(ori_wall).ToRevitType()
    wallline_pts = [ori_wall.Location.Curve.ToProtoType().StartPoint, ori_wall.Location.Curve.ToProtoType().EndPoint]
    wallline_mdpt = Autodesk.Revit.DB.Point.Create(wallline_pts[0].ToRevitType()/2 + wallline_pts[1].ToRevitType()/2).ToProtoType()
    vec = XYZfromPoints(refpt,wallline_mdpt)
    if ori_dir.DotProduct(vec) >= 0:
        # no need to flip
        return False
    else:
        # need to flip
        if hasattr(ori_wall, "Flip"):
            ori_wall.Flip()
        return True

###############################################################
# Current doc/app/ui
###############################################################
doc = DocumentManager.Instance.CurrentDBDocument

###############################################################
# Prepare the input
###############################################################
OUT_createReferences = UnwrapElement(IN[0])
glob_ref,glob_grids,rm_seps_cord_relative,rm_seps_cord,rm_zones_cord,rm_zones_grids,rm_zones_pts = OUT_createReferences

OUT_setMaterial = UnwrapElement(IN[1])
floor_type, roof_type, int_wall_type, ext_wall_type, window_type, int_door_type, ext_door_type = OUT_setMaterial

###############################################################
# Record file into a .txt
###############################################################
# Get the current file path
saveDir = getFileDirectory()

stdout_original = sys.stdout
stdout_file = open(saveDir+"log\log06.txt", 'w')
sys.stdout = stdout_file

###############################################################
# Transaction in Revit
###############################################################
TransactionManager.Instance.EnsureInTransaction(doc)

clear_model(True)

collector = FilteredElementCollector(doc)
levels = collector.OfClass(Level).ToElements()

#--------------------------------------------------------------
#------------------ OK NOW YOU CAN CODE -----------------------
#--------------------------------------------------------------
# Create exterior walls
wall_exterior = []
glob_centerpt  = Autodesk.Revit.DB.Point.Create(XYZ(foot_to_meter(glob_ref[0]/2), foot_to_meter(glob_ref[1]/2),foot_to_meter(levels[0].Elevation))).ToProtoType()

for glob_g in glob_grids:
    glob_g_line = glob_g.Curve#.ToRevitType(True)
    outerwall =  CustomizedWall(levels[0], levels[1], ext_wall_type)
    outerwall.wallByLine(doc, glob_g_line)
    wall_exterior.append(outerwall)

# Room zone creation
room_zones = []
for rm_zone_grids in rm_zones_grids:
    room_zone = CustomizedZone(levels[0], levels[1],rm_zone_grids)
    room_zone.zoneAnalysis()
    room_zone.zoneWalls(doc, int_wall_type)
    room_zones.append(room_zone)

# Collect interior walls
wall_interior = []
wall_interior_rm_cr = []
wall_interior_rm_rm = []
for rz in room_zones:
    wall_interior_rm_cr.append(rz.zone_walls)
    wall_interior_rm_rm.append(rz.sep_walls)
    wall_interior.append(rz.all_walls_inzone)

# Flatten the list of interior walls
wall_interior = [element for sublist in wall_interior for element in sublist]

# Create the building floor
perimeter_floor = find_perimeter_lines(foot_to_meter(glob_ref[0]),foot_to_meter(glob_ref[1]),levels[0])
building_floor= doc.Create.NewFloor(perimeter_floor, UnwrapElement(floor_type), UnwrapElement(levels[0]), True)

# Create the building roof/ceiling
roof_Array = clr.StrongBox[ModelCurveArray](ModelCurveArray())
perimeter_roof = find_perimeter_lines(foot_to_meter(glob_ref[0]),foot_to_meter(glob_ref[1]),levels[1])
building_roof = doc.Create.NewFootPrintRoof(perimeter_roof, UnwrapElement(levels[1]), UnwrapElement(roof_type), roof_Array)  

# Adapat part of the exterior and interiror walls' orientations and archive orientation adapataion
wall_exterior_flippers, wall_interior_flippers = [], []

# Flap exterior walls if needed
for ww in wall_exterior:
    if flapWallByRefPoint(ww.ww,glob_centerpt):
        wall_exterior_flippers.append([ww.ww, 'True'])
    else:
        wall_exterior_flippers.append([ww.ww, 'False'])

# Flap interior walls if needed
for ww in wall_interior:
    if flapWallByRefPoint(ww.ww,glob_centerpt):
        wall_interior_flippers.append([ww.ww, 'True'])
    else:
        wall_interior_flippers.append([ww.ww, 'False'])

wall_flippers = [wall_exterior_flippers, wall_interior_flippers]
doc.Regenerate()

#--------------------------------------------------------------
#------------------ OK NOW END THE CODE -----------------------
#--------------------------------------------------------------
TransactionManager.Instance.TransactionTaskDone()

# Close and save the recording file
sys.stdout = stdout_original
stdout_file.close()

##############################s#################################
# Prepare the output 
###############################################################
OUT_createGeo = [wall_flippers,wall_exterior,wall_interior,wall_interior_rm_cr,wall_interior_rm_rm,building_floor,building_roof,room_zones]
OUT = [OUT_createReferences,OUT_setMaterial,OUT_createGeo]

#   - - - - - - - - - - OUT - - - - - - - - - -
#   OUT[0] 
#   OUT_createReferences
#   glob_ref,glob_grids,rm_seps_cord_relative,rm_seps_cord,rm_zones_cord,rm_zones_grids,rm_zones_pts

#   OUT[1]
#   OUT_setMaterial
#   floor_type, roof_type, int_wall_type, ext_wall_type, window_type, int_door_type, ext_door_type

#   OUT[2]
#   OUT_createGeo
#   wall_flippers,wall_exterior,wall_interior,wall_interior_rm_cr,wall_interior_rm_rm,building_floor,building_roof,room_zones

#   - - - - - - - - - - - - - - - - - - - - -


# ========================================================================================
# # Prob1 # #
# (Autodesk.DesignScript.Geometry.Curve), but was called with (Autodesk.Revit.DB.Curve[]). 
# # Prob2 # #
# https://forum.dynamobim.com/t/create-floor-python/51048/7
# https://forum.dynamobim.com/t/problem-with-floor-byoutlinetypeandlevel/42417
# ========================================================================================
# ----------------------------------------
exterior_window_slider = CodeBlock()
# ---------- exterior_window_slider.designscript (2 lines) ----------
[[-0.60,0.50],[-0.90,-0.55,0.20,0.75]
,[-0.70,0.60],[-0.35,0.10,0.70]];
# ----------------------------------------
exterior_window_height = CodeBlock { 0.65; }
interior_door_slider = CodeBlock { 0.05; }
n109_exitReferences = Python(IN[0]=n105_constraints2Spaces)  # "109_exitReferences"; CPython3
# ---------- n109_exitReferences.python (183 lines) ----------
###############################################################
# Load the Libraries
###############################################################
# general libraries
import clr
import sys
import math
import System

# identify the pathway
import io
import os
localapp = os.getenv(r'LOCALAPPDATA')
sys.path.append(os.path.join(localapp, r'python-3.8.3-embed-amd64\Lib\site-packages'))

# plotting
#import pandas as pd
#import numpy as np
#import matplotlib.pyplot as plt
#import matplotlib as mpl
#from matplotlib import cm
#from matplotlib.ticker import MultipleLocator, FormatStrFormatter, MaxNLocator
#mpl.rcParams['text.usetex'] = True
#from mpl_toolkits.axes_grid1.inset_locator import inset_axes, zoomed_inset_axes
#from mpl_toolkits.axes_grid1.anchored_artists import AnchoredSizeBar
#import scipy.stats as ss
#from scipy.stats import norm

# dynamo/revit-related libraries
clr.AddReference('DynamoRevitDS')
import Dynamo 
from System import Array
from System.Collections.Generic import *
clr.AddReference("RevitNodes")
import Revit
clr.ImportExtensions(Revit.Elements)
clr.ImportExtensions(Revit.GeometryConversion)
clr.AddReference("RevitServices")
import RevitServices
from RevitServices.Persistence import DocumentManager 
from RevitServices.Transactions import TransactionManager 
clr.AddReference("RevitAPI")
clr.AddReference('ProtoGeometry')
import Autodesk 
from Autodesk.DesignScript.Geometry import *
from Autodesk.DesignScript import *
from Autodesk.Revit.DB import *
from Autodesk.Revit.DB import Parameter
from Autodesk.Revit.DB.Architecture import *
from Autodesk.Revit.DB import IFailuresPreprocessor


###############################################################
# Customize functions
###############################################################

"""
Extract the directory of the dyn.
"""


def getFileDirectory(filename=" "):
    dynscriptpath = Dynamo.Applications.DynamoRevit(
    ).RevitDynamoModel.CurrentWorkspace.FileName
    pathelement = dynscriptpath.split("\\")[:-1]
    folderpath = ""
    for i in pathelement:
        folderpath += (i + "\\")
    if filename != " ":
        folderpath += (filename)
    return folderpath

"""
Clear the model
"""


def clear_model(bool_value):
    doc.Regenerate()
    if bool_value:
        del_door = FilteredElementCollector(doc).OfCategory(
            BuiltInCategory.OST_Doors).WhereElementIsNotElementType().ToElements()
        del_floor = FilteredElementCollector(doc).OfCategory(
            BuiltInCategory.OST_Floors).WhereElementIsNotElementType().ToElements()
        del_wall = FilteredElementCollector(doc).OfCategory(
            BuiltInCategory.OST_Walls).WhereElementIsNotElementType().ToElements()
        del_roof = FilteredElementCollector(doc).OfCategory(
            BuiltInCategory.OST_Roofs).WhereElementIsNotElementType().ToElements()
        del_all = [del_door, del_floor, del_wall, del_roof]
        for element_type in del_all:
            for element in element_type:
                doc.Delete(element.Id)


"""
Units displayed/assigned in Dynamo are feet. 1meter = 3.28084 foot
meter_to_foot: Converts a value from Revit's internal units to a given display unit.
foot_to_meter: Converts a value from a given display unit to Revit's internal units.
"""


def meter_to_foot(ori_value):
    if isinstance(ori_value, list):
        return [UnitUtils.ConvertFromInternalUnits(value, UnitTypeId.Meters) for value in ori_value]
    return float(UnitUtils.ConvertFromInternalUnits(ori_value, UnitTypeId.Meters))


def foot_to_meter(ori_value):
    if isinstance(ori_value, list):
        return [UnitUtils.ConvertToInternalUnits(value, UnitTypeId.Meters) for value in ori_value]
    return float(UnitUtils.ConvertToInternalUnits(ori_value, UnitTypeId.Meters))


def doorspace(region, defual_doorwidth = 1.0):
    if abs(region[0]*region[2]) >= defual_doorwidth:
        return region
    else:
        region[2] = 0
        return region

###############################################################
# Current doc/app/ui
###############################################################
doc = DocumentManager.Instance.CurrentDBDocument

###############################################################
# Prepare the input
###############################################################
storey_zone_space_levels_list = IN[0]
storey_level_list, zone_level_list, space_level_list = storey_zone_space_levels_list

storey_zone_levels_list = [storey_level_list, zone_level_list]
storey_zone_levels_list = [x for xs in storey_zone_levels_list for x in xs]
gx, gy, gz, [x1, y1], [x2, y2], [x3, y3], [x4, y4] = storey_zone_levels_list

###############################################################
# Record file into a .txt
###############################################################
# Get the current file path
saveDir = getFileDirectory()

stdout_original = sys.stdout
stdout_file = open(saveDir+"log\log05.txt", 'w')
sys.stdout = stdout_file

###############################################################
# Transaction in Revit
###############################################################
TransactionManager.Instance.EnsureInTransaction(doc)

#--------------------------------------------------------------
#------------------ OK NOW YOU CAN CODE -----------------------
#--------------------------------------------------------------
# regions: global dimension, region reference, halfregions
regions = [[gy, y1 / gy - 1, y1 / gy],
           [gx, (x1 + x2) / gx - 1, 0.5 * (x2 - x1) / gx],
           [gy, (y2 + y3) / gy - 1, 0.5 * (y1 - y3) / gy],
           [gx, x3 / gx - 1, x3 / gx]]

defual_doorwidth = 1.0

extdoors_slider_bdry = []
for region in regions:
    region_temp = doorspace(region,defual_doorwidth)
    if region_temp[2] != 0:
        extdoors_slider_bdry.append(
            [region_temp[1]- 0.50 * region_temp[2], region_temp[1] + 0.50 * region_temp[2]])
    else:
        extdoors_slider_bdry.append([])

#--------------------------------------------------------------
#------------------ OK NOW END THE CODE -----------------------
#--------------------------------------------------------------
TransactionManager.Instance.TransactionTaskDone()

# Close and save the recording file
sys.stdout = stdout_original
stdout_file.close()

###############################################################
# Prepare the output 
###############################################################
OUT = extdoors_slider_bdry
# ----------------------------------------
n110_createOpenings = Python(IN[0]=n108_creategeo, IN[1]=exterior_window_slider, IN[2]=exterior_window_height, IN[3]=interior_door_slider, IN[4]=n109_exitReferences)  # "110_createOpenings"; IronPython2
# ---------- n110_createOpenings.python (362 lines) ----------
###############################################################
# Load the Libraries
###############################################################
# general libraries
import clr
import sys
import math
import System

# identify the pathway
import io
import os
localapp = os.getenv(r'LOCALAPPDATA')
sys.path.append(os.path.join(localapp, r'python-3.8.3-embed-amd64\Lib\site-packages'))

# plotting
#import pandas as pd
#import numpy as np
#import matplotlib.pyplot as plt
#import matplotlib as mpl
#from matplotlib import cm
#from matplotlib.ticker import MultipleLocator, FormatStrFormatter, MaxNLocator
#mpl.rcParams['text.usetex'] = True
#from mpl_toolkits.axes_grid1.inset_locator import inset_axes, zoomed_inset_axes
#from mpl_toolkits.axes_grid1.anchored_artists import AnchoredSizeBar
#import scipy.stats as ss
#from scipy.stats import norm

# dynamo/revit-related libraries
clr.AddReference('DynamoRevitDS')
import Dynamo 
from System import Array
from System.Collections.Generic import *
clr.AddReference("RevitNodes")
import Revit
clr.ImportExtensions(Revit.Elements)
clr.ImportExtensions(Revit.GeometryConversion)
clr.AddReference("RevitServices")
import RevitServices
from RevitServices.Persistence import DocumentManager 
from RevitServices.Transactions import TransactionManager 
clr.AddReference("RevitAPI")
clr.AddReference('ProtoGeometry')
import Autodesk 
from Autodesk.DesignScript.Geometry import *
from Autodesk.DesignScript import *
from Autodesk.Revit.DB import *
from Autodesk.Revit.DB import Parameter
from Autodesk.Revit.DB.Architecture import *
from Autodesk.Revit.DB import IFailuresPreprocessor

from Revit import GeometryConversion as gc
from itertools import combinations

###############################################################
# Customize functions
###############################################################

"""
Extract the directory of the dyn.
"""


def getFileDirectory(filename=" "):
    dynscriptpath = Dynamo.Applications.DynamoRevit(
    ).RevitDynamoModel.CurrentWorkspace.FileName
    pathelement = dynscriptpath.split("\\")[:-1]
    folderpath = ""
    for i in pathelement:
        folderpath += (i + "\\")
    if filename != " ":
        folderpath += (filename)
    return folderpath


"""
Clear the model
"""


def clear_door_window(bool_value):
    doc.Regenerate()
    if bool_value:
        del_door = FilteredElementCollector(doc).OfCategory(
            BuiltInCategory.OST_Doors).WhereElementIsNotElementType().ToElements()
        del_window = FilteredElementCollector(doc).OfCategory(
            BuiltInCategory.OST_Windows).WhereElementIsNotElementType().ToElements()
        for element_d in del_door:
            doc.Delete(element_d.Id)
        for element_w in del_window:
            doc.Delete(element_w.Id)

"""
Units displayed/assigned in Dynamo are feet. 1meter = 3.28084 foot
meter_to_foot: Converts a value from Revit's internal units to a given display unit.
foot_to_meter: Converts a value from a given display unit to Revit's internal units.
"""


def meter_to_foot(ori_value):
    if isinstance(ori_value, list):
        return [UnitUtils.ConvertFromInternalUnits(value, UnitTypeId.Meters) for value in ori_value]
    return float(UnitUtils.ConvertFromInternalUnits(ori_value, UnitTypeId.Meters))


def foot_to_meter(ori_value):
    if isinstance(ori_value, list):
        return [UnitUtils.ConvertToInternalUnits(value, UnitTypeId.Meters) for value in ori_value]
    return float(UnitUtils.ConvertToInternalUnits(ori_value, UnitTypeId.Meters))


"""
CustomizedWall -> CustomizedDoor
"""


class CustomizedDoor:
    def __init__(self, doc, doortype, masterwall, zonelevel, adj=0.0):
        self.type = UnwrapElement(doortype)
        self.wall = masterwall
        self.level = UnwrapElement(zonelevel)
        self.width = meter_to_foot(self.type.LookupParameter("Width").AsDouble())

        # adjust = 0 : in the middle of the wall; adjust = -1.0: at the start place of the wall; adjust = 1.0: at the end place of the wall (-----x/y+++++|)
        ww_sta = masterwall.Location.Curve.GetEndPoint(0)
        ww_end = masterwall.Location.Curve.GetEndPoint(1)
        adj_x = abs(ww_sta.X - ww_end.X - self.width)/2
        adj_y = abs(ww_sta.Y - ww_end.Y - self.width)/2
        # adj_x = (adj_x - self.width) if adj_x>self.width else 0
        # adj_y = (adj_y - self.width) if adj_y>self.width else 0

        self.loc_x = (ww_sta.X + ww_end.X)/2 + adj*adj_x
        self.loc_y = (ww_sta.Y + ww_end.Y)/2 + adj*adj_y
        self.loc = Autodesk.Revit.DB.XYZ(
            self.loc_x, self.loc_y, foot_to_meter(self.level.Elevation))
        self.oo = doc.Create.NewFamilyInstance(
            self.loc, self.type, masterwall, self.level, Autodesk.Revit.DB.Structure.StructuralType.NonStructural)

        # this doesnot work but why?
        #ww_sta = masterwall.Location.Curve.ToProtoType().StartPoint
        #ww_end = masterwall.Location.Curve.ToProtoType().EndPoint
        # this doesnot work but why?


"""
CustomizedWall -> CustomizedWindow
"""


class CustomizedWindow:
    def __init__(self, doc, windowtype, masterwall, zonelevel, adj=0.0, height=2.5):
        self.type = UnwrapElement(windowtype)
        self.wall = masterwall
        self.level = UnwrapElement(zonelevel)
        self.width = meter_to_foot(self.type.LookupParameter("Rough Width").AsDouble())
        
        ww_sta = masterwall.Location.Curve.GetEndPoint(0)
        ww_end = masterwall.Location.Curve.GetEndPoint(1)
        adj_x = abs(ww_sta.X - ww_end.X - self.width)/2 
        adj_y = abs(ww_sta.Y - ww_end.Y - self.width)/2
        # adj_x = (adj_x - self.width) if adj_x>self.width else 0
        # adj_y = (adj_y - self.width) if adj_y>self.width else 0

        self.loc_x = (ww_sta.X + ww_end.X)/2 + adj*adj_x
        self.loc_y = (ww_sta.Y + ww_end.Y)/2 + adj*adj_y
        self.loc = Autodesk.Revit.DB.XYZ(
            self.loc_x, self.loc_y, foot_to_meter(self.level.Elevation)+foot_to_meter(height))
        self.oo = doc.Create.NewFamilyInstance(
            self.loc, self.type, masterwall, self.level, Autodesk.Revit.DB.Structure.StructuralType.NonStructural)


"""
Flip an object horizontally ...
"""
def FlipObject(item):
    if hasattr(item, "Flip"):
        print "yes"
        try:
            item.Flip()
            return True
        except: return False
    else:
        print "no"
        return False


"""
Flatten a list
"""


def flatten(xss):
    return [x for xs in xss for x in xs]


"""
Flap the openings in a wall
"""


def flapOpeningsInWall(w_flipped):
    openings_flipped = []
    if hasattr(w_flipped,"FindInserts"):
        openings_toflip = [w_flipped.Document.GetElement(x) for x in w_flipped.FindInserts(True,False,False,False)]
        openings_flipped = [op.flipFacing() for op in openings_toflip]
    return  openings_flipped

###############################################################
# Current doc/app/ui
###############################################################
doc = DocumentManager.Instance.CurrentDBDocument

###############################################################
# Prepare the input
###############################################################
dataflow = UnwrapElement(IN[0])
OUT_createReferences,OUT_setMaterial,OUT_createGeo = dataflow

glob_ref,glob_grids,rm_seps_cord_relative,rm_seps_cord,rm_zones_cord,rm_zones_grids,rm_zones_pts = OUT_createReferences
floor_type, roof_type, int_wall_type, ext_wall_type, window_type, int_door_type, ext_door_type = OUT_setMaterial
wall_flippers,wall_exterior,wall_interior,wall_interior_rm_cr,wall_interior_rm_rm,building_floor,building_roof,room_zones = OUT_createGeo
wall_exterior_flippers, wall_interior_flippers = wall_flippers

windows_indices = IN[1]
window_height = IN[2]
int_door_slider = IN[3]
extdoors_slider_bdry = IN[4]

###############################################################
# Record file into a .txt
###############################################################
# Get the current file path
saveDir = getFileDirectory()

stdout_original = sys.stdout
stdout_file = open(saveDir+"log\log07.txt", 'w')
sys.stdout = stdout_file

###############################################################
# Transaction in Revit
###############################################################
TransactionManager.Instance.EnsureInTransaction(doc)

clear_door_window(True)

collector = FilteredElementCollector(doc)
levels = collector.OfClass(Level).ToElements()

#--------------------------------------------------------------
#------------------ OK NOW YOU CAN CODE -----------------------
#--------------------------------------------------------------
glob_centerpt  = Autodesk.Revit.DB.Point.Create(XYZ(foot_to_meter(glob_ref[0]/2), foot_to_meter(glob_ref[1]/2),foot_to_meter(levels[0].Elevation))).ToProtoType()

# Create exterior doors
# ********** to improve according to rooms' locations **********
exterior_doors = []
for ii in range(len(wall_exterior)):
    if (extdoors_slider_bdry[ii]):
        # add a parameter here, considering the width of the door for chosed door type
        out_door_slider = (extdoors_slider_bdry[ii][0] + extdoors_slider_bdry[ii][1])/2
        exterior_doors.append(CustomizedDoor(doc,ext_door_type,wall_exterior[ii].ww,levels[0],out_door_slider))

# Create interior doors
interior_doors = []
val_tol = 0.001

for jj in range(len(room_zones)):
    room_zone = room_zones[jj]
    seps_list_ori = list(rm_seps_cord_relative[jj])
    zone_doors = []

    # doors in sep_wall
    for sw in room_zone.sep_walls:
        sep_walls_door = CustomizedDoor(doc,int_door_type,sw.ww,room_zone.level_b,0.0+int_door_slider)
        zone_doors.append(sep_walls_door)

    # doors in zone_wall
    for ii in range(len(room_zone.all_walls_inzone)):
        rw = room_zone.all_walls_inzone[ii]
        ww_sta = rw.ww.Location.Curve.GetEndPoint(0)
        ww_end = rw.ww.Location.Curve.GetEndPoint(1)
        if abs(ww_sta.X - ww_end.X) < val_tol:
            # skip the separation walls
            continue
        else:
            # for each zone (corridor-room) wall
            # add the starting coordination
            seps_list_ori.append(0.0)

            # add the finishing coordination
            seps_list_ori.append(meter_to_foot(abs(ww_sta.X - ww_end.X)))
            seps_list_ori.sort()

            # initialize the separation index list 
            seps_list = []
            for ss in range(len(seps_list_ori)-1):
                seps_list.append((seps_list_ori[ss+1]+seps_list_ori[ss])/2+int_door_slider*(seps_list_ori[ss+1]-seps_list_ori[ss])/2)
            for sep in seps_list:
                sep_index = -1 + 2*sep/(meter_to_foot(abs(ww_sta.X - ww_end.X)))
                zone_walls_door = CustomizedDoor(doc,int_door_type,rw.ww,room_zone.level_b,sep_index)
                zone_doors.append(zone_walls_door)
    interior_doors.append(zone_doors)

# # Create exterior windows
exterior_windows = []
# for jj in range(len(wall_exterior)):
#     ew = wall_exterior[jj].ww
#     for window_index in windows_indices[jj]:
#         exterior_window = CustomizedWindow(doc,window_type,ew,room_zone.level_b,window_index,window_height)
#         exterior_windows.append(exterior_window)

# Correct the orientations of exterior_doors&windows and interior doors&windows
for ii in range(len(wall_exterior_flippers)):
    flipper = wall_exterior_flippers[ii]
    if (flipper[1] == "True"):
        flapOpeningsInWall(flipper[0])
    else:
        continue

for ii in range(len(wall_interior_flippers)):
    flipper = wall_interior_flippers[ii]
    if (flipper[1] == "True"):
        flapOpeningsInWall(flipper[0])
    else:
        continue

doc.Regenerate()

#--------------------------------------------------------------
#------------------ OK NOW END THE CODE -----------------------
#--------------------------------------------------------------
TransactionManager.Instance.TransactionTaskDone()

# Close and save the recording file
sys.stdout = stdout_original
stdout_file.close()

###############################################################
# Prepare the output 
###############################################################
OUT_createOpenings = [exterior_doors, interior_doors, exterior_windows]
OUT = [OUT_createReferences,OUT_setMaterial,OUT_createGeo,OUT_createOpenings]

#   - - - - - - - - - - OUT - - - - - - - - - -

#   OUT[0]
#   OUT_createReferences
#   glob_ref,glob_grids,rm_seps_cord_relative,rm_seps_cord,rm_zones_cord,rm_zones_grids,rm_zones_pts

#   OUT[1]
#   OUT_setMaterial
#   floor_type, roof_type, int_wall_type, ext_wall_type, window_type, int_door_type, ext_door_type

#   OUT[2]
#   OUT_createGeo
#   wall_flippers,wall_exterior,wall_interior,wall_interior_rm_cr,wall_interior_rm_rm,building_floor,building_roof,room_zones

#   OUT[3]
#   OUT_createOpenings 
#   exterior_doors, interior_doors, exterior_windows

#   - - - - - - - - - - - - - - - - - - - - -
# ----------------------------------------
# group: Process - D : Divide Spaces
n111_createSeparators = Python(IN[0]=n110_createOpenings)  # "111_createSeparators"; IronPython2
# ---------- n111_createSeparators.python (428 lines) ----------
###############################################################
# Load the Libraries
###############################################################
# general libraries
import clr
import sys
import math
import System

# identify the pathway
import io
import os
localapp = os.getenv(r'LOCALAPPDATA')
sys.path.append(os.path.join(localapp, r'python-3.8.3-embed-amd64\Lib\site-packages'))

# plotting
#import pandas as pd
#import numpy as np
#import matplotlib.pyplot as plt
#import matplotlib as mpl
#from matplotlib import cm
#from matplotlib.ticker import MultipleLocator, FormatStrFormatter, MaxNLocator
#mpl.rcParams['text.usetex'] = True
#from mpl_toolkits.axes_grid1.inset_locator import inset_axes, zoomed_inset_axes
#from mpl_toolkits.axes_grid1.anchored_artists import AnchoredSizeBar
#import scipy.stats as ss
#from scipy.stats import norm

# dynamo/revit-related libraries
clr.AddReference('DynamoRevitDS')
import Dynamo 
from System import Array
from System.Collections.Generic import *
clr.AddReference("RevitNodes")
import Revit
clr.ImportExtensions(Revit.Elements)
clr.ImportExtensions(Revit.GeometryConversion)
clr.AddReference("RevitServices")
import RevitServices
from RevitServices.Persistence import DocumentManager 
from RevitServices.Transactions import TransactionManager 
clr.AddReference("RevitAPI")
clr.AddReference('ProtoGeometry')
import Autodesk 
from Autodesk.DesignScript.Geometry import *
from Autodesk.DesignScript import *
from Autodesk.Revit.DB import *
from Autodesk.Revit.DB import Parameter
from Autodesk.Revit.DB.Architecture import *
from Autodesk.Revit.DB import IFailuresPreprocessor


###############################################################
# Customize functions
###############################################################

"""
Extract the directory of the dyn.
"""


def getFileDirectory(filename=" "):
    dynscriptpath = Dynamo.Applications.DynamoRevit(
    ).RevitDynamoModel.CurrentWorkspace.FileName
    pathelement = dynscriptpath.split("\\")[:-1]
    folderpath = ""
    for i in pathelement:
        folderpath += (i + "\\")
    if filename != " ":
        folderpath += (filename)
    return folderpath


"""
Units displayed/assigned in Dynamo are feet. 1meter = 3.28084 foot
meter_to_foot: Converts a value from Revit's internal units to a given display unit.
foot_to_meter: Converts a value from a given display unit to Revit's internal units.
"""


def meter_to_foot(ori_value):
    if isinstance(ori_value, list):
        return [UnitUtils.ConvertFromInternalUnits(value, UnitTypeId.Meters) for value in ori_value]
    return float(UnitUtils.ConvertFromInternalUnits(ori_value, UnitTypeId.Meters))


def foot_to_meter(ori_value):
    if isinstance(ori_value, list):
        return [UnitUtils.ConvertToInternalUnits(value, UnitTypeId.Meters) for value in ori_value]
    return float(UnitUtils.ConvertToInternalUnits(ori_value, UnitTypeId.Meters))


"""
find the intersection point from two lines
"""


def intersectionPointOfLines(line_1, line_2):
    def det(a, b):
        return a[0] * b[1] - a[1] * b[0]

    line1 = [[line_1.StartPoint.X, line_1.StartPoint.Y], [
        line_1.EndPoint.X, line_1.EndPoint.Y]]
    line2 = [[line_2.StartPoint.X, line_2.StartPoint.Y], [
        line_2.EndPoint.X, line_2.EndPoint.Y]]
    xdiff = [line1[0][0] - line1[1][0], line2[0][0] - line2[1][0]]
    ydiff = [line1[0][1] - line1[1][1], line2[0][1] - line2[1][1]]
    div = det(xdiff, ydiff)

    if (bool(line_1.Intersect(line_2))):
        case = 0
        pt_intersection = line_1.Intersect(line_2)[0]
        if line_1.StartPoint.IsAlmostEqualTo(line_2.StartPoint) or line_1.StartPoint.IsAlmostEqualTo(line_2.EndPoint) or line_1.EndPoint.IsAlmostEqualTo(line_2.StartPoint) or line_1.EndPoint.IsAlmostEqualTo(line_2.EndPoint):
            mutual_inter = False
        else:
            mutual_inter = True
    else:
        pt_intersection = None
        mutual_inter = False
        if abs(div) < 0.0001:
            case = 1
        else:
            case = 2
    return case,pt_intersection,mutual_inter


"""
Creat XYZ from a startpoint and a endpoint
"""


def XYZfromPoints(startpoint,endpoint):
    
    delta_x = endpoint.X - startpoint.X 
    delta_y = endpoint.Y - startpoint.Y 
    delta_z = endpoint.Z - startpoint.Z 
    return XYZ(delta_x,delta_y,delta_z)


"""
find the intersection point from two lines
"""


def intersectionPointsOfWalls(wall_1, wall_2):
    innerPoint,outerPoint = [], []
    wallWidth_1, wallWidth_2 = wall_1.Width, wall_2.Width
    wallline_1, wallline_2 = wall_1.Location.Curve.ToProtoType(True), wall_2.Location.Curve.ToProtoType(True)

    wallline_1_pt1, wallline_1_pt2 = wallline_1.StartPoint, wallline_1.EndPoint
    wallline_2_pt1, wallline_2_pt2 = wallline_2.StartPoint, wallline_2.EndPoint
    res_walllines = intersectionPointOfLines(wallline_1,wallline_2)

    if res_walllines[0] == 0 and res_walllines[2] == False:
        wallline_1_vec = XYZfromPoints(wallline_1_pt1, wallline_1_pt2) if wallline_1_pt1.IsAlmostEqualTo(res_walllines[1]) else XYZfromPoints(wallline_1_pt2,wallline_1_pt1)
        wallline_2_vec = XYZfromPoints(wallline_2_pt1, wallline_2_pt2) if wallline_2_pt1.IsAlmostEqualTo(res_walllines[1]) else XYZfromPoints(wallline_2_pt2,wallline_2_pt1)
        wallline_1_vec_unit, wallline_2_vec_unit = wallline_1_vec.Divide(wallline_1_vec.GetLength()), wallline_2_vec.Divide(wallline_2_vec.GetLength())
        innerPoint = res_walllines[1].ToRevitType() + wallline_1_vec_unit*wallWidth_1/2 + wallline_2_vec_unit*wallWidth_2/2
        outerPoint = res_walllines[1].ToRevitType() - wallline_1_vec_unit*wallWidth_1/2 - wallline_2_vec_unit*wallWidth_2/2
    # TOO ADD
    # if res_walllines[0] == 0 and res_walllines[2] == True:
    # wall intersect and non continuously connected
    return innerPoint.ToPoint(),outerPoint.ToPoint()


"""
Get an element by value 
"""


def getElementByValue(doc,v):
    # if value is ElementId or Reference object
    if isinstance(v, (ElementId, Reference)):
        return doc.GetElement(v)
    # if value is a integer
    elif isinstance(v, (int, Int16, Int32, Int64)):
        return doc.GetElement(ElementId(v))
    # if value is a String 'integer'
    elif isinstance(v, (str, String)) and str(v).isdigit():
        return doc.GetElement(ElementId(int(v)))
    # if value is a String Unique Id
    elif isinstance(v, (str, String)) and '-' in str(v):
        return doc.GetElement(v)


"""
Get the phase of selected elements
*  *  *  needs to improve  *  *  * 
"""


def getPhases(item):
    if hasattr(item, "CreatedPhaseId"):
        print "01"
        #return item.Document.GetElement(item.CreatedPhaseId), item.Document.GetElement(item.DemolishedPhaseId)
        return item.Document.GetElement(item.CreatedPhaseId)
    else:
        print "00"
        return None


###############################################################
# Current doc/app/ui
###############################################################
doc = DocumentManager.Instance.CurrentDBDocument

###############################################################
# Prepare the input
###############################################################
dataflow = UnwrapElement(IN[0])
OUT_createReferences,OUT_setMaterial,OUT_createGeo,OUT_createOpenings = dataflow

glob_ref,glob_grids,rm_seps_cord_relative,rm_seps_cord,rm_zones_cord,rm_zones_grids,rm_zones_pts = OUT_createReferences
floor_type, roof_type, int_wall_type, ext_wall_type, window_type, int_door_type, ext_door_type = OUT_setMaterial
wall_exterior_flippers,wall_exterior,wall_interior,wall_interior_rm_cr,wall_interior_rm_rm,building_floor,building_roof,room_zones = OUT_createGeo
exterior_doors, interior_doors, exterior_windows = OUT_createOpenings

glob_dim_x, glob_dim_y = glob_ref[0], glob_ref[1]

###############################################################
# Record file into a .txt
###############################################################
# Get the current file path
saveDir = getFileDirectory()

stdout_original = sys.stdout
stdout_file = open(saveDir+"log\log08.txt", 'w')
sys.stdout = stdout_file

###############################################################
# Transaction in Revit
###############################################################
TransactionManager.Instance.EnsureInTransaction(doc)

OUT = []

collector = FilteredElementCollector(doc)
levels = collector.OfClass(Level).ToElements()

#--------------------------------------------------------------
#------------------ OK NOW YOU CAN CODE -----------------------
#--------------------------------------------------------------
w_ext = []
w_zne = []

for w in wall_exterior:
    w_ext.append(w.ww)

for room_zone in room_zones:
    w_zne_0 = []
    for w in room_zone.zone_walls:
        w_zne_0.append(w.ww)
    w_zne.append(w_zne_0)

# Select all the exterior walls (that are not connected yet) to be intersected for each zone
w_ext_tempo_all = []

# Select all the zone walls (that are not connected yet) to be intersected for each zone
w_zne_tempo_all = []

# Select the zone point to start with
w_zne_pt_all = []

# Selection process
for jj in range(len(room_zones)):
    w_ext_tempo = [x for x in w_ext]
    #print "\n start a new zone", len(w_ext_tempo)
    w_zne_tempo = [x for sublist in w_zne for x in sublist]
    #print "\n start a new zone", len(w_zne_tempo)
    w_z = w_zne[jj]
    #Select the intersection points of the walls
    res_zz = intersectionPointsOfWalls(w_z[0],w_z[1])
    #Select the intersection points of the walls - the outer point
    w_zne_pt_all.append(res_zz[1])

    for we in w_ext:
        res_z_e_0 = intersectionPointOfLines(w_z[0].Location.Curve.ToProtoType(True), we.Location.Curve.ToProtoType(True))
        res_z_e_1 = intersectionPointOfLines(w_z[1].Location.Curve.ToProtoType(True), we.Location.Curve.ToProtoType(True))
        if res_z_e_0[0] == 0 or res_z_e_1[0] == 0:
            #print "\n in this zone", "interaction yes"
            w_ext_tempo.remove(we)
        else:
            #print "\n in this zone", "interaction no"
            continue
    w_ext_tempo_all.append(w_ext_tempo)

    w_zne_tempo.remove(w_z[0])
    w_zne_tempo.remove(w_z[1])
    w_zne_tempo_all.append(w_zne_tempo)

# Intersection Process
pts_ll_int_all=[]
for jj in range(len(room_zones)):
    pt = w_zne_pt_all[jj]
    w_to_intersect = w_ext_tempo_all[jj]+w_zne_tempo_all[jj]
    pt_l_x = Autodesk.Revit.DB.Line.CreateBound(Autodesk.Revit.DB.XYZ(
        foot_to_meter(0), foot_to_meter(pt.Y), foot_to_meter(pt.Z)), Autodesk.Revit.DB.XYZ(
        foot_to_meter(glob_dim_x), foot_to_meter(pt.Y), foot_to_meter(pt.Z))).ToProtoType(True)
    pt_l_y = Autodesk.Revit.DB.Line.CreateBound(Autodesk.Revit.DB.XYZ(
        foot_to_meter(pt.X), foot_to_meter(0), foot_to_meter(pt.Z)), Autodesk.Revit.DB.XYZ(
        foot_to_meter(pt.X), foot_to_meter(glob_dim_y), foot_to_meter(pt.Z))).ToProtoType(True)
    pt_ll = [pt_l_x, pt_l_y]

    pts_ll_int = []
    
    # for each intersecting line (the 1st in the X, and the 2nd in the Y direction)
    for pt_l in pt_ll:
        pts_l_int = []
        for w in w_to_intersect:
            ## Raw Option: find the intersection point at the middle line of wall
            #res_intersect = intersectionPointOfLines(
            #    pt_l, w.Location.Curve.ToProtoType(True))
            
            res_intersect = intersectionPointOfLines(
                pt_l, w.Location.Curve.ToProtoType(True))
            if (res_intersect[1] != None) and (res_intersect[2] == True):
                if pts_l_int == [] or (pt.DistanceTo(res_intersect[1]) <= pt.DistanceTo(pts_l_int)):
                    line_vec = XYZfromPoints(res_intersect[1], pt)
                    line_vec_unit = line_vec.Divide(line_vec.GetLength())
                    # New Option: find the intersection point at the closer-side line of wall
                    pts_l_int = res_intersect[1].ToRevitType() + line_vec_unit*w.Width/2
                    pts_l_int = pts_l_int.ToPoint()
                else:
                    continue
            else:
                continue
        pts_ll_int.append(pts_l_int)
    pts_ll_int = [pts_ll_int[0] if pt.DistanceTo(pts_ll_int[0]) <= pt.DistanceTo(pts_ll_int[1]) else pts_ll_int[1]] 
    pts_ll_int_all.append(pts_ll_int[0])

# Create separation lines for NewRoomBoundaries
sep_bounds = []
for (w_zne_pt, pt_int) in zip(w_zne_pt_all,pts_ll_int_all):
    w_zne_pt_xyz = UnwrapElement(w_zne_pt).ToRevitType()
    pt_int_xyz = UnwrapElement(pt_int).ToRevitType()
    sep_l = Autodesk.Revit.DB.Line.CreateBound(w_zne_pt_xyz,pt_int_xyz)
    sep_bounds.append(sep_l.ToProtoType())

# Extract Floor level 
elem_floor = FilteredElementCollector(doc).OfCategory(BuiltInCategory.OST_Floors).WhereElementIsNotElementType().ToElements()
floor_level = getElementByValue(doc,elem_floor[0].LevelId)

# Build sketchplane of the floor level
plane_vector = Vector.ByCoordinates(0.0,0.0,1.0)
facePlane = Plane.CreateByNormalAndOrigin(plane_vector.ToRevitType(),XYZ(0,0,floor_level.Elevation))
sketchPlane = SketchPlane.Create(doc, facePlane)

# Collect floorplan views
viewTypes = FilteredElementCollector(doc).OfClass(ViewFamilyType)
for i in viewTypes:
    if i.ViewFamily == ViewFamily.FloorPlan:
        viewTypeId = i.Id
        break
    else:
        continue

existingPlans = FilteredElementCollector(doc).OfClass(View).ToElements()
existingPlanNames, existingPlanElements = [], []
targetPlanView = []
for i in existingPlans:
    if not i.IsTemplate:
        if i.ViewType == ViewType.FloorPlan:
            existingPlanNames.append(i.ToDSType(True).Name)
            existingPlanElements.append(i)
            if i.ToDSType(True).Name == "Level0":
                targetPlanView = i
            else:
                continue 
doc.Regenerate()

# Delete previous created RoomBoundaryLines
del_sep_bounds = FilteredElementCollector(doc).OfCategory(
            BuiltInCategory.OST_RoomSeparationLines).WhereElementIsNotElementType().ToElements()
for bound in del_sep_bounds:
    doc.Delete(bound.Id)

# Collect separation lines as "curvearray"
#*  *  *  needs to improve  *  *  * 
#*  *  delete duplicated ones  *  * 
curvearray = CurveArray()
sep_bounds_lines = [sep_bound.ToRevitType() for sep_bound in sep_bounds]
for line in sep_bounds_lines:
    curvearray.Append(line)

# Create Separators for rooms (spaces)
doc.Create.NewRoomBoundaryLines(sketchPlane, curvearray, targetPlanView)
doc.Regenerate()
sep_elements = FilteredElementCollector(doc).OfCategory(
            BuiltInCategory.OST_RoomSeparationLines).WhereElementIsNotElementType().ToElements()

#--------------------------------------------------------------
#------------------ OK NOW END THE CODE -----------------------
#--------------------------------------------------------------
TransactionManager.Instance.TransactionTaskDone()

# Close and save the recording file
sys.stdout = stdout_original
stdout_file.close()

###############################################################
# Prepare the output 
###############################################################
OUT_createSeparators = [sep_bounds,sketchPlane,targetPlanView,sep_elements]
OUT = [OUT_createReferences,OUT_setMaterial,OUT_createGeo,OUT_createOpenings,OUT_createSeparators]

#   - - - - - - - - - - OUT - - - - - - - - - -

#   OUT[0]
#   OUT_createReferences
#   glob_ref,glob_grids,rm_seps_cord_relative,rm_seps_cord,rm_zones_cord,rm_zones_grids,rm_zones_pts

#   OUT[1]
#   OUT_setMaterial
#   floor_type, roof_type, int_wall_type, ext_wall_type, window_type, int_door_type, ext_door_type

#   OUT[2]
#   OUT_createGeo
#   wall_flippers,wall_exterior,wall_interior,wall_interior_rm_cr,wall_interior_rm_rm,building_floor,building_roof,room_zones

#   OUT[3]
#   OUT_createOpenings 
#   exterior_doors, interior_doors, exterior_windows

#   OUT[4]
#   OUT_createSeparators 
#   sep_bounds,sketchPlane,targetPlanView,sep_elements

#   - - - - - - - - - - - - - - - - - - - - -
# ----------------------------------------
select_phase = RevitPhases("New Construction")
n112_placeSpaces = Python(IN[0]=n111_createSeparators, IN[1]=select_phase)  # "112_placeSpaces"; IronPython2
# ---------- n112_placeSpaces.python (295 lines) ----------
###############################################################
# Load the Libraries
###############################################################
# general libraries
import clr
import sys
import math
import System

# identify the pathway
import io
import os
localapp = os.getenv(r'LOCALAPPDATA')
sys.path.append(os.path.join(localapp, r'python-3.8.3-embed-amd64\Lib\site-packages'))

# plotting
#import pandas as pd
#import numpy as np
#import matplotlib.pyplot as plt
#import matplotlib as mpl
#from matplotlib import cm
#from matplotlib.ticker import MultipleLocator, FormatStrFormatter, MaxNLocator
#mpl.rcParams['text.usetex'] = True
#from mpl_toolkits.axes_grid1.inset_locator import inset_axes, zoomed_inset_axes
#from mpl_toolkits.axes_grid1.anchored_artists import AnchoredSizeBar
#import scipy.stats as ss
#from scipy.stats import norm

# dynamo/revit-related libraries
clr.AddReference('DynamoRevitDS')
import Dynamo 
from System import Array
from System.Collections.Generic import *
clr.AddReference("RevitNodes")
import Revit
clr.ImportExtensions(Revit.Elements)
clr.ImportExtensions(Revit.GeometryConversion)
clr.AddReference("RevitServices")
import RevitServices
from RevitServices.Persistence import DocumentManager 
from RevitServices.Transactions import TransactionManager 
clr.AddReference("RevitAPI")
clr.AddReference('ProtoGeometry')
import Autodesk 
from Autodesk.DesignScript.Geometry import *
from Autodesk.DesignScript import *
from Autodesk.Revit.DB import *
from Autodesk.Revit.DB import Parameter
from Autodesk.Revit.DB.Architecture import *
from Autodesk.Revit.DB import IFailuresPreprocessor


###############################################################
# Customize functions
###############################################################

"""
Extract the directory of the dyn.
"""


def getFileDirectory(filename=" "):
    dynscriptpath = Dynamo.Applications.DynamoRevit(
    ).RevitDynamoModel.CurrentWorkspace.FileName
    pathelement = dynscriptpath.split("\\")[:-1]
    folderpath = ""
    for i in pathelement:
        folderpath += (i + "\\")
    if filename != " ":
        folderpath += (filename)
    return folderpath


"""
Clear the model
"""


def clear_model(bool_value):
    doc.Regenerate()
    if bool_value:
        del_door = FilteredElementCollector(doc).OfCategory(
            BuiltInCategory.OST_Doors).WhereElementIsNotElementType().ToElements()
        del_floor = FilteredElementCollector(doc).OfCategory(
            BuiltInCategory.OST_Floors).WhereElementIsNotElementType().ToElements()
        del_wall = FilteredElementCollector(doc).OfCategory(
            BuiltInCategory.OST_Walls).WhereElementIsNotElementType().ToElements()
        del_roof = FilteredElementCollector(doc).OfCategory(
            BuiltInCategory.OST_Roofs).WhereElementIsNotElementType().ToElements()
        del_all = [del_door, del_floor, del_wall, del_roof]
        for element_type in del_all:
            for element in element_type:
                doc.Delete(element.Id)


"""
Units displayed/assigned in Dynamo are feet. 1meter = 3.28084 foot
meter_to_foot: Converts a value from Revit's internal units to a given display unit.
foot_to_meter: Converts a value from a given display unit to Revit's internal units.
"""


def meter_to_foot(ori_value):
    if isinstance(ori_value, list):
        return [UnitUtils.ConvertFromInternalUnits(value, UnitTypeId.Meters) for value in ori_value]
    return float(UnitUtils.ConvertFromInternalUnits(ori_value, UnitTypeId.Meters))


def foot_to_meter(ori_value):
    if isinstance(ori_value, list):
        return [UnitUtils.ConvertToInternalUnits(value, UnitTypeId.Meters) for value in ori_value]
    return float(UnitUtils.ConvertToInternalUnits(ori_value, UnitTypeId.Meters))


def ProcessList(_func, _list):
   return map( lambda x: ProcessList(_func, x) if type(x)==list else _func(x), _list )


"""
Flatten a list
"""


def flatten(xss):
    return [x for xs in xss for x in xs]


"""
Determine whether a line situates in a Revit built room
"""


def ifPointIncludedInZone(point,zone):
    zone_customizedwalls = zone.all_walls_inzone
    zone_walls = [item.ww for item in zone_customizedwalls]
    zone_walls_lines = [item.Location.Curve.ToProtoType(True) for item in zone_walls]
    pt_x, pt_y = [], []
    for ll in zone_walls_lines:
        pt_x.append(ll.StartPoint.X)
        pt_x.append(ll.EndPoint.X)
        pt_y.append(ll.StartPoint.Y)
        pt_y.append(ll.EndPoint.Y)
    pt_x_zone, pt_y_zone = (min(pt_x),max(pt_x)), (min(pt_y),max(pt_y))
    if pt_x_zone[0] <= meter_to_foot(point.X) <= pt_x_zone[1] and pt_y_zone[0] <= meter_to_foot(point.Y) <= pt_y_zone[1]:
        return True
    else:
        return False


###############################################################
# Current doc/app/ui
###############################################################
doc = DocumentManager.Instance.CurrentDBDocument

###############################################################
# Prepare the input
###############################################################
dataflow = UnwrapElement(IN[0])
OUT_createReferences,OUT_setMaterial,OUT_createGeo,OUT_createOpenings,OUT_createSeparators= dataflow

glob_ref,glob_grids,rm_seps_cord_relative,rm_seps_cord,rm_zones_cord,rm_zones_grids,rm_zones_pts = OUT_createReferences
floor_type, roof_type, int_wall_type, ext_wall_type, window_type, int_door_type, ext_door_type = OUT_setMaterial
wall_exterior_flippers,wall_exterior,wall_interior,wall_interior_rm_cr,wall_interior_rm_rm,building_floor,building_roof,room_zones = OUT_createGeo
exterior_doors, interior_doors, exterior_windows = OUT_createOpenings
sep_bounds,sketchPlane,targetPlanView,sep_elements = OUT_createSeparators

phase = UnwrapElement(IN[1])

###############################################################
# Record file into a .txt
###############################################################
# Get the current file path
saveDir = getFileDirectory()

stdout_original = sys.stdout
stdout_file = open(saveDir+"log\log09.txt", 'w')
sys.stdout = stdout_file

###############################################################
# Transaction in Revit
###############################################################
TransactionManager.Instance.EnsureInTransaction(doc)

collector = FilteredElementCollector(doc)
levels = collector.OfClass(Level).ToElements()

#--------------------------------------------------------------
#------------------ OK NOW YOU CAN CODE -----------------------
#--------------------------------------------------------------
room_as_spaces = []

# To improve the initialization of room creation
for j,level in enumerate(levels):
    try:
        planTopology = doc.get_PlanTopology(level)
        rooms = []
        
        for i,plancircuit in enumerate(planTopology.Circuits):
            if plancircuit.IsRoomLocated == True:
                continue
            TransactionManager.Instance.EnsureInTransaction(doc)
            room = doc.Create.NewRoom(phase)
            room.Name = "Name" + str(i)
            room.Number = str(j) + "." + str(i+1)
            room.LimitOffset = levels[1].Elevation-levels[0].Elevation

            try:
                room2 = doc.Create.NewRoom(room,plancircuit)
            except:
                continue

            TransactionManager.Instance.TransactionTaskDone()
            rooms.append(room2)
        room_as_spaces.append(rooms)
    except:
        continue
room_as_spaces = flatten(room_as_spaces)

# Classify the spaces
nb_room, nb_corridor = 1,1
space_of_rooms, space_of_corridors = [],[]

for jj in range(len(room_as_spaces)):
    print "jj=", jj
    criteria = False
    for zz in range(len(room_zones)):
        if ifPointIncludedInZone(room_as_spaces[jj].Location.Point,room_zones[zz]):
            criteria = True
            break
        else:
            continue
    if criteria:
    #    print "room +1"
        room_as_spaces[jj].Name = "Room" + str(nb_room) 
        nb_room+=1
        space_of_rooms.append(room_as_spaces[jj])
    else:
    #    print "corridor +1"
        room_as_spaces[jj].Name = "Corridor" + str(nb_corridor)
        nb_corridor+=1
        space_of_corridors.append(room_as_spaces[jj])
doc.Regenerate()

# Visualized the bounding boxed of two types of spaces
bbx_space_of_rooms, bbx_space_of_corridors = [],[]
bbx_space_of_rooms = [sp.ClosedShell.GetBoundingBox().ToProtoType() for sp in space_of_rooms]
bbx_space_of_corridors = [sp.ClosedShell.GetBoundingBox().ToProtoType() for sp in space_of_corridors]

#--------------------------------------------------------------
#------------------ OK NOW END THE CODE -----------------------
#--------------------------------------------------------------
TransactionManager.Instance.TransactionTaskDone()

# Close and save the recording file
sys.stdout = stdout_original
stdout_file.close()

###############################################################
# Prepare the output 
###############################################################
OUT_placeSpaces = [space_of_rooms, space_of_corridors, bbx_space_of_rooms, bbx_space_of_corridors]
OUT = [OUT_createReferences,OUT_setMaterial,OUT_createGeo,OUT_createOpenings,OUT_createSeparators,OUT_placeSpaces]

#   - - - - - - - - - - OUT - - - - - - - - - -

#   OUT[0]
#   OUT_createReferences
#   glob_ref,glob_grids,rm_seps_cord_relative,rm_seps_cord,rm_zones_cord,rm_zones_grids,rm_zones_pts

#   OUT[1]
#   OUT_setMaterial
#   floor_type, roof_type, int_wall_type, ext_wall_type, window_type, int_door_type, ext_door_type

#   OUT[2]
#   OUT_createGeo
#   wall_flippers,wall_exterior,wall_interior,wall_interior_rm_cr,wall_interior_rm_rm,building_floor,building_roof,room_zones

#   OUT[3]
#   OUT_createOpenings 
#   exterior_doors, interior_doors, exterior_windows

#   OUT[4]
#   OUT_createSeparators 
#   sep_bounds,sketchPlane,targetPlanView,sep_elements

#   OUT[5]
#   OUT_placeSpaces 
#   space_of_rooms, space_of_corridors, bbx_space_of_rooms, bbx_space_of_corridors

#   - - - - - - - - - - - - - - - - - - - - -

# ========================================================================================
# # Prob1 # #
# https://forum.dynamobim.com/t/how-to-get-the-elements-inside-a-boundingbox/5863/12
# ========================================================================================
# ----------------------------------------
code_block = CodeBlock(out=n112_placeSpaces)
# ---------- code_block.designscript (8 lines) ----------
out;
OUT_createReferences=out[0];
OUT_setMaterial=out[1];
OUT_createGeo=out[2];
OUT_createOpenings=out[3];
OUT_createSeparators=out[4];
OUT_placeSpaces=out[5];
proceed_trigger = "";
# ----------------------------------------

# group: Process - E1 : Export the input data
code_block_2 = CodeBlock(sem=n100_setMaterial, geo=n105_constraints2Spaces) { sem; geo; input = [sem, geo]; }
n113_extractInput = Python(IN[0]=modelNumber, IN[1]=code_block_2.input)  # "113_extractInput"; CPython3
# ---------- n113_extractInput.python (185 lines) ----------
###############################################################
# Load the Libraries
###############################################################
# general libraries
import clr
import sys
import math
import System

# identify the pathway
import io
import os
localapp = os.getenv(r'LOCALAPPDATA')
sys.path.append(os.path.join(localapp, r'python-3.8.3-embed-amd64\Lib\site-packages'))

# plotting
import pandas as pd
import numpy as np
import matplotlib.pyplot as plt
import matplotlib as mpl
from matplotlib import cm
from matplotlib.ticker import MultipleLocator, FormatStrFormatter, MaxNLocator
mpl.rcParams['text.usetex'] = True
from mpl_toolkits.axes_grid1.inset_locator import inset_axes, zoomed_inset_axes
from mpl_toolkits.axes_grid1.anchored_artists import AnchoredSizeBar
import scipy.stats as ss
from scipy.stats import norm
import ast 

# dynamo/revit-related libraries
clr.AddReference('DynamoRevitDS')
import Dynamo 
from System import Array
from System.Collections.Generic import *
clr.AddReference("RevitNodes")
import Revit
clr.ImportExtensions(Revit.Elements)
clr.ImportExtensions(Revit.GeometryConversion)
clr.AddReference("RevitServices")
import RevitServices
from RevitServices.Persistence import DocumentManager 
from RevitServices.Transactions import TransactionManager 
clr.AddReference("RevitAPI")
clr.AddReference('ProtoGeometry')
import Autodesk 
from Autodesk.DesignScript.Geometry import *
from Autodesk.DesignScript import *
from Autodesk.Revit.DB import *
from Autodesk.Revit.DB import Parameter
from Autodesk.Revit.DB.Architecture import *
from Autodesk.Revit.DB import IFailuresPreprocessor


###############################################################
# Customize functions
###############################################################


"""
Extract the directory of the dyn.
"""


def getFileDirectory(filename=" "):
    dynscriptpath = Dynamo.Applications.DynamoRevit(
    ).RevitDynamoModel.CurrentWorkspace.FileName
    pathelement = dynscriptpath.split("\\")[:-1]
    folderpath = ""
    for i in pathelement:
        folderpath += (i + "\\")
    if filename != " ":
        folderpath += (filename)
    return folderpath


"""
Extract the directory for input extraction
"""


def get_directory_extractinput(nr_model):
    dynscriptpath = Dynamo.Applications.DynamoRevit(
    ).RevitDynamoModel.CurrentWorkspace.FileName
    pathelement = dynscriptpath.split("\\")[:-1]
    folderpath = ""
    for i in pathelement:
        folderpath += (i + "\\")
    folderpath += ('res\\inputdata_'+str(nr_model))
    return folderpath


###############################################################
# Current doc/app/ui
###############################################################
doc = DocumentManager.Instance.CurrentDBDocument

###############################################################
# Prepare the input
###############################################################
nr_model = int(IN[0])
inputparameters = UnwrapElement(IN[1])

[sema_inputparameters, geo_inputparameters] = inputparameters
storey_level_list, zone_level_list, space_level_list = geo_inputparameters

###############################################################
# Record file into a .txt
###############################################################
# Get the current file path
saveDir = getFileDirectory()

stdout_original = sys.stdout
stdout_file = open(saveDir+"log\log10.txt", 'w')
sys.stdout = stdout_file

saveDir_extractinput = get_directory_extractinput(nr_model)

###############################################################
# Transaction in Revit
###############################################################
TransactionManager.Instance.EnsureInTransaction(doc)

#--------------------------------------------------------------
#------------------ OK NOW YOU CAN CODE -----------------------
#--------------------------------------------------------------

# Convert the inputparameters to to pandas dataframe
# (till now we only consider the geometric part)
def is_list_empty(list):
    return not bool(list)

summary_geom_Input = []

for item in storey_level_list:
    summary_geom_Input.append(item)

for item in zone_level_list:
    for sub_item in item:
        summary_geom_Input.append(sub_item)

for item in space_level_list:
    if is_list_empty(item):
        summary_geom_Input.append(0)
    else:    
        for sub_item in item:
            summary_geom_Input.append(sub_item) 

input_column_headings = [
    'dimension_x',
    'dimension_y',
    'dimension_z',
    'room_zone1_x',
    'room_zone1_y',
    'room_zone2_x',
    'room_zone2_y',
    'room_zone3_x',
    'room_zone3_y',
    'room_zone4_x',
    'room_zone4_y',
    'room_zone1_sep_x1',
    'room_zone2_sep_x1',
    'room_zone2_sep_x2',
    'room_zone2_sep_x3',
    'room_zone3_sep_x1',
    'room_zone3_sep_x2',
    'room_zone3_sep_x3',
    'room_zone3_sep_x4',
    'room_zone4_sep_x1']

geom_Input = pd.DataFrame([summary_geom_Input], columns = input_column_headings)
geom_Input.to_hdf(saveDir_extractinput+'.h5', key = 'geom_Input', mode = 'w')

#--------------------------------------------------------------
#------------------ OK NOW END THE CODE -----------------------
#--------------------------------------------------------------
TransactionManager.Instance.TransactionTaskDone()

# Close and save the recording file
sys.stdout = stdout_original
stdout_file.close()

###############################################################
# Prepare the output 
###############################################################
OUT = str(saveDir_extractinput+'.h5')
# ----------------------------------------

# group: Process - E2 : Export the output data
n114_saveModel = Python(IN[0]=code_block.proceed_trigger, IN[1]=modelNumber)  # "114_saveModel"; CPython3
# ---------- n114_saveModel.python (84 lines) ----------
###############################################################
# Load the Libraries
###############################################################
# general libraries
import clr
import sys
import math
import System

# identify the pathway
import io
import os
localapp = os.getenv(r'LOCALAPPDATA')
sys.path.append(os.path.join(localapp, r'python-3.8.3-embed-amd64\Lib\site-packages'))

# plotting
#import pandas as pd
#import numpy as np
#import matplotlib.pyplot as plt
#import matplotlib as mpl
#from matplotlib import cm
#from matplotlib.ticker import MultipleLocator, FormatStrFormatter, MaxNLocator
#mpl.rcParams['text.usetex'] = True
#from mpl_toolkits.axes_grid1.inset_locator import inset_axes, zoomed_inset_axes
#from mpl_toolkits.axes_grid1.anchored_artists import AnchoredSizeBar
#import scipy.stats as ss
#from scipy.stats import norm

# dynamo/revit-related libraries
clr.AddReference('DynamoRevitDS')
import Dynamo 
from System import Array
from System.Collections.Generic import *
clr.AddReference("RevitNodes")
import Revit
clr.ImportExtensions(Revit.Elements)
clr.ImportExtensions(Revit.GeometryConversion)
clr.AddReference("RevitServices")
import RevitServices
from RevitServices.Persistence import DocumentManager 
from RevitServices.Transactions import TransactionManager 
clr.AddReference("RevitAPI")
clr.AddReference('ProtoGeometry')
import Autodesk 
from Autodesk.DesignScript.Geometry import *
from Autodesk.DesignScript import *
from Autodesk.Revit.DB import *
from Autodesk.Revit.DB import Parameter
from Autodesk.Revit.DB.Architecture import *
from Autodesk.Revit.DB import IFailuresPreprocessor


###############################################################
# Customize functions
###############################################################


"""
Extract the directory of the dyn.
"""

def get_directory_modelsaving(nr_model):
    dynscriptpath = Dynamo.Applications.DynamoRevit(
    ).RevitDynamoModel.CurrentWorkspace.FileName
    pathelement = dynscriptpath.split("\\")[:-1]
    folderpath = ""
    for i in pathelement:
        folderpath += (i + "\\")
    folderpath += ("test_"+str(nr_model))
    return folderpath

###############################################################
# Current doc/app/ui
###############################################################

# Get the Input
proceed_trigger = IN[0]
nr_model = int(IN[1])

# Save the model
OUT = get_directory_modelsaving(nr_model)

# TransactionManager.Instance.EnsureInTransaction(doc)
# TransactionManager.Instance.TransactionTaskDone()
# ----------------------------------------
healing_planexport = Custom[Healing-PlanExport](imagePath=n114_saveModel)
saveAs = Custom[Document.SaveAs](filePath=n114_saveModel)  # package Clockwork for Dynamo 2.x; Saves the active Revit document under the given name.
checkRules = Input(checkRules: string)
healing_compliance = Custom[Healing-Compliance](generationSuccess=saveAs, checkRules=checkRules)
outputInfo = Output(healing_compliance)  # "outputInfo:String"
successInfo = Output(saveAs)  # "successInfo: bool"
inputInfo = Output(n113_extractInput)  # "inputInfo:String"
code_block_3 = CodeBlock(path=n114_saveModel) { path+".png"; }
healing_planexport_2 = Custom[Healing-PlanExport](imagePath=code_block_3)
