# Dynamo custom node Healing-PlanExport.dyf (Dynamo 2.12.0.5650)
# category: Healing
# packages: archi-lab.net 2022.210.1022

view_type = ViewTypesUi("FloorPlan")
getByType = archilab.Revit.Views.Views.GetByType(viewType=view_type)
imagePath = Input(imagePath: string)
export_range = ExportRangeUi("VisibleRegionOfCurrentView")
image_file_type = ImageFileTypeUi("PNG")
zoom_fit_type = ZoomFitTypeUi("Zoom")
code_block = CodeBlock { 500; }
image_resolution = ImageResolutionUi("DPI_600")
code_block_2 = CodeBlock { 100; }
fit_direction_type = FitDirectionTypeUi("Horizontal")
boolean = BoolSelector(true)
export_image_by_view = Custom[Export Image by View](view=getByType, filePath=imagePath, exportRange=export_range, imageFileType=image_file_type, zoomFitType=zoom_fit_type, pixelSize=code_block, imageResolution=image_resolution, zoomPercentage=code_block_2, fitDirectionType=fit_direction_type, runIt=boolean)  # package archi-lab.net; This node will export a list of Views and save them as images (JPG, BMP etc).
Output = Output(export_image_by_view)  # ""
