# Dynamo custom node Healing-Regeneration.dyf (Dynamo 2.12.0.5650)
# category: Healing

saveInput = Input(saveInput: bool)
saveInput_2 = Output(saveInput)  # "saveInput: bool"
python_script = Python()  # CPython3; unwired: IN[0]
# ---------- python_script.python (71 lines) ----------
###############################################################
# Load the Libraries
###############################################################
# general libraries
from xml.dom.minidom import Document
import clr
import sys
import math
import System
import csv 

# identify the pathway
import io
import os
localapp = os.getenv(r'LOCALAPPDATA')
sys.path.append(os.path.join(localapp, r'python-3.8.3-embed-amd64\Lib\site-packages'))

# plotting
import pandas as pd
import numpy as np
import matplotlib.pyplot as plt
import matplotlib as mpl
from matplotlib import cm
from matplotlib.ticker import MultipleLocator, FormatStrFormatter, MaxNLocator
mpl.rcParams['text.usetex'] = True
from mpl_toolkits.axes_grid1.inset_locator import inset_axes, zoomed_inset_axes
from mpl_toolkits.axes_grid1.anchored_artists import AnchoredSizeBar
import scipy.stats as ss
from scipy.stats import norm
import ast 

# dynamo/revit-related libraries
clr.AddReference('DynamoRevitDS')
import Dynamo 
from System import Array
from System.Collections.Generic import *
clr.AddReference("RevitNodes")
import Revit
clr.ImportExtensions(Revit.Elements)
clr.ImportExtensions(Revit.GeometryConversion)
clr.AddReference("RevitServices")
import RevitServices
from RevitServices.Persistence import DocumentManager 
from RevitServices.Transactions import TransactionManager 
clr.AddReference("RevitAPI")
clr.AddReference('ProtoGeometry')
import Autodesk 
from Autodesk.DesignScript.Geometry import *
from Autodesk.DesignScript import *
from Autodesk.Revit.DB import *
from Autodesk.Revit.DB import Parameter
from Autodesk.Revit.DB.Architecture import *
from Autodesk.Revit.DB import IFailuresPreprocessor

###############################################################
# Customize functions
###############################################################

###############################################################
# Current doc/app/ui
###############################################################

doc = DocumentManager.Instance.CurrentDBDocument
TransactionManager.Instance.EnsureInTransaction(doc)
doc.Regenerate()
TransactionManager.Instance.TransactionTaskDone()

###############################################################
# Prepare the output 
###############################################################
OUT = []
# ----------------------------------------
analyzeModel = Input(analyzeModel: bool)
analyzeModel_2 = Output(analyzeModel)  # "analyzeModel: bool"
checkCompliance = Input(checkCompliance: bool)
checkCompliance_2 = Output(checkCompliance)  # "checkCompliance: bool"
checkRules = Input(checkRules: string)
checkRules_2 = Output(checkRules)  # "checkRules: string"
