# Dynamo custom node Healing-UpdateParameters.dyf (Dynamo 2.12.0.5650)
# category: Healing
# packages: Clockwork for Dynamo 2.x 2.3.0

checkRules = Input(checkRules: string)
checkRules_2 = Output(checkRules)  # "checkRules: string"
checkCompliance = Input(checkCompliance: bool)
checkCompliance_2 = Output(checkCompliance)  # "checkCompliance: bool"
analyzeModel = Input(analyzeModel: bool)
analyzeModel_2 = Output(analyzeModel)  # "analyzeModel: bool"
saveInput = Input(saveInput: bool)
saveInput_2 = Output(saveInput)  # "saveInput: bool"
modelNumber = Input(modelNumber: int)
varyParameterCSV = Input(varyParameterCSV: string)
n01_getFileDirectory = Python(IN[0]=varyParameterCSV)  # "01_getFileDirectory"; CPython3
# ---------- n01_getFileDirectory.python (53 lines) ----------
###############################################################
# Load the Libraries
###############################################################
# general libraries
import clr
import sys

# identify the pathway
import io
import os
localapp = os.getenv(r'LOCALAPPDATA')
sys.path.append(os.path.join(localapp, r'python-3.8.3-embed-amd64\Lib\site-packages'))

# dynamo/revit-related libraries
clr.AddReference('DynamoRevitDS')
import Dynamo
from System.Collections.Generic import *
clr.AddReference("RevitNodes")
import Revit
from RevitServices.Persistence import DocumentManager 
from RevitServices.Transactions import TransactionManager 
clr.AddReference("RevitAPI")

###############################################################
# Customize functions
###############################################################


"""
Extract the directory of the dyn.
"""

def getFileDirectory(filename=" "):
    dynscriptpath = Dynamo.Applications.DynamoRevit(
    ).RevitDynamoModel.CurrentWorkspace.FileName
    pathelement = dynscriptpath.split("\\")[:-1]
    folderpath = ""
    for i in pathelement:
        folderpath += (i + "\\")
    if filename != " ":
        folderpath += (filename)
    return folderpath


###############################################################
# Current doc/app/ui
###############################################################

# Get the Input
initialParameterFile = IN[0]

# Export the file name with directory
OUT = getFileDirectory(initialParameterFile)
# ----------------------------------------
boolean = BoolSelector(true)
importCSV = Data.ImportCSV(filePath=n01_getFileDirectory, transpose=boolean)
n121_freshParameters = Python(IN[0]=modelNumber, IN[1]=importCSV)  # "121_freshParameters"; CPython3
# ---------- n121_freshParameters.python (193 lines) ----------
###############################################################
# Load the Libraries
###############################################################
# general libraries
from wsgiref import validate
import clr
import sys
import math
import System

# identify the pathway
import io
import os
localapp = os.getenv(r'LOCALAPPDATA')
sys.path.append(os.path.join(localapp, r'python-3.8.3-embed-amd64\Lib\site-packages'))

# plotting
import pandas as pd
import numpy as np
import matplotlib.pyplot as plt
import matplotlib as mpl
from matplotlib import cm
from matplotlib.ticker import MultipleLocator, FormatStrFormatter, MaxNLocator
mpl.rcParams['text.usetex'] = True
from mpl_toolkits.axes_grid1.inset_locator import inset_axes, zoomed_inset_axes
from mpl_toolkits.axes_grid1.anchored_artists import AnchoredSizeBar
import scipy.stats as ss
from scipy.stats import norm
import ast 

# dynamo/revit-related libraries
clr.AddReference('DynamoRevitDS')
import Dynamo 
from System import Array
from System.Collections.Generic import *
clr.AddReference("RevitNodes")
import Revit
clr.ImportExtensions(Revit.Elements)
clr.ImportExtensions(Revit.GeometryConversion)
clr.AddReference("RevitServices")
import RevitServices
from RevitServices.Persistence import DocumentManager 
from RevitServices.Transactions import TransactionManager 
clr.AddReference("RevitAPI")
clr.AddReference('ProtoGeometry')
import Autodesk 
from Autodesk.DesignScript.Geometry import *
from Autodesk.DesignScript import *
from Autodesk.Revit.DB import *
from Autodesk.Revit.DB import Parameter
from Autodesk.Revit.DB.Architecture import *
from Autodesk.Revit.DB import GlobalParametersManager

###############################################################
# Customize functions
###############################################################


"""
Extract the directory of the dyn.
"""

def getFileDirectory(filename=" "):
    dynscriptpath = Dynamo.Applications.DynamoRevit(
    ).RevitDynamoModel.CurrentWorkspace.FileName
    pathelement = dynscriptpath.split("\\")[:-1]
    folderpath = ""
    for i in pathelement:
        folderpath += (i + "\\")
    if filename != " ":
        folderpath += (filename)
    return folderpath


"""
Extract the directory of the dyn.
"""

def get_directory_modelsaving(nr_model):
    dynscriptpath = Dynamo.Applications.DynamoRevit(
    ).RevitDynamoModel.CurrentWorkspace.FileName
    pathelement = dynscriptpath.split("\\")[:-1]
    folderpath = ""
    for i in pathelement:
        folderpath += (i + "\\")
    folderpath += ("test_"+str(nr_model))
    return folderpath


"""
Units displayed/assigned in Dynamo are feet. 1meter = 3.28084 foot
meter_to_foot: Converts a value from Revit's internal units to a given display unit.
foot_to_meter: Converts a value from a given display unit to Revit's internal units.
"""


def meter_to_foot(ori_value):
    if isinstance(ori_value, list):
        return [UnitUtils.ConvertFromInternalUnits(value, UnitTypeId.Meters) for value in ori_value]
    return float(UnitUtils.ConvertFromInternalUnits(ori_value, UnitTypeId.Meters))


def foot_to_meter(ori_value):
    if isinstance(ori_value, list):
        return [UnitUtils.ConvertToInternalUnits(value, UnitTypeId.Meters) for value in ori_value]
    return float(UnitUtils.ConvertToInternalUnits(ori_value, UnitTypeId.Meters))


"""
Fresh global parameters / fresh a list of global parameters
till now, only for doubleparametervalues...
"""


def fresh_GlobalParameter(doc,names,values):

    # Fix the unit problem

    values = foot_to_meter(values)
    
    # Update the parameter values

    for ii in range(len(names)):
        name = names[ii]
        value = values[ii]
        gp_id = Autodesk.Revit.DB.GlobalParametersManager.FindByName(doc, name)
        gp_element = doc.GetElement(gp_id)
        gp_value = gp_element.GetValue().Value
        if abs(value - gp_value) < 0.0001:
            continue
        else:
            gp_element.SetValue(DoubleParameterValue(value))

###############################################################
# Current doc/app/ui
###############################################################
doc = DocumentManager.Instance.CurrentDBDocument

###############################################################
# Prepare the input
###############################################################
nr_model = int(IN[0])
csvdata = IN[1]
 
###############################################################
# Record file into a .txt
###############################################################
# Get the current file path
saveDir = getFileDirectory()

stdout_original = sys.stdout
stdout_file = open(saveDir+"log\log31.txt", 'w')
sys.stdout = stdout_file

###############################################################
# Transaction in Revit
###############################################################
TransactionManager.Instance.EnsureInTransaction(doc)

#--------------------------------------------------------------
#------------------ OK NOW YOU CAN CODE -----------------------
#--------------------------------------------------------------

# Update the Nr of the model

nr_model_gp_id = Autodesk.Revit.DB.GlobalParametersManager.FindByName(
        doc, 'nr_model')
nr_model_gp_element = doc.GetElement(nr_model_gp_id)
nr_model_gp_element.SetValue(IntegerParameterValue(nr_model))

# Set all global parameters by csv values based on the variation number: nr_model
names = []
values = []

for item in csvdata:
    names.append(item[0])
    values.append(item[nr_model])

fresh_GlobalParameter(doc,names,values)

#--------------------------------------------------------------
#------------------ OK NOW END THE CODE -----------------------
#--------------------------------------------------------------
TransactionManager.Instance.TransactionTaskDone()

# Close and save the recording file
sys.stdout = stdout_original
stdout_file.close()

###############################################################
# Prepare the output 
###############################################################
OUT = get_directory_modelsaving(nr_model)
# ----------------------------------------
saveAs = Custom[Document.SaveAs](filePath=n121_freshParameters)  # package Clockwork for Dynamo 2.x; Saves the active Revit document under the given name.
