# Dynamo custom node IfcExporter.dyf (Dynamo 2.12.0.5650)
# category: ModelHealer
# IfcExporter
# packages: Rhythm 2023.2.2, Genius Loci 2022.4.19, Clockwork for Dynamo 2.x 2.3.0

directory_path_output = StringInput("C:\dev\teaching\bimfunda\bimfunda_assignment\SS23-assign2\data\4_ifc_export")
DirectoryPathIN = Input(DirectoryPathIN: var[]..[])
directory_from_path = DirectoryObject(path=DirectoryPathIN)
code_block = CodeBlock { "*.rvt"; }
getDirectoryContents = FileSystem.GetDirectoryContents(directory=directory_from_path, searchString=code_block)
ID = Input(ID: var[]..[])
contains = String.Contains(string=getDirectoryContents.files, searchFor=ID)
filterByBoolMask = List.FilterByBoolMask(list=getDirectoryContents.files, mask=contains)
ʳʰʸᵗʰᵐ_applications = Rhythm.Revit.Application.Applications.OpenDocumentFile(filePath=filterByBoolMask.in)
ʳʰʸᵗʰᵐ_documents = Rhythm.Revit.Application.Documents.DynamoDocumentToDbDocument(dynamoDocument=ʳʰʸᵗʰᵐ_applications)
DirectoryPathOUT = Input(DirectoryPathOUT: var[]..[])
flatten = List.Flatten(list=ʳʰʸᵗʰᵐ_documents)
element_types = ElementTypes("View3D")
ʳʰʸᵗʰᵐ_collector = Rhythm.Revit.Selection.Collector.ElementsOfTypeInDocument(document=flatten, elementType=element_types)
boolean = BoolSelector(false)
clean = List.Clean(list=ʳʰʸᵗʰᵐ_collector, preserveIndices=boolean)
firstItem = List.FirstItem(list=clean@L2)
number_of_3dviews_per_document = DoubleInput(1)
chop = List.Chop(list=firstItem, lengths=number_of_3dviews_per_document)
flatten_2 = List.Flatten(list=chop)
fileName = FileSystem.FileName(path=filterByBoolMask.in)
code_block_2 = CodeBlock { "rvt"; }
code_block_3 = CodeBlock { "ifc"; }
replace = String.Replace(string=fileName, searchFor=code_block_2, replaceWith=code_block_3)
code_block_4 = CodeBlock { "IFC4"; }
export_ifc_in_document = Custom[Export IFC in Document](document=ʳʰʸᵗʰᵐ_documents, DirectoryPath=DirectoryPathOUT, view=flatten_2, Filename=replace, IFCversion=code_block_4, lacing=Longest)  # package Genius Loci; Export Views to IFC file from document. The Project Origin option works only with Revit 2018 and above. Some other IFC options are embedded inside the python script.
passthrough = Custom[Passthrough](passThrough=ʳʰʸᵗʰᵐ_documents, waitFor=export_ifc_in_document)  # package Clockwork for Dynamo 2.x; Forces a sequential order of execution. The node wired into the output of the Passthrough node will be executed *after* the node wired into the waitFor input (e.g. important for some Revit operations). The value of the passThrough input will be passed on to the node wired into the output port of the Passthrough node.
boolean_2 = BoolSelector(false)
ʳʰʸᵗʰᵐ_applications_2 = Rhythm.Revit.Application.Applications.CloseDocument(document=passthrough, save=boolean_2)
Succeed = Output(ʳʰʸᵗʰᵐ_applications_2)
