# Dynamo custom node extract-Topology-OB-SP.dyf (Dynamo 2.12.0.5650)
# category: ModelHealer
# extract the topology between Objects and Spaces
# packages: Clockwork for Dynamo 2.x 2.3.0, archi-lab.net 2022.210.1022

# group: Get Room Boundaries
categories = Categories("OST_Rooms")
all_elements_of_category = ElementsOfCategory(Category=categories)
boundaries = Custom[Room.Boundaries](room=all_elements_of_category)  # package Clockwork for Dynamo 2.x; Gets a list of all boundaries of a given room or area and a corresponding list of the elements that are generating those boundaries.
boolean = BoolSelector(false)
clean = List.Clean(list=boundaries.elements, preserveIndices=boolean)
type = Object.Type(object=clean@L2)

# group: Input
directoryOUT = Input(directoryOUT: var[]..[])
topologySpaceSeplineTXT = Input(topologySpaceSeplineTXT: var[]..[])
concat = String.Concat(string0=directoryOUT, string1=topologySpaceSeplineTXT)
topologySpaceWallTXT = Input(topologySpaceWallTXT: var[]..[])
concat_2 = String.Concat(string0=directoryOUT, string1=topologySpaceWallTXT)
topologySpaceHostTXT = Input(topologySpaceHostTXT: var[]..[])
concat_3 = String.Concat(string0=directoryOUT, string1=topologySpaceHostTXT)
topologySpaceDoorTXT = Input(topologySpaceDoorTXT: var[]..[])
concat_4 = String.Concat(string0=directoryOUT, string1=topologySpaceDoorTXT)
topologySpaceWindowTXT = Input(topologySpaceWindowTXT: var[]..[])
concat_5 = String.Concat(string0=directoryOUT, string1=topologySpaceWindowTXT)

# group: Get related walls
code_block = CodeBlock { "Revit.Elements.Wall"; }
eq = type == code_block
filterByBoolMask = List.FilterByBoolMask(list=clean, mask=eq)
type_2 = archilab.Revit.Elements.Elements.Type(element=filterByBoolMask.in)
name = WallType.Name(wallType=type_2)
code_block_2 = CodeBlock { "\n"; }
code_block_3 = CodeBlock { ","; }
string = StringInput("IfcGUID")
getParameterValueByName = Element.GetParameterValueByName(element=filterByBoolMask.in, parameterName=string)
join = String.Join(separator=code_block_3, string0=getParameterValueByName)
flatten = List.Flatten(list=join)
join_2 = String.Join(separator=code_block_2, string0=flatten)
writeText = FileSystem.WriteText(filePath=concat_2, text=join_2)

# group: Set separation line to move with nearby elements
code_block_4 = CodeBlock { "Revit.Elements.ModelCurve"; }
eq_2 = type == code_block_4
filterByBoolMask_2 = List.FilterByBoolMask(list=clean, mask=eq_2)
clean_2 = List.Clean(list=filterByBoolMask_2.in)
isEmpty = List.IsEmpty(list=clean_2@L2)
filterByBoolMask_3 = List.FilterByBoolMask(list=clean_2, mask=isEmpty)
flatten_2 = List.Flatten(list=filterByBoolMask_3.out)
code_block_5 = CodeBlock { "Moves With Nearby Elements"; }
boolean_2 = BoolSelector(true)
setParameterByName = Element.SetParameterByName(element=flatten_2, parameterName=code_block_5, value=boolean_2)
getParameterValueByName_2 = Element.GetParameterValueByName(element=setParameterByName, parameterName=code_block_5)

# group: Get related separation lines
code_block_6 = CodeBlock { "\n"; }
code_block_7 = CodeBlock { ","; }
passthrough = Custom[Passthrough](passThrough=filterByBoolMask_2.in, waitFor=getParameterValueByName_2)  # package Clockwork for Dynamo 2.x; Forces a sequential order of execution. The node wired into the output of the Passthrough node will be executed *after* the node wired into the waitFor input (e.g. important for some Revit operations). The value of the passThrough input will be passed on to the node wired into the output port of the Passthrough node.
id = Element.Id(element=passthrough)
string_from_object = FromObject(object=id)
join_3 = String.Join(separator=code_block_7, string0=string_from_object)
join_4 = String.Join(separator=code_block_6, string0=join_3)
writeText_2 = FileSystem.WriteText(filePath=concat, text=join_4)

# group: Get spaces
code_block_8 = CodeBlock { "\n"; }
string_2 = StringInput("IfcGUID")
getParameterValueByName_3 = Element.GetParameterValueByName(element=all_elements_of_category, parameterName=string_2)
join_5 = String.Join(separator=code_block_8, string0=getParameterValueByName_3)
writeText_3 = FileSystem.WriteText(filePath=concat_3, text=join_5)

# group: Get related doors
code_block_9 = CodeBlock { "\n"; }
code_block_10 = CodeBlock { ","; }
select_phase = RevitPhases("Phase 1")
doors = Custom[Room.Doors](room=all_elements_of_category, phase=select_phase)  # package Clockwork for Dynamo 2.x; Retrieves all doors that are associated with a room (hosted in walls and roofs).
string_3 = StringInput("IfcGUID")
getParameterValueByName_4 = Element.GetParameterValueByName(element=doors, parameterName=string_3)
join_6 = String.Join(separator=code_block_10, string0=getParameterValueByName_4)
flatten_3 = List.Flatten(list=join_6)
join_7 = String.Join(separator=code_block_9, string0=flatten_3)
writeText_4 = FileSystem.WriteText(filePath=concat_4, text=join_7)

# group: Get related windows
code_block_11 = CodeBlock { "\n"; }
code_block_12 = CodeBlock { ","; }
select_phase_2 = RevitPhases("Phase 1")
windows = Custom[Room.Windows](room=all_elements_of_category, phase=select_phase_2)  # package Clockwork for Dynamo 2.x; Retrieves all windows that are associated with a room (hosted in walls and roofs).
string_4 = StringInput("IfcGUID")
getParameterValueByName_5 = Element.GetParameterValueByName(element=windows, parameterName=string_4)
join_8 = String.Join(separator=code_block_12, string0=getParameterValueByName_5)
flatten_4 = List.Flatten(list=join_8)
join_9 = String.Join(separator=code_block_11, string0=flatten_4)
writeText_5 = FileSystem.WriteText(filePath=concat_5, text=join_9)

# group: Output.
list_create = List.Create(item0=writeText_2, item1=writeText, item2=writeText_3, item3=writeText_4, item4=writeText_5)
allTrue = List.AllTrue(list=list_create)
Succeed = Output(allTrue)
