# Dynamo custom node varyDesign.dyf (Dynamo 2.12.0.5650)
# category: ModelHealer
# varyDesign
# packages: Rhythm 2023.2.2, Clockwork for Dynamo 2.x 2.3.0

# group: Input
DirectoryPathIN = Input(DirectoryPathIN: var[]..[])
ID = Input(ID: var[]..[])
VaryCSV = Input(VaryCSV: var[]..[])
DirectoryPathOUT = Input(DirectoryPathOUT: var[]..[])

# group: get the external Document.
directory_from_path = DirectoryObject(path=DirectoryPathIN)
code_block = CodeBlock { "*.rvt"; }
getDirectoryContents = FileSystem.GetDirectoryContents(directory=directory_from_path, searchString=code_block)
contains = String.Contains(string=getDirectoryContents.files, searchFor=ID)
filterByBoolMask = List.FilterByBoolMask(list=getDirectoryContents.files, mask=contains)
ʳʰʸᵗʰᵐ_applications = Rhythm.Revit.Application.Applications.OpenDocumentFile(filePath=filterByBoolMask.in)
ʳʰʸᵗʰᵐ_documents = Rhythm.Revit.Application.Documents.DynamoDocumentToDbDocument(dynamoDocument=ʳʰʸᵗʰᵐ_applications)

# group: get the variation Data.
boolean = BoolSelector(true)
importCSV = Data.ImportCSV(filePath=VaryCSV, transpose=boolean)
firstItem = List.FirstItem(list=importCSV@L2)
string_from_object = FromObject(object=firstItem)
contains_2 = String.Contains(string=string_from_object, searchFor=ID)
filterByBoolMask_2 = List.FilterByBoolMask(list=importCSV, mask=contains_2)
flatten = List.Flatten(list=filterByBoolMask_2.in)
firstItem_2 = List.FirstItem(list=importCSV)
string = StringInput("doorID")
indexOfDoor = List.IndexOf(list=firstItem_2, element=string)
doorID = List.GetItemAtIndex(list=flatten, index=indexOfDoor)
firstItem_3 = List.FirstItem(list=importCSV)
string_2 = StringInput("wallID")
indexOfWall = List.IndexOf(list=firstItem_3, element=string_2)
wallID = List.GetItemAtIndex(list=flatten, index=indexOfWall)

# group: prepare the save path
code_block_2 = CodeBlock { "\\"; }
add = DirectoryPathOUT + code_block_2
remove_rvt = BoolSelector(false)
fileName = FileSystem.FileName(path=filterByBoolMask.in, withExtension=remove_rvt)
add_2 = add + fileName
code_block_3 = CodeBlock { ".rvt"; }
add_3 = add_2 + code_block_3

# group: vary the design.
passthrough = Custom[Passthrough](passThrough=ʳʰʸᵗʰᵐ_documents, waitFor=doorID)  # package Clockwork for Dynamo 2.x; Forces a sequential order of execution. The node wired into the output of the Passthrough node will be executed *after* the node wired into the waitFor input (e.g. important for some Revit operations). The value of the passThrough input will be passed on to the node wired into the output port of the Passthrough node.
varydesigns_externaldocuments = Python(IN[0]=passthrough, IN[1]=add_3, IN[2]=doorID, IN[3]=wallID)  # CPython3
# ---------- varydesigns_externaldocuments.python (78 lines) ----------
###############################################################
# Import general packages.
import clr
import sys
import math
import System
import io
import os
import importlib

# Import Revit/Dynamo API related packages.
clr.AddReference('DynamoRevitDS')
import Dynamo
from System import Array
from System.Collections.Generic import *
clr.AddReference("RevitNodes")
import Revit
clr.ImportExtensions(Revit.Elements)
clr.ImportExtensions(Revit.GeometryConversion)
clr.AddReference("RevitServices")
import RevitServices
from RevitServices.Persistence import DocumentManager 
from RevitServices.Transactions import TransactionManager 
clr.AddReference("RevitAPI")
clr.AddReference('ProtoGeometry')
import Autodesk 
from Autodesk.DesignScript.Geometry import *
from Autodesk.DesignScript import *
from Autodesk.Revit.DB import *
from Autodesk.Revit.DB import Parameter
from Autodesk.Revit.DB.Architecture import *
from Autodesk.Revit.DB import IFailuresPreprocessor

# Import external python packages.
localapp = os.getenv(r'LOCALAPPDATA')
sys.path.append(os.path.join(localapp, r'python-3.8.3-embed-amd64\Lib\site-packages'))

# Import customized python packgaes.
sys.path.append(r'C:\dev\phd\jw\healing\src\godyn')

import healBasics
importlib.reload(healBasics)

###############################################################
doc = DocumentManager.Instance.CurrentDBDocument


###############################################################
# Temporary functions


###############################################################
# Prepare the input (of the Python Node)
ext_doc = IN[0]
savepath = IN[1]
doorid = IN[2]
wallid = IN[3]

##############################################################
# Prepare the output (of the Python Node)
out = []


###############################################################
# Start Transaction in Revit
out = healBasics.varyDesigns(ext_doc, savepath, doorid, wallid)


###############################################################
# Main part


###############################################################
# End Transaction in Revit

###############################################################
# End
OUT = out
# ----------------------------------------

code_block_4 = CodeBlock(Succeed=varydesigns_externaldocuments) { Succeed; }
