# Dynamo custom node varyGPs.dyf (Dynamo 2.12.0.5650)
# category: ModelHealer
# vary the Global Parameters.
# packages: Clockwork for Dynamo 2.x 2.3.0, Rhythm 2023.2.2

# group: Input
DirectoryPathIN = Input(DirectoryPathIN: var[]..[])
ID = Input(ID: var[]..[])
VaryCSV = Input(VaryCSV: var[]..[])
DirectoryPathOUT = Input(DirectoryPathOUT: var[]..[])

# group: prepare the save path.
remove_rvt = BoolSelector(false)
code_block = CodeBlock { "\\"; }
add = DirectoryPathOUT + code_block
code_block_2 = CodeBlock { ".rvt"; }

# group: get the external Document.
directory_from_path = DirectoryObject(path=DirectoryPathIN)
code_block_3 = CodeBlock { "*.rvt"; }
getDirectoryContents = FileSystem.GetDirectoryContents(directory=directory_from_path, searchString=code_block_3)
fileName = FileSystem.FileName(path=getDirectoryContents.files, withExtension=remove_rvt)
string_from_object = FromObject(object=ID)
eq = fileName == string_from_object
filterByBoolMask = List.FilterByBoolMask(list=getDirectoryContents.files, mask=eq)
ʳʰʸᵗʰᵐ_applications = Rhythm.Revit.Application.Applications.OpenDocumentFile(filePath=filterByBoolMask.in)
ʳʰʸᵗʰᵐ_documents = Rhythm.Revit.Application.Documents.DynamoDocumentToDbDocument(dynamoDocument=ʳʰʸᵗʰᵐ_applications)

# group: get the variation GPs and GPs' values.
boolean = BoolSelector(false)
importCSV = Data.ImportCSV(filePath=VaryCSV, transpose=boolean)
gp_names_first_column = List.FirstItem(list=importCSV)
string_from_object_2 = FromObject(object=gp_names_first_column)
getItemAtIndex = List.GetItemAtIndex(list=importCSV, index=ID)

# group (continued): prepare the save path.
fileName_2 = FileSystem.FileName(path=filterByBoolMask.in, withExtension=remove_rvt)
add_2 = add + fileName_2
add_3 = add_2 + code_block_2

# group: vary the design.
passthrough = Custom[Passthrough](passThrough=ʳʰʸᵗʰᵐ_documents, waitFor=string_from_object_2)  # package Clockwork for Dynamo 2.x; Forces a sequential order of execution. The node wired into the output of the Passthrough node will be executed *after* the node wired into the waitFor input (e.g. important for some Revit operations). The value of the passThrough input will be passed on to the node wired into the output port of the Passthrough node.
passthrough_2 = Custom[Passthrough](passThrough=passthrough, waitFor=getItemAtIndex)
varygps_externaldocuments = Python(IN[0]=passthrough_2, IN[1]=add_3, IN[2]=string_from_object_2, IN[3]=getItemAtIndex)  # CPython3
# ---------- varygps_externaldocuments.python (78 lines) ----------
###############################################################
# Import general packages.
import clr
import sys
import math
import System
import io
import os
import importlib

# Import Revit/Dynamo API related packages.
clr.AddReference('DynamoRevitDS')
import Dynamo
from System import Array
from System.Collections.Generic import *
clr.AddReference("RevitNodes")
import Revit
clr.ImportExtensions(Revit.Elements)
clr.ImportExtensions(Revit.GeometryConversion)
clr.AddReference("RevitServices")
import RevitServices
from RevitServices.Persistence import DocumentManager 
from RevitServices.Transactions import TransactionManager 
clr.AddReference("RevitAPI")
clr.AddReference('ProtoGeometry')
import Autodesk 
from Autodesk.DesignScript.Geometry import *
from Autodesk.DesignScript import *
from Autodesk.Revit.DB import *
from Autodesk.Revit.DB import Parameter
from Autodesk.Revit.DB.Architecture import *
from Autodesk.Revit.DB import IFailuresPreprocessor

# Import external python packages.
localapp = os.getenv(r'LOCALAPPDATA')
sys.path.append(os.path.join(localapp, r'python-3.8.3-embed-amd64\Lib\site-packages'))

# Import customized python packgaes.
sys.path.append(r'C:\dev\phd\jw\healing\src\godyn')

import healBasics
importlib.reload(healBasics)

###############################################################
doc = DocumentManager.Instance.CurrentDBDocument


###############################################################
# Temporary functions


###############################################################
# Prepare the input (of the Python Node)
ext_doc = IN[0]
savepath = IN[1]
gp_names = IN[2]
gp_values = IN[3]

##############################################################
# Prepare the output (of the Python Node)
out = []


###############################################################
# Start Transaction in Revit
out = healBasics.varyGPs(ext_doc, savepath, gp_names, gp_values)


###############################################################
# Main part


###############################################################
# End Transaction in Revit

###############################################################
# End
OUT = out
# ----------------------------------------

# group: OUTPUT
code_block_4 = CodeBlock(Succeed=varygps_externaldocuments) { Succeed; }
