# Dynamo custom node visualizeSelection.dyf (Dynamo 2.12.0.5650)
# category: ModelHealer
# visualize the selected elements.
# packages: Clockwork for Dynamo 2.x 2.3.0

CSVPathFailure = Input(CSVPathFailure: var[]..[])
IBCRulesAsString = Input(IBCRulesAsString: var[]..[])

# group: select elements.
readCSV = Python(IN[0]=CSVPathFailure)  # CPython3
# ---------- readCSV.python (84 lines) ----------
###############################################################
# Import general packages.
import clr
import sys
import math
import System
import io
import os
import importlib

# Import Revit/Dynamo API related packages.
clr.AddReference('DynamoRevitDS')
import Dynamo
from System import Array
from System.Collections.Generic import *
clr.AddReference("RevitNodes")
import Revit
clr.ImportExtensions(Revit.Elements)
clr.ImportExtensions(Revit.GeometryConversion)
clr.AddReference("RevitServices")
import RevitServices
from RevitServices.Persistence import DocumentManager 
from RevitServices.Transactions import TransactionManager 
clr.AddReference("RevitAPI")
clr.AddReference('ProtoGeometry')
import Autodesk 
from Autodesk.DesignScript.Geometry import *
from Autodesk.DesignScript import *
from Autodesk.Revit.DB import *
from Autodesk.Revit.DB import Parameter
from Autodesk.Revit.DB.Architecture import *
from Autodesk.Revit.DB import IFailuresPreprocessor

# Import external python packages.
localapp = os.getenv(r'LOCALAPPDATA')
sys.path.append(os.path.join(localapp, r'python-3.8.3-embed-amd64\Lib\site-packages'))

# Import customized python packgaes.
sys.path.append(r'C:\dev\phd\jw\healing\src\godyn')

import healBasics
importlib.reload(healBasics)
import healChecks
importlib.reload(healChecks)
import healParameters
importlib.reload(healParameters)
import healVisual
importlib.reload(healVisual)

###############################################################
doc = DocumentManager.Instance.CurrentDBDocument


###############################################################
# Temporary functions


###############################################################
# Prepare the input (of the Python Node)
csvPath = IN[0]


##############################################################
# Prepare the output (of the Python Node)
out = []


###############################################################
# Start Transaction in Revit
TransactionManager.Instance.EnsureInTransaction(doc)


###############################################################
# Main part
out = healBasics.readCSV(csvPath, skip_first_col=True, transpose=True, clear_list=True)

###############################################################
# End Transaction in Revit
TransactionManager.Instance.TransactionTaskDone()


###############################################################
# End
OUT = out
# ----------------------------------------
number = DoubleInput(0)
getItemAtIndex = List.GetItemAtIndex(list=readCSV@L2, index=number)
indexOf = List.IndexOf(list=getItemAtIndex, element=IBCRulesAsString)
getItemAtIndex_2 = List.GetItemAtIndex(list=readCSV, index=indexOf)
removeItemAtIndex = List.RemoveItemAtIndex(list=getItemAtIndex_2, indices=number)
getElementsByIfcGUIDs = Python(IN[0]=removeItemAtIndex)  # CPython3
# ---------- getElementsByIfcGUIDs.python (84 lines) ----------
###############################################################
# Import general packages.
import clr
import sys
import math
import System
import io
import os
import importlib

# Import Revit/Dynamo API related packages.
clr.AddReference('DynamoRevitDS')
import Dynamo
from System import Array
from System.Collections.Generic import *
clr.AddReference("RevitNodes")
import Revit
clr.ImportExtensions(Revit.Elements)
clr.ImportExtensions(Revit.GeometryConversion)
clr.AddReference("RevitServices")
import RevitServices
from RevitServices.Persistence import DocumentManager 
from RevitServices.Transactions import TransactionManager 
clr.AddReference("RevitAPI")
clr.AddReference('ProtoGeometry')
import Autodesk 
from Autodesk.DesignScript.Geometry import *
from Autodesk.DesignScript import *
from Autodesk.Revit.DB import *
from Autodesk.Revit.DB import Parameter
from Autodesk.Revit.DB.Architecture import *
from Autodesk.Revit.DB import IFailuresPreprocessor

# Import external python packages.
localapp = os.getenv(r'LOCALAPPDATA')
sys.path.append(os.path.join(localapp, r'python-3.8.3-embed-amd64\Lib\site-packages'))

# Import customized python packgaes.
sys.path.append(r'C:\dev\phd\jw\healing\src\godyn')

import healBasics
importlib.reload(healBasics)
import healChecks
importlib.reload(healChecks)
import healParameters
importlib.reload(healParameters)
import healVisual
importlib.reload(healVisual)

###############################################################
doc = DocumentManager.Instance.CurrentDBDocument


###############################################################
# Temporary functions


###############################################################
# Prepare the input (of the Python Node)
element = IN[0]


##############################################################
# Prepare the output (of the Python Node)
out = []


###############################################################
# Start Transaction in Revit
TransactionManager.Instance.EnsureInTransaction(doc)


###############################################################
# Main part
out = healBasics.getElementsByIfcGUIDs(doc, element)

###############################################################
# End Transaction in Revit
TransactionManager.Instance.TransactionTaskDone()


###############################################################
# End
OUT = out
# ----------------------------------------

# group: override the display color.
number_2 = DoubleInput(255)
byARGB = Color.ByARGB(red=number_2, green=number_2)
categories = Categories("OST_Views")
all_elements_of_category = ElementsOfCategory(Category=categories)
boolean = BoolSelector(false)
clean = List.Clean(list=all_elements_of_category, preserveIndices=boolean)
code_block = CodeBlock { "View Name"; }
getParameterValueByName = Element.GetParameterValueByName(element=clean, parameterName=code_block)
level = Custom[Element.Level](element=getElementsByIfcGUIDs)  # package Clockwork for Dynamo 2.x; Gets an element's level
name = Level.Name(level=level)
string = StringInput("D_ue")
string_2 = StringInput("RES")
replace = String.Replace(string=name, searchFor=string, replaceWith=string_2)
string_3 = StringInput("_")
add = replace + string_3
add_2 = add + IBCRulesAsString
eq = getParameterValueByName == add_2@L1
filterByBoolMask = List.FilterByBoolMask(list=clean, mask=eq@L2)
flatten = List.Flatten(list=filterByBoolMask.in)
python_script = Python(IN[0]=getElementsByIfcGUIDs, IN[1]=byARGB, IN[2]=flatten)  # CPython3
# ---------- python_script.python (88 lines) ----------
###############################################################
# Import general packages.
import clr
import sys
import math
import System
import io
import os
import importlib

# Import Revit/Dynamo API related packages.
clr.AddReference('DynamoRevitDS')
import Dynamo
from System import Array
from System.Collections.Generic import *
clr.AddReference("RevitNodes")
import Revit
clr.ImportExtensions(Revit.Elements)
clr.ImportExtensions(Revit.GeometryConversion)
clr.AddReference("RevitServices")
import RevitServices
from RevitServices.Persistence import DocumentManager 
from RevitServices.Transactions import TransactionManager 
clr.AddReference("RevitAPI")
clr.AddReference('ProtoGeometry')
import Autodesk 
from Autodesk.DesignScript.Geometry import *
from Autodesk.DesignScript import *
from Autodesk.Revit.DB import *
from Autodesk.Revit.DB import Parameter
from Autodesk.Revit.DB.Architecture import *
from Autodesk.Revit.DB import IFailuresPreprocessor

# Import external python packages.
localapp = os.getenv(r'LOCALAPPDATA')
sys.path.append(os.path.join(localapp, r'python-3.8.3-embed-amd64\Lib\site-packages'))

# Import customized python packgaes.
sys.path.append(r'C:\dev\phd\jw\healing\src\godyn')

import healBasics
importlib.reload(healBasics)
import healChecks
importlib.reload(healChecks)
import healParameters
importlib.reload(healParameters)
import healVisual
importlib.reload(healVisual)


def ConvertColor(e):
	return Autodesk.Revit.DB.Color(e.Red, e.Green, e.Blue)

def OverrideColorPattern(e, c, f, view):
	gSettings = OverrideGraphicSettin
###############################################################
doc = DocumentManager.Instance.CurrentDBDocument


###############################################################
# Temporary functions


###############################################################
# Prepare the input (of the Python Node)
element = UnwrapElement(IN[0])
color = UnwrapElement(IN[1])
view = UnwrapElement(IN[2])

##############################################################
# Prepare the output (of the Python Node)
out = []


###############################################################
# Start Transaction in Revit
TransactionManager.Instance.EnsureInTransaction(doc)


###############################################################
# Main part
out = healVisual.overrideSpaceDisplay(element, color, view)

###############################################################
# End Transaction in Revit
TransactionManager.Instance.TransactionTaskDone()

OUT=out
# ----------------------------------------

CSVPathFailureNeighbors = Input(CSVPathFailureNeighbors: var[]..[])

# group: select elements.
readCSV_2 = Python(IN[0]=CSVPathFailureNeighbors)  # CPython3; same code as readCSV
number_3 = DoubleInput(0)
getItemAtIndex_3 = List.GetItemAtIndex(list=readCSV_2@L2, index=number_3)
indexOf_2 = List.IndexOf(list=getItemAtIndex_3, element=IBCRulesAsString)
getItemAtIndex_4 = List.GetItemAtIndex(list=readCSV_2, index=indexOf_2)
removeItemAtIndex_2 = List.RemoveItemAtIndex(list=getItemAtIndex_4, indices=number_3)
getElementsByIfcGUIDs_2 = Python(IN[0]=removeItemAtIndex_2)  # CPython3; same code as getElementsByIfcGUIDs

# group: override the display color.
number_4 = DoubleInput(255)
byARGB_2 = Color.ByARGB(red=number_4)
categories_2 = Categories("OST_Views")
all_elements_of_category_2 = ElementsOfCategory(Category=categories_2)
boolean_2 = BoolSelector(false)
clean_2 = List.Clean(list=all_elements_of_category_2, preserveIndices=boolean_2)
code_block_2 = CodeBlock { "View Name"; }
getParameterValueByName_2 = Element.GetParameterValueByName(element=clean_2, parameterName=code_block_2)
level_2 = Custom[Element.Level](element=getElementsByIfcGUIDs_2)
name_2 = Level.Name(level=level_2)
string_4 = StringInput("D_ue")
string_5 = StringInput("RES")
replace_2 = String.Replace(string=name_2, searchFor=string_4, replaceWith=string_5)
string_6 = StringInput("_")
add_3 = replace_2 + string_6
add_4 = add_3 + IBCRulesAsString
eq_2 = getParameterValueByName_2 == add_4@L1
filterByBoolMask_2 = List.FilterByBoolMask(list=clean_2, mask=eq_2@L2)
flatten_2 = List.Flatten(list=filterByBoolMask_2.in)
python_script_2 = Python(IN[0]=getElementsByIfcGUIDs_2, IN[1]=byARGB_2, IN[2]=flatten_2)  # CPython3
# ---------- python_script_2.python (88 lines) ----------
###############################################################
# Import general packages.
import clr
import sys
import math
import System
import io
import os
import importlib

# Import Revit/Dynamo API related packages.
clr.AddReference('DynamoRevitDS')
import Dynamo
from System import Array
from System.Collections.Generic import *
clr.AddReference("RevitNodes")
import Revit
clr.ImportExtensions(Revit.Elements)
clr.ImportExtensions(Revit.GeometryConversion)
clr.AddReference("RevitServices")
import RevitServices
from RevitServices.Persistence import DocumentManager 
from RevitServices.Transactions import TransactionManager 
clr.AddReference("RevitAPI")
clr.AddReference('ProtoGeometry')
import Autodesk 
from Autodesk.DesignScript.Geometry import *
from Autodesk.DesignScript import *
from Autodesk.Revit.DB import *
from Autodesk.Revit.DB import Parameter
from Autodesk.Revit.DB.Architecture import *
from Autodesk.Revit.DB import IFailuresPreprocessor

# Import external python packages.
localapp = os.getenv(r'LOCALAPPDATA')
sys.path.append(os.path.join(localapp, r'python-3.8.3-embed-amd64\Lib\site-packages'))

# Import customized python packgaes.
sys.path.append(r'C:\dev\phd\jw\healing\src\godyn')

import healBasics
importlib.reload(healBasics)
import healChecks
importlib.reload(healChecks)
import healParameters
importlib.reload(healParameters)
import healVisual
importlib.reload(healVisual)


def ConvertColor(e):
	return Autodesk.Revit.DB.Color(e.Red, e.Green, e.Blue)

def OverrideColorPattern(e, c, f, view):
	gSettings = OverrideGraphicSettin
###############################################################
doc = DocumentManager.Instance.CurrentDBDocument


###############################################################
# Temporary functions


###############################################################
# Prepare the input (of the Python Node)
element = UnwrapElement(IN[0])
color = UnwrapElement(IN[1])
view = UnwrapElement(IN[2])

##############################################################
# Prepare the output (of the Python Node)
out = []


###############################################################
# Start Transaction in Revit
TransactionManager.Instance.EnsureInTransaction(doc)


###############################################################
# Main part
out = healVisual.overrideElementDisplay(element, color, view)

###############################################################
# End Transaction in Revit
TransactionManager.Instance.TransactionTaskDone()

OUT=out
# ----------------------------------------

# group: output.
list_create = List.Create(item0=python_script, item1=python_script_2)
Succeed = Output(list_create)
