# Dynamo graph Execute_autoCheck.dyn (Dynamo 2.12.0.5650)

# group: SS
name_ss = StringInput("ss")
nr_ss = StringInput("134")
sub_nr_ssiteration = StringInput("7")

# group: Input
string = StringInput("C:\dev\phd\ModelHealer\data\")
sa_or_ss_processor = CodeBlock(name=name_ss, nr=nr_ss, subnr=sub_nr_ssiteration) { name; nr; subnr; }
rerunnodes = Python()  # CPython3; frozen; unwired: IN[0]
# ---------- rerunnodes.python (83 lines) ----------
###############################################################
# Import general packages.
import clr
import sys
import math
import System
import io
import os
import importlib

# Import Revit/Dynamo API related packages.
clr.AddReference('DynamoRevitDS')
import Dynamo
from System import Array
from System.Collections.Generic import *
clr.AddReference("RevitNodes")
import Revit
clr.ImportExtensions(Revit.Elements)
clr.ImportExtensions(Revit.GeometryConversion)
clr.AddReference("RevitServices")
import RevitServices
from RevitServices.Persistence import DocumentManager 
from RevitServices.Transactions import TransactionManager 
clr.AddReference("RevitAPI")
clr.AddReference('ProtoGeometry')
import Autodesk 
from Autodesk.DesignScript.Geometry import *
from Autodesk.DesignScript import *
from Autodesk.Revit.DB import *
from Autodesk.Revit.DB import Parameter
from Autodesk.Revit.DB.Architecture import *
from Autodesk.Revit.DB import IFailuresPreprocessor

# Import external python packages.
localapp = os.getenv(r'LOCALAPPDATA')
sys.path.append(os.path.join(localapp, r'python-3.8.3-embed-amd64\Lib\site-packages'))

# Import customized python packgaes.
sys.path.append(r'C:\dev\phd\jw\healing\src\godyn')

import healBasics
importlib.reload(healBasics)
import healChecks
importlib.reload(healChecks)
import healParameters
importlib.reload(healParameters)

###############################################################
doc = DocumentManager.Instance.CurrentDBDocument


###############################################################
# Temporary functions


###############################################################
# Prepare the input (of the Python Node)
element = IN[0]


##############################################################
# Prepare the output (of the Python Node)
out = []


###############################################################
# Start Transaction in Revit
TransactionManager.Instance.EnsureInTransaction(doc)


###############################################################
# Main part
healBasics.rerunNodes()


###############################################################
# End Transaction in Revit
TransactionManager.Instance.TransactionTaskDone()


###############################################################
# End
OUT = out
# ----------------------------------------

# group: path
string_2 = StringInput("-")
concat = String.Concat(string0=string, string1=sa_or_ss_processor.name, string2=string_2, string3=sa_or_ss_processor.nr, string4=string_2, string5=sa_or_ss_processor.subnr)
string_3 = StringInput("\vary")
variations_input = concat + string_3
string_4 = StringInput("\res")
compliance_checking_output = concat + string_4

ibc_rules = StringInput("IBC1020_2,IBC1207_1,IBC1207_3")
directory_from_path = DirectoryObject(path=variations_input)
code_block = CodeBlock { "*.rvt"; }
getDirectoryContents = FileSystem.GetDirectoryContents(directory=directory_from_path, searchString=code_block)
sortStrListbyNumber = Python(IN[0]=getDirectoryContents.files)  # CPython3
# ---------- sortStrListbyNumber.python (75 lines) ----------
###############################################################
# Import general packages.
import clr
import sys
import math
import System
import io
import os
import importlib

# Import Revit/Dynamo API related packages.
clr.AddReference('DynamoRevitDS')
import Dynamo
from System import Array
from System.Collections.Generic import *
clr.AddReference("RevitNodes")
import Revit
clr.ImportExtensions(Revit.Elements)
clr.ImportExtensions(Revit.GeometryConversion)
clr.AddReference("RevitServices")
import RevitServices
from RevitServices.Persistence import DocumentManager 
from RevitServices.Transactions import TransactionManager 
clr.AddReference("RevitAPI")
clr.AddReference('ProtoGeometry')
import Autodesk 
from Autodesk.DesignScript.Geometry import *
from Autodesk.DesignScript import *
from Autodesk.Revit.DB import *
from Autodesk.Revit.DB import Parameter
from Autodesk.Revit.DB.Architecture import *
from Autodesk.Revit.DB import IFailuresPreprocessor

# Import external python packages.
localapp = os.getenv(r'LOCALAPPDATA')
sys.path.append(os.path.join(localapp, r'python-3.8.3-embed-amd64\Lib\site-packages'))

# Import customized python packgaes.
sys.path.append(r'C:\dev\phd\jw\healing\src\godyn')

import dataBasics
importlib.reload(dataBasics)

###############################################################
doc = DocumentManager.Instance.CurrentDBDocument


###############################################################
# Temporary functions


###############################################################
# Prepare the input (of the Python Node)
my_list = IN[0]


##############################################################
# Prepare the output (of the Python Node)
out = []


###############################################################
# Start Transaction in Revit

###############################################################
# Main part
out = dataBasics.sortStrListbyNumber(my_list)

###############################################################
# End Transaction in Revit


###############################################################
# End
OUT = out
# ----------------------------------------
boolean = BoolSelector(false)
fileName = FileSystem.FileName(path=sortStrListbyNumber, withExtension=boolean)
toNumber = String.ToNumber(string=fileName)
autoCheck = Custom[autoCheck](DirectoryPathIN=variations_input, DirectoryPathOUT=compliance_checking_output, IBCRulesAsAString=ibc_rules, ID=toNumber, lacing=Longest)  # automatically check building rules.

# group: SA
nr_sa = StringInput("34")
sub_nr_saboundary = StringInput("0.3")
name_sa = StringInput("sa")

code_block_2 = CodeBlock {  }
