# Dynamo graph Execute_autoParametrize-door.dyn (Dynamo 2.12.0.5650)
# packages: Clockwork for Dynamo 2.x 2.3.0, Genius Loci 2022.4.19

# group: notes.
# note: https://forum.dynamobim.com/t/autodesk-revit-db-reference-to-curve/26075
# note: https://forum.dynamobim.com/t/geometric-references-in-dimension-byelements-node/32816/4
# note: https://forum.dynamobim.com/t/dimension-by-references-geniusloci-package-wont-create-dimensions/71768/6

code_block = CodeBlock { "d_dr_sn"; }
select_level = StringInput("U1_OK")
list_create = List.Create(item0=select_level)

# group: Select Level
run = BoolSelector(true)
getLevelByLevelName = Python(IN[0]=run, IN[1]=list_create)  # CPython3
# ---------- getLevelByLevelName.python (89 lines) ----------
###############################################################
# Import general packages.
import clr
import sys
import math
import System
import io
import os
import importlib

# Import Revit/Dynamo API related packages.
clr.AddReference('DynamoRevitDS')
import Dynamo
from System import Array
from System.Collections.Generic import *
clr.AddReference("RevitNodes")
import Revit
clr.ImportExtensions(Revit.Elements)
clr.ImportExtensions(Revit.GeometryConversion)
clr.AddReference("RevitServices")
import RevitServices
from RevitServices.Persistence import DocumentManager 
from RevitServices.Transactions import TransactionManager 
clr.AddReference("RevitAPI")
clr.AddReference('ProtoGeometry')
import Autodesk 
from Autodesk.DesignScript.Geometry import *
from Autodesk.DesignScript import *
from Autodesk.Revit.DB import *
from Autodesk.Revit.DB import Parameter
from Autodesk.Revit.DB.Architecture import *
from Autodesk.Revit.DB import IFailuresPreprocessor

# Import external python packages.
localapp = os.getenv(r'LOCALAPPDATA')
sys.path.append(os.path.join(localapp, r'python-3.8.3-embed-amd64\Lib\site-packages'))

# Import customized python packgaes.
sys.path.append(r'C:\dev\phd\jw\healing\src\godyn')

import healBasics
importlib.reload(healBasics)
import healChecks
importlib.reload(healChecks)
import healParameters
importlib.reload(healParameters)

###############################################################
doc = DocumentManager.Instance.CurrentDBDocument


###############################################################
# Temporary functions


###############################################################
# Prepare the input (of the Python Node)
run = IN[0]
names = IN[1]


##############################################################
# Prepare the output (of the Python Node)
out = []


###############################################################
# Start Transaction in Revit
TransactionManager.Instance.EnsureInTransaction(doc)


###############################################################
# Main part
levels = []

if run:
    levels = healBasics.getLevelsByNames(doc, names)
    OUT = levels
else:
	OUT = "Set Run to True"


###############################################################
# End Transaction in Revit
TransactionManager.Instance.TransactionTaskDone()


###############################################################
# End
# ----------------------------------------
single_level = CodeBlock(level=getLevelByLevelName) { single_level = level[0]; }

# group: Select Doors (base) constrained on this level
categories = Categories("OST_Doors")
all_elements_of_category = ElementsOfCategory(Category=categories)
name = Element.Name(element=single_level)
code_block_2 = CodeBlock { "Level"; }
getParameterValueByName = Element.GetParameterValueByName(element=all_elements_of_category, parameterName=code_block_2)
name_2 = Element.Name(element=getParameterValueByName)
eq = name == name_2
code_block_3 = CodeBlock { true; }
allIndicesOf = List.AllIndicesOf(list=eq, item=code_block_3)
elements_based_constrained_on = List.GetItemAtIndex(list=all_elements_of_category, index=allIndicesOf)  # "Elements based constrained on one level"

# group: Divide Elements hosted by walls locating in the directions of SN and EW .
host = Custom[Element.Host+](element=elements_based_constrained_on)  # package Clockwork for Dynamo 2.x; Gets an element's host. Unlike the OOTB node FamilyInstance.GetHost it not only works for family instances but also for elements like wall sweeps, foundations, railings, builing pads and topo subregions.
string = StringInput("d_wl_ew")
getParameterValueByName_2 = Element.GetParameterValueByName(element=host, parameterName=string)
number = DoubleInput(0)
ge = getParameterValueByName_2 >= number
isNull = Object.IsNull(object=ge)
in_sn_out_ew = List.FilterByBoolMask(list=elements_based_constrained_on, mask=isNull)

# group: Element Reference (SN)
familyinstance_referencetype = Custom[FamilyInstance ReferenceType](lacing=Shortest)  # package Genius Loci; Works only in Revit 2018.1 and later. Identifies references of family instances corresponding to reference planes and reference lines in the family.
centerleftright = CodeBlock(x=familyinstance_referencetype) { x[9]; }
familyinstance_reference_bytype = Custom[FamilyInstance Reference ByType](familyInstance=in_sn_out_ew.in@L1, ReferenceType=centerleftright)  # package Genius Loci; Works only in Revit 2018.1 and later. Gets the reference corresponding to the given Reference Plane in the family instance. Also works with linked family instance.
string_from_object = FromObject(object=familyinstance_reference_bytype.ReferenceName)
string_2 = StringInput("Center")
contains = String.Contains(string=string_from_object, searchFor=string_2)
filterByBoolMask = List.FilterByBoolMask(list=familyinstance_reference_bytype.Reference, mask=contains)
strongreference = CodeBlock(x=familyinstance_referencetype) { x[1]; }
familyinstance_reference_bytype_2 = Custom[FamilyInstance Reference ByType](familyInstance=in_sn_out_ew.in@L1, ReferenceType=strongreference)
string_from_object_2 = FromObject(object=familyinstance_reference_bytype_2.ReferenceName)
contains_2 = String.Contains(string=string_from_object_2, searchFor=string_2)
filterByBoolMask_2 = List.FilterByBoolMask(list=familyinstance_reference_bytype_2.Reference, mask=contains_2)
join = List.Join(list0=filterByBoolMask.in, list1=filterByBoolMask_2.in)
indexOf = List.IndexOf(list=familyinstance_reference_bytype.Reference, element=filterByBoolMask.in)
indexOf_2 = List.IndexOf(list=familyinstance_reference_bytype_2.Reference, element=filterByBoolMask_2.in)
join_2 = List.Join(list0=indexOf, list1=indexOf_2)
reorder = List.Reorder(list=join, indices=join_2)
reference_element = Custom[Reference Element](reference=reorder)  # package Genius Loci; Returns the Revit Element from a reference in the given document.
getLocation = Element.GetLocation(element=reference_element)

run_2 = BoolSelector(true)
grid_in_sn_direction = StringInput("1")
grid_in_ew_direction = StringInput("A")

# group: Select Grid
list_create_2 = List.Create(item0=grid_in_sn_direction, item1=grid_in_ew_direction)
getGridByGridName = Python(IN[0]=run_2, IN[1]=list_create_2)  # CPython3
# ---------- getGridByGridName.python (88 lines) ----------
###############################################################
# Import general packages.
import clr
import sys
import math
import System
import io
import os
import importlib

# Import Revit/Dynamo API related packages.
clr.AddReference('DynamoRevitDS')
import Dynamo
from System import Array
from System.Collections.Generic import *
clr.AddReference("RevitNodes")
import Revit
clr.ImportExtensions(Revit.Elements)
clr.ImportExtensions(Revit.GeometryConversion)
clr.AddReference("RevitServices")
import RevitServices
from RevitServices.Persistence import DocumentManager 
from RevitServices.Transactions import TransactionManager 
clr.AddReference("RevitAPI")
clr.AddReference('ProtoGeometry')
import Autodesk 
from Autodesk.DesignScript.Geometry import *
from Autodesk.DesignScript import *
from Autodesk.Revit.DB import *
from Autodesk.Revit.DB import Parameter
from Autodesk.Revit.DB.Architecture import *
from Autodesk.Revit.DB import IFailuresPreprocessor

# Import external python packages.
localapp = os.getenv(r'LOCALAPPDATA')
sys.path.append(os.path.join(localapp, r'python-3.8.3-embed-amd64\Lib\site-packages'))

# Import customized python packgaes.
sys.path.append(r'C:\dev\phd\jw\healing\src\godyn')

import healBasics
importlib.reload(healBasics)
import healChecks
importlib.reload(healChecks)
import healParameters
importlib.reload(healParameters)

###############################################################
doc = DocumentManager.Instance.CurrentDBDocument


###############################################################
# Temporary functions


###############################################################
# Prepare the input (of the Python Node)
run = IN[0]
names = IN[1]

##############################################################
# Prepare the output (of the Python Node)
out = []


###############################################################
# Start Transaction in Revit
TransactionManager.Instance.EnsureInTransaction(doc)


###############################################################
# Main part
grids = []

if run:
    grids = healBasics.getGridsByNames(doc, names)
    OUT = grids
else:
	OUT = "Set Run to True"


###############################################################
# End Transaction in Revit
TransactionManager.Instance.TransactionTaskDone()


###############################################################
# End
# ----------------------------------------
code_block_4 = CodeBlock(grids=getGridByGridName) { grids; grid_SN = grids[0]; grid_EW = grids[1]; }
grid_curve_ew = Grid.Curve(grid=code_block_4.grid_EW)
element_reference = Custom[Element Reference](element=code_block_4.grid_EW)  # package Genius Loci; Gets the reference of a geometric object or a dimension or a reference plane.
grid_curve_sn = Grid.Curve(grid=code_block_4.grid_SN)
element_reference_2 = Custom[Element Reference](element=code_block_4.grid_SN)

# group: Assign values to PP (for Elements hosted by) (wall SN)
closestPointTo = Geometry.ClosestPointTo(geometry=grid_curve_ew, other=getLocation)
X = Point.X(point=closestPointTo)
Y = Point.Y(point=closestPointTo)
Z = Point.Z(point=closestPointTo)
byCoordinates = Point.ByCoordinates(x=X, y=Y, z=Z)
distanceTo = Geometry.DistanceTo(geometry=byCoordinates, other=getLocation)
setParameterByName = Element.SetParameterByName(element=reference_element, parameterName=code_block, value=distanceTo)
meter2foot = BoolSelector(true)
foot2meter = BoolSelector(false)
unitConvert = Python(IN[0]=distanceTo, IN[1]=meter2foot, IN[2]=foot2meter)  # CPython3
# ---------- unitConvert.python (86 lines) ----------
###############################################################
# Load the Libraries

import clr
import sys
import math
import System
import io
import os

localapp = os.getenv(r'LOCALAPPDATA')
sys.path.append(os.path.join(localapp, r'python-3.8.3-embed-amd64\Lib\site-packages'))
sys.path.append(os.path.join(localapp, r'python-3.8.3-embed-amd64\Lib\jw-packages'))

# dynamo/revit-related libraries
clr.AddReference('DynamoRevitDS')
import Dynamo 
from System import Array
from System.Collections.Generic import *
clr.AddReference("RevitNodes")
import Revit
clr.ImportExtensions(Revit.Elements)
clr.ImportExtensions(Revit.GeometryConversion)
clr.AddReference("RevitServices")
import RevitServices
from RevitServices.Persistence import DocumentManager 
from RevitServices.Transactions import TransactionManager 
clr.AddReference("RevitAPI")
clr.AddReference('ProtoGeometry')
import Autodesk 
from Autodesk.DesignScript.Geometry import *
from Autodesk.DesignScript import *
from Autodesk.Revit.DB import *
from Autodesk.Revit.DB import Parameter
from Autodesk.Revit.DB.Architecture import *
from Autodesk.Revit.DB import IFailuresPreprocessor

doc = DocumentManager.Instance.CurrentDBDocument

###############################################################
# Customize functions

def foot_to_meter(ori_value):
    if isinstance(ori_value, list):
        return [UnitUtils.ConvertFromInternalUnits(value, UnitTypeId.Meters) for value in ori_value]
    return float(UnitUtils.ConvertFromInternalUnits(ori_value, UnitTypeId.Meters))


def meter_to_foot(ori_value):
    if isinstance(ori_value, list):
        return [UnitUtils.ConvertToInternalUnits(value, UnitTypeId.Meters) for value in ori_value]
    return float(UnitUtils.ConvertToInternalUnits(ori_value, UnitTypeId.Meters))


###############################################################
# Prepare the input, output

ori = IN[0]
meter2foot = IN[1]
foot2meter = IN[2]

###############################################################
# Start Transaction in Revit

#TransactionManager.Instance.EnsureInTransaction(doc)

###############################################################
# Main part

out = []
if (meter2foot and foot2meter) or (not meter2foot and not foot2meter):
    out = 'Please (only) chose one conversion type as True.'
elif meter2foot or foot2meter:
    if meter2foot:
        out = meter_to_foot(ori)
    elif foot2meter:
        out = foot_to_meter(ori)
    out = [round(v,5) for v in out]
###############################################################
# End Transaction in Revit

#TransactionManager.Instance.TransactionTaskDone()

###############################################################
# End the node
OUT = out
# ----------------------------------------

# group: Create GP (SN)
regenerate_pp = Python(IN[0]=setParameterByName)  # CPython3
# ---------- regenerate_pp.python (31 lines) ----------
###############################################################
# Load the Libraries

import clr
import sys
import math
import System
import io
import os

# dynamo/revit-related libraries
clr.AddReference('DynamoRevitDS')
import Dynamo 
from System import Array
from System.Collections.Generic import *
clr.AddReference("RevitNodes")
import Revit
clr.ImportExtensions(Revit.Elements)
clr.ImportExtensions(Revit.GeometryConversion)
clr.AddReference("RevitServices")
import RevitServices
from RevitServices.Persistence import DocumentManager 
from RevitServices.Transactions import TransactionManager 
clr.AddReference("RevitAPI")
clr.AddReference('ProtoGeometry')

doc = DocumentManager.Instance.CurrentDBDocument
doc.Regenerate()

output = IN[0]
OUT = output
# ----------------------------------------
code_block_5 = CodeBlock { "_"; }
add = list_create + code_block_5
add_2 = add + code_block
id = Element.Id(element=reference_element)
sortByKey = List.SortByKey(list=reference_element, keys=id)
count = List.Count(list=sortByKey.sortedList)
ofRepeatedItem = List.OfRepeatedItem(item=add_2, amount=count)
code_block_6 = CodeBlock { 0; }
range = Range(start=code_block_6, end=count)
add_3 = ofRepeatedItem + range
list_create_3 = List.Create(item0=add_3)
flatten = List.Flatten(list=list_create_3)
createGP = Python(IN[0]=flatten, IN[1]=unitConvert)  # CPython3
# ---------- createGP.python (83 lines) ----------
###############################################################
# Import general packages.
import clr
import sys
import math
import System
import io
import os
import importlib

# Import Revit/Dynamo API related packages.
clr.AddReference('DynamoRevitDS')
import Dynamo
from System import Array
from System.Collections.Generic import *
clr.AddReference("RevitNodes")
import Revit
clr.ImportExtensions(Revit.Elements)
clr.ImportExtensions(Revit.GeometryConversion)
clr.AddReference("RevitServices")
import RevitServices
from RevitServices.Persistence import DocumentManager 
from RevitServices.Transactions import TransactionManager 
clr.AddReference("RevitAPI")
clr.AddReference('ProtoGeometry')
import Autodesk 
from Autodesk.DesignScript.Geometry import *
from Autodesk.DesignScript import *
from Autodesk.Revit.DB import *
from Autodesk.Revit.DB import Parameter
from Autodesk.Revit.DB.Architecture import *
from Autodesk.Revit.DB import IFailuresPreprocessor

# Import external python packages.
localapp = os.getenv(r'LOCALAPPDATA')
sys.path.append(os.path.join(localapp, r'python-3.8.3-embed-amd64\Lib\site-packages'))

# Import customized python packgaes.
sys.path.append(r'C:\dev\phd\jw\healing\src\godyn')

import healBasics
importlib.reload(healBasics)
import healChecks
importlib.reload(healChecks)
import healParameters
importlib.reload(healParameters)

###############################################################
doc = DocumentManager.Instance.CurrentDBDocument


###############################################################
# Temporary functions


###############################################################
# Prepare the input (of the Python Node)
gp_names = IN[0]
gp_values = IN[1]


##############################################################
# Prepare the output (of the Python Node)
out = []


###############################################################
# Start Transaction in Revit
TransactionManager.Instance.EnsureInTransaction(doc)


###############################################################
# Main part
new_gps = healParameters.setGlobalParameters(doc, gp_names, gp_values)

###############################################################
# End Transaction in Revit
TransactionManager.Instance.TransactionTaskDone()


###############################################################
# End
OUT = new_gps
# ----------------------------------------
regenerate_gp = Python(IN[0]=createGP)  # CPython3; same code as regenerate_pp
assigngptopp_sn = Python(IN[0]=code_block, IN[1]=regenerate_pp, IN[2]=regenerate_gp)  # CPython3
# ---------- assigngptopp_sn.python (84 lines) ----------
###############################################################
# Import general packages.
import clr
import sys
import math
import System
import io
import os
import importlib

# Import Revit/Dynamo API related packages.
clr.AddReference('DynamoRevitDS')
import Dynamo
from System import Array
from System.Collections.Generic import *
clr.AddReference("RevitNodes")
import Revit
clr.ImportExtensions(Revit.Elements)
clr.ImportExtensions(Revit.GeometryConversion)
clr.AddReference("RevitServices")
import RevitServices
from RevitServices.Persistence import DocumentManager 
from RevitServices.Transactions import TransactionManager 
clr.AddReference("RevitAPI")
clr.AddReference('ProtoGeometry')
import Autodesk 
from Autodesk.DesignScript.Geometry import *
from Autodesk.DesignScript import *
from Autodesk.Revit.DB import *
from Autodesk.Revit.DB import Parameter
from Autodesk.Revit.DB.Architecture import *
from Autodesk.Revit.DB import IFailuresPreprocessor

# Import external python packages.
localapp = os.getenv(r'LOCALAPPDATA')
sys.path.append(os.path.join(localapp, r'python-3.8.3-embed-amd64\Lib\site-packages'))

# Import customized python packgaes.
sys.path.append(r'C:\dev\phd\jw\healing\src\godyn')

import healBasics
importlib.reload(healBasics)
import healChecks
importlib.reload(healChecks)
import healParameters
importlib.reload(healParameters)

###############################################################
doc = DocumentManager.Instance.CurrentDBDocument


###############################################################
# Temporary functions


###############################################################
# Prepare the input (of the Python Node)
pp_name = IN[0]
all_elements = IN[1]
all_gps = IN[2]


##############################################################
# Prepare the output (of the Python Node)
out = []


###############################################################
# Start Transaction in Revit
TransactionManager.Instance.EnsureInTransaction(doc)


###############################################################
# Main part
out = healParameters.assignGlobalParameters(doc, all_elements, all_gps, pp_name)

###############################################################
# End Transaction in Revit
TransactionManager.Instance.TransactionTaskDone()


###############################################################
# End
OUT = all_gps
# ----------------------------------------

# group: Select FloorPlan View according to Level
categories_2 = Categories("OST_Views")
all_elements_of_category_2 = ElementsOfCategory(Category=categories_2)
boolean = BoolSelector(false)
clean = List.Clean(list=all_elements_of_category_2, preserveIndices=boolean)
code_block_7 = CodeBlock { "View Name"; }
getParameterValueByName_3 = Element.GetParameterValueByName(element=clean, parameterName=code_block_7)
eq_2 = getParameterValueByName_3 == list_create@L1
filterByBoolMask_3 = List.FilterByBoolMask(list=clean, mask=eq_2@L2)
flatten_2 = List.Flatten(list=filterByBoolMask_3.in)

# group: Create and label Dimension (SN)
byStartPointEndPoint = Line.ByStartPointEndPoint(startPoint=getLocation, endPoint=closestPointTo)
XAxis = Vector.XAxis()
code_block_8 = CodeBlock { 0.5; }
translate = Geometry.Translate(geometry=byStartPointEndPoint, direction=XAxis, distance=code_block_8)
addItemToFront = List.AddItemToFront(item=element_reference, list=reorder@L1, lacing=Longest)
dimension_byreferences = Custom[Dimension ByReferences](view=flatten_2@L1, line=translate, references=addItemToFront, lacing=Longest)  # package Genius Loci; Creates a new linear dimension from at least two geometric references of an object.
regenerate = Python(IN[0]=dimension_byreferences)  # CPython3; same code as regenerate_pp
flatten_3 = List.Flatten(list=regenerate)
passthrough = Custom[Passthrough](passThrough=flatten_3, waitFor=assigngptopp_sn)  # package Clockwork for Dynamo 2.x; Forces a sequential order of execution. The node wired into the output of the Passthrough node will be executed *after* the node wired into the waitFor input (e.g. important for some Revit operations). The value of the passThrough input will be passed on to the node wired into the output port of the Passthrough node.
labeldimensions_sn = Python(IN[0]=assigngptopp_sn, IN[1]=passthrough)  # CPython3
# ---------- labeldimensions_sn.python (83 lines) ----------
###############################################################
# Import general packages.
import clr
import sys
import math
import System
import io
import os
import importlib

# Import Revit/Dynamo API related packages.
clr.AddReference('DynamoRevitDS')
import Dynamo
from System import Array
from System.Collections.Generic import *
clr.AddReference("RevitNodes")
import Revit
clr.ImportExtensions(Revit.Elements)
clr.ImportExtensions(Revit.GeometryConversion)
clr.AddReference("RevitServices")
import RevitServices
from RevitServices.Persistence import DocumentManager 
from RevitServices.Transactions import TransactionManager 
clr.AddReference("RevitAPI")
clr.AddReference('ProtoGeometry')
import Autodesk 
from Autodesk.DesignScript.Geometry import *
from Autodesk.DesignScript import *
from Autodesk.Revit.DB import *
from Autodesk.Revit.DB import Parameter
from Autodesk.Revit.DB.Architecture import *
from Autodesk.Revit.DB import IFailuresPreprocessor

# Import external python packages.
localapp = os.getenv(r'LOCALAPPDATA')
sys.path.append(os.path.join(localapp, r'python-3.8.3-embed-amd64\Lib\site-packages'))

# Import customized python packgaes.
sys.path.append(r'C:\dev\phd\jw\healing\src\godyn')

import healBasics
importlib.reload(healBasics)
import healChecks
importlib.reload(healChecks)
import healParameters
importlib.reload(healParameters)

###############################################################
doc = DocumentManager.Instance.CurrentDBDocument


###############################################################
# Temporary functions


###############################################################
# Prepare the input (of the Python Node)
all_gps = UnwrapElement(IN[0])
all_dms = UnwrapElement(IN[1])


##############################################################
# Prepare the output (of the Python Node)
out = []


###############################################################
# Start Transaction in Revit
TransactionManager.Instance.EnsureInTransaction(doc)


###############################################################
# Main part
out = healParameters.labelDimensionsbyGlobalParameters(all_gps, all_dms)

###############################################################
# End Transaction in Revit
TransactionManager.Instance.TransactionTaskDone()


###############################################################
# End
OUT = out
# ----------------------------------------

code_block_9 = CodeBlock { "d_dr_ew"; }

# group: Element Reference (EW)
familyinstance_referencetype_2 = Custom[FamilyInstance ReferenceType](lacing=Shortest)
centerleftright_2 = CodeBlock(x=familyinstance_referencetype_2) { x[9]; }
familyinstance_reference_bytype_3 = Custom[FamilyInstance Reference ByType](familyInstance=in_sn_out_ew.out@L1, ReferenceType=centerleftright_2)
string_from_object_3 = FromObject(object=familyinstance_reference_bytype_3.ReferenceName)
string_3 = StringInput("Center")
contains_3 = String.Contains(string=string_from_object_3, searchFor=string_3)
filterByBoolMask_4 = List.FilterByBoolMask(list=familyinstance_reference_bytype_3.Reference, mask=contains_3)
strongreference_2 = CodeBlock(x=familyinstance_referencetype_2) { x[1]; }
familyinstance_reference_bytype_4 = Custom[FamilyInstance Reference ByType](familyInstance=in_sn_out_ew.out@L1, ReferenceType=strongreference_2)
string_from_object_4 = FromObject(object=familyinstance_reference_bytype_4.ReferenceName)
contains_4 = String.Contains(string=string_from_object_4, searchFor=string_3)
filterByBoolMask_5 = List.FilterByBoolMask(list=familyinstance_reference_bytype_4.Reference, mask=contains_4)
join_3 = List.Join(list0=filterByBoolMask_4.in, list1=filterByBoolMask_5.in)
indexOf_3 = List.IndexOf(list=familyinstance_reference_bytype_3.Reference, element=filterByBoolMask_4.in)
indexOf_4 = List.IndexOf(list=familyinstance_reference_bytype_4.Reference, element=filterByBoolMask_5.in)
join_4 = List.Join(list0=indexOf_3, list1=indexOf_4)
reorder_2 = List.Reorder(list=join_3, indices=join_4)
reference_element_2 = Custom[Reference Element](reference=reorder_2)
getLocation_2 = Element.GetLocation(element=reference_element_2)

# group: Assign values to PP (for Elements hosted by) (wall EW)
closestPointTo_2 = Geometry.ClosestPointTo(geometry=grid_curve_sn, other=getLocation_2)
X_2 = Point.X(point=closestPointTo_2)
Y_2 = Point.Y(point=closestPointTo_2)
Z_2 = Point.Z(point=closestPointTo_2)
byCoordinates_2 = Point.ByCoordinates(x=X_2, y=Y_2, z=Z_2)
distanceTo_2 = Geometry.DistanceTo(geometry=byCoordinates_2, other=getLocation_2)
setParameterByName_2 = Element.SetParameterByName(element=reference_element_2, parameterName=code_block_9, value=distanceTo_2)
meter2foot_2 = BoolSelector(true)
foot2meter_2 = BoolSelector(false)
unitConvert_2 = Python(IN[0]=distanceTo_2, IN[1]=meter2foot_2, IN[2]=foot2meter_2)  # CPython3; same code as unitConvert

# group: Create GP (EW)
regenerate_pp_2 = Python(IN[0]=setParameterByName_2)  # CPython3; same code as regenerate_pp
code_block_10 = CodeBlock { "_"; }
add_4 = list_create + code_block_10
add_5 = add_4 + code_block_9
id_2 = Element.Id(element=reference_element_2)
sortByKey_2 = List.SortByKey(list=reference_element_2, keys=id_2)
count_2 = List.Count(list=sortByKey_2.sortedList)
ofRepeatedItem_2 = List.OfRepeatedItem(item=add_5, amount=count_2)
code_block_11 = CodeBlock { 0; }
range_2 = Range(start=code_block_11, end=count_2)
add_6 = ofRepeatedItem_2 + range_2
list_create_4 = List.Create(item0=add_6)
flatten_4 = List.Flatten(list=list_create_4)
createGP_2 = Python(IN[0]=flatten_4, IN[1]=unitConvert_2)  # CPython3; same code as createGP
regenerate_gp_2 = Python(IN[0]=createGP_2)  # CPython3; same code as regenerate_pp
assigngptopp_ew = Python(IN[0]=code_block_9, IN[1]=regenerate_pp_2, IN[2]=regenerate_gp_2)  # CPython3; same code as assigngptopp_sn

# group: Create and label Dimension (EW)
byStartPointEndPoint_2 = Line.ByStartPointEndPoint(startPoint=getLocation_2, endPoint=closestPointTo_2)
YAxis = Vector.YAxis()
code_block_12 = CodeBlock { 0.5; }
translate_2 = Geometry.Translate(geometry=byStartPointEndPoint_2, direction=YAxis, distance=code_block_12)
addItemToFront_2 = List.AddItemToFront(item=element_reference_2, list=reorder_2@L1, lacing=Longest)
dimension_byreferences_2 = Custom[Dimension ByReferences](view=flatten_2@L1, line=translate_2, references=addItemToFront_2, lacing=Longest)
regenerate_2 = Python(IN[0]=dimension_byreferences_2)  # CPython3; same code as regenerate_pp
flatten_5 = List.Flatten(list=regenerate_2)
passthrough_2 = Custom[Passthrough](passThrough=flatten_5, waitFor=assigngptopp_ew)
labeldimensions_ew = Python(IN[0]=assigngptopp_ew, IN[1]=passthrough_2)  # CPython3; same code as labeldimensions_sn
