# Dynamo graph Execute_autoParametrize.dyn "10_autoParametrizing" (Dynamo 2.12.0.5650)

grid_in_sn_direction = StringInput("1")
grid_in_ew_direction = StringInput("A")
code_block = CodeBlock { "distance_sn"; }
code_block_2 = CodeBlock { "distance_ew"; }
select_level = StringInput("D_ue_U1_OK")
select_level_2 = StringInput("D_ue_E0_OK")
select_level_3 = StringInput("D_ue_E1_OK")
list_create = List.Create(item0=select_level, item1=select_level_2, item2=select_level_3)
run = BoolSelector(true)
autoParametrize = Custom[autoParametrize](gridNameSN=grid_in_sn_direction, gridNameEW=grid_in_ew_direction, ppNameSN=code_block, ppNameEW=code_block_2, levelName=list_create, Run=run, lacing=Longest)  # automated parametrize the current model in South-North and East-West directions.
rerunnodes = Python()  # CPython3; unwired: IN[0]
# ---------- rerunnodes.python (83 lines) ----------
###############################################################
# Import general packages.
import clr
import sys
import math
import System
import io
import os
import importlib

# Import Revit/Dynamo API related packages.
clr.AddReference('DynamoRevitDS')
import Dynamo
from System import Array
from System.Collections.Generic import *
clr.AddReference("RevitNodes")
import Revit
clr.ImportExtensions(Revit.Elements)
clr.ImportExtensions(Revit.GeometryConversion)
clr.AddReference("RevitServices")
import RevitServices
from RevitServices.Persistence import DocumentManager 
from RevitServices.Transactions import TransactionManager 
clr.AddReference("RevitAPI")
clr.AddReference('ProtoGeometry')
import Autodesk 
from Autodesk.DesignScript.Geometry import *
from Autodesk.DesignScript import *
from Autodesk.Revit.DB import *
from Autodesk.Revit.DB import Parameter
from Autodesk.Revit.DB.Architecture import *
from Autodesk.Revit.DB import IFailuresPreprocessor

# Import external python packages.
localapp = os.getenv(r'LOCALAPPDATA')
sys.path.append(os.path.join(localapp, r'python-3.8.3-embed-amd64\Lib\site-packages'))

# Import customized python packgaes.
sys.path.append(r'C:\dev\phd\jw\healing\src\godyn')

import healBasics
importlib.reload(healBasics)
import healChecks
importlib.reload(healChecks)
import healParameters
importlib.reload(healParameters)

###############################################################
doc = DocumentManager.Instance.CurrentDBDocument


###############################################################
# Temporary functions


###############################################################
# Prepare the input (of the Python Node)
element = IN[0]


##############################################################
# Prepare the output (of the Python Node)
out = []


###############################################################
# Start Transaction in Revit
TransactionManager.Instance.EnsureInTransaction(doc)


###############################################################
# Main part
healBasics.rerunNodes()


###############################################################
# End Transaction in Revit
TransactionManager.Instance.TransactionTaskDone()


###############################################################
# End
OUT = out
# ----------------------------------------
