# Dynamo graph Execute_copyOccupantLoadFactors.dyn "02_copyOccupantLoadFactors" (Dynamo 2.12.0.5650)
# packages: LunchBox for Dynamo 2018.7.6

# group: SELECT AREAS
code_block = CodeBlock { "Rooms"; }
byName = Category.ByName(name=code_block)
all_elements_of_category = ElementsOfCategory(Category=byName)

# group: OCCUPANCY LOAD FACTOR (for non-corridors)
code_block_2 = CodeBlock { "OLF Value"; }
code_block_3 = CodeBlock { "OLF"; }
getParameterValueByName = Element.GetParameterValueByName(element=all_elements_of_category, parameterName=code_block_3)
toNumber = String.ToNumber(string=getParameterValueByName)
setParameterByName = Element.SetParameterByName(element=all_elements_of_category, parameterName=code_block_2, value=toNumber)

# group: FIXED OL FACTOR (ignore for now)
code_block_4 = CodeBlock { ROOMS; }  # frozen; unwired: ROOMS
code_block_5 = CodeBlock { "LS Fixed Occupant Load"; }
getParameterValueByName_2 = Element.GetParameterValueByName(element=code_block_4, parameterName=code_block_5)
string_from_object = FromObject(obj=getParameterValueByName_2)
code_block_6 = CodeBlock { "1"; }
eq = string_from_object == code_block_6
filterByBoolMask = List.FilterByBoolMask(list=code_block_4, mask=eq)
code_block_7 = CodeBlock { "LS OL Factor Net Gross Fixed_Key"; }
getParameterValueByName_3 = Element.GetParameterValueByName(element=filterByBoolMask.out, parameterName=code_block_7)
code_block_8 = CodeBlock { "FIXED"; }
eq_2 = getParameterValueByName_3 == code_block_8
boolean = BoolSelector(true)
boolean_2 = BoolSelector(false)
if_ = If(test=eq_2, true=boolean, false=boolean_2)
setParameterByName_2 = Element.SetParameterByName(element=filterByBoolMask.out, parameterName=code_block_5, value=if_)

# group: OCCUPANCY LOAD OVERRIDE (ignore for now)
code_block_9 = CodeBlock { ROOMS; }  # frozen; unwired: ROOMS
code_block_10 = CodeBlock { "LS Fixed Occupant Load Override"; }
getParameterValueByName_4 = Element.GetParameterValueByName(element=code_block_9, parameterName=code_block_10)
code_block_11 = CodeBlock { 0; }
gt = getParameterValueByName_4 > code_block_11
boolean_3 = BoolSelector(false)
# note: Custom Node: LunchBox
#     v.2018.7.6
replaceNulls = Lists.Manage.ReplaceNulls(Data=gt, ReplaceWith=boolean_3)
filterByBoolMask_2 = List.FilterByBoolMask(list=code_block_9, mask=replaceNulls)
code_block_12 = CodeBlock { 0; }
setParameterByName_3 = Element.SetParameterByName(element=filterByBoolMask_2.out, parameterName=code_block_10, value=code_block_12)

# group: OCCUPANCY LOAD FACTOR (needs to update for UNOCCUPIED spaces, e.g.corridors)
setParameterByName_4 = Element.SetParameterByName(element=all_elements_of_category)  # unwired: parameterName, value
