# Dynamo graph Execute_createModels.dyn (Dynamo 2.12.0.5650)
# packages: archi-lab.net 2022.210.1022

rerunnodes = Python()  # CPython3; unwired: IN[0]
# ---------- rerunnodes.python (83 lines) ----------
###############################################################
# Import general packages.
import clr
import sys
import math
import System
import io
import os
import importlib

# Import Revit/Dynamo API related packages.
clr.AddReference('DynamoRevitDS')
import Dynamo
from System import Array
from System.Collections.Generic import *
clr.AddReference("RevitNodes")
import Revit
clr.ImportExtensions(Revit.Elements)
clr.ImportExtensions(Revit.GeometryConversion)
clr.AddReference("RevitServices")
import RevitServices
from RevitServices.Persistence import DocumentManager 
from RevitServices.Transactions import TransactionManager 
clr.AddReference("RevitAPI")
clr.AddReference('ProtoGeometry')
import Autodesk 
from Autodesk.DesignScript.Geometry import *
from Autodesk.DesignScript import *
from Autodesk.Revit.DB import *
from Autodesk.Revit.DB import Parameter
from Autodesk.Revit.DB.Architecture import *
from Autodesk.Revit.DB import IFailuresPreprocessor

# Import external python packages.
localapp = os.getenv(r'LOCALAPPDATA')
sys.path.append(os.path.join(localapp, r'python-3.8.3-embed-amd64\Lib\site-packages'))

# Import customized python packgaes.
sys.path.append(r'C:\dev\phd\jw\healing\src\godyn')

import healBasics
importlib.reload(healBasics)
import healChecks
importlib.reload(healChecks)
import healParameters
importlib.reload(healParameters)

###############################################################
doc = DocumentManager.Instance.CurrentDBDocument


###############################################################
# Temporary functions


###############################################################
# Prepare the input (of the Python Node)
element = IN[0]


##############################################################
# Prepare the output (of the Python Node)
out = []


###############################################################
# Start Transaction in Revit
TransactionManager.Instance.EnsureInTransaction(doc)


###############################################################
# Main part
healBasics.rerunNodes()


###############################################################
# End Transaction in Revit
TransactionManager.Instance.TransactionTaskDone()


###############################################################
# End
OUT = out
# ----------------------------------------
createSkeleton = Python()  # CPython3; unwired: IN[0], IN[1]
# ---------- createSkeleton.python (92 lines) ----------
###############################################################
# Import general packages.
import clr
import sys
import math
import System
import io
import os
import importlib

# Import Revit/Dynamo API related packages.
clr.AddReference('DynamoRevitDS')
import Dynamo
from System import Array
from System.Collections.Generic import *
clr.AddReference("RevitNodes")
import Revit
clr.ImportExtensions(Revit.Elements)
clr.ImportExtensions(Revit.GeometryConversion)
clr.AddReference("RevitServices")
import RevitServices
from RevitServices.Persistence import DocumentManager 
from RevitServices.Transactions import TransactionManager 
clr.AddReference("RevitAPI")
clr.AddReference('ProtoGeometry')
import Autodesk 
from Autodesk.DesignScript.Geometry import *
from Autodesk.DesignScript import *
from Autodesk.Revit.DB import *
from Autodesk.Revit.DB import Parameter
from Autodesk.Revit.DB.Architecture import *
from Autodesk.Revit.DB import IFailuresPreprocessor, SaveAsOptions

# Import external python packages.
localapp = os.getenv(r'LOCALAPPDATA')
sys.path.append(os.path.join(localapp, r'python-3.8.3-embed-amd64\Lib\site-packages'))

# Import customized python packgaes.
sys.path.append(r'C:\dev\phd\jw\healing\src\godyn')

import healBasics
importlib.reload(healBasics)
import healChecks
importlib.reload(healChecks)
import healParameters
importlib.reload(healParameters)
import healVisual
importlib.reload(healVisual)

###############################################################
doc = DocumentManager.Instance.CurrentDBDocument


###############################################################
# Temporary functions


###############################################################
# Prepare the input (of the Python Node)
savepath = IN[0]
run = IN[1]

if isinstance(savepath, list):
    savepath = savepath[0]
    
##############################################################
# Prepare the output (of the Python Node)
out = []


###############################################################
# Start Transaction in Revit
TransactionManager.Instance.EnsureInTransaction(doc)


###############################################################
# Main part
if run:
    out = healBasics.createSkeleton(doc)

###############################################################
# End Transaction in Revit
if run:
    
    optionSave = SaveAsOptions()
    optionSave.OverwriteExistingFile = True
    doc.SaveAs(savepath, optionSave)

TransactionManager.Instance.TransactionTaskDone()
###############################################################
# End
OUT = out
# ----------------------------------------

# group: model information
string = StringInput("C:\dev\phd\ModelHealer\ini\model")
directory_from_path = DirectoryObject(path=string)
string_2 = StringInput("ini_param.rvt")
getDirectoryContents = FileSystem.GetDirectoryContents(directory=directory_from_path, searchString=string_2)
file_from_path = FileObject(path=getDirectoryContents.files)
boolean = BoolSelector(false)
code_block = CodeBlock { 1; 3; }

run_skeleton = BoolSelector(true)

# group: create failure visualization .rvts
string_3 = StringInput("\")
add = string + string_3  # lacing=Longest
fileName = FileSystem.FileName(path=getDirectoryContents.files, withExtension=boolean)
list_create = List.Create(item0=code_block.out0, item1=code_block.out1)
add_2 = fileName + list_create  # lacing=Longest
string_4 = StringInput(".rvt")
add_3 = add_2 + string_4
add_4 = add + add_3  # lacing=Longest
boolean_2 = BoolSelector(true)
copyFile = FileSystem.CopyFile(file=file_from_path, destinationPath=add_4, overwrite=boolean_2, lacing=Longest)

# group: create a simplified .rvt
string_5 = StringInput("ini_param_skeleton.rvt")
replace = String.Replace(string=getDirectoryContents.files, searchFor=string_2, replaceWith=string_5)
passThrough = Custom[PassThrough](passThrough=run_skeleton, waitFor=copyFile)  # package archi-lab.net; Ripped this off from Clockwork. Sorry Andy.
copyFile_2 = FileSystem.CopyFile(file=file_from_path, destinationPath=replace, overwrite=passThrough, lacing=Longest)
