# Dynamo graph Execute_setConstraints.dyn (Dynamo 2.12.0.5650)
# packages: JsonData 2.0.2

k_search_neighbor = DoubleInput(3)

# group: Locate to the correct directory.
string = StringInput("C:\dev\phd\ModelHealer\ini\topo\")
string_2 = StringInput("neighbor_")
string_from_object = FromObject(object=k_search_neighbor)
add = string_2 + string_from_object
add_2 = string + add
string_3 = StringInput("\")
add_3 = add_2 + string_3
string_4 = StringInput("IBC1020_2")
string_5 = StringInput("IBC1207_1")
string_6 = StringInput("IBC1207_3")
list_create = List.Create(item0=string_4, item1=string_5, item2=string_6)
code_block = CodeBlock(rules=list_create) { rules[0]; }

string_7 = StringInput("res_ini_constraints_applied.json")
add_4 = add_3 + string_7
fromJsonFile = JsonData.Utilities.Read.FromJsonFile(filepath=add_4)
getValueByKey = JsonObject.GetValueByKey(jsonObject=fromJsonFile, keys=code_block, Nesting=true, Option="None")
keys = JsonData.Elements.JsonObject.Keys(jsonObject=getValueByKey)
findByName = GlobalParameter.FindByName(name=keys)
values = JsonData.Elements.JsonObject.Values(jsonObject=getValueByKey)
code_block_2 = CodeBlock { "="; }
split = String.Split(string=values, separator0=code_block_2)
transpose = List.Transpose(lists=split)
code_block_3 = CodeBlock(list=transpose) { list[1]; }
setConstraints = Python(IN[0]=findByName, IN[1]=code_block_3)  # CPython3
# ---------- setConstraints.python (81 lines) ----------
###############################################################
# Import general packages.
import clr
import sys
import math
import System
import io
import os
import importlib

# Import Revit/Dynamo API related packages.
clr.AddReference('DynamoRevitDS')
import Dynamo
from System import Array
from System.Collections.Generic import *
clr.AddReference("RevitNodes")
import Revit
clr.ImportExtensions(Revit.Elements)
clr.ImportExtensions(Revit.GeometryConversion)
clr.AddReference("RevitServices")
import RevitServices
from RevitServices.Persistence import DocumentManager 
from RevitServices.Transactions import TransactionManager 
clr.AddReference("RevitAPI")
clr.AddReference('ProtoGeometry')
import Autodesk 
from Autodesk.DesignScript.Geometry import *
from Autodesk.DesignScript import *
from Autodesk.Revit.DB import *
from Autodesk.Revit.DB import Parameter
from Autodesk.Revit.DB.Architecture import *
from Autodesk.Revit.DB import IFailuresPreprocessor

# Import external python packages.
localapp = os.getenv(r'LOCALAPPDATA')
sys.path.append(os.path.join(localapp, r'python-3.8.3-embed-amd64\Lib\site-packages'))

# Import customized python packgaes.
sys.path.append(r'C:\dev\phd\jw\healing\src\godyn')

import healBasics
importlib.reload(healBasics)
import healChecks
importlib.reload(healChecks)
import healParameters
importlib.reload(healParameters)
import healVisual
importlib.reload(healVisual)

###############################################################
doc = DocumentManager.Instance.CurrentDBDocument


###############################################################
# Temporary functions

###############################################################
# Prepare the input (of the Python Node)
gps = UnwrapElement(IN[0])
gp_expresses = IN[1]

##############################################################
# Prepare the output (of the Python Node)

###############################################################
# Start Transaction in Revit
TransactionManager.Instance.EnsureInTransaction(doc)


###############################################################
# Main part
out = healParameters.setConstraints(gps, gp_expresses)

###############################################################
# End Transaction in Revit
TransactionManager.Instance.TransactionTaskDone()


###############################################################
# End
OUT = out
# ----------------------------------------

# group: rerun
rerun = Python()  # CPython3; unwired: IN[0]
# ---------- rerun.python (84 lines) ----------
###############################################################
# Import general packages.
import clr
import sys
import math
import System
import io
import os
import importlib

# Import Revit/Dynamo API related packages.
clr.AddReference('DynamoRevitDS')
import Dynamo
from System import Array
from System.Collections.Generic import *
clr.AddReference("RevitNodes")
import Revit
clr.ImportExtensions(Revit.Elements)
clr.ImportExtensions(Revit.GeometryConversion)
clr.AddReference("RevitServices")
import RevitServices
from RevitServices.Persistence import DocumentManager 
from RevitServices.Transactions import TransactionManager 
clr.AddReference("RevitAPI")
clr.AddReference('ProtoGeometry')
import Autodesk 
from Autodesk.DesignScript.Geometry import *
from Autodesk.DesignScript import *
from Autodesk.Revit.DB import *
from Autodesk.Revit.DB import Parameter
from Autodesk.Revit.DB.Architecture import *
from Autodesk.Revit.DB import IFailuresPreprocessor

# Import external python packages.
localapp = os.getenv(r'LOCALAPPDATA')
sys.path.append(os.path.join(localapp, r'python-3.8.3-embed-amd64\Lib\site-packages'))

# Import customized python packgaes.
sys.path.append(r'C:\dev\phd\jw\healing\src\godyn')

import healBasics
importlib.reload(healBasics)
import healChecks
importlib.reload(healChecks)
import healParameters
importlib.reload(healParameters)
import healVisual
importlib.reload(healVisual)

###############################################################
doc = DocumentManager.Instance.CurrentDBDocument


###############################################################
# Temporary functions


###############################################################
# Prepare the input (of the Python Node)
element = IN[0]


##############################################################
# Prepare the output (of the Python Node)
out = []


###############################################################
# Start Transaction in Revit
TransactionManager.Instance.EnsureInTransaction(doc)


###############################################################
# Main part
healBasics.rerunNodes()

###############################################################
# End Transaction in Revit
TransactionManager.Instance.TransactionTaskDone()


###############################################################
# End
OUT = out
# ----------------------------------------
