# Dynamo graph Execute_varyGPs.dyn (Dynamo 2.12.0.5650)

# group: SS
name_ss = StringInput("ss")
nr_ss = StringInput("114")
algo_ss = StringInput("sweep")

# group: SA
boundary = StringInput("0.3")
nr_sa = StringInput("14")
algo_sa = StringInput("morris")
name_sa = StringInput("sa")

# group: Input
string = StringInput("C:\dev\phd\ModelHealer\data\")
sa_or_ss_processor = CodeBlock(name=name_ss, nr=nr_ss, algo=algo_ss, bdry=boundary) { name; nr; algo; bdry; }
rerunnodes = Python()  # CPython3; unwired: IN[0]
# ---------- rerunnodes.python (83 lines) ----------
###############################################################
# Import general packages.
import clr
import sys
import math
import System
import io
import os
import importlib

# Import Revit/Dynamo API related packages.
clr.AddReference('DynamoRevitDS')
import Dynamo
from System import Array
from System.Collections.Generic import *
clr.AddReference("RevitNodes")
import Revit
clr.ImportExtensions(Revit.Elements)
clr.ImportExtensions(Revit.GeometryConversion)
clr.AddReference("RevitServices")
import RevitServices
from RevitServices.Persistence import DocumentManager 
from RevitServices.Transactions import TransactionManager 
clr.AddReference("RevitAPI")
clr.AddReference('ProtoGeometry')
import Autodesk 
from Autodesk.DesignScript.Geometry import *
from Autodesk.DesignScript import *
from Autodesk.Revit.DB import *
from Autodesk.Revit.DB import Parameter
from Autodesk.Revit.DB.Architecture import *
from Autodesk.Revit.DB import IFailuresPreprocessor

# Import external python packages.
localapp = os.getenv(r'LOCALAPPDATA')
sys.path.append(os.path.join(localapp, r'python-3.8.3-embed-amd64\Lib\site-packages'))

# Import customized python packgaes.
sys.path.append(r'C:\dev\phd\jw\healing\src\godyn')

import healBasics
importlib.reload(healBasics)
import healChecks
importlib.reload(healChecks)
import healParameters
importlib.reload(healParameters)

###############################################################
doc = DocumentManager.Instance.CurrentDBDocument


###############################################################
# Temporary functions


###############################################################
# Prepare the input (of the Python Node)
element = IN[0]


##############################################################
# Prepare the output (of the Python Node)
out = []


###############################################################
# Start Transaction in Revit
TransactionManager.Instance.EnsureInTransaction(doc)


###############################################################
# Main part
healBasics.rerunNodes()


###############################################################
# End Transaction in Revit
TransactionManager.Instance.TransactionTaskDone()


###############################################################
# End
OUT = out
# ----------------------------------------

add = string + sa_or_ss_processor.name
string_2 = StringInput("-")
add_2 = add + string_2
add_3 = add_2 + sa_or_ss_processor.nr
add_4 = add_3 + string_2
add_5 = add_4 + sa_or_ss_processor.bdry
string_3 = StringInput("\dups")
duplications_input = add_5 + string_3
string_4 = StringInput("\vary")
variations_output = add_5 + string_4
string_5 = StringInput("\")
add_6 = string_5 + sa_or_ss_processor.name
string_6 = StringInput("_vary_")
add_7 = add_6 + string_6
add_8 = add_7 + sa_or_ss_processor.algo
string_7 = StringInput(".csv")
add_9 = add_8 + string_7
gp_values = add_5 + add_9
directory_from_path = DirectoryObject(path=duplications_input)
code_block = CodeBlock { "*.rvt"; }
getDirectoryContents = FileSystem.GetDirectoryContents(directory=directory_from_path, searchString=code_block)
sortStrListbyNumber = Python(IN[0]=getDirectoryContents.files)  # CPython3
# ---------- sortStrListbyNumber.python (75 lines) ----------
###############################################################
# Import general packages.
import clr
import sys
import math
import System
import io
import os
import importlib

# Import Revit/Dynamo API related packages.
clr.AddReference('DynamoRevitDS')
import Dynamo
from System import Array
from System.Collections.Generic import *
clr.AddReference("RevitNodes")
import Revit
clr.ImportExtensions(Revit.Elements)
clr.ImportExtensions(Revit.GeometryConversion)
clr.AddReference("RevitServices")
import RevitServices
from RevitServices.Persistence import DocumentManager 
from RevitServices.Transactions import TransactionManager 
clr.AddReference("RevitAPI")
clr.AddReference('ProtoGeometry')
import Autodesk 
from Autodesk.DesignScript.Geometry import *
from Autodesk.DesignScript import *
from Autodesk.Revit.DB import *
from Autodesk.Revit.DB import Parameter
from Autodesk.Revit.DB.Architecture import *
from Autodesk.Revit.DB import IFailuresPreprocessor

# Import external python packages.
localapp = os.getenv(r'LOCALAPPDATA')
sys.path.append(os.path.join(localapp, r'python-3.8.3-embed-amd64\Lib\site-packages'))

# Import customized python packgaes.
sys.path.append(r'C:\dev\phd\jw\healing\src\godyn')

import dataBasics
importlib.reload(dataBasics)

###############################################################
doc = DocumentManager.Instance.CurrentDBDocument


###############################################################
# Temporary functions


###############################################################
# Prepare the input (of the Python Node)
my_list = IN[0]


##############################################################
# Prepare the output (of the Python Node)
out = []


###############################################################
# Start Transaction in Revit

###############################################################
# Main part
out = dataBasics.sortStrListbyNumber(my_list)

###############################################################
# End Transaction in Revit


###############################################################
# End
OUT = out
# ----------------------------------------
boolean = BoolSelector(false)
fileName = FileSystem.FileName(path=sortStrListbyNumber, withExtension=boolean)
toNumber = String.ToNumber(string=fileName)
varyGPs = Custom[varyGPs](DirectoryPathIN=duplications_input, DirectoryPathOUT=variations_output, VaryCSV=gp_values, ID=toNumber, lacing=Longest)  # vary the Global Parameters.
