# Dynamo graph test-handler.dyn (Dynamo 2.12.0.5650)

code_block = CodeBlock { "E0_OK_d_wl_sn8"; }
code_block_2 = CodeBlock { 11; }
python_script = Python(IN[0]=code_block, IN[1]=code_block_2)  # CPython3
# ---------- python_script.python (120 lines) ----------
###############################################################
# Import general packages.
import clr
import sys
import math
import System
import io
import os
import importlib

# Import Revit/Dynamo API related packages.
clr.AddReference('DynamoRevitDS')
import Dynamo
from System import Array
from System.Collections.Generic import *
clr.AddReference("RevitNodes")
import Revit
clr.ImportExtensions(Revit.Elements)
clr.ImportExtensions(Revit.GeometryConversion)
clr.AddReference("RevitServices")
import RevitServices
from RevitServices.Persistence import DocumentManager 
from RevitServices.Transactions import TransactionManager 
clr.AddReference("RevitAPI")
clr.AddReference('ProtoGeometry')
import Autodesk 
from Autodesk.DesignScript.Geometry import *
from Autodesk.DesignScript import *
from Autodesk.Revit.DB import *
from Autodesk.Revit.DB import Parameter
from Autodesk.Revit.DB.Architecture import *
from Autodesk.Revit.DB import IFailuresPreprocessor, Transaction

# Import external python packages.
localapp = os.getenv(r'LOCALAPPDATA')
sys.path.append(os.path.join(localapp, r'python-3.8.3-embed-amd64\Lib\site-packages'))

# Import customized python packgaes.
sys.path.append(r'C:\dev\phd\jw\healing\src\godyn')

import healBasics
importlib.reload(healBasics)
import healChecks
importlib.reload(healChecks)
import healParameters
importlib.reload(healParameters)
import healVisual
importlib.reload(healVisual)

###############################################################
doc = DocumentManager.Instance.CurrentDBDocument

###############################################################
# Temporary functions

class WallWarningSwallower(IFailuresPreprocessor):

    __namespace__ = "Autodesk.Revit.DB"
    def PreprocessFailures(self, failuresAccessor):
        failMessages = failuresAccessor.GetFailureMessages()
        if failMessages.Count == 0:
            return FailureProcessingResult.Continue
        if failuresAccessor.GetSeverity() == FailureSeverity.Warning:
            for currentMessage in failMessages:
                failuresAccessor.DeleteWarning(currentMessage)
            return FailureProcessingResult.Continue
            
class DuplicateMarkSwallower(IFailuresPreprocessor):

    __namespace__ = "Autodesk.Revit.DB"
    def PreprocessFailures(self, failuresAccessor):
        failMessages = a.GetFailureMessages()
        for  f in failMessages:
            id = f.GetFailureDefinitionId()
            if id == 414:
                failuresAccessor.DeleteWarning(f)
        return FailureProcessingResult.Continue

def foot_to_meter(ori_value):
    if isinstance(ori_value, list):
        return [UnitUtils.ConvertToInternalUnits(value, UnitTypeId.Meters) for value in ori_value]
    return float(UnitUtils.ConvertToInternalUnits(ori_value, UnitTypeId.Meters))

###############################################################
# Prepare the input (of the Python Node)
name = IN[0]
value = IN[1]

##############################################################
# Prepare the output (of the Python Node)
out = []


###############################################################
# Start Transaction in Revit

###############################################################
# Main part

TransactionManager.Instance.ForceCloseTransaction()
t = Transaction(doc)

t.Start('test')
options = t.GetFailureHandlingOptions()
options.SetFailuresPreprocessor(DuplicateMarkSwallower())
t.SetFailureHandlingOptions(options)
	
gp_id = Autodesk.Revit.DB.GlobalParametersManager.FindByName(doc, name)
gp_element = doc.GetElement(gp_id)
gp_value = foot_to_meter(value)
gp_element.SetValue(DoubleParameterValue(gp_value))

t.Commit()
###############################################################
# End Transaction in Revit
TransactionManager.Instance.TransactionTaskDone()

###############################################################
# End
OUT = out
# ----------------------------------------
rerunnodes = Python()  # CPython3; frozen; unwired: IN[0]
# ---------- rerunnodes.python (83 lines) ----------
###############################################################
# Import general packages.
import clr
import sys
import math
import System
import io
import os
import importlib

# Import Revit/Dynamo API related packages.
clr.AddReference('DynamoRevitDS')
import Dynamo
from System import Array
from System.Collections.Generic import *
clr.AddReference("RevitNodes")
import Revit
clr.ImportExtensions(Revit.Elements)
clr.ImportExtensions(Revit.GeometryConversion)
clr.AddReference("RevitServices")
import RevitServices
from RevitServices.Persistence import DocumentManager 
from RevitServices.Transactions import TransactionManager 
clr.AddReference("RevitAPI")
clr.AddReference('ProtoGeometry')
import Autodesk 
from Autodesk.DesignScript.Geometry import *
from Autodesk.DesignScript import *
from Autodesk.Revit.DB import *
from Autodesk.Revit.DB import Parameter
from Autodesk.Revit.DB.Architecture import *
from Autodesk.Revit.DB import IFailuresPreprocessor

# Import external python packages.
localapp = os.getenv(r'LOCALAPPDATA')
sys.path.append(os.path.join(localapp, r'python-3.8.3-embed-amd64\Lib\site-packages'))

# Import customized python packgaes.
sys.path.append(r'C:\dev\phd\jw\healing\src\godyn')

import healBasics
importlib.reload(healBasics)
import healChecks
importlib.reload(healChecks)
import healParameters
importlib.reload(healParameters)

###############################################################
doc = DocumentManager.Instance.CurrentDBDocument


###############################################################
# Temporary functions


###############################################################
# Prepare the input (of the Python Node)
element = IN[0]


##############################################################
# Prepare the output (of the Python Node)
out = []


###############################################################
# Start Transaction in Revit
TransactionManager.Instance.EnsureInTransaction(doc)


###############################################################
# Main part
healBasics.rerunNodes()


###############################################################
# End Transaction in Revit
TransactionManager.Instance.TransactionTaskDone()


###############################################################
# End
OUT = out
# ----------------------------------------
