# Dynamo graph 01_setSpaceFunctions.dyn (Dynamo 2.12.0.5650)
# packages: BumbleBee 2019.2.1, archi-lab.net 2019.2.27

# group: SPECIFY KEY SCHEDULE
# note: Input Type: Views
key_schedule_view_name = Views("ROOM TEST")  # graph input

# group: SPECIFY EXCEL FILE
# note: Input Type: File Path
specify_excel_file_with_area = Filename(".\setSpaceFunctions.xlsx")  # "Specify Excel File with Area Fuctions"

# group: SPECIFY CODE TYPE
# note: Input Type: String
specify_code_type_ibc_nfpa_101 = StringInput("IBC")

# group: SPECIFY CODE YEAR
# note: Input Type: String
specify_code_year_2012_2015_2018 = StringInput("2018")

# group: READS EXCEL
code_block = CodeBlock { true; false; "A2"; }
toUpper = String.ToUpper(string=specify_code_type_ibc_nfpa_101)
code_block_2 = CodeBlock { " "; }
concat = String.Concat(string0=toUpper, string1=code_block_2, string2=specify_code_year_2012_2015_2018)

# group: LAST CELL IN TABLE
code_block_3 = CodeBlock { "true"; "F1"; "F2"; }
# note: Archi-lab_Bumblebee
read_excel = Custom[Read Excel](filePath=specify_excel_file_with_area, runIt=code_block_3.out0, sheetName=concat, origin=code_block_3.out1, extent=code_block_3.out2)  # package BumbleBee; This node will read an excel file. You can read an entore sheet contents, read from specific origin cell, read only specific range, or do all of the former for multiple sheets at the same time.
flatten = List.Flatten(list=read_excel)
code_block_4 = CodeBlock { 1; }
getItemAtIndex = List.GetItemAtIndex(list=flatten, index=code_block_4)

# group (continued): READS EXCEL
# note: Archi-lab_Bumblebee
read_excel_2 = Custom[Read Excel](filePath=specify_excel_file_with_area, runIt=code_block.out0, sheetName=concat, byColumn=code_block.out1, origin=code_block.out2, extent=getItemAtIndex)

# group: WRITE TO KEY SCHEDULE
code_block_5 = CodeBlock { ["Function", "OLF", "OLF Type", "OLF Source"]; }
boolean = BoolSelector(true)
# note: Archi-lab_Bumblebee
key_schedule = Custom[Key Schedule](viewSchedule=key_schedule_view_name, data=read_excel_2, parameterNames=code_block_5, upperCase=boolean)  # package archi-lab.net; This node will take a key schedule, data and a list of parameters and populate it with infomation from data parameter. Visit www.archi-lab.net for more information on how to prep this node for take off.
