# Dynamo graph test_constraints.dyn (Dynamo 2.12.0.5650)

code_block = CodeBlock { "U1_OK_d_wl_sn19"; }
findByName = GlobalParameter.FindByName(name=code_block)
code_block_2 = CodeBlock { "U1_OK_d_wl_sn1"; }
python_script = Python(IN[0]=findByName, IN[1]=code_block_2)  # CPython3
# ---------- python_script.python (35 lines) ----------
import clr
clr.AddReference('RevitAPI')
from Autodesk.Revit.DB import *

clr.AddReference("RevitNodes")
import Revit

clr.AddReference("RevitServices")
import RevitServices
from RevitServices.Persistence import DocumentManager
from RevitServices.Transactions import TransactionManager

doc = DocumentManager.Instance.CurrentDBDocument

def toList(e):
	if not isinstance(e, list):
		return [e]
	else:
		return e
def un(e):
	return UnwrapElement(e)

gloPar = un(toList(IN[0]))
expres = toList(IN[1])

TransactionManager.Instance.EnsureInTransaction(doc)

for i,k in zip(gloPar,expres):
	if i.IsValidFormula(k):
		i.SetFormula(k)
		OUT = "It's over, it's done"
	else:
		OUT = "Invalid expression"
		
TransactionManager.Instance.TransactionTaskDone()
# ----------------------------------------
